# Dynamo graph AddSharedClassificationParameters.dyn (Dynamo 1.3.4.6666)

sharedParameterFile = Parameter.SharedParameterFile()
parse = Custom[SharedParameterFile.Parse](path=sharedParameterFile)  # Returns all parameters from a shared parameter file.
sharedparameter_groups = StringInput("BIM_Identity_Data,BIM_Dynamo_Data")
code_block = CodeBlock { ","; }
split = String.Split(sharedparameter_groups, code_block)
containsItem = List.ContainsItem(list=split)  # unwired: item
map = List.Map(list=parse.groups, f_x=containsItem)
filterByBoolMask = List.FilterByBoolMask(list=parse.names, mask=map)
filterByBoolMask_2 = List.FilterByBoolMask(list=parse.groups, mask=map)
select_builtin_parameter_group = BuiltInParameterGroup("PG_IDENTITY_DATA")
count = List.Count(filterByBoolMask.in)
ofRepeatedItem = List.OfRepeatedItem(item=select_builtin_parameter_group, amount=count)
code_block_2 = CodeBlock { "Pr"; }
contains = String.Contains(searchFor=code_block_2)  # unwired: str
map_2 = List.Map(list=filterByBoolMask_2.in, f_x=contains)
not_ = Not(map_2)
addSharedParamsToFamily = RBG_VSNodes.Document.AddSharedParamsToFamily(filterByBoolMask.in, filterByBoolMask_2.in, ofRepeatedItem, not_)
watch = Watch(addSharedParamsToFamily)
code_block_3 = CodeBlock {  }
