# Dynamo graph CC_GMA2_Alternating Placement@Top_Cut_Bottom Level.dyn (Dynamo 2.3.0.5885)
# packages: CivilConnection2020 4.0.4, infranea 0.0.4, Dynamo@ROCO_Dyf 1.0.0, ROCO Dyf Packages 1.0.0, Clockwork for Dynamo 2.x 2.1.2, DynamoROCO 2.3.0.0

code_block = CodeBlock { "select below"; }
civilApplication = CivilConnection.CivilApplication.CivilApplication()
selectAlignmentByNameAndDrawing2 = Custom[SelectAlignmentByNameAndDrawing2](descritpionText=code_block, civilApp=civilApplication)  # package Dynamo@ROCO_Dyf
setStartEndEndstation = Custom[Alignment.SetStartEndEndstation](alignment=selectAlignmentByNameAndDrawing2.alignment)  # package infranea; Sets start and endstation of the alignment
code_block_2 = CodeBlock(startStation=setStartEndEndstation.startStation, endStation=setStartEndEndstation.endStation, alignment=setStartEndEndstation.alignment) { startStation; endStation; alignment; }

# group: Input
base_level_m = Levels("T.A.W.")  # graph input
n2nd_family_type = FamilyTypes("[Pr_20_85_62_14]_TBC Sheet pile AZ36-700N_(GMA2):AZ36-700N")  # "2nd Family Type"; graph input
number_of_type_1_elements_in = DoubleSlider(1, range=1..20 step 1)  # "Number of Type 1 Elements in Sequence"; graph input
number_of_type_2_elements_in = DoubleSlider(1, range=0..20 step 1)  # "Number of Type 2 Elements in Sequence"; graph input
n1st_family_type = FamilyTypes("[Pr_20_85_62_10]_TBC Combi-Buispaal 1422-12_C9 Slot_ROCO_(GMA2):D*T - Lock_1422*12 - C9")  # "1st Family Type"; graph input
top_offset_m = DoubleInput(6.5)  # graph input
bottom_offset_m = DoubleInput(-25)  # graph input
cut_offset_m = DoubleInput(-25)  # graph input
roco_pe_id_startid = DoubleInput(1)  # graph input
mirror_1st_family = BoolSelector(false)  # graph input
mirror_2nd_family = BoolSelector(false)  # graph input
spacing_2nd = DoubleInput(0)  # graph input
spacing_1st = DoubleInput(0)  # graph input

# group: Input to Script Parameters
name = CivilConnection.Alignment.Name(alignment=code_block_2.alignment)
name_2 = CivilConnection.CivilDocument.Name(civilDocument=selectAlignmentByNameAndDrawing2.civilDocument)
code_block_3 = CodeBlock()
# ---------- code_block_3.designscript (6 lines) ----------
"\"CivilDocument.Name\": \"";
"\", \"Alignment.Name\": \"";
"\", \"Startstation\": ";
", \"Endstation\"";
", \"BaseLevel\"";
", \"Parameter for Pointdistance\" : \"Width\"";
# ----------------------------------------
startstation = CodeBlock(startStation=code_block_2.startStation) { startStation; }
string_from_object = FromObject(obj=startstation)
endstation = CodeBlock(endStation=code_block_2.endStation) { endStation; }
string_from_object_2 = FromObject(obj=endstation)
baselevel = Level.Elevation(level=base_level_m)
string_from_object_3 = FromObject(obj=baselevel)
parameter_for_pairdistance = CodeBlock { "ROCO_CLE_Length_Calc"; }

# group: C3DInfo for Component
code = CodeBlock(alignmentName=name) { out: string = alignmentName[0] +"|#"; }
name_3 = Watch(code)  # "ROCO.PM.Alignment.Name"
name_4 = Watch(name_2)  # "ROCO.PM.C3DDocument.Name"

# group: Converted Input
concat = String.Concat(string0=code_block_3.out0, string1=name_2, string2=code_block_3.out1, string3=name, string4=code_block_3.out2, string5=string_from_object, string6=code_block_3.out3, string7=string_from_object_2, string8=code_block_3.out4, string9=string_from_object_3, string10=code_block_3.out5, lacing=Longest)

# group: Get Elementwidth & Passtrough
getParameterValueByName = Element.GetParameterValueByName(element=n2nd_family_type, parameterName=parameter_for_pairdistance)
code_block_4 = CodeBlock(alignment=code_block_2.alignment, startstation=startstation, endstation=endstation, elevation=baselevel, type1Number=number_of_type_1_elements_in, type2Number=number_of_type_2_elements_in) { alignment; startstation; endstation; elevation; type1Number; type2Number; }
getParameterValueByName_2 = Element.GetParameterValueByName(element=n1st_family_type, parameterName=parameter_for_pairdistance)

watch = Watch(getParameterValueByName)
toDouble = Python(IN[0]=code_block_4.startstation)
# ---------- toDouble.python (13 lines) ----------
# Load the Python Standard and DesignScript Libraries
import sys
import clr
clr.AddReference('ProtoGeometry')
from Autodesk.DesignScript.Geometry import *

# The inputs to this node will be stored as a list in the IN variables.
dataEnteringNode = IN

# Place your code below this line

# Assign your output to the OUT variable.
OUT = float(IN[0])
# ----------------------------------------
toDouble_2 = Python(IN[0]=code_block_4.endstation)  # same code as toDouble
toDouble_3 = Python(IN[0]=getParameterValueByName_2)  # same code as toDouble
toDouble_4 = Python(IN[0]=getParameterValueByName)  # same code as toDouble

# group (continued): Get Elementwidth & Passtrough
code_block_5 = CodeBlock(alignment=code_block_4.alignment, startstation=toDouble, endstation=toDouble_2, elevation=code_block_4.elevation, type1Number=code_block_4.type1Number, type1Width=toDouble_3, type2Number=code_block_4.type2Number, type2Width=toDouble_4)
# ---------- code_block_5.designscript (12 lines) ----------
alignment;
startstation;
endstation;
elevation;
type1Number;
type1Width;
type1Gap = type1Width * type1Number;
0;
type2Number;
type2Width;
type2Gap = type2Width * type2Number;
startstation2 = startstation+ type1Gap;
# ----------------------------------------

code_block_6 = CodeBlock()
# ---------- code_block_6.designscript (12 lines) ----------
["ROCO_CTE_OBS.Code",
"ROCO_CTE_OBS.Description",
"ROCO_CTE_Classification.Uniclass.Co.Code",
"ROCO_CTE_Classification.Uniclass.Co.Description",
"ROCO_CTE_Classification.Uniclass.EF.Code",
"ROCO_CTE_Classification.Uniclass.EF.Description",
"ROCO_CTE_Classification.Uniclass.En.Code",
"ROCO_CTE_Classification.Uniclass.En.Description",
"ROCO_CTE_Classification.Uniclass.SL.Code",
"ROCO_CTE_Classification.Uniclass.SL.Description",
"ROCO_CTE_Classification.Uniclass.Ss.Code",
"ROCO_CTE_Classification.Uniclass.Ss.Description"];
# ----------------------------------------

# group: Classification Input
code_2 = StringInput("")  # "Classification.ROCO.OBS.Code"; graph input
description = StringInput("")  # "Classification.ROCO.OBS.Description"; graph input
code_3 = StringInput("")  # "Uniclass.ROCO.Co.Code"; graph input
description_2 = StringInput("")  # "Uniclass.ROCO.Co.Description"; graph input
code_4 = StringInput("EF_37_50")  # "Classification.Uniclass.EF.Code"; graph input
description_3 = StringInput("Tunnels")  # "Classification.Uniclass.EF.Description"; graph input
code_5 = StringInput("En_")  # "Classification.Uniclass.En.Code"; graph input
description_4 = StringInput("")  # "Classification.Uniclass.En.Description"; graph input
code_6 = StringInput("SL_")  # "Classification.Uniclass.SL.Code"; graph input
description_5 = StringInput("")  # "Classification.Uniclass.SL.Description"; graph input
code_7 = StringInput("Ss_")  # "Classification.Uniclass.Ss.Code"; graph input
description_6 = StringInput("")  # "Classification.Uniclass.Ss.Description"; graph input

list_create = List.Create(item0=code_2, item1=description, item2=code_3, item3=description_2, item4=code_4, item5=description_3, item6=code_5, item7=description_4, item8=code_6, item9=description_5, item10=code_7, item11=description_6)
byKeysValues = DesignScript.Builtin.Dictionary.ByKeysValues(keys=code_block_6, values=list_create)
code_block_7 = CodeBlock()
# ---------- code_block_7.designscript (3 lines) ----------
["ROCO_CLE_Base_Offset",
"ROCO_CLE_Top_Offset",
"ROCO_CLE_Cut_Offset"];
# ----------------------------------------
list_create_2 = List.Create(item0=bottom_offset_m, item1=top_offset_m, item2=cut_offset_m)
byKeysValues_2 = DesignScript.Builtin.Dictionary.ByKeysValues(keys=code_block_7, values=list_create_2)
code_block_8 = CodeBlock(familyTypes1=n1st_family_type, familyType2=n2nd_family_type, topOffset=top_offset_m, baseOffset=bottom_offset_m, cutOffset=cut_offset_m, indexStart=roco_pe_id_startid, mirror2ndFam=mirror_1st_family, mirror1stFam=mirror_2nd_family, classificationParameters=byKeysValues, geometryParameters=byKeysValues_2)
# ---------- code_block_8.designscript (10 lines) ----------
familyTypes1;
familyType2;
topOffset;
baseOffset;
cutOffset;
indexStart;
mirror2ndFam;
mirror1stFam;
classificationParameters;
geometryParameters;
# ----------------------------------------

# group: createStations
code_block_9 = CodeBlock(alignment=code_block_5.alignment, startstation=code_block_5.startstation, endstation=code_block_5.endstation, elevation=code_block_5.elevation, type1Number=code_block_5.type1Number, type1Width=code_block_5.type1Width, type2Number=code_block_5.type2Number, type2Width=code_block_5.type2Width, type1Mirror=code_block_8.mirror2ndFam, type2Mirror=code_block_8.mirror1stFam, type2Spacing=spacing_2nd, type1Spacing=spacing_1st)
# ---------- code_block_9.designscript (16 lines) ----------
alignment;
startstation;
endstation;
elevation;
type1Number;
type1Width;
type2Gap = type1Width * type1Number;
0;
type2Number;
type2Width;
type1Gap = type2Width * type2Number;
startstation2 = startstation + type2Gap;
type1Mirror;
type2Mirror;
type2Spacing;
type1Spacing;
# ----------------------------------------
code_block_10 = CodeBlock { 0; }
eq = code_block_9.type2Number == code_block_10
code_block_11 = CodeBlock { null; }
if_ = If(test=eq, true=code_block_11, false=code_block_9.type2Width)
isNull = Object.IsNull(obj=code_block_9.type2Width)
if_2 = If(test=isNull, true=code_block_10, false=code_block_9.type2Gap)
add = code_block_9.type2Spacing + if_2
if_3 = If(test=eq, true=code_block_11, false=add)
createStations3ByStartEndIntervalSpacing = Custom[CreateStations3ByStartEndIntervalSpacing](startStation=code_block_9.startstation2, endStation=code_block_9.endstation, interval=if_, spacing_m=if_3)  # package ROCO Dyf Packages; creates stationlist based on start, end, interval and spacing. (spacing can be zero or Null
code_block_12 = CodeBlock { ["startStation","endStation"]; ["endStation","startStation"]; "midStation"; "index"; }
midstations_dictionary = DesignScript.Builtin.Dictionary.ValueAtKey(dictionary=createStations3ByStartEndIntervalSpacing, key=code_block_12.out2, lacing=CrossProduct)
isNull_2 = Object.IsNull(obj=code_block_9.type1Width)
if_4 = If(test=isNull_2, true=code_block_10, false=code_block_9.type1Gap)
add_2 = code_block_9.type1Spacing + if_4
createStations3ByStartEndIntervalSpacing_2 = Custom[CreateStations3ByStartEndIntervalSpacing](startStation=code_block_9.startstation, endStation=code_block_9.endstation, interval=code_block_9.type1Width, spacing_m=add_2)
code_block_13 = CodeBlock { ["startStation","endStation"]; ["endStation","startStation"]; "midStation"; "index"; }
mirroredorder_dictionary = DesignScript.Builtin.Dictionary.ValueAtKey(dictionary=createStations3ByStartEndIntervalSpacing_2, key=code_block_13.out1, lacing=CrossProduct)
regularorder_dictionary = DesignScript.Builtin.Dictionary.ValueAtKey(dictionary=createStations3ByStartEndIntervalSpacing_2, key=code_block_13.out0, lacing=CrossProduct)
if_5 = If(test=code_block_9.type1Mirror, true=mirroredorder_dictionary, false=regularorder_dictionary)
mirroredorder_dictionary_2 = DesignScript.Builtin.Dictionary.ValueAtKey(dictionary=createStations3ByStartEndIntervalSpacing, key=code_block_12.out1, lacing=CrossProduct)
regularorder_dictionary_2 = DesignScript.Builtin.Dictionary.ValueAtKey(dictionary=createStations3ByStartEndIntervalSpacing, key=code_block_12.out0, lacing=CrossProduct)
if_6 = If(test=code_block_9.type2Mirror, true=mirroredorder_dictionary_2, false=regularorder_dictionary_2)
midstations_dictionary_2 = DesignScript.Builtin.Dictionary.ValueAtKey(dictionary=createStations3ByStartEndIntervalSpacing_2, key=code_block_13.out2, lacing=CrossProduct)
index_dictionary_valueatkey = DesignScript.Builtin.Dictionary.ValueAtKey(dictionary=createStations3ByStartEndIntervalSpacing_2, key=code_block_13.out3, lacing=CrossProduct)
index_dictionary_valueatkey_2 = DesignScript.Builtin.Dictionary.ValueAtKey(dictionary=createStations3ByStartEndIntervalSpacing, key=code_block_12.out3, lacing=CrossProduct)
code_block_14 = CodeBlock(alignment=code_block_9.alignment, type1PosStations=if_5, type2PosStations=if_6, type1MidStations=midstations_dictionary_2, type2MidStation=mirroredorder_dictionary_2, elevations=code_block_9.elevation, index1=index_dictionary_valueatkey, index2=index_dictionary_valueatkey_2) { alignment; type1PosStations; type2PosStations; type1MidStations; type2MidStation; elevations; index1; index2; }

# group: Creating reference info dict for objects
code_block_15 = CodeBlock { ["docName","aliName","StartStation","EndStation"]; }
code_block_16 = CodeBlock(civilDocumentName=name_2, alignmentName=name, startStation=startstation, endStation=endstation) { civilDocumentName; alignmentName; startStation; endStation; }
list_create_3 = List.Create(item0=code_block_16.civilDocumentName, item1=code_block_16.alignmentName, item2=code_block_16.startStation, item3=code_block_16.endStation)
flatten = List.Flatten(list=list_create_3)
# note: description
code_block_17 = CodeBlock { ["Source","Type","ObjectDOB"]; ["C3D","Corridor&Alignment"]; }
now = DateTime.Now()

string_from_object_4 = FromObject(obj=now)

# group (continued): Creating reference info dict for objects
addItemToEnd = List.AddItemToEnd(item=string_from_object_4, list=code_block_17.out1)
byKeysValues_3 = DesignScript.Builtin.Dictionary.ByKeysValues(keys=code_block_17.out0, values=addItemToEnd)
code_block_18 = CodeBlock(keys=code_block_15, values=flatten, main_dict=byKeysValues_3) { keys; values; main_dict; }

byKeysValues_4 = DesignScript.Builtin.Dictionary.ByKeysValues(keys=code_block_15, values=flatten)

# group (continued): Creating reference info dict for objects
code_block_19 = CodeBlock(c3dInfoDict=byKeysValues_4) { c3dInfoDict; }

code_block_20 = CodeBlock { "No config file used"; }

# group: Create script meta data file
string = StringInput("ScriptName")
python_script = Python()  # unwired: IN[0]
# ---------- python_script.python (29 lines) ----------
# Importing Reference Modules
# CLR ( Common Language Runtime Module )
import clr
# Adding the DynamoRevitDS.dll module to work with the Dynamo API
clr.AddReference('DynamoRevitDS')
import Dynamo 

# access to the current Dynamo instance and workspace
dynamoRevit = Dynamo.Applications.DynamoRevit()
currentWorkspace = dynamoRevit.RevitDynamoModel.CurrentWorkspace

# Access current version of dynamo
version=dynamoRevit.RevitDynamoModel.Version

# checks version of dynamo and adjusts output according to version
if version.StartsWith("1."):
	
	# Gets file name which includes full path
	filename=currentWorkspace.FileName
	
	
	# Splits out file path to just file name
	OUT=filename

elif version.StartsWith("2."):
	OUT=currentWorkspace.Name

else:
	OUT="Not supported"
# ----------------------------------------
string_from_object_5 = FromObject(obj=python_script)
byKeysValues_5 = DesignScript.Builtin.Dictionary.ByKeysValues(keys=string, values=string_from_object_5)
string_2 = StringInput("username")
userName = Custom[System.UserName]()  # package Clockwork for Dynamo 2.x; Returns the user name of the person who is currently logged on to Windows on the machine the script is executed on.
setValueAtKeys = DesignScript.Builtin.Dictionary.SetValueAtKeys(dictionary=byKeysValues_5, keys=string_2, values=userName)
code_block_21 = CodeBlock(scriptMeta=setValueAtKeys) { scriptMeta; }

# group: creating parameter_value dict for all type objects, including the script info
code_block_22 = CodeBlock { ["ROCO_CTE_Dynamo.GUID","ROCO_CTE_Dynamo.Script"]; }
generateGuid = DynamoROCO.DesignLog.GenerateGuid()
string_3 = StringInput("ConfigFileMeta")
# note: description
code_block_23 = CodeBlock(c3DInfoDict=code_block_19, configFileMeta=code_block_20, scriptMeta=code_block_21) { c3DInfoDict; configFileMeta; scriptMeta; }
byKeysValues_6 = DesignScript.Builtin.Dictionary.ByKeysValues(keys=string_3, values=code_block_23.configFileMeta)
string_4 = StringInput("ScriptMeta")
setValueAtKeys_2 = DesignScript.Builtin.Dictionary.SetValueAtKeys(dictionary=byKeysValues_6, keys=string_4, values=code_block_23.scriptMeta)
stringifyJSON = Data.StringifyJSON(values=setValueAtKeys_2, lacing=Longest)
list_create_4 = List.Create(item0=generateGuid, item1=stringifyJSON)
setValueAtKeys_3 = DesignScript.Builtin.Dictionary.SetValueAtKeys(keys=code_block_22, values=list_create_4)  # unwired: dictionary
string_5 = StringInput("ROCO_CTE_Reference_Source_Data")
code_block_24 = CodeBlock(C3D_Reference_Dict=code_block_23.c3DInfoDict) { C3D_Reference_Dict; }
stringifyJSON_2 = Data.StringifyJSON(values=code_block_24, lacing=Longest)

# group: Create Positions for type1
code_block_25 = CodeBlock(alignment=code_block_14.alignment, type1PosStations=code_block_14.type1PosStations, type1MidStations=code_block_14.type1MidStations, elevations=code_block_14.elevations, index1=code_block_14.index1) { alignment; type1PosStations; type1MidStations; elevations; index1; }
code_block_26 = CodeBlock { 0; }
type1points_alignment = CivilConnection.Alignment.PointByStationOffsetElevation(alignment=code_block_25.alignment, station=code_block_25.type1PosStations, offset=code_block_26, elevation=code_block_25.elevations, lacing=CrossProduct)
X = Point.X(point=type1points_alignment)
surveyPoint = Coordinates.SurveyPoint()
X_2 = Point.X(point=surveyPoint)
add_3 = X + X_2
Y = Point.Y(point=type1points_alignment)
Y_2 = Point.Y(point=surveyPoint)
add_4 = Y + Y_2
Z = Point.Z(point=type1points_alignment)
byCoordinates = Point.ByCoordinates(x=add_3, y=add_4, z=Z)
code_block_27 = CodeBlock(type1Positions=byCoordinates, type1MidStations=code_block_25.type1MidStations, index=code_block_25.index1) { type1Positions; type1MidStations; index; }

byKeysValues_7 = DesignScript.Builtin.Dictionary.ByKeysValues(keys=code_block_22, values=list_create_4)

# group (continued): creating parameter_value dict for all type objects, including the script info
setValueAtKeys_4 = DesignScript.Builtin.Dictionary.SetValueAtKeys(dictionary=byKeysValues_7, keys=string_5, values=stringifyJSON_2)
code_block_28 = CodeBlock(DynamoParameterDict=setValueAtKeys_4) { DynamoParameterDict; }

code_block_29 = CodeBlock(familyTypes1=code_block_8.familyTypes1, familyType2=code_block_8.familyType2, topOffset=code_block_8.topOffset, baseOffset=code_block_8.baseOffset, cutOffset=code_block_8.cutOffset, indexStart=code_block_8.indexStart, mirror2ndFam=code_block_8.mirror2ndFam, mirror1stFam=code_block_8.mirror1stFam, classificationDict=code_block_8.classificationParameters, geometryParameters=code_block_8.geometryParameters, DynamoParameterDict=code_block_28)
# ---------- code_block_29.designscript (11 lines) ----------
familyTypes1;
familyType2;
topOffset;
baseOffset;
cutOffset;
indexStart;
mirror2ndFam;
mirror1stFam;
classificationDict;
geometryParameters;
DynamoParameterDict;
# ----------------------------------------

# group: CreateParameterValues1
code_block_30 = CodeBlock { "ROCO_CNU_OBS.Index"; "ROCO_CNU_Station"; }
code_block_31 = CodeBlock(index1=code_block_27.index, indexstart=code_block_29.indexStart, type1MidStations=code_block_27.type1MidStations, ClassificationDict=code_block_29.classificationDict, geometryParameters=code_block_29.geometryParameters, DynamoParameterDict=code_block_29.DynamoParameterDict) { index1; indexstart; type1MidStations; ClassificationDict; geometryParameters; DynamoParameterDict; }
set1indexvalues = code_block_31.index1 + code_block_31.indexstart
parameterset1_dictionary = DesignScript.Builtin.Dictionary.ByKeysValues(keys=code_block_30.out0, values=set1indexvalues, lacing=CrossProduct)
setValueAtKeys_5 = DesignScript.Builtin.Dictionary.SetValueAtKeys(dictionary=parameterset1_dictionary, keys=code_block_30.out1, values=code_block_31.type1MidStations, lacing=Longest)
keys = DesignScript.Builtin.Dictionary.Keys(dictionary=code_block_31.ClassificationDict)
valueAtKey = DesignScript.Builtin.Dictionary.ValueAtKey(dictionary=code_block_31.ClassificationDict, key=keys)
setValueAtKeys_6 = DesignScript.Builtin.Dictionary.SetValueAtKeys(dictionary=setValueAtKeys_5, keys=keys, values=valueAtKey)
keys_2 = DesignScript.Builtin.Dictionary.Keys(dictionary=code_block_31.geometryParameters)
valueAtKey_2 = DesignScript.Builtin.Dictionary.ValueAtKey(dictionary=code_block_31.geometryParameters, key=keys_2)
setValueAtKeys_7 = DesignScript.Builtin.Dictionary.SetValueAtKeys(dictionary=setValueAtKeys_6, keys=keys_2, values=valueAtKey_2)
keys_3 = DesignScript.Builtin.Dictionary.Keys(dictionary=code_block_31.DynamoParameterDict)
valueAtKey_3 = DesignScript.Builtin.Dictionary.ValueAtKey(dictionary=code_block_31.DynamoParameterDict, key=keys_3)
setValueAtKeys_8 = DesignScript.Builtin.Dictionary.SetValueAtKeys(dictionary=setValueAtKeys_7, keys=keys_3, values=valueAtKey_3)

# group: Create Positions for type2
code_block_32 = CodeBlock(alignment=code_block_14.alignment, type2PosStations=code_block_14.type2PosStations, type2MidStations=code_block_14.type2MidStation, elevations=code_block_14.elevations, index2=code_block_14.index2) { alignment; type2PosStations; type2MidStations; elevations; index2; }
code_block_33 = CodeBlock { 0; }
type2points_alignment = CivilConnection.Alignment.PointByStationOffsetElevation(alignment=code_block_32.alignment, station=code_block_32.type2PosStations, offset=code_block_33, elevation=code_block_32.elevations, lacing=CrossProduct)
X_3 = Point.X(point=type2points_alignment)
surveyPoint_2 = Coordinates.SurveyPoint()
X_4 = Point.X(point=surveyPoint_2)
add_5 = X_3 + X_4
Y_3 = Point.Y(point=type2points_alignment)
Y_4 = Point.Y(point=surveyPoint_2)
add_6 = Y_3 + Y_4
Z_2 = Point.Z(point=type2points_alignment)
byCoordinates_2 = Point.ByCoordinates(x=add_5, y=add_6, z=Z_2)
code_block_34 = CodeBlock(type2Positions=byCoordinates_2, type2MidStations=code_block_32.type2MidStations, index=code_block_32.index2) { type2Positions; type2MidStations; index; }

# group: Create family instances
code_block_35 = CodeBlock(type1Positions=code_block_27.type1Positions, type2Positions=code_block_34.type2Positions, familyType1=code_block_29.familyTypes1, familyType2=code_block_29.familyType2) { type1Positions; type2Positions; familyType1; familyType2; }
byPoints = AdaptiveComponent.ByPoints(points=code_block_35.type1Positions, familyType=code_block_35.familyType1)
byPoints_2 = AdaptiveComponent.ByPoints(points=code_block_35.type2Positions, familyType=code_block_35.familyType2)

# group: Set Type1Parameters
code_block_36 = CodeBlock(parameterDict=setValueAtKeys_8, familyInstance=byPoints) { parameterDict; familyInstance; }
element_SetParams = Custom[element_SetParams](elementInstance=code_block_36.familyInstance, parameterDict=code_block_36.parameterDict, lacing=Longest)  # package ROCO Dyf Packages; Sets parameters based on element and parameter dict

# group: CreateParameterValues2
code_block_37 = CodeBlock { "ROCO_CNU_OBS.Index"; "ROCO_CNU_Station"; }
code_block_38 = CodeBlock(index2=code_block_34.index, indexstart=code_block_29.indexStart, type2MidStations=code_block_34.type2MidStations, ClassificationDict=code_block_29.classificationDict, geometryParameters=code_block_29.geometryParameters, DynamoParameterDict=code_block_29.DynamoParameterDict) { index2; indexstart; type2MidStations; ClassificationDict; geometryParameters; DynamoParameterDict; }
set1indexvalues_2 = code_block_38.index2 + code_block_38.indexstart
parameterset1_dictionary_2 = DesignScript.Builtin.Dictionary.ByKeysValues(keys=code_block_37.out0, values=set1indexvalues_2, lacing=CrossProduct)
setValueAtKeys_9 = DesignScript.Builtin.Dictionary.SetValueAtKeys(dictionary=parameterset1_dictionary_2, keys=code_block_37.out1, values=code_block_38.type2MidStations, lacing=Longest)
keys_4 = DesignScript.Builtin.Dictionary.Keys(dictionary=code_block_38.ClassificationDict)
valueAtKey_4 = DesignScript.Builtin.Dictionary.ValueAtKey(dictionary=code_block_38.ClassificationDict, key=keys_4)
setValueAtKeys_10 = DesignScript.Builtin.Dictionary.SetValueAtKeys(dictionary=setValueAtKeys_9, keys=keys_4, values=valueAtKey_4)
keys_5 = DesignScript.Builtin.Dictionary.Keys(dictionary=code_block_38.geometryParameters)
valueAtKey_5 = DesignScript.Builtin.Dictionary.ValueAtKey(dictionary=code_block_38.geometryParameters, key=keys_5)
setValueAtKeys_11 = DesignScript.Builtin.Dictionary.SetValueAtKeys(dictionary=setValueAtKeys_10, keys=keys_5, values=valueAtKey_5)
keys_6 = DesignScript.Builtin.Dictionary.Keys(dictionary=code_block_38.DynamoParameterDict)
valueAtKey_6 = DesignScript.Builtin.Dictionary.ValueAtKey(dictionary=code_block_38.DynamoParameterDict, key=keys_6)
setValueAtKeys_12 = DesignScript.Builtin.Dictionary.SetValueAtKeys(dictionary=setValueAtKeys_11, keys=keys_6, values=valueAtKey_6)

# group: Set Type1Parameters
code_block_39 = CodeBlock(parameterDict=setValueAtKeys_12, familyInstance=byPoints_2) { parameterDict; familyInstance; }
element_SetParams_2 = Custom[element_SetParams](elementInstance=code_block_39.familyInstance, parameterDict=code_block_39.parameterDict, lacing=Longest)

code_block_40 = CodeBlock(alignment=code_block_5.alignment, startstation=code_block_5.startstation, endstation=code_block_5.endstation, elevation=code_block_5.elevation, type1Number=code_block_5.type1Number, type1Width=code_block_5.type1Width, type2Number=code_block_5.type2Number, type2Width=code_block_5.type2Width)
# ---------- code_block_40.designscript (9 lines) ----------
alignment;
startstation;
endstation;
elevation;
type1Number;
type1Width;
type1Gap = type1Width * type1Number;
type2Number;
type2Width;
# ----------------------------------------
watch_2 = Watch(code_block_40.type2Width)
watch_3 = Watch(code_block_40.alignment)
watch_4 = Watch(code_block_40.startstation)
watch_5 = Watch(code_block_40.endstation)
watch_6 = Watch(code_block_40.elevation)
watch_7 = Watch(code_block_40.type1Width)
watch_8 = Watch(code_block_40.type1Gap)
watch_9 = Watch(code_block_40.type1Number)
watch_10 = Watch(code_block_40.type2Number)
pointGroupsByDoubleInterval = CivilConnection.Alignment.PointGroupsByDoubleInterval(alignment=watch_3, StartStation=watch_4, EndStation=watch_5, Elevation=watch_6, Distance=watch_7, InnerInterval=watch_8, NumberOfMinorGroups=watch_9, OuterInterval=watch_10)
