# Dynamo graph CC_GMA2_GMA4_createObjects@CorridorFLpoints.dyn (Dynamo 2.3.0.5885)
# packages: Data-Shapes 2019.2.40, CivilConnection2020 4.0.4, archi-lab.net 2020.22.9, Clockwork for Dynamo 2.x 2.1.2, DynamoROCO 2.3.0.0

# group: DATA MANIPULATION
# note: Data manipulation on Dynamo Objects

# group: NOT IN USE
# note: Nodes to consider part of the final graph

# group: INPUT
# note: Data input and preperation for other nodes

# group: GET
# note: Get parameter values from Revit objects

# group: DEBUG
# note: Check if the graph is working as expected

# group: Package
# note: All used nodes from a package have a prefix
# added to them with the name of the node.

# group: FUNCTION
# note: Creation of dynamo objects

# group: OUTPUT
# note: Object creation in Revit, final output

# group: SET
# note: Set parameters on Revit objects

# group: INFO
# note: GENERAL INFO
# Version: 2
# Author: Dick Elsman
# Company: Infranea | ROCO
# email: dick.elsman@infranea.com
# Dynamo Core version: 2.3.0.5885
# Dynamo Revit version: 2.3.0.6270
# Revit version: 2020.2
# note: INSTRUCTIONS
# <DESCRIPTION>
# Allows the user to place GMA2 objects on featureline points in the direction of the alignment (and corridor).  Duration of scripts depends on complexity of corridor and to be placed objects. Min runtime is about 5 minutes
# <INSTRUCTIONS>
# navigate to the folder to play, and press play in the Dynamo Player.
# NB! This script requires a JSON config file for it to index objects and data from sources. This/these file(s) shoudl be stored in <script directory>\config_files
# note: KNOWN ISSUES AND LIMITATIONS
# - Does not support retaining objects yet
# - Does not yet facilitate slopes in floors
# note: USED PACKAGES
# Packages from path:
# C:\Users\delsman\BIM 360\BAM Belgium\Oosterweel - THV ROCO\Project Files\003 Shared\000 Library\001 Dynamo Custom Nodes
# archi-lab.net 		v2020.22.9
# LunchBox for Dynamo 	v2018.8.8
# Rhythm 			v2019.11.7
# spring nodes 		v203.1.0

# group: Importing civil documents from application and fomratting for selecting corridor and FPcodes in UI
code_block = CodeBlock { "Civil3D Corridor"; }
# note: description
civilApplication = CivilConnection.CivilApplication.CivilApplication()
getDocuments = CivilConnection.CivilApplication.GetDocuments(civilApplication=civilApplication)
name = CivilConnection.CivilDocument.Name(civilDocument=getDocuments, lacing=Longest)
string = StringInput(" | ")
operators = name + string
getCorridors = CivilConnection.CivilDocument.GetCorridors(civilDocument=getDocuments)
name_2 = CivilConnection.Corridor.Name(corridor=getCorridors)
operators_2 = operators + name_2
operators_3 = operators_2 + string
getCodes = CivilConnection.Corridor.GetCodes(corridor=getCorridors)
operators_4 = operators_3 + getCodes
flatten = List.Flatten(list=operators_4)
list_create = List.Create(item0=flatten)
code_block_2 = CodeBlock { zero:int=0; }
data_shapes_ui_dropdown_data = Custom[Data-Shapes_UI.DropDown Data](InputName=code_block, Keys=list_create, Values=list_create, DefaultValueIndex=code_block_2, lacing=Shortest)  # package Data-Shapes; Create data for DropDown input in UI.MultiInputForm ++ . Check out www.data-shapes.net for more infos.
string_2 = StringInput("Select only 1 FL point code below!")
code_block_3 = CodeBlock { "Doc | Corridor | FLPointCode"; }
addItemToFront = List.AddItemToFront(item=code_block_3, list=flatten)
code_block_4 = CodeBlock { false; 75; }
ui_treeview_input = Custom[UI.TreeView input](InputName=string_2, Data=addItemToFront, FirstItemIsTitle=code_block_4.out0, Height=code_block_4.out1)  # package Data-Shapes; Create a TreeView input for UI.MultipleInputForm ++ . Check out www.data-shapes.net for more infos and tips!
length = String.Length(str=flatten)
maximumItem = List.MaximumItem(list=length)
code_block_5 = CodeBlock(civilApplication=civilApplication, seperator=string) { civilApplication; seperator; }
code_block_6 = CodeBlock(UIobject=ui_treeview_input, stringLength=maximumItem, civilApplication=code_block_5.civilApplication, Separator=code_block_5.seperator) { UIobject; stringLength; civilApplication; Separator; }

# group: Reading config folder for configuration files, preparing UI to select the configuration file
code_block_7 = CodeBlock { 0; "Cancel"; "Select configuration"; "Select configuration predefined in the script folder"; }
# note: importing text file containing json into 2 streams:
# 1 stream is used for importing the pictures into the UI.
# 1 stream is used as foundation for the information in the script
python_script = Python()  # unwired: IN[0]
# ---------- python_script.python (29 lines) ----------
# Importing Reference Modules
# CLR ( Common Language Runtime Module )
import clr
# Adding the DynamoRevitDS.dll module to work with the Dynamo API
clr.AddReference('DynamoRevitDS')
import Dynamo 

# access to the current Dynamo instance and workspace
dynamoRevit = Dynamo.Applications.DynamoRevit()
currentWorkspace = dynamoRevit.RevitDynamoModel.CurrentWorkspace

# Access current version of dynamo
version=dynamoRevit.RevitDynamoModel.Version

# checks version of dynamo and adjusts output according to version
if version.StartsWith("1."):
	
	# Gets file name which includes full path
	filename=currentWorkspace.FileName
	
	
	# Splits out file path to just file name
	OUT=filename

elif version.StartsWith("2."):
	OUT=currentWorkspace.FileName

else:
	OUT="Not supported"
# ----------------------------------------
directoryName = FileSystem.DirectoryName(path=python_script)
code_block_8 = CodeBlock { "\\config_files"; }
concat = String.Concat(string0=directoryName, string1=code_block_8)
directory_from_path = DirectoryObject(path=concat)
code_block_9 = CodeBlock { false; }
getDirectoryContents = FileSystem.GetDirectoryContents(directory=directory_from_path, includeSubdirectories=code_block_9)
code_block_10 = CodeBlock { "JSON"; true; }
contains = String.Contains(str=getDirectoryContents.files, searchFor=code_block_10.out0, ignoreCase=code_block_10.out1)
filterByBoolMask = List.FilterByBoolMask(list=getDirectoryContents.files, mask=contains)
fileName = FileSystem.FileName(path=filterByBoolMask.in)
data_shapes_ui_dropdown_data_2 = Custom[Data-Shapes_UI.DropDown Data](Keys=fileName, Values=filterByBoolMask.in, DefaultValueIndex=code_block_7.out0)
code_block_11 = CodeBlock { "Enter the author name you want to place on the objects. By default windows username"; }
ui_textnote_data = Custom[UI.TextNote Data](TextNote=code_block_11)  # package Data-Shapes; Create Data for TextNote input in UI.MultipleInputForm ++ . Check out www.data-shapes.net for more informations
code_block_12 = CodeBlock { "Username to place on all objects in this run"; }
userName = Custom[System.UserName]()  # package Clockwork for Dynamo 2.x; Returns the user name of the person who is currently logged on to Windows on the machine the script is executed on.
ui_textbox_data = Custom[UI.TextBox Data](InputName=code_block_12, DefaultText=userName)  # package Data-Shapes; Create Data for TextBox input in UI.MultipleInputForm ++ . Check out www.data-shapes.net for more informations
list_create_2 = List.Create(item0=data_shapes_ui_dropdown_data_2, item1=ui_textnote_data, item2=ui_textbox_data)
count = List.Count(list=fileName)
operators_5 = count != code_block_7.out0
code_block_13 = CodeBlock(description=code_block_7.out3, buttonText=code_block_7.out2, inputs=list_create_2, hasData=operators_5, cancelButton=code_block_7.out1) { description; logo; buttonText; inputs; hasData; cancelButton; maxHeight; maxWidth; }  # unwired: logo, maxHeight, maxWidth

# group: User selects config file to run script with
data_shapes_ui_multipleinputform = Custom[Data-Shapes_UI.MultipleInputForm ++](Description_optional=code_block_13.description, ButtonText_optional=code_block_13.buttonText, Inputs=code_block_13.inputs, Toggle=code_block_13.hasData, CancelButtonText_optional=code_block_13.cancelButton)  # package Data-Shapes; Create a form with multiple inputs. see www.data-shapes.net for tutorials and infos!
code_block_14 = CodeBlock(x=data_shapes_ui_multipleinputform.User_Inputs) { selectedConfigFile=x[0]; userName=x[1]; }

# group: Import JSON file for script config
code_block_15 = CodeBlock(selectedConfigFile=code_block_14.selectedConfigFile, username=code_block_14.userName) { selectedConfigFile; username; }
code_block_16 = CodeBlock { 0; }
getItemAtIndex = List.GetItemAtIndex(list=code_block_15.selectedConfigFile, index=code_block_16)
readText = FileSystem.ReadText(file=getItemAtIndex)
parseJSON = Data.ParseJSON(json=readText)
code_block_17 = CodeBlock { "scriptDataDict"; "imageDict"; "configData"; }
valueAtKey = DesignScript.Builtin.Dictionary.ValueAtKey(dictionary=parseJSON, key=code_block_17.out1)
valueAtKey_2 = DesignScript.Builtin.Dictionary.ValueAtKey(dictionary=parseJSON, key=code_block_17.out0)
valueAtKey_3 = DesignScript.Builtin.Dictionary.ValueAtKey(dictionary=parseJSON, key=code_block_17.out2)
code_block_18 = CodeBlock { "#adaptivePoints"; }
valueAtKey_4 = DesignScript.Builtin.Dictionary.ValueAtKey(dictionary=valueAtKey_3, key=code_block_18)
code_block_19 = CodeBlock(imageDict=valueAtKey, scriptSettingsDict=valueAtKey_2, amountAdaptivePoints=valueAtKey_4, configFileMeta=valueAtKey_3, username=code_block_15.username) { imageDict; scriptSettingsDict; amountAdaptivePoints; configFileMeta; username; }

# group: Building dictionary for use in UI
# note: building UI data to feed the listview for selecting type objects
code_block_20 = CodeBlock(scriptDataDict=code_block_19.scriptSettingsDict) { scriptDataDict; }
keys = DesignScript.Builtin.Dictionary.Keys(dictionary=code_block_20)
toNumber = String.ToNumber(str=keys)
sortListByAnother = archilab.Lists.Lists.SortListByAnother(list=keys, sortBy=toNumber)
string_3 = StringInput(" : ")
operators_6 = sortListByAnother.list + string_3
valueAtKey_5 = DesignScript.Builtin.Dictionary.ValueAtKey(dictionary=code_block_20, key=sortListByAnother.list)
string_4 = StringInput("name")
valueAtKey_6 = DesignScript.Builtin.Dictionary.ValueAtKey(dictionary=valueAtKey_5, key=string_4)
operators_7 = operators_6 + valueAtKey_6
code_block_21 = CodeBlock(listviewDisplayData=operators_7, sorted_dict_keys=sortListByAnother.list) { item_index_values; listviewDisplayData; sorted_dict_keys; }  # unwired: item_index_values

# group: Creating image data for use in script
# note: Converting the imported json into 2 filepath, 1 for the logo in the UI, the other as reference image in the UI
code_block_22 = CodeBlock(JSONImportPictureData=code_block_19.imageDict) { JSONImportPictureData; }
code_block_23 = CodeBlock { "Logo"; "ReferenceImage"; }
valueAtKey_7 = DesignScript.Builtin.Dictionary.ValueAtKey(dictionary=code_block_22, key=code_block_23.out0)
fromPath = FileObject(path=valueAtKey_7)  # "File.FromPath"
readFromFile = Image.ReadFromFile(file=fromPath)
code_block_24 = CodeBlock(Logo=readFromFile) { Logo; }
string_5 = StringInput("Reference image")
valueAtKey_8 = DesignScript.Builtin.Dictionary.ValueAtKey(dictionary=code_block_22, key=code_block_23.out1)
fromPath_2 = FileObject(path=valueAtKey_8)  # "File.FromPath"
string_from_object = FromObject(obj=fromPath_2)
filepath_from_string_python = Python(IN[0]=string_from_object)  # "filepath from string:python script"
# ---------- filepath_from_string_python.python (14 lines) ----------
# Load the Python Standard and DesignScript Libraries
import sys
import clr
import os
clr.AddReference('ProtoGeometry')
from Autodesk.DesignScript.Geometry import *

# The inputs to this node will be stored as a list in the IN variables.


# Place your code below this line

# Assign your outputto the OUT variable.
OUT = os.path.join(IN[0])
# ----------------------------------------
boolean = BoolSelector(false)
data_shapes_ui_image_data = Custom[Data-Shapes_UI.Image Data](Image=filepath_from_string_python, ShowBorder_optional=boolean)  # package Data-Shapes; Places an image on UI.MultipleInutForm ++ .
data_shapes_ui_inputgroup_data = Custom[Data-Shapes_UI.InputGroup Data](GroupTitle=string_5, Inputs=data_shapes_ui_image_data)  # package Data-Shapes; Creates a group of inputs for UI.MultipleInputForm ++ . Check out www.data-shapes.net for more infos !
code_block_25 = CodeBlock(LogoImage=code_block_24, referenceImageObject=data_shapes_ui_inputgroup_data) { LogoImage; referenceImageObject; }

# group: creating input values for selecting type objects
string_6 = StringInput("Select below which objects of the tunnel you want to place based on the alignments. Note: be sure you have loaded all the correct families in the project BEFORE continueing.")
# note: description
code_block_26 = CodeBlock(item_index_values=code_block_21.item_index_values, listviewDisplayData=code_block_21.listviewDisplayData, sorted_dict_keys=code_block_21.sorted_dict_keys, referenceImage=code_block_25.referenceImageObject, uiLogo=code_block_25.LogoImage) { item_index_values; listviewDisplayData; sorted_dict_keys; referenceImage; uiLogo; }
string_7 = StringInput("Continue")
string_8 = StringInput("Select which object to create in this script")
code_block_27 = CodeBlock { "Select which objects of the tunnel  sections you want to place"; }
code_block_28 = CodeBlock { false; }
data_shapes_ui_listview_data = Custom[Data-Shapes_UI.Listview Data](InputName=code_block_27, Keys=code_block_26.listviewDisplayData, Values=code_block_26.sorted_dict_keys, SortItems_optionnal=code_block_28)  # package Data-Shapes; Create data for ListView input in UI.MultiInputForm ++ . Check out www.data-shapes.net for more infos.
list_create_3 = List.Create(item0=data_shapes_ui_listview_data)
data_shapes_ui_inputgroup_data_2 = Custom[Data-Shapes_UI.InputGroup Data](GroupTitle=string_8, Inputs=list_create_3)
list_create_4 = List.Create(item0=code_block_26.referenceImage, item1=data_shapes_ui_inputgroup_data_2)
boolean_2 = BoolSelector(true)
code_block_29 = CodeBlock { "Cancel"; 1000; }
code_block_30 = CodeBlock(Descritpion=string_6, logo=code_block_26.uiLogo, ButtonText=string_7, inputs=list_create_4, objectHasData=boolean_2, cancelButtonText=code_block_29.out0, maxHeight=code_block_29.out1, uiWidth=code_block_29.out1) { Descritpion; logo; ButtonText; inputs; objectHasData; cancelButtonText; maxHeight; uiWidth; }

# group: User selects type object to place with script
# note: User selects which objects to place
data_shapes_ui_multipleinputform_2 = Custom[Data-Shapes_UI.MultipleInputForm ++](Description_optional=code_block_30.Descritpion, Logo_optional=code_block_30.logo, ButtonText_optional=code_block_30.ButtonText, Inputs=code_block_30.inputs, Toggle=code_block_30.objectHasData, CancelButtonText_optional=code_block_30.cancelButtonText, MaxHeight_optional=code_block_30.maxHeight, Width_optional=code_block_30.uiWidth)
code_block_31 = CodeBlock { null; }
if_ = If(test=data_shapes_ui_multipleinputform_2.Was_Cancelled, true=code_block_31, false=data_shapes_ui_multipleinputform_2.User_Inputs)
code_block_32 = CodeBlock(selectedItems=if_) { selectedItems; }

# group: Filtering scritpDataDict based on selected items
# note: description
code_block_33 = CodeBlock(scritpDataDict=code_block_19.scriptSettingsDict, selectedItems=code_block_32) { scritpDataDict; selectedItems; }
flatten_2 = List.Flatten(list=code_block_33.selectedItems)
designscriptbuiltin = DesignScript.Builtin.Dictionary.ValueAtKey(dictionary=code_block_33.scritpDataDict, key=flatten_2)
code_block_34 = CodeBlock(selectedDict=designscriptbuiltin) { selectedDict; }
string_9 = StringInput(" : ")
operators_8 = flatten_2 + string_9
string_10 = StringInput("name")
designscriptbuiltin_2 = DesignScript.Builtin.Dictionary.ValueAtKey(dictionary=code_block_34, key=string_10)
operators_9 = operators_8 + designscriptbuiltin_2
code_block_35 = CodeBlock(selectedObjectDicts=code_block_34, selectedObjectTypeNames=operators_9) { selectedObjectDicts; selectedObjectTypeNames; }

# group: Filter families in project based on search query of config_file
code_block_36 = CodeBlock { 1; }
getItemAtIndex_2 = List.GetItemAtIndex(index=code_block_36)  # unwired: list
code_block_37 = CodeBlock { "filters targetlist based on string: "; "'|' is used to define 'or'"; "',' is used to define 'and'"; }
# note: filter Family object items based on string
string_11 = StringInput("fam_search")
designscriptbuiltin_3 = DesignScript.Builtin.Dictionary.ValueAtKey(dictionary=code_block_35.selectedObjectDicts, key=string_11)
element_types = ElementTypes("Family")
all_elements_of_type = ElementsOfType(element_type=element_types)
name_3 = Element.Name(element=all_elements_of_type)
boolean_3 = BoolSelector(true)
code_block_38 = CodeBlock(filters=designscriptbuiltin_3, targetList=name_3, ignoreCase=boolean_3) { filters; targetList; ignoreCase; }
python_script_2 = Python(IN[0]=code_block_38.filters, IN[1]=code_block_38.targetList, IN[2]=code_block_38.ignoreCase)
# ---------- python_script_2.python (76 lines) ----------
# Load the Python Standard and DesignScript Libraries
import sys
import clr
clr.AddReference('ProtoGeometry')
from Autodesk.DesignScript.Geometry import *
# functions

def unique(list0): 
    # insert the list to the set 
    list_set = set(list0) 
    # convert the set to the list 
    unique_list = (list(list_set)) 
    return unique_list
    
# The inputs to this node will be stored as a list in the IN variables.
filters=IN[0]
targetlist = IN[1]
ignorecase=IN[2]

outdict={}
tempdict={}
list1=[]
target_templist=[]
target_temp = list(targetlist)
target_outlist=[]
i=0
# Place your code below this line
for filtr in filters:
    if "str" in str(type(filtr)):
        list1.append(filtr.split(","))
    else:
        list1.append(["@/NSF/@"])
    i += 1

if ignorecase:  # setting all items to lower instead of capitalized, then reassinging them in the to edit list.
    j = 0
    for sublist in list1:
        k = 0
        for item in sublist:
            sublist[k] = item.lower()
            k += 1
        list1[j] = sublist
        j += 1
    j = 0
    for item in target_temp:
        target_temp[j] = item.lower()
        j += 1

outdict["filters"] = list1

for sublist in list1:                   #FOR SUBLIST IN LIST OF SEARCH QUERIES
    target_templist.Clear()             #CLEAR TEMP LIST OF TARGETS
    count0 = 0                          #SETTING REFERENCE VALUE 0
    for target in target_temp:          #FOR EACH SEARCH QUERY
        count1 = 0                      #COUNT MATCHES=O
        for item in sublist:            #FOR EACH SEARCH ITEM IN THE SEARCH QUERY
            if "|" in item:             # filter based on OR value
                item = item.split("|")  #split the match cases
                for i in item:          #if 1 of the matches is in the string, add 1 to the counter
                    if i in target:
                        count1 += 1
                        break
            elif "!=" in item[:2]:       #if search query contains "not" symbol
                if item[2:] in target:
                    count1 -= 1         #reduces count of checks
                else:
                	count1 += 1
            elif item in target:        #if target contains stringvalue
                count1 += 1
        if count1 == len(sublist):
            target_templist.append(targetlist[count0])
        count0 += 1
    target_outlist.append(unique(list(target_templist)))
outdict["match"] = target_outlist
# Assign your output to the OUT variable.
OUT = outdict
# ----------------------------------------
code_block_39 = CodeBlock { "match"; }
valueAtKey_9 = DesignScript.Builtin.Dictionary.ValueAtKey(dictionary=python_script_2, key=code_block_39)

# group: creating input data for selecting families and type in UI
# note: description
byName = Family.ByName(name=valueAtKey_9)
types = Family.Types(family=byName)
python_script_3 = Python(IN[0]=types)
# ---------- python_script_3.python (21 lines) ----------
# Load the Python Standard and DesignScript Libraries
import sys
import clr
clr.AddReference('ProtoGeometry')
from Autodesk.DesignScript.Geometry import *

# The inputs to this node will be stored as a list in the IN variables.
inlist=IN[0]
templist=[]
outlist=[]
# Place your code below this line
for sublist in inlist:
	templist.Clear()
	for item in sublist:
		for i in item:
			templist.append(i)
	outlist.append(list(templist))
			
		
# Assign your output to the OUT variable.
OUT = outlist
# ----------------------------------------
isEmpty = List.IsEmpty(list=python_script_3, lacing=Longest)
code_block_40 = CodeBlock { ["N/A"]; }
code_block_41 = CodeBlock(targetlist=python_script_3, booleanList=isEmpty, itemToPlace=code_block_40) { targetlist; booleanList; itemToPlace; }
replaceitemsbybool_python_script = Python(IN[0]=code_block_41.targetlist, IN[1]=code_block_41.booleanList, IN[2]=code_block_41.itemToPlace)
# ---------- replaceitemsbybool_python_script.python (20 lines) ----------
# Load the Python Standard and DesignScript Libraries
import sys
import clr
clr.AddReference('ProtoGeometry')
from Autodesk.DesignScript.Geometry import *

# The inputs to this node will be stored as a list in the IN variables.
targetlist, booleanlist, replaceitem = IN
i=0
# Place your code below this line
try:
	while i< len(booleanlist):
		if booleanlist[i]:
			targetlist[i]=replaceitem
		i+=1
except:
	pass

# Assign your output to the OUT variable.
OUT = targetlist
# ----------------------------------------
name_4 = Family.Name(family=byName)
string_12 = StringInput(" | Type: ")
operators_10 = name_4 + string_12  # lacing=Longest
name_5 = FamilyType.Name(familyType=types)
operators_11 = operators_10 + name_5
string_13 = StringInput("  | Category: ")
operators_12 = operators_11 + string_13  # lacing=Longest
getCategory = Element.GetCategory(element=types)
operators_13 = operators_12 + getCategory
python_script_4 = Python(IN[0]=operators_13)  # same code as python_script_3
isEmpty_2 = List.IsEmpty(list=python_script_4, lacing=Longest)
code_block_42 = CodeBlock { ["no family or type found"]; }
code_block_43 = CodeBlock(targetlist=python_script_4, booleanList=isEmpty_2, itemToPlace=code_block_42) { targetlist; booleanList; itemToPlace; }
replaceitemsbybool_python_script_2 = Python(IN[0]=code_block_43.targetlist, IN[1]=code_block_43.booleanList, IN[2]=code_block_43.itemToPlace)  # same code as replaceitemsbybool_python_script
code_block_44 = CodeBlock(familyTypes=replaceitemsbybool_python_script, inputFamilyTypeString=replaceitemsbybool_python_script_2) { familyTypes; inputFamilyTypeString; }

code_block_45 = CodeBlock(referenceImage=code_block_25.referenceImageObject, groupNames=code_block_35.selectedObjectTypeNames, Logo=code_block_25.LogoImage, civilApplication=code_block_6.civilApplication) { referenceImage; groupNames; Logo; civilApplication; }

# group: Creating UI objects for selecting family types and civil corridor FPCodes
code_block_46 = CodeBlock { "select famliy + type"; }
# note: description
code_block_47 = CodeBlock(uiObject=code_block_6.UIobject, stringLength=code_block_6.stringLength, familyTypes=code_block_44.familyTypes, family_input_selection_string=code_block_44.inputFamilyTypeString, logo=code_block_45.Logo, referenceImage=code_block_45.referenceImage, groupImages=code_block_45.groupNames) { uiObject; stringLength; familyTypes; family_input_selection_string; logo; referenceImage; groupImages; }
code_block_48 = CodeBlock { 0; }
data_shapes_ui_dropdown_data_3 = Custom[Data-Shapes_UI.DropDown Data](InputName=code_block_46, Keys=code_block_47.family_input_selection_string, Values=code_block_47.familyTypes, DefaultValueIndex=code_block_48, lacing=Longest)
flatten_3 = List.Flatten(list=code_block_47.family_input_selection_string)
length_2 = String.Length(str=flatten_3)
maximumItem_2 = List.MaximumItem(list=length_2)
code_block_49 = CodeBlock(UIobject=data_shapes_ui_dropdown_data_3, stringLength=maximumItem_2) { UIobject; stringLength; }
clockwork_Passthrough = Custom[Clockwork_Passthrough](passThrough=code_block_49.UIobject, waitFor=code_block_47.uiObject)  # package Clockwork for Dynamo 2.x; Forces a sequential order of execution. The node wired into the output of the Passthrough node will be executed *after* the node wired into the waitFor input (e.g. important for some Revit operations). The value of the passThrough input will be passed on to the node wired into the output port of the Passthrough node.
clockwork_Passthrough_2 = Custom[Clockwork_Passthrough](passThrough=code_block_47.uiObject, waitFor=code_block_49.UIobject)
addItemToEnd = List.AddItemToEnd(item=clockwork_Passthrough_2)  # unwired: list
map = List.Map(list=clockwork_Passthrough, f_x=addItemToEnd)
python_script_5 = Python(IN[0]=map)
# ---------- python_script_5.python (24 lines) ----------
# Load the Python Standard and DesignScript Libraries
import sys
import clr
clr.AddReference('ProtoGeometry')
from Autodesk.DesignScript.Geometry import *

# The inputs to this node will be stored as a list in the IN variables.
inlist=IN[0]
templist=[]
outlist=[]
# Place your code below this line
for sublist in inlist:
	templist.Clear()
	for item in sublist:
		if "list" in str(type(item)):
			for i in item:
				templist.append(i)
		else:
			templist.append(item)
	outlist.append(list(templist))
			
		
# Assign your output to the OUT variable.
OUT = outlist
# ----------------------------------------
string_14 = StringInput("Continue")
string_15 = StringInput("instructions:")
string_16 = StringInput("Select which familys and types match with the objects previously checked. Additionally select the corridor featurelinepoint on which the objects should be hosted. If the UI shows \"No family or type found\", it means that no family is loaded which matches the search query for the object. Make sure the names of the families are correct!")
data_shapes_ui_textnote_data = Custom[Data-Shapes_UI.TextNote Data](Title=string_15, TextNote=string_16)  # package Data-Shapes; Create Data for TextNote input in UI.MultipleInputForm ++ . Check out www.data-shapes.net for more informations
data_shapes_ui_inputgroup_data_3 = Custom[Data-Shapes_UI.InputGroup Data](GroupTitle=code_block_47.groupImages, Inputs=map)
addItemToFront_2 = List.AddItemToFront(item=data_shapes_ui_textnote_data, list=data_shapes_ui_inputgroup_data_3)
addItemToFront_3 = List.AddItemToFront(item=code_block_47.referenceImage, list=addItemToFront_2)
isNull = Object.IsNull(obj=data_shapes_ui_inputgroup_data_3)
uniqueItems = List.UniqueItems(list=isNull)
operators_Not = Not(x=uniqueItems)
code_block_50 = CodeBlock { "Cancel"; 1000; }
max = Math.Max(value1=code_block_47.stringLength, value2=code_block_49.stringLength)
code_block_51 = CodeBlock(chars=max) { chars; width = Math.Max(750, Math.Round(200*chars/25 + 0.5*chars)); }
code_block_52 = CodeBlock(logo=code_block_47.logo, ButtonText=string_14, inputs=addItemToFront_3, objectHasData=operators_Not, cancelButtonText=code_block_50.out0, maxHeight=code_block_50.out1, uiWidth=code_block_51.width) { Descritpion; logo; ButtonText; inputs; objectHasData; cancelButtonText; maxHeight; uiWidth; }  # unwired: Descritpion

# group: User selects family types and FP codes
# note: description
data_shapes_ui_multipleinputform_3 = Custom[Data-Shapes_UI.MultipleInputForm ++](Description_optional=code_block_52.Descritpion, Logo_optional=code_block_52.logo, ButtonText_optional=code_block_52.ButtonText, Inputs=code_block_52.inputs, Toggle=code_block_52.objectHasData, CancelButtonText_optional=code_block_52.cancelButtonText, MaxHeight_optional=code_block_52.maxHeight, Width_optional=code_block_52.uiWidth)
code_block_53 = CodeBlock { null; }
if_2 = If(test=data_shapes_ui_multipleinputform_3.Was_Cancelled, true=code_block_53, false=data_shapes_ui_multipleinputform_3.User_Inputs)
code_block_54 = CodeBlock(selectedItems=if_2) { selectedItems; }

# group: creating data for table view based on selected family types and civil info
code_block_55 = CodeBlock { "Overview"; }
# note: description
code_block_56 = CodeBlock(groupNames=code_block_45.groupNames, selectedFamilyTypesAndCivilData=code_block_54, stringSeperator=code_block_6.Separator) { groupNames; selectedFamilyTypesAndCivilData; stringSeperator; }
code_block_57 = CodeBlock { null; }
flatten_4 = List.Flatten(list=code_block_56.selectedFamilyTypesAndCivilData)
code_block_58 = CodeBlock { 2; }
chop = List.Chop(list=flatten_4, lengths=code_block_58)
code_block_59 = CodeBlock { 0; 1; }
getItemAtIndex_3 = List.GetItemAtIndex(list=chop, index=code_block_59.out0, lacing=CrossProduct)
family = FamilyType.Family(familyType=getItemAtIndex_3)
name_6 = Family.Name(family=family)
operators_14 = code_block_57 == name_6
code_block_60 = CodeBlock { "N/A"; }
if_3 = If(test=operators_14, true=code_block_60, false=name_6)
name_7 = FamilyType.Name(familyType=getItemAtIndex_3)
if_4 = If(test=operators_14, true=code_block_60, false=name_7)
getItemAtIndex_4 = List.GetItemAtIndex(list=chop, index=code_block_59.out1, lacing=CrossProduct)
split = String.Split(str=getItemAtIndex_4, separator0=code_block_56.stringSeperator)
code_block_61 = CodeBlock { 0; 1; 2; }
getItemAtIndex_5 = List.GetItemAtIndex(list=split, index=code_block_61.out0, lacing=CrossProduct)
getItemAtIndex_6 = List.GetItemAtIndex(list=split, index=code_block_61.out1, lacing=CrossProduct)
getItemAtIndex_7 = List.GetItemAtIndex(list=split, index=code_block_61.out2, lacing=CrossProduct)
list_create_5 = List.Create(item0=code_block_56.groupNames, item1=if_3, item2=if_4, item3=getItemAtIndex_5, item4=getItemAtIndex_6, item5=getItemAtIndex_7)
code_block_62 = CodeBlock(tableTitle=code_block_55, tableData=list_create_5) { tableTitle; tableData; }

# group: creating input objects from formatted data
# note: description
code_block_63 = CodeBlock(tableTitle=code_block_62.tableTitle, tableData=code_block_62.tableData, referenceImage=code_block_45.referenceImage, logo=code_block_45.Logo) { tableTitle; tableData; referenceImage; logo; }
string_17 = StringInput("Continue")
string_18 = StringInput("Instructions")
string_19 = StringInput("Check if the data in the table is correct, before pressing \"continue\". DO NOT  change anything if you are not sure what to input. The script continues based on this data! put in N/A in a family name to remove it from the list to place.")
data_shapes_ui_textnote_data_2 = Custom[Data-Shapes_UI.TextNote Data](Title=string_18, TextNote=string_19)
code_block_64 = CodeBlock { ["Selected object","Family name", "Family type","Civil document", "Corridor name", "FL point code"]; }
transpose = List.Transpose(lists=code_block_63.tableData)
addItemToFront_4 = List.AddItemToFront(item=code_block_64, list=transpose)
code_block_65 = CodeBlock { true; }
data_shapes_ui_datatable_input = Custom[Data-Shapes_UI.DataTable input](InputName=code_block_63.tableTitle, Data=addItemToFront_4, FirstRowIsTitles=code_block_65)  # package Data-Shapes; Create a DataTable view input for UI.MultipleInputForm ++
data_shapes_ui_inputgroup_data_4 = Custom[Data-Shapes_UI.InputGroup Data](Inputs=data_shapes_ui_datatable_input)
addItemToFront_5 = List.AddItemToFront(item=data_shapes_ui_textnote_data_2, list=data_shapes_ui_inputgroup_data_4)
addItemToFront_6 = List.AddItemToFront(item=code_block_63.referenceImage, list=addItemToFront_5)
isNull_2 = Object.IsNull(obj=data_shapes_ui_datatable_input)
uniqueItems_2 = List.UniqueItems(list=isNull_2)
operators_Not_2 = Not(x=uniqueItems_2)
clockwork_Passthrough_3 = Custom[Clockwork_Passthrough](passThrough=addItemToFront_6, waitFor=operators_Not_2)
code_block_66 = CodeBlock { "Cancel"; 1200; }
code_block_67 = CodeBlock(logo=code_block_63.logo, ButtonText=string_17, inputs=clockwork_Passthrough_3, objectHasData=operators_Not_2, maxHeight=code_block_66.out1, uiWidth=code_block_66.out1, tableTitles=code_block_64) { Descritpion; logo; ButtonText; inputs; objectHasData; cancelButtonText; maxHeight; uiWidth; tableTitles; }  # unwired: Descritpion, cancelButtonText

# group: UI table summary view
# note: description
data_shapes_ui_multipleinputform_4 = Custom[Data-Shapes_UI.MultipleInputForm ++](Logo_optional=code_block_67.logo, ButtonText_optional=code_block_67.ButtonText, Inputs=code_block_67.inputs, Toggle=code_block_67.objectHasData, CancelButtonText_optional=code_block_67.cancelButtonText, MaxHeight_optional=code_block_67.maxHeight, Width_optional=code_block_67.uiWidth)
code_block_68 = CodeBlock { null; }
if_5 = If(test=data_shapes_ui_multipleinputform_4.Was_Cancelled, true=code_block_68, false=data_shapes_ui_multipleinputform_4.User_Inputs)
code_block_69 = CodeBlock(selectedValues=if_5) { selectedValues; }

# group: splitting table data and filtering out obsolete items
# note: description
code_block_70 = CodeBlock(tableHeaders=code_block_67.tableTitles, tableValues=code_block_69) { tableHeaders; tableValues; }
flatten_5 = List.Flatten(list=code_block_70.tableValues)
count_2 = List.Count(list=code_block_70.tableHeaders)
chop_2 = List.Chop(list=flatten_5, lengths=count_2)
code_block_71 = CodeBlock { 0; 1; 2; 3; 4; 5; }
removeItemAtIndex = List.RemoveItemAtIndex(list=chop_2, indices=code_block_71.out0)
objectnamegroup_list = List.GetItemAtIndex(list=removeItemAtIndex, index=code_block_71.out0, lacing=Longest)
familyname_list_getitematindex = List.GetItemAtIndex(list=removeItemAtIndex, index=code_block_71.out1, lacing=Longest)
toUpper = String.ToUpper(str=familyname_list_getitematindex)
code_block_72 = CodeBlock { "N/A"; }
operators_15 = toUpper != code_block_72
object_type_list = List.FilterByBoolMask(list=objectnamegroup_list, mask=operators_15)
family_name_list = List.FilterByBoolMask(list=familyname_list_getitematindex, mask=operators_15)
familytype_list_getitematindex = List.GetItemAtIndex(list=removeItemAtIndex, index=code_block_71.out2, lacing=Longest)
family_type_name_list = List.FilterByBoolMask(list=familytype_list_getitematindex, mask=operators_15)
civildocumentname_list = List.GetItemAtIndex(list=removeItemAtIndex, index=code_block_71.out3, lacing=Longest)
filterByBoolMask_2 = List.FilterByBoolMask(list=civildocumentname_list, mask=operators_15)
corridorname_list_getitematindex = List.GetItemAtIndex(list=removeItemAtIndex, index=code_block_71.out4, lacing=Longest)
corridorname_list = List.FilterByBoolMask(list=corridorname_list_getitematindex, mask=operators_15)
flpointcode_list_getitematindex = List.GetItemAtIndex(list=removeItemAtIndex, index=code_block_71.out5, lacing=Longest)
flpointcode_list = List.FilterByBoolMask(list=flpointcode_list_getitematindex, mask=operators_15)
list_create_6 = List.Create(item0=object_type_list.in, item1=family_name_list.in, item2=family_type_name_list.in, item3=filterByBoolMask_2.in, item4=corridorname_list.in, item5=flpointcode_list.in)
code_block_73 = CodeBlock(filteredTableContent=list_create_6, objectTypes=object_type_list.in, familyNames=family_name_list.in, familyTypeNames=family_type_name_list.in, civilDocumentName=filterByBoolMask_2.in, corridorName=corridorname_list.in, FlpointCode=flpointcode_list.in) { filteredTableContent; objectTypes; familyNames; familyTypeNames; civilDocumentName; corridorName; FlpointCode; }

# group: Obtaining type ID's to filter settings dictionary
# note: description
code_block_74 = CodeBlock(objectNames=code_block_73.objectTypes) { objectNames; }
string_20 = StringInput(" : ")
split_2 = String.Split(str=code_block_74, separator0=string_20)
code_block_75 = CodeBlock { 0; }
getItemAtIndex_8 = List.GetItemAtIndex(index=code_block_75)  # unwired: list
map_2 = List.Map(list=split_2, f_x=getItemAtIndex_8)
code_block_76 = CodeBlock(selectedObjectKeys=map_2) { selectedObjectKeys; }

# group: Creating reference info dict for objects
code_block_77 = CodeBlock { ["docName","corName","FLpCode"]; }
code_block_78 = CodeBlock(civilDocumentName=code_block_73.civilDocumentName, corridorName=code_block_73.corridorName, flPointCode=code_block_73.FlpointCode) { civilDocumentName; corridorName; flPointCode; }
list_create_7 = List.Create(item0=code_block_78.civilDocumentName, item1=code_block_78.corridorName, item2=code_block_78.flPointCode)
transpose_2 = List.Transpose(lists=list_create_7)
# note: description
code_block_79 = CodeBlock { ["Source","Type","ObjectDOB"]; ["C3D","Corridor&FLPoints"]; }
now = DateTime.Now()
addItemToEnd_2 = List.AddItemToEnd(item=now, list=code_block_79.out1)
byKeysValues = DesignScript.Builtin.Dictionary.ByKeysValues(keys=code_block_79.out0, values=addItemToEnd_2)
code_block_80 = CodeBlock(keys=code_block_77, values=transpose_2, main_dict=byKeysValues) { keys; values; main_dict; }
dict_nested_in_list_python = Python(IN[0]=code_block_80.keys, IN[1]=code_block_80.values, IN[2]=code_block_80.main_dict)  # "dict nested in list: Python Script"
# ---------- dict_nested_in_list_python.python (25 lines) ----------
# Load the Python Standard and DesignScript Libraries
import sys
import clr
clr.AddReference('ProtoGeometry')
from Autodesk.DesignScript.Geometry import *

# The inputs to this node will be stored as a list in the IN variables.
keys, values, main_dict= IN

outlist=[]
# Place your code below this line
for sublist in values:
	tempdict={}
	i=0
	while i< len(keys):
		keyItem= str(keys[i])
		listItem=str(sublist[i])
		tempdict[keyItem]=listItem
		i+=1
		main_dict["Reference"]=tempdict
				
	outlist.append(main_dict.copy())
		
# Assign your output to the OUT variable.
OUT = outlist
# ----------------------------------------
code_block_81 = CodeBlock(c3dInfoDict=dict_nested_in_list_python) { c3dInfoDict; }

# group: creating diverse dicts to continue script
# note: description
code_block_82 = CodeBlock(settingsDict=code_block_19.scriptSettingsDict, selectedObjectKeys=code_block_76, c3dInfo=code_block_81) { settingsDict; selectedObjectKeys; c3dInfo; username; }  # unwired: username
flatten_6 = List.Flatten(list=code_block_82.selectedObjectKeys)
designscriptbuiltin_4 = DesignScript.Builtin.Dictionary.ValueAtKey(dictionary=code_block_82.settingsDict, key=flatten_6)
byKeysValues_2 = DesignScript.Builtin.Dictionary.ByKeysValues(keys=flatten_6, values=designscriptbuiltin_4)
string_21 = StringInput("defaultParameters")
designscriptbuiltin_5 = DesignScript.Builtin.Dictionary.ValueAtKey(dictionary=designscriptbuiltin_4, key=string_21)
string_22 = StringInput(" : ")
operators_16 = flatten_6 + string_22
string_23 = StringInput("name")
designscriptbuiltin_6 = DesignScript.Builtin.Dictionary.ValueAtKey(dictionary=designscriptbuiltin_4, key=string_23)
operators_17 = operators_16 + designscriptbuiltin_6
string_24 = StringInput("numberParams")
designscriptbuiltin_list_of = DesignScript.Builtin.Dictionary.ValueAtKey(dictionary=designscriptbuiltin_4, key=string_24)
string_25 = StringInput("C3D info")
setValueAtKeys = DesignScript.Builtin.Dictionary.SetValueAtKeys(dictionary=designscriptbuiltin_4, keys=string_25, values=code_block_82.c3dInfo)
code_block_83 = CodeBlock { ["fam_search","defaultParameters","numberParams"]; }
designscriptbuiltin_prepare_dict = DesignScript.Builtin.Dictionary.RemoveKeys(dictionary=setValueAtKeys, keys=code_block_83)
code_block_84 = CodeBlock(defaultParameterList=designscriptbuiltin_5, selectedItemNames=operators_17, numberParameterNames=designscriptbuiltin_list_of, scriptSettings=designscriptbuiltin_prepare_dict) { defaultParameterList; selectedItemNames; numberParameterNames; scriptSettings; }

# group: get corridor featurelinepoints
# note: Get Featureline points
code_block_85 = CodeBlock(civilApplication=code_block_45.civilApplication, documentNames=code_block_73.civilDocumentName, corridorNames=code_block_73.corridorName, FlpointCodes=code_block_73.FlpointCode) { civilApplication; documentNames; corridorNames; FlpointCodes; }
getDocumentByName = CivilConnection.CivilApplication.GetDocumentByName(civilApplication=code_block_85.civilApplication, name=code_block_85.documentNames)
getCorridorByName = CivilConnection.CivilDocument.GetCorridorByName(civilDocument=getDocumentByName, name=code_block_85.corridorNames)
baselines = CivilConnection.Corridor.Baselines(corridor=getCorridorByName)
flatten_7 = List.Flatten(list=baselines)
getBaselineRegions = CivilConnection.Baseline.GetBaselineRegions(baseline=flatten_7)
stations = CivilConnection.BaselineRegion.Stations(baselineRegion=getBaselineRegions)
getFeaturelinePointsByCode = CivilConnection.Baseline.GetFeaturelinePointsByCode(baseline=flatten_7, code=code_block_85.FlpointCodes)
code_block_86 = CodeBlock(baselineStations=stations, baseline_fl_points=getFeaturelinePointsByCode, corridor=getCorridorByName) { baselineStations; baseline_fl_points; corridor; }
move_last_dimension_in_list_up_1 = Python()  # "Move last dimension in list up 1 (flatten-1):Python Script"; unwired: IN[0]; same code as python_script_3

# group: get directional flPoints for each baseline
code_block_87 = CodeBlock(baseline=flatten_7) { baseline; }
code_block_88 = CodeBlock { ["LEFT_OF_AXIS","RIGHT_OF_AXIS","ORIGIN"]; }
getFeaturelinePointsByCode_2 = CivilConnection.Baseline.GetFeaturelinePointsByCode(code=code_block_88, lacing=Longest)  # unwired: baseline
map_3 = List.Map(list=code_block_87, f_x=getFeaturelinePointsByCode_2)
code_block_89 = CodeBlock { 0; 1; 2; }
left_list_getitematindex = List.GetItemAtIndex(list=map_3, index=code_block_89.out0, lacing=CrossProduct)
right_list_getitematindex = List.GetItemAtIndex(list=map_3, index=code_block_89.out1, lacing=CrossProduct)
origin_list_getitematindex = List.GetItemAtIndex(list=map_3, index=code_block_89.out2, lacing=CrossProduct)
code_block_90 = CodeBlock(leftOfOrigin=left_list_getitematindex, rightOfOrigin=right_list_getitematindex, corridorOrigin=origin_list_getitematindex) { leftOfOrigin; rightOfOrigin; corridorOrigin; }

# group: creating pointpairs from FLpoints
# note: description
code_block_91 = CodeBlock(leftOfOrigin=code_block_90.leftOfOrigin, rightOfOrigin=code_block_90.rightOfOrigin, corridorOrigin=code_block_90.corridorOrigin) { leftOfOrigin; rightOfOrigin; corridorOrigin; }
byFeaturelinePoints = DynamoROCO.PointsOrganization.ByFeaturelinePoints(points=code_block_91.corridorOrigin, lacing=Longest)
chordDistanceXY = DynamoROCO.PointPairInfo.ChordDistanceXY(pointPairInfo=byFeaturelinePoints)

byFeaturelinePoints_2 = DynamoROCO.PointsOrganization.ByFeaturelinePoints(points=code_block_91.leftOfOrigin, lacing=Longest)

# group (continued): creating pointpairs from FLpoints
chordDistanceXY_2 = DynamoROCO.PointPairInfo.ChordDistanceXY(pointPairInfo=byFeaturelinePoints_2)

byFeaturelinePoints_3 = DynamoROCO.PointsOrganization.ByFeaturelinePoints(points=code_block_91.rightOfOrigin, lacing=Longest)

# group (continued): creating pointpairs from FLpoints
chordDistanceXY_3 = DynamoROCO.PointPairInfo.ChordDistanceXY(pointPairInfo=byFeaturelinePoints_3)
code_block_92 = CodeBlock(leftOfOriginLengths=chordDistanceXY_2, rightOfOriginLengths=chordDistanceXY_3, corridorOriginLengths=chordDistanceXY) { leftOfOriginLengths; rightOfOriginLengths; corridorOriginLengths; }

# group: Curve direction: S,L or R
# note: description
code_block_93 = CodeBlock(leftOfOriginLengths=code_block_92.leftOfOriginLengths, rightOfOriginLengths=code_block_92.rightOfOriginLengths, corridorOriginLengths=code_block_92.corridorOriginLengths) { leftOfOriginLengths; rightOfOriginLengths; corridorOriginLengths; }
operators_18 = code_block_93.corridorOriginLengths < code_block_93.rightOfOriginLengths
code_block_94 = CodeBlock { "R"; null; }
if_6 = If(test=operators_18, true=code_block_94.out0, false=code_block_94.out1)
operators_19 = code_block_93.corridorOriginLengths < code_block_93.leftOfOriginLengths
code_block_95 = CodeBlock { "L"; null; }
if_7 = If(test=operators_19, true=code_block_95.out0, false=code_block_95.out1)
operators_20 = code_block_93.corridorOriginLengths == code_block_93.leftOfOriginLengths
code_block_96 = CodeBlock { "S"; null; }
if_8 = If(test=operators_20, true=code_block_96.out0, false=code_block_96.out1)

# group: creating FLpointpairs from FLpoints
code_block_97 = CodeBlock(flPoints=code_block_90.leftOfOrigin) { flPoints; }
# note: Creating flPointsPairs from LEFT_OF_AXIS target
byFeaturelinePoints_4 = DynamoROCO.PointsOrganization.ByFeaturelinePoints(points=code_block_97, lacing=Longest)
chordDistanceXY_4 = DynamoROCO.PointPairInfo.ChordDistanceXY(pointPairInfo=byFeaturelinePoints_4)
firstPointAngle = DynamoROCO.PointPairInfo.FirstPointAngle(pointPairInfo=byFeaturelinePoints_4)
lastPointAngle = DynamoROCO.PointPairInfo.LastPointAngle(pointPairInfo=byFeaturelinePoints_4)
first = DynamoROCO.PointPairInfo.First(pointPairInfo=byFeaturelinePoints_4)
last = DynamoROCO.PointPairInfo.Last(pointPairInfo=byFeaturelinePoints_4)
code_block_98 = CodeBlock(chordDistancexy=chordDistanceXY_4, firstPointAngle=firstPointAngle, lastPointAngle=lastPointAngle, firstPoint=first, lastPoint=last) { chordDistancexy; firstPointAngle; lastPointAngle; firstPoint; lastPoint; }

# group: creating pointpair coordinate list
# note: description
code_block_99 = CodeBlock(firstPoint=code_block_98.firstPoint, lastPoint=code_block_98.lastPoint) { firstPoint; lastPoint; }
code_block_100 = CodeBlock(firstList=code_block_99.firstPoint, lastList=code_block_99.lastPoint) { firstList; lastList; }
createpointpairs_from_first_and = Python(IN[0]=code_block_100.firstList, IN[1]=code_block_100.lastList)  # "createPointPairs from first and last point: Python Script"
# ---------- createpointpairs_from_first_and.python (39 lines) ----------
# Load the Python Standard and DesignScript Libraries
import sys
import clr
clr.AddReference('ProtoGeometry')
from Autodesk.DesignScript.Geometry import *

# The inputs to this node will be stored as a list in the IN variables.
firstPointsList, lastPointsList = IN

templist=[]
outlist=[]
i=0
j=0

# Place your code below this line
templist = []
templist1 =[]
outlist = []
i = 0

while i < len(firstPointsList):
    firstPoints = firstPointsList[i]
    lastPoints = lastPointsList[i]
    templist1.Clear()
    j = 0
    while j < len(firstPoints):
    	k = 0
    	templist.Clear()
        while k < len(firstPoints[j]):
            templist.append([firstPoints[j][k], lastPoints[j][k]])
            k += 1
        templist1.append(list(templist))
        j += 1
    outlist.append(list(templist1))
    i += 1


# Assign your output to the OUT variable.
OUT = outlist
# ----------------------------------------
code_block_101 = CodeBlock(pointpairlist_LEFT_OF_ORIGIN=createpointpairs_from_first_and) { pointpairlist_LEFT_OF_ORIGIN; }

# group: creating FLpointpairs from FLpoints
# note: Create flPointPairs from selected FPointCodes
code_block_102 = CodeBlock(flPoints=code_block_86.baseline_fl_points) { flPoints; }
byFeaturelinePoints_5 = DynamoROCO.PointsOrganization.ByFeaturelinePoints(points=code_block_102, lacing=Longest)
chordDistanceXY_5 = DynamoROCO.PointPairInfo.ChordDistanceXY(pointPairInfo=byFeaturelinePoints_5)
firstPointAngle_2 = DynamoROCO.PointPairInfo.FirstPointAngle(pointPairInfo=byFeaturelinePoints_5)
lastPointAngle_2 = DynamoROCO.PointPairInfo.LastPointAngle(pointPairInfo=byFeaturelinePoints_5)
first_2 = DynamoROCO.PointPairInfo.First(pointPairInfo=byFeaturelinePoints_5)
last_2 = DynamoROCO.PointPairInfo.Last(pointPairInfo=byFeaturelinePoints_5)
code_block_103 = CodeBlock(chordDistancexy=chordDistanceXY_5, firstPointAngle=firstPointAngle_2, lastPointAngle=lastPointAngle_2, firstPoint=first_2, lastPoint=last_2) { chordDistancexy; firstPointAngle; lastPointAngle; firstPoint; lastPoint; }

# group: creating pointpair coordinate list
# note: description
code_block_104 = CodeBlock(firstPoint=code_block_103.firstPoint, lastPoint=code_block_103.lastPoint) { firstPoint; lastPoint; }
code_block_105 = CodeBlock(firstList=code_block_104.firstPoint, lastList=code_block_104.lastPoint) { firstList; lastList; }
createpointpairs_from_first_and_2 = Python(IN[0]=code_block_105.firstList, IN[1]=code_block_105.lastList)  # "createPointPairs from first and last point: Python Script"; same code as createpointpairs_from_first_and
code_block_106 = CodeBlock(pointpairlist_selectedFLPoints=createpointpairs_from_first_and_2, firstList=code_block_105.firstList) { pointpairlist_selectedFLPoints; firstList; }

# group: Combines target and axis lists for GMA4
code_block_107 = CodeBlock(pointpairlist_LEFT_OF_ORIGIN=code_block_101, pointpairlist_selectedFLPoints=code_block_106.pointpairlist_selectedFLPoints) { pointpairlist_LEFT_OF_ORIGIN; pointpairlist_selectedFLPoints; }
list_create_8 = List.Create(item0=code_block_107.pointpairlist_selectedFLPoints)
X = Point.X(point=code_block_107.pointpairlist_LEFT_OF_ORIGIN)
Y = Point.Y(point=code_block_107.pointpairlist_LEFT_OF_ORIGIN)
Z = Point.Z(point=code_block_107.pointpairlist_selectedFLPoints)
byCoordinates = Point.ByCoordinates(x=X, y=Y, z=Z)
createpointpairs_from_first_and_3 = Python(IN[0]=code_block_107.pointpairlist_selectedFLPoints, IN[1]=byCoordinates)  # "createPointPairs from first and last point: Python Script"; same code as createpointpairs_from_first_and
move_last_dimension_in_list_up_1_2 = Python(IN[0]=createpointpairs_from_first_and_3)  # "Move last dimension in list up 1 (flatten-1):Python Script"
# ---------- move_last_dimension_in_list_up_1_2.python (29 lines) ----------
# Load the Python Standard and DesignScript Libraries
import sys
import clr
clr.AddReference('ProtoGeometry')
from Autodesk.DesignScript.Geometry import *

# The inputs to this node will be stored as a list in the IN variables.
inlist=IN[0]
templist=[]
templist0=[]
templist1=[]
outlist=[]
# Place your code below this line
for sublist in inlist:
	templist.Clear()
	for item in sublist:
		templist1.Clear()
		for i in item:
			templist0.Clear()
			for j in i:
				for k in j:
					templist0.append(k)
			templist1.append(list(templist0))
		templist.append(list(templist1))
	outlist.append(list(templist))
			
		
# Assign your output to the OUT variable.
OUT = outlist
# ----------------------------------------
list_create_9 = List.Create(item0=move_last_dimension_in_list_up_1_2)
code_block_108 = CodeBlock(poinpairList_GMA2=list_create_8, pointpairlist_GMA4=list_create_9) { poinpairList_GMA2; pointpairlist_GMA4; }

# group: filter for GMA2 or GMA4 info
code_block_109 = CodeBlock(AmountAdaptivePoints=code_block_19.amountAdaptivePoints, poinpairList_GMA2=code_block_108.poinpairList_GMA2, pointpairlist_GMA4=code_block_108.pointpairlist_GMA4) { AmountAdaptivePoints; poinpairList_GMA2; pointpairlist_GMA4; }
code_block_110 = CodeBlock { "GMA2"; "GMA4"; }
byKeysValues_3 = DesignScript.Builtin.Dictionary.ByKeysValues(keys=code_block_110.out0, values=code_block_109.poinpairList_GMA2)
setValueAtKeys_2 = DesignScript.Builtin.Dictionary.SetValueAtKeys(dictionary=byKeysValues_3, keys=code_block_110.out1, values=code_block_109.pointpairlist_GMA4)
valueAtKey_10 = DesignScript.Builtin.Dictionary.ValueAtKey(dictionary=setValueAtKeys_2, key=code_block_109.AmountAdaptivePoints)
code_block_111 = CodeBlock(amountAdaptivePoints=code_block_109.AmountAdaptivePoints, pointpairList_GMA=valueAtKey_10) { amountAdaptivePoints; pointpairList_GMA; }

# group: Creating adaptive components
# note: description
code_block_112 = CodeBlock(familyTypeNames=code_block_73.familyTypeNames, pointpairLists=code_block_111.pointpairList_GMA, corridorNames=code_block_86.corridor, flPointCodes=code_block_73.FlpointCode, familyNames=code_block_73.familyNames) { familyTypeNames; pointpairLists; corridorNames; flPointCodes; familyNames; }
byFamilyNameAndTypeName = FamilyType.ByFamilyNameAndTypeName(familyName=code_block_112.familyNames, typeName=code_block_112.familyTypeNames)
code_block_113 = CodeBlock(familyTypes=byFamilyNameAndTypeName, pointpairLists=code_block_112.pointpairLists, corridorNames=code_block_112.corridorNames, flPointCodes=code_block_112.flPointCodes) { familyTypes; pointpairLists; corridorNames; flPointCodes; }
byPoints = AdaptiveComponent.ByPoints(points=code_block_113.pointpairLists, familyType=code_block_113.familyTypes, lacing=Longest)

# group: format data for inputs and creating inputs for user to enter parameters
# note: description
code_block_114 = CodeBlock(referenceImage=code_block_25.referenceImageObject, Logo=code_block_45.Logo, defaultParameterLists=code_block_84.defaultParameterList, selectedGroupNames=code_block_84.selectedItemNames) { referenceImage; Logo; defaultParameterLists; selectedGroupNames; }
code_block_115 = CodeBlock { "Continue"; 1000; 850; "Cancel"; }
code_block_116 = CodeBlock { "ROCO_CNU_OBS.Index_start"; "0.0000"; }
setValueAtKeys_3 = DesignScript.Builtin.Dictionary.SetValueAtKeys(keys=code_block_116.out0, values=code_block_116.out1)  # unwired: dictionary
map_4 = List.Map(list=code_block_114.defaultParameterLists, f_x=setValueAtKeys_3)
keys_2 = DesignScript.Builtin.Dictionary.Keys(dictionary=map_4)
sort = List.Sort()  # unwired: list
map_5 = List.Map(list=keys_2, f_x=sort)
valueAtKey_11 = DesignScript.Builtin.Dictionary.ValueAtKey(dictionary=map_4, key=map_5)
data_shapes_ui_textbox_data = Custom[Data-Shapes_UI.TextBox Data](InputName=map_5, DefaultText=valueAtKey_11)  # package Data-Shapes; Create Data for TextBox input in UI.MultipleInputForm ++ . Check out www.data-shapes.net for more informations
data_shapes_ui_inputgroup_data_5 = Custom[Data-Shapes_UI.InputGroup Data](GroupTitle=code_block_114.selectedGroupNames, Inputs=data_shapes_ui_textbox_data)
code_block_117 = CodeBlock { 1; }
chop_3 = List.Chop(list=data_shapes_ui_inputgroup_data_5, lengths=code_block_117)
string_26 = StringInput("For the object types: enter the desired parameters")
data_shapes_ui_textnote_data_3 = Custom[Data-Shapes_UI.TextNote Data](TextNote=string_26)
addItemToFront_7 = List.AddItemToFront(item=data_shapes_ui_textnote_data_3)  # unwired: list
map_6 = List.Map(list=chop_3, f_x=addItemToFront_7)
addItemToFront_8 = List.AddItemToFront(item=code_block_114.referenceImage)  # unwired: list
map_7 = List.Map(list=map_6, f_x=addItemToFront_8)
boolean_4 = BoolSelector(true)
code_block_118 = CodeBlock(logo=code_block_114.Logo, ButtonText=code_block_115.out0, inputs=map_7, objectHasData=boolean_4, cancelButtonText=code_block_115.out3, maxHeight=code_block_115.out1, uiWidth=code_block_115.out2, ParameterValueHeaderLists=map_5) { Descritpion; logo; ButtonText; inputs; objectHasData; cancelButtonText; maxHeight; uiWidth; ParameterValueHeaderLists; }  # unwired: Descritpion

# group: User enters parameter values for each object type
data_shapes_ui_multipleinputform_5 = Custom[Data-Shapes_UI.MultipleInputForm ++](Description_optional=code_block_118.Descritpion, Logo_optional=code_block_118.logo, ButtonText_optional=code_block_118.ButtonText, Inputs=code_block_118.inputs, Toggle=code_block_118.objectHasData, CancelButtonText_optional=code_block_118.cancelButtonText, MaxHeight_optional=code_block_118.maxHeight, Width_optional=code_block_118.uiWidth)
watch = Watch(data_shapes_ui_multipleinputform_5.User_Inputs)

# group: creating PE id for each object (ascending, incrementing by 1)
# note: description
code_block_119 = CodeBlock(adaptiveCompontents=byPoints, parameter_dict_keys=code_block_118.ParameterValueHeaderLists, parameter_dict_values=watch, firstPointsList=code_block_106.firstList) { adaptiveCompontents; parameter_dict_keys; parameter_dict_values; firstPointsList; }
byKeysValues_4 = DesignScript.Builtin.Dictionary.ByKeysValues(keys=code_block_119.parameter_dict_keys, values=code_block_119.parameter_dict_values, lacing=Longest)
string_27 = StringInput("ROCO_CNU_OBS.Index_start")
valueAtKey_12 = DesignScript.Builtin.Dictionary.ValueAtKey(dictionary=byKeysValues_4, key=string_27)
toNumber_2 = String.ToNumber(str=valueAtKey_12)
code_block_120 = CodeBlock { "ROCO_CNU_OBS.Index"; }
create_id_dict_from_list = Python(IN[0]=code_block_119.adaptiveCompontents, IN[1]=toNumber_2, IN[2]=code_block_120)  # "create ID dict from list adaptive components + start offset: Python Script"
# ---------- create_id_dict_from_list.python (41 lines) ----------
# Load the Python Standard and DesignScript Libraries
import sys
import clr
clr.AddReference('ProtoGeometry')
from Autodesk.DesignScript.Geometry import *

# The inputs to this node will be stored as a list in the IN variables.
firstPointsList, idStart, key = IN

templist = []
templist1 =[]
outlist = []
i = 0
j = 0

# Place your code below this line


while i < len(firstPointsList):
    firstPoints = firstPointsList[i]
    index = idStart[i]
    templist1.Clear()
    j = 0
    while j < len(firstPoints):
    	k = 0
    	templist.Clear()
        while k < len(firstPoints[j]):
            index_str = str(index)
            index_str = index_str.split(".")[0]
            index_str = index_str.split(",")[0]
            templist.append({key: int(index_str)})
            index += 1
            k += 1
        templist1.append(list(templist))
        j += 1
    outlist.append(list(templist1))
    i += 1


# Assign your output to the OUT variable.
OUT = outlist
# ----------------------------------------
code_block_121 = CodeBlock(PE_Id_dict=create_id_dict_from_list, adaptiveComponents=code_block_119.adaptiveCompontents) { PE_Id_dict; adaptiveComponents; }

# group: Create script meta data file
string_28 = StringInput("ScriptName")
python_script_6 = Python()  # unwired: IN[0]
# ---------- python_script_6.python (29 lines) ----------
# Importing Reference Modules
# CLR ( Common Language Runtime Module )
import clr
# Adding the DynamoRevitDS.dll module to work with the Dynamo API
clr.AddReference('DynamoRevitDS')
import Dynamo 

# access to the current Dynamo instance and workspace
dynamoRevit = Dynamo.Applications.DynamoRevit()
currentWorkspace = dynamoRevit.RevitDynamoModel.CurrentWorkspace

# Access current version of dynamo
version=dynamoRevit.RevitDynamoModel.Version

# checks version of dynamo and adjusts output according to version
if version.StartsWith("1."):
	
	# Gets file name which includes full path
	filename=currentWorkspace.FileName
	
	
	# Splits out file path to just file name
	OUT=filename

elif version.StartsWith("2."):
	OUT=currentWorkspace.Name

else:
	OUT="Not supported"
# ----------------------------------------
string_from_object_2 = FromObject(obj=python_script_6)
byKeysValues_5 = DesignScript.Builtin.Dictionary.ByKeysValues(keys=string_28, values=string_from_object_2)
string_29 = StringInput("username")
code_block_122 = CodeBlock(username=code_block_19.username) { username; }
setValueAtKeys_4 = DesignScript.Builtin.Dictionary.SetValueAtKeys(dictionary=byKeysValues_5, keys=string_29, values=code_block_122)
code_block_123 = CodeBlock(scriptMeta=setValueAtKeys_4) { scriptMeta; }

# group: creating parameter_value dict for all type objects, including the script info
# note: description
code_block_124 = CodeBlock(parameterDict=byKeysValues_4, removeStartIDValue=string_27, c3DInfoDict=code_block_81, numberParams=designscriptbuiltin_list_of, configFileMeta=code_block_19.configFileMeta, scriptMeta=code_block_123) { parameterDict; removeStartIDValue; c3DInfoDict; numberParams; configFileMeta; scriptMeta; }
removeKeys = DesignScript.Builtin.Dictionary.RemoveKeys(dictionary=code_block_124.parameterDict, keys=code_block_124.removeStartIDValue)
code_block_125 = CodeBlock { ["ROCO_CTE_Dynamo.GUID","ROCO_CTE_Dynamo.Script"]; }
generateGuid = DynamoROCO.DesignLog.GenerateGuid()
string_30 = StringInput("ConfigFileMeta")
byKeysValues_6 = DesignScript.Builtin.Dictionary.ByKeysValues(keys=string_30, values=code_block_124.configFileMeta)
string_31 = StringInput("ScriptMeta")
setValueAtKeys_5 = DesignScript.Builtin.Dictionary.SetValueAtKeys(dictionary=byKeysValues_6, keys=string_31, values=code_block_124.scriptMeta)
stringifyJSON = Data.StringifyJSON(values=setValueAtKeys_5, lacing=Longest)
list_create_10 = List.Create(item0=generateGuid, item1=stringifyJSON)
setValueAtKeys_6 = DesignScript.Builtin.Dictionary.SetValueAtKeys(dictionary=removeKeys, keys=code_block_125, values=list_create_10)
string_32 = StringInput("ROCO_CTE_Reference_Source_Data")
code_block_126 = CodeBlock(C3D_Reference_Dict=code_block_124.c3DInfoDict) { C3D_Reference_Dict; }
stringifyJSON_2 = Data.StringifyJSON(values=code_block_126, lacing=Longest)
setValueAtKeys_7 = DesignScript.Builtin.Dictionary.SetValueAtKeys(dictionary=setValueAtKeys_6, keys=string_32, values=stringifyJSON_2)
code_block_127 = CodeBlock(numberParams=code_block_124.numberParams) { numberParams; }
valueAtKey_13 = DesignScript.Builtin.Dictionary.ValueAtKey(dictionary=setValueAtKeys_6, key=code_block_127)
toNumber_3 = String.ToNumber(str=valueAtKey_13)
code_block_128 = CodeBlock(in_dict=setValueAtKeys_7, keys=code_block_127, values=toNumber_3) { in_dict; keys; values; }
create_parameter_dictionary = Python(IN[0]=code_block_128.in_dict, IN[1]=code_block_128.keys, IN[2]=code_block_128.values)  # "create parameter dictionary: Python Script"
# ---------- create_parameter_dictionary.python (30 lines) ----------
# Load the Python Standard and DesignScript Libraries
import sys
import clr
clr.AddReference('ProtoGeometry')
from Autodesk.DesignScript.Geometry import *

# The inputs to this node will be stored as a list in the IN variables.
in_list, add_keys, add_values =IN

tempdict ={}
outlist=[]
templist=[]
# Place your code below this line
i=0
while i< len(in_list):
	in_dict=in_list[i]
	keylist=add_keys[i]
	valuelist=add_values[i]
	j=0
	while j< len(keylist):
		in_dict[keylist[j]]=valuelist[j]	
		j+=1
	outlist.append(in_dict)
	i+=1

	
		
	
# Assign your output to the OUT variable.
OUT = outlist
# ----------------------------------------
code_block_129 = CodeBlock(parameterDict=create_parameter_dictionary) { parameterDict; }

# group: compiling parameter list and setting parameters on elements
# note: description
code_block_130 = CodeBlock(adaptiveComponents=code_block_121.adaptiveComponents, pe_id_dict=code_block_121.PE_Id_dict, defaultParameterList=code_block_129) { adaptiveComponents; pe_id_dict; defaultParameterList; }
code_block_131 = CodeBlock(target_dict=code_block_130.pe_id_dict, dict_to_add=code_block_130.defaultParameterList) { target_dict; dict_to_add; }
add_dict_to_dict_in_sublist = Python(IN[0]=code_block_131.dict_to_add, IN[1]=code_block_131.target_dict)  # "add dict to dict in sublist: Python Script"
# ---------- add_dict_to_dict_in_sublist.python (28 lines) ----------
# Load the Python Standard and DesignScript Libraries
import sys
import clr
clr.AddReference('ProtoGeometry')
from Autodesk.DesignScript.Geometry import *

# The inputs to this node will be stored as a list in the IN variables.
dicts_to_add, target_list = IN

templist=[]
templist1=[]
outlist=[]
i=0
# Place your code below this line
while i< len(target_list):
	templist1.Clear()
	for sublist in target_list[i]:
		templist.Clear()
		for item in sublist:
			for key in dicts_to_add[i]:
				item[key]=dicts_to_add[i].get(key)
			templist.append(item)
		templist1.append(list(templist))
	outlist.append(list(templist1))
	i+=1

# Assign your output to the OUT variable.
OUT = outlist
# ----------------------------------------
keys_3 = DesignScript.Builtin.Dictionary.Keys(dictionary=add_dict_to_dict_in_sublist)
valueAtKey_14 = DesignScript.Builtin.Dictionary.ValueAtKey(dictionary=add_dict_to_dict_in_sublist, key=keys_3)
code_block_132 = CodeBlock(parameterNames=keys_3, paremeterValues=valueAtKey_14) { parameterNames; paremeterValues; }
parameterByName = Parameter.ParameterByName(element=code_block_130.adaptiveComponents, name=code_block_132.parameterNames, lacing=Longest)
setValue = Parameter.SetValue(parameter=parameterByName, value=code_block_132.paremeterValues, lacing=Shortest)
clockwork_Passthrough_4 = Custom[Clockwork_Passthrough](passThrough=parameterByName, waitFor=setValue)
parameters_set_0_watch = Watch(clockwork_Passthrough_4)  # graph output

clockwork_Passthrough_5 = Custom[Clockwork_Passthrough](passThrough=code_block_121.adaptiveComponents, waitFor=parameters_set_0_watch)

# group: creating point rotation list
# note: description
code_block_133 = CodeBlock(firstPointAngle=code_block_103.firstPointAngle, lastPointAngle=code_block_103.lastPointAngle) { firstPointAngle; lastPointAngle; }
code_block_134 = CodeBlock { -1; }
mul = code_block_133.firstPointAngle * code_block_134
code_block_135 = CodeBlock { -180; }
sub = mul - code_block_135
mul_2 = code_block_133.lastPointAngle * code_block_134
sub_2 = mul_2 - code_block_135
code_block_136 = CodeBlock(firstList=sub, lastList=sub_2) { firstList; lastList; }
createpointpairs_from_first_and_4 = Python(IN[0]=code_block_136.firstList, IN[1]=code_block_136.lastList)  # "createPointPairs from first and last point: Python Script"; same code as createpointpairs_from_first_and
code_block_137 = CodeBlock()
# ---------- code_block_137.designscript (2 lines) ----------
["ROCO_CDG_Rotation_E_pt1",
"ROCO_CDG_Rotation_E_pt2"];
# ----------------------------------------
createpointpairdict_from_first = Python(IN[0]=createpointpairs_from_first_and_4, IN[1]=code_block_137)  # "createPointPairDict from first and last point: Python Script"
# ---------- createpointpairdict_from_first.python (39 lines) ----------
# Load the Python Standard and DesignScript Libraries
import sys
import clr
clr.AddReference('ProtoGeometry')
from Autodesk.DesignScript.Geometry import *

# The inputs to this node will be stored as a list in the IN variables.
firstItemsList, keyList = IN

templist = []
templist1 = []
outlist = []
i = 0

while i < len(firstItemsList):
    firstPoints = firstItemsList[i]

    templist1.Clear()
    j = 0
    while j < len(firstPoints):
        k = 0
        templist.Clear()
        while k < len(firstPoints[j]):
            pairList = firstPoints[j][k]
            n = 0
            tempdict = {}
            while n < len(keyList):
                tempdict[keyList[n]] = pairList[n]
                n += 1
            templist.append(tempdict)
            k += 1
        templist1.append(list(templist))
        j += 1
    outlist.append(list(templist1))
    i += 1


# Assign your output to the OUT variable.
OUT = outlist
# ----------------------------------------
code_block_138 = CodeBlock(rotation_profiles=createpointpairdict_from_first) { rotation_profiles; }

code_block_139 = CodeBlock(baselineStations=code_block_86.baselineStations) { baselineStations; }
code_block_140 = CodeBlock { ["ROCO_CNU_Station"]; }
createstationdict_from_baseline = Python(IN[0]=code_block_139, IN[1]=code_block_140)  # "createStationDict from baseline stations: Python Script"
# ---------- createstationdict_from_baseline.python (39 lines) ----------
# Load the Python Standard and DesignScript Libraries
import sys
import clr
clr.AddReference('ProtoGeometry')
from Autodesk.DesignScript.Geometry import *

# The inputs to this node will be stored as a list in the IN variables.
firstItemsList, keyList = IN

templist = []
templist1 = []
outlist = []
i = 0

while i < len(firstItemsList):
    firstPoints = firstItemsList[i]

    templist1.Clear()
    j = 0
    while j < len(firstPoints):
        k = 0
        templist.Clear()
        while k < len(firstPoints[j]):
            object = firstPoints[j][k]
            n = 0
            tempdict = {}
            while n < len(keyList):
                tempdict[keyList[n]] = object
                n += 1
            templist.append(tempdict)
            k += 1
        templist1.append(list(templist))
        j += 1
    outlist.append(list(templist1))
    i += 1


# Assign your output to the OUT variable.
OUT = outlist
# ----------------------------------------
code_block_141 = CodeBlock(stationDict=createstationdict_from_baseline) { stationDict; }

# group: compiling parameter list and setting parameters on elements
# note: description
code_block_142 = CodeBlock(adaptiveComponents=clockwork_Passthrough_5, profileRotationDict=code_block_138, stationsDict=code_block_141) { adaptiveComponents; profileRotationDict; stationsDict; }
keys_4 = DesignScript.Builtin.Dictionary.Keys(dictionary=code_block_142.profileRotationDict)
valueAtKey_15 = DesignScript.Builtin.Dictionary.ValueAtKey(dictionary=code_block_142.profileRotationDict, key=keys_4)
code_block_143 = CodeBlock(parameterNames=keys_4, paremeterValues=valueAtKey_15) { parameterNames; paremeterValues; }
parameterByName_2 = Parameter.ParameterByName(element=code_block_142.adaptiveComponents, name=code_block_143.parameterNames, lacing=Longest)
setValue_2 = Parameter.SetValue(parameter=parameterByName_2, value=code_block_143.paremeterValues, lacing=Shortest)
clockwork_Passthrough_6 = Custom[Clockwork_Passthrough](passThrough=parameterByName_2, waitFor=setValue_2)
rotations_set_watch = Watch(clockwork_Passthrough_6)  # graph output
keys_5 = DesignScript.Builtin.Dictionary.Keys(dictionary=code_block_142.stationsDict)
valueAtKey_16 = DesignScript.Builtin.Dictionary.ValueAtKey(dictionary=code_block_142.stationsDict, key=keys_5)
code_block_144 = CodeBlock(parameterNames=keys_5, paremeterValues=valueAtKey_16) { parameterNames; paremeterValues; }
parameterByName_3 = Parameter.ParameterByName(element=code_block_142.adaptiveComponents, name=code_block_144.parameterNames, lacing=Longest)
setValue_3 = Parameter.SetValue(parameter=parameterByName_3, value=code_block_144.paremeterValues, lacing=Shortest)
clockwork_Passthrough_7 = Custom[Clockwork_Passthrough](passThrough=parameterByName_3, waitFor=setValue_3)
stations_set_watch = Watch(clockwork_Passthrough_7)  # graph output

ui_treeview_input_2 = Custom[UI.TreeView input]()  # unwired: Data
