# Dynamo graph CC_GMA2_createObjects_between_FL@CorridorFLpointsAssembly.dyn (Dynamo 2.3.0.5885)
# packages: Data-Shapes 2019.2.40, archi-lab.net 2020.22.9, Clockwork for Dynamo 2.x 2.1.2, DynamoROCO 2.3.0.0, CivilConnection2020 4.0.4, ROCO Dyf Packages 1.0.0

# group: DATA MANIPULATION
# note: Data manipulation on Dynamo Objects

# group: NOT IN USE
# note: Nodes to consider part of the final graph

# group: INPUT
# note: Data input and preperation for other nodes

# group: GET
# note: Get parameter values from Revit objects

# group: DEBUG
# note: Check if the graph is working as expected

# group: Package
# note: All used nodes from a package have a prefix
# added to them with the name of the node.

# group: FUNCTION
# note: Creation of dynamo objects

# group: OUTPUT
# note: Object creation in Revit, final output

# group: SET
# note: Set parameters on Revit objects

# group: INFO
# note: GENERAL INFO
# Version: 3
# Author: Dick Elsman
# Company: Infranea | ROCO
# email: dick.elsman@infranea.com
# Dynamo Core version: 2.3.0.5885
# Dynamo Revit version: 2.3.0.6270
# Revit version: 2020.2
# note: INSTRUCTIONS
# <DESCRIPTION>
# Allows the user to place GMA2 objects on featureline points in the direction of the alignment (and corridor).  Duration of scripts depends on complexity of corridor and to be placed objects. Min runtime is about 5 minutes
# <INSTRUCTIONS>
# navigate to the folder to play, and press play in the Dynamo Player.
# NB! This script requires a JSON config file for it to index objects and data from sources. This/these file(s) shoudl be stored in <script directory>\config_files
# note: KNOWN ISSUES AND LIMITATIONS
# - Does not support retaining objects yet
# - Does not yet facilitate slopes in floors
# note: SCRIPT META
# Script Name: CC_GMA2_GMA4_createObjects@CorridorFLpoints.dyn
# Packages used in this script:
# Data-Shapes version: 2019.2.40
# Clockwork for Dynamo 2.x version: 2.1.2
# DynamoROCO version: 2.3.0.0
# ROCO Dyf Packages version: 1.0.0
# TimeStamp : 2020/2/6 17:58

# group: User selects config file to run script with
readConfigFileDirectory = Custom[readConfigFileDirectory]()  # package ROCO Dyf Packages; Import config file names stored in workspace, output UI objects for Data-Shapes containing filenames
code_block = CodeBlock(chars=readConfigFileDirectory.strLength) { chars; width = Math.Max(350, Math.Round(175*chars/25 + 0.5*chars)); }
data_shapes_ui_multipleinputform = Custom[Data-Shapes_UI.MultipleInputForm ++](Description_optional=readConfigFileDirectory.description, Logo_optional=readConfigFileDirectory.logo, ButtonText_optional=readConfigFileDirectory.buttonText, Inputs=readConfigFileDirectory.UIObjects, Toggle=readConfigFileDirectory.hasData, CancelButtonText_optional=readConfigFileDirectory.cancelButton, Width_optional=code_block.width)  # package Data-Shapes; Create a form with multiple inputs. see www.data-shapes.net for tutorials and infos!
code_block_2 = CodeBlock(x=data_shapes_ui_multipleinputform.User_Inputs) { selectedConfigFile=x[0]; }

# group: Import JSON file for script config
code_block_3 = CodeBlock(selectedConfigFile=code_block_2) { selectedConfigFile; }
code_block_4 = CodeBlock { 0; }
getItemAtIndex = List.GetItemAtIndex(list=code_block_3, index=code_block_4)
readText = FileSystem.ReadText(file=getItemAtIndex)
parseJSON = Data.ParseJSON(json=readText)
code_block_5 = CodeBlock { "scriptDataDict"; "imageDict"; "configData"; }
valueAtKey = DesignScript.Builtin.Dictionary.ValueAtKey(dictionary=parseJSON, key=code_block_5.out1)
valueAtKey_2 = DesignScript.Builtin.Dictionary.ValueAtKey(dictionary=parseJSON, key=code_block_5.out0)
valueAtKey_3 = DesignScript.Builtin.Dictionary.ValueAtKey(dictionary=parseJSON, key=code_block_5.out2)
code_block_6 = CodeBlock { "#adaptivePoints"; }
valueAtKey_4 = DesignScript.Builtin.Dictionary.ValueAtKey(dictionary=valueAtKey_3, key=code_block_6)
code_block_7 = CodeBlock(imageDict=valueAtKey, scriptSettingsDict=valueAtKey_2, amountAdaptivePoints=valueAtKey_4, configFileMeta=valueAtKey_3) { imageDict; scriptSettingsDict; amountAdaptivePoints; configFileMeta; }

code_block_8 = CodeBlock(imageDict=code_block_7.imageDict, scriptSettingsDict=code_block_7.scriptSettingsDict, amountAdaptivePoints=code_block_7.amountAdaptivePoints, configFileMeta=code_block_7.configFileMeta) { imageDict; scriptSettingsDict; amountAdaptivePoints; configFileMeta; }
code_block_9 = CodeBlock(imageDict=code_block_8.imageDict, scriptSettingsDict=code_block_8.scriptSettingsDict, amountAdaptivePoints=code_block_8.amountAdaptivePoints, configFileMeta=code_block_8.configFileMeta) { imageDict; scriptSettingsDict; amountAdaptivePoints; configFileMeta; }

# group: Building dictionary for use in UI
# note: building UI data to feed the listview for selecting type objects
code_block_10 = CodeBlock(scriptDataDict=code_block_7.scriptSettingsDict) { scriptDataDict; }
keys = DesignScript.Builtin.Dictionary.Keys(dictionary=code_block_10)
toNumber = String.ToNumber(str=keys)
sortListByAnother = archilab.Lists.Lists.SortListByAnother(list=keys, sortBy=toNumber)
string = StringInput(" : ")
operators = sortListByAnother.list + string
valueAtKey_5 = DesignScript.Builtin.Dictionary.ValueAtKey(dictionary=code_block_10, key=sortListByAnother.list)
string_2 = StringInput("name")
valueAtKey_6 = DesignScript.Builtin.Dictionary.ValueAtKey(dictionary=valueAtKey_5, key=string_2)
operators_2 = operators + valueAtKey_6
code_block_11 = CodeBlock(listviewDisplayData=operators_2, sorted_dict_keys=sortListByAnother.list) { item_index_values; listviewDisplayData; sorted_dict_keys; }  # unwired: item_index_values

# group: Creating image data for use in script
# note: Converting the imported json into 2 filepath, 1 for the logo in the UI, the other as reference image in the UI
code_block_12 = CodeBlock(JSONImportPictureData=code_block_7.imageDict) { JSONImportPictureData; }
code_block_13 = CodeBlock { "Logo"; "ReferenceImage"; }
valueAtKey_7 = DesignScript.Builtin.Dictionary.ValueAtKey(dictionary=code_block_12, key=code_block_13.out0)
fromPath = FileObject(path=valueAtKey_7)  # "File.FromPath"
readFromFile = Image.ReadFromFile(file=fromPath)
code_block_14 = CodeBlock(Logo=readFromFile) { Logo; }
string_3 = StringInput("Reference image")
valueAtKey_8 = DesignScript.Builtin.Dictionary.ValueAtKey(dictionary=code_block_12, key=code_block_13.out1)
fromPath_2 = FileObject(path=valueAtKey_8)  # "File.FromPath"
string_from_object = FromObject(obj=fromPath_2)
filepath_from_string_python = Python(IN[0]=string_from_object)  # "filepath from string:python script"
# ---------- filepath_from_string_python.python (14 lines) ----------
# Load the Python Standard and DesignScript Libraries
import sys
import clr
import os
clr.AddReference('ProtoGeometry')
from Autodesk.DesignScript.Geometry import *

# The inputs to this node will be stored as a list in the IN variables.


# Place your code below this line

# Assign your outputto the OUT variable.
OUT = os.path.join(IN[0])
# ----------------------------------------
boolean = BoolSelector(false)
data_shapes_ui_image_data = Custom[Data-Shapes_UI.Image Data](Image=filepath_from_string_python, ShowBorder_optional=boolean)  # package Data-Shapes; Places an image on UI.MultipleInutForm ++ .
data_shapes_ui_inputgroup_data = Custom[Data-Shapes_UI.InputGroup Data](GroupTitle=string_3, Inputs=data_shapes_ui_image_data)  # package Data-Shapes; Creates a group of inputs for UI.MultipleInputForm ++ . Check out www.data-shapes.net for more infos !
code_block_15 = CodeBlock(LogoImage=code_block_14, referenceImageObject=data_shapes_ui_inputgroup_data) { LogoImage; referenceImageObject; }

# group: creating input values for selecting type objects
string_4 = StringInput("Select below which objects of the tunnel you want to place based on the alignments. Note: be sure you have loaded all the correct families in the project BEFORE continueing.")
# note: description
code_block_16 = CodeBlock(item_index_values=code_block_11.item_index_values, listviewDisplayData=code_block_11.listviewDisplayData, sorted_dict_keys=code_block_11.sorted_dict_keys, referenceImage=code_block_15.referenceImageObject, uiLogo=code_block_15.LogoImage, scriptSettingsDict=code_block_8.scriptSettingsDict) { item_index_values; listviewDisplayData; sorted_dict_keys; referenceImage; uiLogo; scriptSettingsDict; }
string_5 = StringInput("Continue")
string_6 = StringInput("Select which object to create in this script")
code_block_17 = CodeBlock { "Select which objects of the tunnel  sections you want to place"; 0; }
boolean_2 = BoolSelector(true)
code_block_18 = CodeBlock { "Cancel"; 1000; }

ui_radiobuttons_data = Custom[UI.RadioButtons Data](InputName=code_block_17.out0, Keys=code_block_16.listviewDisplayData, Values=code_block_16.sorted_dict_keys, DefaultValueIndex=code_block_17.out1)  # package Data-Shapes; Create radio buttons input for UI.MultipleInputForm ++ .

# group (continued): creating input values for selecting type objects
list_create = List.Create(item0=ui_radiobuttons_data)
data_shapes_ui_inputgroup_data_2 = Custom[Data-Shapes_UI.InputGroup Data](GroupTitle=string_6, Inputs=list_create)
list_create_2 = List.Create(item0=code_block_16.referenceImage, item1=data_shapes_ui_inputgroup_data_2)
code_block_19 = CodeBlock(Descritpion=string_4, logo=code_block_16.uiLogo, ButtonText=string_5, inputs=list_create_2, objectHasData=boolean_2, cancelButtonText=code_block_18.out0, maxHeight=code_block_18.out1, uiWidth=code_block_18.out1, scriptSettingsDict=code_block_16.scriptSettingsDict) { Descritpion; logo; ButtonText; inputs; objectHasData; cancelButtonText; maxHeight; uiWidth; scriptSettingsDict; }

# group: User selects type object to place with script
# note: User selects which objects to place
data_shapes_ui_multipleinputform_2 = Custom[Data-Shapes_UI.MultipleInputForm ++](Description_optional=code_block_19.Descritpion, Logo_optional=code_block_19.logo, ButtonText_optional=code_block_19.ButtonText, Inputs=code_block_19.inputs, Toggle=code_block_19.objectHasData, CancelButtonText_optional=code_block_19.cancelButtonText, MaxHeight_optional=code_block_19.maxHeight, Width_optional=code_block_19.uiWidth)
code_block_20 = CodeBlock { null; }
if_ = If(test=data_shapes_ui_multipleinputform_2.Was_Cancelled, true=code_block_20, false=data_shapes_ui_multipleinputform_2.User_Inputs)
code_block_21 = CodeBlock(selectedItems=if_) { selectedItems; }

# group: Filtering scritpDataDict based on selected items
# note: description
code_block_22 = CodeBlock(scritpDataDict=code_block_19.scriptSettingsDict, selectedItems=code_block_21) { scritpDataDict; selectedItems; }
flatten = List.Flatten(list=code_block_22.selectedItems)
designscriptbuiltin = DesignScript.Builtin.Dictionary.ValueAtKey(dictionary=code_block_22.scritpDataDict, key=flatten)
code_block_23 = CodeBlock(selectedDict=designscriptbuiltin) { selectedDict; }
string_7 = StringInput(" : ")
operators_3 = flatten + string_7
string_8 = StringInput("name")
designscriptbuiltin_2 = DesignScript.Builtin.Dictionary.ValueAtKey(dictionary=code_block_23, key=string_8)
operators_4 = operators_3 + designscriptbuiltin_2
code_block_24 = CodeBlock(selectedObjectDicts=code_block_23, selectedObjectTypeNames=operators_4, objectName=operators_4) { selectedObjectDicts; selectedObjectTypeNames; objectName; }

# group: Filter families in project based on search query of config_file
code_block_25 = CodeBlock { "filters targetlist based on string: "; "'|' is used to define 'or'"; "',' is used to define 'and'"; }
# note: filter Family object items based on string
string_9 = StringInput("fam_search")
designscriptbuiltin_3 = DesignScript.Builtin.Dictionary.ValueAtKey(dictionary=code_block_24.selectedObjectDicts, key=string_9)
element_types = ElementTypes("Family")
all_elements_of_type = ElementsOfType(element_type=element_types)
name = Element.Name(element=all_elements_of_type)
boolean_3 = BoolSelector(true)
code_block_26 = CodeBlock(filters=designscriptbuiltin_3, targetList=name, ignoreCase=boolean_3) { filters; targetList; ignoreCase; }
list_Filterbystring = Custom[List_Filterbystring](TargetList=code_block_26.targetList, Filterlist=code_block_26.filters, ignorCase=code_block_26.ignoreCase)  # package ROCO Dyf Packages; Filters targetlist based on string: | is used to define 'or' , is used to define 'and'
code_block_27 = CodeBlock { "match"; }
valueAtKey_9 = DesignScript.Builtin.Dictionary.ValueAtKey(dictionary=list_Filterbystring, key=code_block_27)
familySelectionUIData_FromName = Custom[FamilySelectionUIData_FromName](familyName=valueAtKey_9)  # package ROCO Dyf Packages; Creates family ui data from Family Names

# group: Obtaining type ID's to filter settings dictionary
# note: description
code_block_28 = CodeBlock(objectNames=code_block_24.objectName) { objectNames; }
string_10 = StringInput(" : ")
split = String.Split(str=code_block_28, separator0=string_10)
code_block_29 = CodeBlock { 0; }
getItemAtIndex_2 = List.GetItemAtIndex(index=code_block_29)  # unwired: list
map = List.Map(list=split, f_x=getItemAtIndex_2)
code_block_30 = CodeBlock(selectedObjectKeys=map) { selectedObjectKeys; }

# group: Importing civil documents from application and fomratting for selecting corridor and FPcodes in UI
string_11 = StringInput("""Start:
select only 1 FL point code below!""")
# note: description
civilApplication_GetFLPCodesAsString = Custom[civilApplication_GetFLPCodesAsString]()  # package ROCO Dyf Packages; gets corridor names form all open CivilDocuments, outputting it in list with format "Doc | Corridor | FLPointsCodes"
code_block_31 = CodeBlock { false; 75; }
ui_treeview_input = Custom[UI.TreeView input](InputName=string_11, Data=civilApplication_GetFLPCodesAsString.flPointCodes, FirstItemIsTitle=code_block_31.out0, Height=code_block_31.out1)  # package Data-Shapes; Create a TreeView input for UI.MultipleInputForm ++ . Check out www.data-shapes.net for more infos and tips!

string_12 = StringInput("""End:
select only 1 FL point code below!""")
code_block_32 = CodeBlock { false; 75; }
ui_treeview_input_2 = Custom[UI.TreeView input](InputName=string_12, Data=civilApplication_GetFLPCodesAsString.flPointCodes, FirstItemIsTitle=code_block_32.out0, Height=code_block_32.out1)
code_block_33 = CodeBlock(x=ui_treeview_input, y=ui_treeview_input_2) { [x,y]; }

# group (continued): Importing civil documents from application and fomratting for selecting corridor and FPcodes in UI
code_block_34 = CodeBlock(UIobject=code_block_33, stringLength=civilApplication_GetFLPCodesAsString.stringLength, civilApplication=civilApplication_GetFLPCodesAsString.civilApplication, Separator=civilApplication_GetFLPCodesAsString.stringSeparator) { UIobject; stringLength; civilApplication; Separator; }

code_block_35 = CodeBlock(referenceImage=code_block_15.referenceImageObject, groupNames=code_block_24.selectedObjectTypeNames, Logo=code_block_15.LogoImage, civilApplication=code_block_34.civilApplication) { referenceImage; groupNames; Logo; civilApplication; }

# group: Creating UI objects for selecting family types and civil corridor FPCodes
# note: description
code_block_36 = CodeBlock(uiObject=code_block_34.UIobject, stringLength=code_block_34.stringLength, familyTypes=familySelectionUIData_FromName.familyTypes, family_input_selection_string=familySelectionUIData_FromName.inputFamilyTypeString, logo=code_block_35.Logo, referenceImage=code_block_35.referenceImage, groupImages=code_block_35.groupNames) { uiObject; stringLength; familyTypes; family_input_selection_string; logo; referenceImage; groupImages; }
string_13 = StringInput("Continue")
string_14 = StringInput("instructions:")
string_15 = StringInput("Select which familys and types match with the objects previously checked. Additionally select the corridor featurelinepoint on which the objects should be hosted. If the UI shows \"No family or type found\", it means that no family is loaded which matches the search query for the object. Make sure the names of the families are correct!")
data_shapes_ui_textnote_data = Custom[Data-Shapes_UI.TextNote Data](Title=string_14, TextNote=string_15)  # package Data-Shapes; Create Data for TextNote input in UI.MultipleInputForm ++ . Check out www.data-shapes.net for more informations
code_block_37 = CodeBlock { "select famliy + type"; }
code_block_38 = CodeBlock { 0; }
data_shapes_ui_dropdown_data = Custom[Data-Shapes_UI.DropDown Data](InputName=code_block_37, Keys=code_block_36.family_input_selection_string, Values=code_block_36.familyTypes, DefaultValueIndex=code_block_38, lacing=Longest)  # package Data-Shapes; Create data for DropDown input in UI.MultiInputForm ++ . Check out www.data-shapes.net for more infos.
flatten_2 = List.Flatten(list=code_block_36.family_input_selection_string)
length = String.Length(str=flatten_2)
maximumItem = List.MaximumItem(list=length)
code_block_39 = CodeBlock(UIobject=data_shapes_ui_dropdown_data, stringLength=maximumItem) { UIobject; stringLength; }
clockwork_Passthrough = Custom[Clockwork_Passthrough](passThrough=code_block_39.UIobject, waitFor=code_block_36.uiObject)  # package Clockwork for Dynamo 2.x; Forces a sequential order of execution. The node wired into the output of the Passthrough node will be executed *after* the node wired into the waitFor input (e.g. important for some Revit operations). The value of the passThrough input will be passed on to the node wired into the output port of the Passthrough node.
clockwork_Passthrough_2 = Custom[Clockwork_Passthrough](passThrough=code_block_36.uiObject, waitFor=code_block_39.UIobject)
addItemToEnd = List.AddItemToEnd(item=clockwork_Passthrough_2)  # unwired: list
map_2 = List.Map(list=clockwork_Passthrough, f_x=addItemToEnd)
code_block_40 = CodeBlock { "Cancel"; 1000; }
max = Math.Max(value1=code_block_36.stringLength, value2=code_block_39.stringLength)
code_block_41 = CodeBlock(chars=max) { chars; width = Math.Max(750, Math.Round(200*chars/25 + 0.5*chars)); }

code_block_42 = CodeBlock(x=map_2) { List.Flatten(x); }

# group (continued): Creating UI objects for selecting family types and civil corridor FPCodes
data_shapes_ui_inputgroup_data_3 = Custom[Data-Shapes_UI.InputGroup Data](GroupTitle=code_block_36.groupImages, Inputs=code_block_42)
addItemToFront = List.AddItemToFront(item=data_shapes_ui_textnote_data, list=data_shapes_ui_inputgroup_data_3)
addItemToFront_2 = List.AddItemToFront(item=code_block_36.referenceImage, list=addItemToFront)
isNull = Object.IsNull(obj=data_shapes_ui_inputgroup_data_3)
uniqueItems = List.UniqueItems(list=isNull)
operators_Not = Not(x=uniqueItems)
code_block_43 = CodeBlock(logo=code_block_36.logo, ButtonText=string_13, inputs=addItemToFront_2, objectHasData=operators_Not, cancelButtonText=code_block_40.out0, maxHeight=code_block_40.out1, uiWidth=code_block_41.width) { Descritpion; logo; ButtonText; inputs; objectHasData; cancelButtonText; maxHeight; uiWidth; }  # unwired: Descritpion

# group: User selects family types and FP codes
# note: description
data_shapes_ui_multipleinputform_3 = Custom[Data-Shapes_UI.MultipleInputForm ++](Description_optional=code_block_43.Descritpion, Logo_optional=code_block_43.logo, ButtonText_optional=code_block_43.ButtonText, Inputs=code_block_43.inputs, Toggle=code_block_43.objectHasData, CancelButtonText_optional=code_block_43.cancelButtonText, MaxHeight_optional=code_block_43.maxHeight, Width_optional=code_block_43.uiWidth)
code_block_44 = CodeBlock { null; }
if_2 = If(test=data_shapes_ui_multipleinputform_3.Was_Cancelled, true=code_block_44, false=data_shapes_ui_multipleinputform_3.User_Inputs)
code_block_45 = CodeBlock(selectedItems=if_2) { List.Flatten(selectedItems); }

code_block_46 = CodeBlock(groupNames=code_block_35.groupNames, selectedFamilyTypesAndCivilData=code_block_45, stringSeperator=code_block_34.Separator, referenceImage=code_block_35.referenceImage, Logo=code_block_35.Logo, civilApplication=code_block_35.civilApplication) { groupNames; selectedFamilyTypesAndCivilData; stringSeperator; referenceImage; Logo; civilApplication; }

# group: creating data for table view based on selected family types and civil info
# note: description
code_block_47 = CodeBlock(groupNames=code_block_46.groupNames, selectedFamilyTypesAndCivilData=code_block_46.selectedFamilyTypesAndCivilData, stringSeperator=code_block_46.stringSeperator)
# ---------- code_block_47.designscript (5 lines) ----------
groupNames;
x=selectedFamilyTypesAndCivilData[0];
y=String.Split(selectedFamilyTypesAndCivilData[1],stringSeperator);
z=String.Split(selectedFamilyTypesAndCivilData[2],stringSeperator);
stringSeperator;
# ----------------------------------------
code_block_48 = CodeBlock(selectedFamily=code_block_47.x, c3d_start=code_block_47.y, c3d_end=code_block_47.z) { selectedFamily; c3d_start; c3d_end; }

# group: Creating reference info dict for objects
# note: description
code_block_49 = CodeBlock(c3d_start=code_block_48.c3d_start, c3d_end=code_block_48.c3d_end) { c3d_start; c3d_end; }
code_block_50 = CodeBlock(x=code_block_49.c3d_start, y=code_block_49.c3d_end) { x[0]; x[1]; x[2]; y[2]; }
code_block_51 = CodeBlock(civilDocumentName=code_block_50.out0, corridorName=code_block_50.out1, flPointCode1=code_block_50.out2, flPointCode2=code_block_50.out3) { [civilDocumentName]; [corridorName]; [flPointCode1+","+flPointCode2]; }
C3DMeta_CorridorFLPoints = Custom[C3DMeta_CorridorFLPoints](civilDocumentName=code_block_51.out0, corridorName=code_block_51.out1, flPointCode=code_block_51.out2)  # package ROCO Dyf Packages; create metadata script for corridorflPoint scripts
code_block_52 = CodeBlock(c3dInfoDict=C3DMeta_CorridorFLPoints) { c3dInfoDict; }

# group: creating diverse dicts to continue script
# note: description
code_block_53 = CodeBlock(settingsDict=code_block_9.scriptSettingsDict, selectedObjectKeys=code_block_30, c3dInfo=code_block_52) { settingsDict; selectedObjectKeys; c3dInfo; }
flatten_3 = List.Flatten(list=code_block_53.selectedObjectKeys)
designscriptbuiltin_4 = DesignScript.Builtin.Dictionary.ValueAtKey(dictionary=code_block_53.settingsDict, key=flatten_3)
byKeysValues = DesignScript.Builtin.Dictionary.ByKeysValues(keys=flatten_3, values=designscriptbuiltin_4)
string_16 = StringInput("defaultParameters")
designscriptbuiltin_5 = DesignScript.Builtin.Dictionary.ValueAtKey(dictionary=designscriptbuiltin_4, key=string_16)
string_17 = StringInput(" : ")
operators_5 = flatten_3 + string_17
string_18 = StringInput("name")
designscriptbuiltin_6 = DesignScript.Builtin.Dictionary.ValueAtKey(dictionary=designscriptbuiltin_4, key=string_18)
operators_6 = operators_5 + designscriptbuiltin_6
string_19 = StringInput("numberParams")
designscriptbuiltin_list_of = DesignScript.Builtin.Dictionary.ValueAtKey(dictionary=designscriptbuiltin_4, key=string_19)
string_20 = StringInput("C3D info")
setValueAtKeys = DesignScript.Builtin.Dictionary.SetValueAtKeys(dictionary=designscriptbuiltin_4, keys=string_20, values=code_block_53.c3dInfo, lacing=Longest)
code_block_54 = CodeBlock { ["fam_search","defaultParameters","numberParams"]; }
designscriptbuiltin_prepare_dict = DesignScript.Builtin.Dictionary.RemoveKeys(dictionary=setValueAtKeys, keys=code_block_54)
code_block_55 = CodeBlock(defaultParameterList=designscriptbuiltin_5, selectedItemNames=operators_6, numberParameterNames=designscriptbuiltin_list_of, scriptSettings=designscriptbuiltin_prepare_dict) { defaultParameterList; selectedItemNames; numberParameterNames; scriptSettings; }

# group: get corridor featurelinepoints
code_block_56 = CodeBlock(x=code_block_48.c3d_start) { x[0]; x[1]; x[2]; }
# note: Get Featureline points
code_block_57 = CodeBlock(civilApplication=code_block_46.civilApplication, documentNames=code_block_56.out0, corridorNames=code_block_56.out1, FlpointCodes=code_block_56.out2) { civilApplication; documentNames; corridorNames; FlpointCodes; }
getDocumentByName = CivilConnection.CivilApplication.GetDocumentByName(civilApplication=code_block_57.civilApplication, name=code_block_57.documentNames)
getCorridorByName = CivilConnection.CivilDocument.GetCorridorByName(civilDocument=getDocumentByName, name=code_block_57.corridorNames)
baselines = CivilConnection.Corridor.Baselines(corridor=getCorridorByName)
flatten_4 = List.Flatten(list=baselines)
getBaselineRegions = CivilConnection.Baseline.GetBaselineRegions(baseline=flatten_4)
getFeaturelinePointsByCode = CivilConnection.Baseline.GetFeaturelinePointsByCode(baseline=flatten_4, code=code_block_57.FlpointCodes)
code_block_58 = CodeBlock(x=getBaselineRegions, y=getFeaturelinePointsByCode) { List.Flatten(x); List.Flatten(y); }
stations = CivilConnection.BaselineRegion.Stations(baselineRegion=code_block_58.out0)
surveyPoint = Coordinates.SurveyPoint()
code_block_59 = CodeBlock(FLPoint=code_block_58.out1, SP=surveyPoint) { x=FLPoint.X+SP.X; y=FLPoint.Y+SP.Y; Z=FLPoint.Z; }
byCoordinates = Point.ByCoordinates(x=code_block_59.x, y=code_block_59.y, z=code_block_59.Z)
code_block_60 = CodeBlock(baselineStations=stations, baseline_fl_points=byCoordinates, corridor=getCorridorByName) { baselineStations; baseline_fl_points; corridor; }

# group: get corridor featurelinepoints
code_block_61 = CodeBlock(x=code_block_48.c3d_end) { x[0]; x[1]; x[2]; }
# note: Get Featureline points
code_block_62 = CodeBlock(civilApplication=code_block_46.civilApplication, documentNames=code_block_61.out0, corridorNames=code_block_61.out1, FlpointCodes=code_block_61.out2) { civilApplication; documentNames; corridorNames; FlpointCodes; }
getDocumentByName_2 = CivilConnection.CivilApplication.GetDocumentByName(civilApplication=code_block_62.civilApplication, name=code_block_62.documentNames)
getCorridorByName_2 = CivilConnection.CivilDocument.GetCorridorByName(civilDocument=getDocumentByName_2, name=code_block_62.corridorNames)
baselines_2 = CivilConnection.Corridor.Baselines(corridor=getCorridorByName_2)
flatten_5 = List.Flatten(list=baselines_2)
getFeaturelinePointsByCode_2 = CivilConnection.Baseline.GetFeaturelinePointsByCode(baseline=flatten_5, code=code_block_62.FlpointCodes)
code_block_63 = CodeBlock(y=getFeaturelinePointsByCode_2) { List.Flatten(y); }
surveyPoint_2 = Coordinates.SurveyPoint()
code_block_64 = CodeBlock(FLPoint=code_block_63, SP=surveyPoint_2) { x=FLPoint.X+SP.X; y=FLPoint.Y+SP.Y; Z=FLPoint.Z; }
byCoordinates_2 = Point.ByCoordinates(x=code_block_64.x, y=code_block_64.y, z=code_block_64.Z)
code_block_65 = CodeBlock(baseline_fl_points=byCoordinates_2, corridor=getCorridorByName_2) { baseline_fl_points; corridor; }
byCoordinates_3 = Point.ByCoordinates()

code_block_66 = CodeBlock(pt1=code_block_60.baseline_fl_points, pt2=code_block_65.baseline_fl_points) { List.Transpose([pt1,pt2]); }

# group: Creating adaptive components
# note: description
code_block_67 = CodeBlock(familyType=code_block_48.selectedFamily, pointpairLists=code_block_66) { familyType; [pointpairLists]; corridorNames; flPointCodes; familyNames; }  # unwired: corridorNames, flPointCodes, familyNames
code_block_68 = CodeBlock(familyTypes=code_block_67.familyType, pointpairLists=code_block_67.out1, corridorNames=code_block_67.corridorNames) { familyTypes; pointpairLists; corridorNames; flPointCodes; }  # unwired: flPointCodes
byPoints = AdaptiveComponent.ByPoints(points=code_block_68.pointpairLists, familyType=code_block_68.familyTypes, lacing=Longest)

# group: format data for inputs and creating inputs for user to enter parameters
# note: description
code_block_69 = CodeBlock(referenceImage=code_block_15.referenceImageObject, Logo=code_block_35.Logo, defaultParameterLists=code_block_55.defaultParameterList, selectedGroupNames=code_block_55.selectedItemNames) { referenceImage; Logo; defaultParameterLists; selectedGroupNames; }
code_block_70 = CodeBlock { "Continue"; 1000; 850; "Cancel"; }
string_21 = StringInput("Instructions:")
string_22 = StringInput("For the object types: enter the start index of de objects")
data_shapes_ui_textnote_data_2 = Custom[Data-Shapes_UI.TextNote Data](Title=string_21, TextNote=string_22)
code_block_71 = CodeBlock { "ROCO_CNU_OBS.Index_start"; "0.0000"; }
code_block_72 = CodeBlock(selectedObjects=code_block_69.selectedGroupNames, keys=code_block_71.out0, values=code_block_71.out1)
# ---------- code_block_72.designscript (8 lines) ----------
selectedObjects;
keys;
values;
count=List.Count(selectedObjects);
paramDict=Dictionary.ByKeysValues(keys, values);
parameterList= List.OfRepeatedItem(paramDict, count);
parameterList.Keys;
parameterList[parameterList.Keys];
# ----------------------------------------
ui_textbox_data = Custom[UI.TextBox Data](InputName=code_block_72.out6, DefaultText=code_block_72.out7)  # package Data-Shapes; Create Data for TextBox input in UI.MultipleInputForm ++ . Check out www.data-shapes.net for more informations
data_shapes_ui_inputgroup_data_4 = Custom[Data-Shapes_UI.InputGroup Data](GroupTitle=code_block_72.selectedObjects, Inputs=ui_textbox_data)
code_block_73 = CodeBlock(item1=data_shapes_ui_textnote_data_2, inList=data_shapes_ui_inputgroup_data_4, item2=code_block_69.referenceImage) { inlist1=List.AddItemToFront(item1, inList); b=List.AddItemToFront(item2,inlist1); c=List.Flatten(b); }
boolean_4 = BoolSelector(true)
passthrough = Custom[Passthrough](passThrough=boolean_4, waitFor=code_block_73.c)  # package Clockwork for Dynamo 2.x; Forces a sequential order of execution. The node wired into the output of the Passthrough node will be executed *after* the node wired into the waitFor input (e.g. important for some Revit operations). The value of the passThrough input will be passed on to the node wired into the output port of the Passthrough node.
code_block_74 = CodeBlock(logo=code_block_69.Logo, ButtonText=code_block_70.out0, inputs=code_block_73.c, objectHasData=passthrough, cancelButtonText=code_block_70.out3, maxHeight=code_block_70.out1, uiWidth=code_block_70.out2, ParameterValueHeaderLists=code_block_72.out6) { Descritpion; logo; ButtonText; inputs; objectHasData; cancelButtonText; maxHeight; uiWidth; ParameterValueHeaderLists; }  # unwired: Descritpion

# group: User enters parameter values for each object type
ui_multipleinputform = Custom[UI.MultipleInputForm ++](Description_optional=code_block_74.Descritpion, Logo_optional=code_block_74.logo, ButtonText_optional=code_block_74.ButtonText, Inputs=code_block_74.inputs, Toggle=code_block_74.objectHasData, CancelButtonText_optional=code_block_74.cancelButtonText, MaxHeight_optional=code_block_74.maxHeight, Width_optional=code_block_74.uiWidth)  # package Data-Shapes; Create a form with multiple inputs. see www.data-shapes.net for tutorials and infos!
code_block_75 = CodeBlock(inList1=ui_multipleinputform.User_Inputs) { List.Chop(inList1,1); }
watch = Watch(code_block_75)

# group: creating PE id for each object (ascending, incrementing by 1)
# note: description
code_block_76 = CodeBlock(adaptiveCompontents=byPoints, parameter_dict_keys=code_block_74.ParameterValueHeaderLists, parameter_dict_values=watch) { [adaptiveCompontents]; parameter_dict_keys; parameter_dict_values; firstPointsList; }  # unwired: firstPointsList
byKeysValues_2 = DesignScript.Builtin.Dictionary.ByKeysValues(keys=code_block_76.parameter_dict_keys, values=code_block_76.parameter_dict_values, lacing=Longest)
string_23 = StringInput("ROCO_CNU_OBS.Index_start")
valueAtKey_10 = DesignScript.Builtin.Dictionary.ValueAtKey(dictionary=byKeysValues_2, key=string_23)
toNumber_2 = String.ToNumber(str=valueAtKey_10)
code_block_77 = CodeBlock { "ROCO_CNU_OBS.Index"; }
create_id_dict_from_list = Python(IN[0]=code_block_76.out0, IN[1]=toNumber_2, IN[2]=code_block_77)  # "create ID dict from list adaptive components + start offset: Python Script"
# ---------- create_id_dict_from_list.python (41 lines) ----------
# Load the Python Standard and DesignScript Libraries
import sys
import clr
clr.AddReference('ProtoGeometry')
from Autodesk.DesignScript.Geometry import *

# The inputs to this node will be stored as a list in the IN variables.
firstPointsList, idStart, key = IN

templist = []
templist1 =[]
outlist = []
i = 0
j = 0

# Place your code below this line


while i < len(firstPointsList):
    firstPoints = firstPointsList[i]
    index = idStart[i]
    templist1.Clear()
    j = 0
    while j < len(firstPoints):
    	k = 0
    	templist.Clear()
        while k < len(firstPoints[j]):
            index_str = str(index)
            index_str = index_str.split(".")[0]
            index_str = index_str.split(",")[0]
            templist.append({key: int(index_str)})
            index += 1
            k += 1
        templist1.append(list(templist))
        j += 1
    outlist.append(list(templist1))
    i += 1


# Assign your output to the OUT variable.
OUT = outlist
# ----------------------------------------
code_block_78 = CodeBlock(PE_Id_dict=create_id_dict_from_list, adaptiveComponents=code_block_76.out0) { List.Flatten(PE_Id_dict); List.Flatten(adaptiveComponents); }

# group: creating parameter_value dict for all type objects, including the script info
# note: description
code_block_79 = CodeBlock(parameterDict=byKeysValues_2, removeStartIDValue=string_23, c3DInfoDict=code_block_55.scriptSettings, numberParams=code_block_55.numberParameterNames, configFileMeta=code_block_9.configFileMeta) { parameterDict; removeStartIDValue; c3DInfoDict; numberParams; configFileMeta; }
removeKeys = DesignScript.Builtin.Dictionary.RemoveKeys(dictionary=code_block_79.parameterDict, keys=code_block_79.removeStartIDValue)
code_block_80 = CodeBlock { ["ROCO_CTE_Dynamo.GUID","ROCO_CTE_Dynamo.Script"]; }
generateGuid = DynamoROCO.DesignLog.GenerateGuid()
string_24 = StringInput("ConfigFileMeta")
byKeysValues_3 = DesignScript.Builtin.Dictionary.ByKeysValues(keys=string_24, values=code_block_79.configFileMeta)
string_25 = StringInput("ScriptMeta")
script_CreateMeta = Custom[Script_CreateMeta]()  # package ROCO Dyf Packages; Creates script meta data to put onto object parameters
setValueAtKeys_2 = DesignScript.Builtin.Dictionary.SetValueAtKeys(dictionary=byKeysValues_3, keys=string_25, values=script_CreateMeta)
stringifyJSON = Data.StringifyJSON(values=setValueAtKeys_2, lacing=Longest)
list_create_3 = List.Create(item0=generateGuid, item1=stringifyJSON)
setValueAtKeys_3 = DesignScript.Builtin.Dictionary.SetValueAtKeys(dictionary=removeKeys, keys=code_block_80, values=list_create_3)
string_26 = StringInput("ROCO_CTE_Reference_Source_Data")
code_block_81 = CodeBlock(C3D_Reference_Dict=code_block_79.c3DInfoDict) { C3D_Reference_Dict; }
stringifyJSON_2 = Data.StringifyJSON(values=code_block_81, lacing=Longest)
setValueAtKeys_4 = DesignScript.Builtin.Dictionary.SetValueAtKeys(dictionary=setValueAtKeys_3, keys=string_26, values=stringifyJSON_2, lacing=Longest)
code_block_82 = CodeBlock(numberParams=code_block_79.numberParams) { numberParams; }
valueAtKey_11 = DesignScript.Builtin.Dictionary.ValueAtKey(dictionary=setValueAtKeys_3, key=code_block_82)
toNumber_3 = String.ToNumber(str=valueAtKey_11)
code_block_83 = CodeBlock(in_dict=setValueAtKeys_4, keys=code_block_82, values=toNumber_3) { in_dict; keys; values; }
create_parameter_dictionary = Python(IN[0]=code_block_83.in_dict, IN[1]=code_block_83.keys, IN[2]=code_block_83.values)  # "create parameter dictionary: Python Script"
# ---------- create_parameter_dictionary.python (30 lines) ----------
# Load the Python Standard and DesignScript Libraries
import sys
import clr
clr.AddReference('ProtoGeometry')
from Autodesk.DesignScript.Geometry import *

# The inputs to this node will be stored as a list in the IN variables.
in_list, add_keys, add_values =IN

tempdict ={}
outlist=[]
templist=[]
# Place your code below this line
i=0
while i< len(in_list):
	in_dict=in_list[i]
	keylist=add_keys[i]
	valuelist=add_values[i]
	j=0
	while j< len(keylist):
		in_dict[keylist[j]]=valuelist[j]	
		j+=1
	outlist.append(in_dict)
	i+=1

	
		
	
# Assign your output to the OUT variable.
OUT = outlist
# ----------------------------------------
code_block_84 = CodeBlock(parameterDict=create_parameter_dictionary) { parameterDict; }

# group: createBaselineStationDict
code_block_85 = CodeBlock(baselineStations=code_block_60.baselineStations) { [baselineStations]; }
code_block_86 = CodeBlock { ["ROCO_CNU_Station"]; }
createstationdict_from_baseline = Python(IN[0]=code_block_85, IN[1]=code_block_86)  # "createStationDict from baseline stations: Python Script"
# ---------- createstationdict_from_baseline.python (39 lines) ----------
# Load the Python Standard and DesignScript Libraries
import sys
import clr
clr.AddReference('ProtoGeometry')
from Autodesk.DesignScript.Geometry import *

# The inputs to this node will be stored as a list in the IN variables.
firstItemsList, keyList = IN

templist = []
templist1 = []
outlist = []
i = 0

while i < len(firstItemsList):
    firstPoints = firstItemsList[i]

    templist1.Clear()
    j = 0
    while j < len(firstPoints):
        k = 0
        templist.Clear()
        while k < len(firstPoints[j]):
            object = firstPoints[j][k]
            n = 0
            tempdict = {}
            while n < len(keyList):
                tempdict[keyList[n]] = object
                n += 1
            templist.append(tempdict)
            k += 1
        templist1.append(list(templist))
        j += 1
    outlist.append(list(templist1))
    i += 1


# Assign your output to the OUT variable.
OUT = outlist
# ----------------------------------------
code_block_87 = CodeBlock(stationDict=createstationdict_from_baseline) { List.Flatten(stationDict); }

code_block_88 = CodeBlock { 1; }

# group: compiling parameter list and setting parameters on elements
# note: description
code_block_89 = CodeBlock(adaptiveComponents=code_block_78.out1, pe_id_dict=code_block_78.out0, defaultParameterList=code_block_84, stationsDict=code_block_87) { adaptiveComponents; List.Flatten(pe_id_dict); List.Flatten(defaultParameterList); List.Flatten(stationsDict); }
flatten_6 = List.Flatten(list=code_block_89.adaptiveComponents, amt=code_block_88)
dictionaryupdate = Custom[dictionaryupdate](targetDict=code_block_89.out1, addDict=code_block_89.out3)  # package ROCO Dyf Packages; Updates dictionary with another dict

flatten_7 = List.Flatten(list=flatten_6)
count = List.Count(list=flatten_6, lacing=Longest)
ofRepeatedItem = List.OfRepeatedItem(item=code_block_89.out2, amount=count, lacing=Longest)
flatten_8 = List.Flatten(list=ofRepeatedItem)

# group (continued): compiling parameter list and setting parameters on elements
dictionaryupdate_2 = Custom[dictionaryupdate](targetDict=flatten_8, addDict=dictionaryupdate)

setParameters = Custom[Element.SetParameters](elementInstance=flatten_7, parameterDict=dictionaryupdate_2, lacing=Longest)  # package ROCO Dyf Packages; Sets parameters based on element and parameter dict

# group (continued): compiling parameter list and setting parameters on elements
parameters_set_0_watch = Watch(setParameters)  # graph output
