# Dynamo graph CC_GMA2_createObjects_wo_dimensions@IntervalCorridorFLpoints.dyn (Dynamo 2.3.0.5885)
# packages: Data-Shapes 2019.2.40, ROCO Dyf Packages 1.0.0, Clockwork for Dynamo 2.x 2.1.2, Data-Shapes 2021.2.9, Clockwork for Dynamo 2.x 2.3.0, DynamoROCO 2.3.0.0, archi-lab.net 2021.25.11

# group: DATA MANIPULATION
# note: Data manipulation on Dynamo Objects

# group: NOT IN USE
# note: Nodes to consider part of the final graph

# group: INPUT
# note: Data input and preperation for other nodes

# group: GET
# note: Get parameter values from Revit objects

# group: DEBUG
# note: Check if the graph is working as expected

# group: Package
# note: All used nodes from a package have a prefix
# added to them with the name of the node.

# group: FUNCTION
# note: Creation of dynamo objects

# group: OUTPUT
# note: Object creation in Revit, final output

# group: SET
# note: Set parameters on Revit objects

# group: INFO
# note: GENERAL INFO
# Version: 3
# Author: Dick Elsman
# Company: Infranea | ROCO
# email: dick.elsman@infranea.com
# Dynamo Core version: 2.3.0.5885
# Dynamo Revit version: 2.3.0.6270
# Revit version: 2020.2
# note: INSTRUCTIONS
# <DESCRIPTION>
# Allows the user to place GMA2 objects on featureline points in the direction of the alignment (and corridor).  Duration of scripts depends on complexity of corridor and to be placed objects. Min runtime is about 5 minutes
# <INSTRUCTIONS>
# navigate to the folder to play, and press play in the Dynamo Player.
# NB! This script requires a JSON config file for it to index objects and data from sources. This/these file(s) shoudl be stored in <script directory>\config_files
# note: KNOWN ISSUES AND LIMITATIONS
# - Does not support retaining objects yet
# - Does not yet facilitate slopes in floors
# note: SCRIPT META
# Script Name: CC_GMA2_GMA4_createObjects@CorridorFLpoints.dyn
# Packages used in this script:
# Data-Shapes version: 2019.2.40
# Clockwork for Dynamo 2.x version: 2.1.2
# DynamoROCO version: 2.3.0.0
# ROCO Dyf Packages version: 1.0.0
# TimeStamp : 2020/2/6 17:58

# group: INPUT
python_script = Python()  # unwired: IN[0]
# ---------- python_script.python (29 lines) ----------
# Importing Reference Modules
# CLR ( Common Language Runtime Module )
import clr
# Adding the DynamoRevitDS.dll module to work with the Dynamo API
clr.AddReference('DynamoRevitDS')
import Dynamo 

# access to the current Dynamo instance and workspace
dynamoRevit = Dynamo.Applications.DynamoRevit()
currentWorkspace = dynamoRevit.RevitDynamoModel.CurrentWorkspace

# Access current version of dynamo
version=dynamoRevit.RevitDynamoModel.Version

# checks version of dynamo and adjusts output according to version
if version.StartsWith("1."):
	
	# Gets file name which includes full path
	filename=currentWorkspace.FileName
	
	
	# Splits out file path to just file name
	OUT=filename

elif version.StartsWith("2."):
	OUT=currentWorkspace.FileName

else:
	OUT="Not supported"
# ----------------------------------------
userName = Custom[System.UserName]()  # package Clockwork for Dynamo 2.x; Returns the user name of the person who is currently logged on to Windows on the machine the script is executed on.
code_block = CodeBlock(workspaceFilePath=python_script, userName=userName) { workspaceFilePath; userName; }

# group: Create UI data from config file
code_block_2 = CodeBlock(workspaceFilepath=code_block.workspaceFilePath) { workspaceFilepath; }
directoryName = FileSystem.DirectoryName(path=code_block_2)
code_block_3 = CodeBlock { "\\config_files"; }
concat = String.Concat(string0=directoryName, string1=code_block_3)
directory_from_path = DirectoryObject(path=concat)
code_block_4 = CodeBlock { false; }
getDirectoryContents = FileSystem.GetDirectoryContents(directory=directory_from_path, includeSubdirectories=code_block_4)
code_block_5 = CodeBlock { false; }
fileName = FileSystem.FileName(path=code_block_2, withExtension=code_block_5)
string = StringInput("@")
split = String.Split(str=fileName, separator0=string)
code_block_6 = CodeBlock(x=split) { "@" +x[1]+".JSON"; true; }
contains = String.Contains(str=getDirectoryContents.files, searchFor=code_block_6.out0, ignoreCase=code_block_6.out1)
filterByBoolMask = List.FilterByBoolMask(list=getDirectoryContents.files, mask=contains)
fileName_2 = FileSystem.FileName(path=filterByBoolMask.in)
length = String.Length(str=fileName_2)
maximumItem = List.MaximumItem(list=length)
code_block_7 = CodeBlock(fileNames=fileName_2, filePaths=filterByBoolMask.in, str_length=maximumItem) { fileNames; filePaths; str_length; }

# group: Create UI objects for selection in script
code_block_8 = CodeBlock(fileNames=code_block_7.fileNames, filePaths=code_block_7.filePaths, userNames=code_block.userName) { fileNames; filePaths; userNames; }
code_block_9 = CodeBlock { 0; "Cancel"; "Select configuration"; "Select configuration predefined in the script folder"; }
dropdown_data = Custom[DropDown Data](Keys=code_block_8.fileNames, Values=code_block_8.filePaths, DefaultValueIndex=code_block_9.out0)  # package Data-Shapes; Create data for DropDown input in UI.MultiInputForm ++ . Check out www.data-shapes.net for more infos.
code_block_10 = CodeBlock { "Enter the author name you want to place on the objects. By default windows username"; }
textnote_data = Custom[TextNote Data](TextNote=code_block_10)  # package Data-Shapes; Create Data for TextNote input in UI.MultipleInputForm ++ . Check out www.data-shapes.net for more informations
code_block_11 = CodeBlock { "Username to place on all objects in this run"; }
textnote_data_2 = Custom[TextNote Data](Title=code_block_11, TextNote=code_block_8.userNames)
list_create = List.Create(item0=dropdown_data, item1=textnote_data, item2=textnote_data_2)
count = List.Count(list=code_block_8.fileNames)
operators = count != code_block_9.out0
code_block_12 = CodeBlock(UIObjects=list_create, fileNames=code_block_8.fileNames, filePaths=code_block_8.filePaths, userNames=code_block_8.userNames, description=code_block_9.out3, buttonText=code_block_9.out2, hasData=operators, cancelButton=code_block_9.out1) { UIObjects; fileNames; filePaths; userNames; description; logo; buttonText; hasData; cancelButton; }  # unwired: logo

# group: OUTPUT
code_block_13 = CodeBlock(description=code_block_12.description, logo=code_block_12.logo, buttonText=code_block_12.buttonText, inputs=code_block_12.UIObjects, hasData=code_block_12.hasData, cancelButton=code_block_12.cancelButton, fileNames=code_block_12.fileNames, filePaths=code_block_12.filePaths, userNames=code_block_12.userNames, str_length=code_block_7.str_length) { description; logo; buttonText; inputs; hasData; cancelButton; fileNames; filePaths; userNames; str_length; }
code_block_14 = CodeBlock(description=code_block_13.description) { description; }
code_block_15 = CodeBlock(logo=code_block_13.logo) { logo; }
code_block_16 = CodeBlock(buttonText=code_block_13.buttonText) { buttonText; }
code_block_17 = CodeBlock(UIObjects=code_block_13.inputs) { UIObjects; }
code_block_18 = CodeBlock(hasData=code_block_13.hasData) { hasData; }
code_block_19 = CodeBlock(cancelButton=code_block_13.cancelButton) { cancelButton; }
code_block_20 = CodeBlock(strLength=code_block_13.str_length) { strLength; }
code_block_21 = CodeBlock(filePaths=code_block_13.filePaths) { filePaths; }
code_block_22 = CodeBlock(fileNames=code_block_13.fileNames) { fileNames; }
code_block_23 = CodeBlock(userName=code_block_13.userNames) { userName; }

# group: User selects config file to run script with
code_block_24 = CodeBlock(chars=code_block_20) { Math.Max(500, Math.Round(200*chars/25 + 0.5*chars)); }
multipleinputform = Custom[MultipleInputForm ++](Description_optional=code_block_14, Logo_optional=code_block_15, ButtonText_optional=code_block_16, Inputs=code_block_17, Toggle=code_block_18, CancelButtonText_optional=code_block_19, Width_optional=code_block_24)  # package Data-Shapes; Create a form with multiple inputs. see www.data-shapes.net for tutorials and infos!
code_block_25 = CodeBlock(x=multipleinputform.User_Inputs) { selectedConfigFile=x[0]; }

# group: Import JSON file for script config
code_block_26 = CodeBlock(selectedConfigFile=code_block_25) { selectedConfigFile; }
code_block_27 = CodeBlock { 0; }
getItemAtIndex = List.GetItemAtIndex(list=code_block_26, index=code_block_27)
readText = FileSystem.ReadText(file=getItemAtIndex)
parseJSON = Data.ParseJSON(json=readText)
code_block_28 = CodeBlock { "scriptDataDict"; "imageDict"; "configData"; }
valueAtKey = DesignScript.Builtin.Dictionary.ValueAtKey(dictionary=parseJSON, key=code_block_28.out1)
valueAtKey_2 = DesignScript.Builtin.Dictionary.ValueAtKey(dictionary=parseJSON, key=code_block_28.out0)
valueAtKey_3 = DesignScript.Builtin.Dictionary.ValueAtKey(dictionary=parseJSON, key=code_block_28.out2)
code_block_29 = CodeBlock { "#adaptivePoints"; }
valueAtKey_4 = DesignScript.Builtin.Dictionary.ValueAtKey(dictionary=valueAtKey_3, key=code_block_29)
code_block_30 = CodeBlock(imageDict=valueAtKey, scriptSettingsDict=valueAtKey_2, amountAdaptivePoints=valueAtKey_4, configFileMeta=valueAtKey_3) { imageDict; scriptSettingsDict; amountAdaptivePoints; configFileMeta; }

# group: Creating image data for use in script
# note: Converting the imported json into 2 filepath, 1 for the logo in the UI, the other as reference image in the UI
code_block_31 = CodeBlock(JSONImportPictureData=code_block_30.imageDict) { JSONImportPictureData; }
code_block_32 = CodeBlock { "Logo"; "ReferenceImage"; }
valueAtKey_5 = DesignScript.Builtin.Dictionary.ValueAtKey(dictionary=code_block_31, key=code_block_32.out0)
fromPath = FileObject(path=valueAtKey_5)  # "File.FromPath"
readFromFile = Image.ReadFromFile(file=fromPath)
code_block_33 = CodeBlock(Logo=readFromFile) { Logo; }
string_2 = StringInput("Reference image")
valueAtKey_6 = DesignScript.Builtin.Dictionary.ValueAtKey(dictionary=code_block_31, key=code_block_32.out1)
fromPath_2 = FileObject(path=valueAtKey_6)  # "File.FromPath"
string_from_object = FromObject(obj=fromPath_2)
filepath_from_string_python = Python(IN[0]=string_from_object)  # "filepath from string:python script"
# ---------- filepath_from_string_python.python (14 lines) ----------
# Load the Python Standard and DesignScript Libraries
import sys
import clr
import os
clr.AddReference('ProtoGeometry')
from Autodesk.DesignScript.Geometry import *

# The inputs to this node will be stored as a list in the IN variables.


# Place your code below this line

# Assign your outputto the OUT variable.
OUT = os.path.join(IN[0])
# ----------------------------------------
boolean = BoolSelector(false)
image_data = Custom[Image Data](Image=filepath_from_string_python, ShowBorder_optional=boolean)  # package Data-Shapes; Places an image on UI.MultipleInutForm ++ .
inputgroup_data = Custom[InputGroup Data](GroupTitle=string_2, Inputs=image_data)  # package Data-Shapes; Creates a group of inputs for UI.MultipleInputForm ++ . Check out www.data-shapes.net for more infos !
code_block_34 = CodeBlock(LogoImage=code_block_33, referenceImageObject=inputgroup_data) { LogoImage; referenceImageObject; }

# group: Importing civil documents from application and fomratting for selecting corridor and FPcodes in UI
# note: description
string_3 = StringInput("Select only 1 FL point code below!")
civilApplication_GetFLPCodesAsString = Custom[civilApplication_GetFLPCodesAsString]()  # package ROCO Dyf Packages; gets corridor names form all open CivilDocuments, outputting it in list with format "Doc | Corridor | FLPointsCodes"
code_block_35 = CodeBlock { false; 75; }
treeview_input = Custom[TreeView input](InputName=string_3, Data=civilApplication_GetFLPCodesAsString.flPointCodes, FirstItemIsTitle=code_block_35.out0, Height=code_block_35.out1)  # package Data-Shapes; Create a TreeView input for UI.MultipleInputForm ++ . Check out www.data-shapes.net for more infos and tips!
code_block_36 = CodeBlock(UIobject=treeview_input, stringLength=civilApplication_GetFLPCodesAsString.stringLength, civilApplication=civilApplication_GetFLPCodesAsString.civilApplication, Separator=civilApplication_GetFLPCodesAsString.stringSeparator) { UIobject; stringLength; civilApplication; Separator; }

# group: Building dictionary for use in UI
# note: building UI data to feed the listview for selecting type objects
code_block_37 = CodeBlock(scriptDataDict=code_block_30.scriptSettingsDict) { scriptDataDict; }
keys = DesignScript.Builtin.Dictionary.Keys(dictionary=code_block_37)
toNumber = String.ToNumber(str=keys)
sortListByAnother = archilab.Lists.Lists.SortListByAnother(list=keys, sortBy=toNumber)
string_4 = StringInput(" : ")
operators_2 = sortListByAnother.list + string_4
valueAtKey_7 = DesignScript.Builtin.Dictionary.ValueAtKey(dictionary=code_block_37, key=sortListByAnother.list)
string_5 = StringInput("name")
valueAtKey_8 = DesignScript.Builtin.Dictionary.ValueAtKey(dictionary=valueAtKey_7, key=string_5)
operators_3 = operators_2 + valueAtKey_8
code_block_38 = CodeBlock(listviewDisplayData=operators_3, sorted_dict_keys=sortListByAnother.list) { listviewDisplayData; sorted_dict_keys; }

code_block_39 = CodeBlock(imageDict=code_block_30.imageDict, scriptSettingsDict=code_block_30.scriptSettingsDict, amountAdaptivePoints=code_block_30.amountAdaptivePoints, configFileMeta=code_block_30.configFileMeta) { imageDict; scriptSettingsDict; amountAdaptivePoints; configFileMeta; }

# group: creating input values for selecting type objects
string_6 = StringInput("Input how much alternating objects you have (interpret blanks as objects)")
# note: description
code_block_40 = CodeBlock(uiLogo=code_block_34.LogoImage) { uiLogo; }
string_7 = StringInput("Continue")
code_block_41 = CodeBlock { "# alternating objects"; "2"; false; }
textbox_data = Custom[TextBox Data](InputName=code_block_41.out0, DefaultText=code_block_41.out1, IsNumberEntry=code_block_41.out2)  # package Data-Shapes; Create Data for TextBox input in UI.MultipleInputForm ++ . Check out www.data-shapes.net for more informations
list_create_2 = List.Create(item0=textbox_data)
inputgroup_data_2 = Custom[InputGroup Data](GroupTitle=string_6, Inputs=list_create_2)
boolean_2 = BoolSelector(true)
code_block_42 = CodeBlock { "Cancel"; 1000; 500; }
code_block_43 = CodeBlock(Descritpion=string_6, logo=code_block_40, ButtonText=string_7, inputs=inputgroup_data_2, objectHasData=boolean_2, cancelButtonText=code_block_42.out0, maxHeight=code_block_42.out1, uiWidth=code_block_42.out2) { Descritpion; logo; ButtonText; inputs; objectHasData; cancelButtonText; maxHeight; uiWidth; }

# group: User selects
# note: User selects which objects to place
multipleinputform_2 = Custom[MultipleInputForm ++](Description_optional=code_block_43.Descritpion, Logo_optional=code_block_43.logo, ButtonText_optional=code_block_43.ButtonText, Inputs=code_block_43.inputs, Toggle=code_block_43.objectHasData, CancelButtonText_optional=code_block_43.cancelButtonText, MaxHeight_optional=code_block_43.maxHeight, Width_optional=code_block_43.uiWidth)
code_block_44 = CodeBlock { null; }
if_ = If(test=multipleinputform_2.Was_Cancelled, true=code_block_44, false=multipleinputform_2.User_Inputs)
code_block_45 = CodeBlock(intervalFreq=if_) { intervalFreq; }

# group: Filtering scritpDataDict based on selected items
# note: description
code_block_46 = CodeBlock(scriptDataDict=code_block_39.scriptSettingsDict) { scriptDataDict[scriptDataDict.Keys]; scriptDataDict.Keys; }
flatten = List.Flatten(list=code_block_46.out1)
string_8 = StringInput(" : ")
operators_4 = flatten + string_8
string_9 = StringInput("name")
designscriptbuiltin = DesignScript.Builtin.Dictionary.ValueAtKey(dictionary=code_block_46.out0, key=string_9)
operators_5 = operators_4 + designscriptbuiltin
code_block_47 = CodeBlock(selectedObjectDicts=code_block_46.out0, selectedObjectTypeNames=operators_5) { selectedObjectDicts; selectedObjectTypeNames; }

# group: Filter families in project based on search query of config_file
code_block_48 = CodeBlock { "filters targetlist based on string: "; "'|' is used to define 'or'"; "',' is used to define 'and'"; }
# note: filter Family object items based on string
string_10 = StringInput("fam_search")
designscriptbuiltin_2 = DesignScript.Builtin.Dictionary.ValueAtKey(dictionary=code_block_47.selectedObjectDicts, key=string_10)
element_types = ElementTypes("Family")
all_elements_of_type = ElementsOfType(element_type=element_types)
name = Element.Name(element=all_elements_of_type)
boolean_3 = BoolSelector(true)
code_block_49 = CodeBlock(filters=designscriptbuiltin_2, targetList=name, ignoreCase=boolean_3) { filters; targetList; ignoreCase; }
filterbystring = Custom[List.Filterbystring](TargetList=code_block_49.targetList, Filterlist=code_block_49.filters, ignorCase=code_block_49.ignoreCase)  # package ROCO Dyf Packages; Filters targetlist based on string: | is used to define 'or' , is used to define 'and'
code_block_50 = CodeBlock { "match"; }
valueAtKey_9 = DesignScript.Builtin.Dictionary.ValueAtKey(dictionary=filterbystring, key=code_block_50)
familySelectionUIData_FromName = Custom[FamilySelectionUIData_FromName](familyName=valueAtKey_9)  # package ROCO Dyf Packages; Creates family ui data from Family Names

# group: creating input values for selecting type objects
code_block_51 = CodeBlock(UIobject=code_block_36.UIobject, stringLength=code_block_36.stringLength, civilApplication=code_block_36.civilApplication, Separator=code_block_36.Separator) { UIobject; chars=stringLength; Math.Max(500, Math.Round(200*chars/25 + 0.5*chars)); civilApplication; Separator; }
code_block_52 = CodeBlock { 1; }
code_block_53 = CodeBlock(listviewDisplayData=code_block_38.listviewDisplayData, sorted_dict_keys=code_block_38.sorted_dict_keys, referenceImage=code_block_34.referenceImageObject, uiLogo=code_block_34.LogoImage, scriptSettingsDict=code_block_39.scriptSettingsDict, frequency=code_block_45, filteredFamilyStr=familySelectionUIData_FromName.inputFamilyTypeString, filteredFamilyObj=familySelectionUIData_FromName.familyTypes)
# ---------- code_block_53.designscript (8 lines) ----------
listviewDisplayData;
sorted_dict_keys;
referenceImage;
uiLogo;
scriptSettingsDict;
String.ToNumber(frequency);
filteredFamilyStr;
filteredFamilyObj;
# ----------------------------------------
# note: description
range = Range(start=code_block_52, end=code_block_53.out5, step=code_block_52)
code_block_54 = CodeBlock(x=range, z=code_block_53.scriptSettingsDict, frequency=code_block_53.out5, filteredFamilieStr=code_block_53.filteredFamilyStr, filteredFamilieObj=code_block_53.filteredFamilyObj)
# ---------- code_block_54.designscript (9 lines) ----------
y=List.Flatten(x)+"";
ScriptSettingsList=List.Flatten(List.OfRepeatedItem(z[z.Keys],frequency),2);
ScriptSettingsDict=Dictionary.ByKeysValues(y,ScriptSettingsList);
y+": "+ScriptSettingsList["name"];
familyTypeStrList=List.Flatten(List.OfRepeatedItem(filteredFamilieStr,frequency),2);
familyTypeObjList=List.Flatten(List.OfRepeatedItem(filteredFamilieObj,frequency),2);
"Blanco";
chars=List.MaximumItem(String.Length(List.Flatten(familyTypeStrList)));
Math.Max(500, Math.Round(200*chars/25 + 0.5*chars));
# ----------------------------------------
code_block_55 = CodeBlock(civilApplication=code_block_51.civilApplication, Separator=code_block_51.Separator, groupNames=code_block_54.out3) { civilApplication; Separator; groupNames; }
string_11 = StringInput("Input which objects you want to place, and enter the frequency.")
string_12 = StringInput("Continue")
string_13 = StringInput("Instructions")
string_14 = StringInput("""Select for each array object the type, frequency and host object.
make sure the selected FLPoint are on the same corridor. If the alternation happens with a blank, instead of a family type, select "blanco".""")
textnote_data_3 = Custom[TextNote Data](Title=string_13, TextNote=string_14)
code_block_56 = CodeBlock { "Select Family + Type"; "Repetition"; "1"; false; 0; }
textbox_data_2 = Custom[TextBox Data](InputName=code_block_56.out1, DefaultText=code_block_56.out2, IsNumberEntry=code_block_56.out3)
addItemToFront = List.AddItemToFront(item=code_block_54.out6, list=code_block_54.familyTypeStrList, lacing=CrossProduct)
addItemToFront_2 = List.AddItemToFront(item=code_block_54.out6, list=code_block_54.familyTypeObjList, lacing=CrossProduct)
dropdown_data_2 = Custom[DropDown Data](InputName=code_block_56.out0, Keys=addItemToFront, Values=addItemToFront_2, DefaultValueIndex=code_block_56.out4)
addItemToEnd = List.AddItemToEnd(item=textbox_data_2, list=dropdown_data_2, lacing=CrossProduct)
addItemToEnd_2 = List.AddItemToEnd(item=code_block_51.UIobject, list=addItemToEnd, lacing=CrossProduct)
inputgroup_data_3 = Custom[InputGroup Data](GroupTitle=code_block_54.out3, Inputs=addItemToEnd_2)
boolean_4 = BoolSelector(true)
code_block_57 = CodeBlock { "Cancel"; 1000; }
max = Math.Max(value1=code_block_54.out8, value2=code_block_51.out2)

code_block_58 = CodeBlock(referenceImage=code_block_34.referenceImageObject, groupNames=code_block_55.groupNames, Logo=code_block_34.LogoImage, civilApplication=code_block_55.civilApplication) { referenceImage; groupNames; Logo; civilApplication; }
addItemToFront_3 = List.AddItemToFront(item=textnote_data_3, list=inputgroup_data_3)

# group (continued): creating input values for selecting type objects
code_block_59 = CodeBlock(Descritpion=string_11, logo=code_block_53.uiLogo, ButtonText=string_12, inputs=addItemToFront_3, objectHasData=boolean_4, cancelButtonText=code_block_57.out0, maxHeight=code_block_57.out1, uiWidth=max, scriptSettingsDict=code_block_54.ScriptSettingsDict) { Descritpion; logo; ButtonText; inputs; objectHasData; cancelButtonText; maxHeight; uiWidth; scriptSettingsDict; }

# group: User selects Family types, frequency, and C3D host
# note: User selects which objects to place
multipleinputform_3 = Custom[MultipleInputForm ++](Description_optional=code_block_59.Descritpion, Logo_optional=code_block_59.logo, ButtonText_optional=code_block_59.ButtonText, Inputs=code_block_59.inputs, Toggle=code_block_59.objectHasData, CancelButtonText_optional=code_block_59.cancelButtonText, MaxHeight_optional=code_block_59.maxHeight, Width_optional=code_block_59.uiWidth)
code_block_60 = CodeBlock { null; }
if_2 = If(test=multipleinputform_3.Was_Cancelled, true=code_block_60, false=multipleinputform_3.User_Inputs)
code_block_61 = CodeBlock(selectedItems=if_2) { List.Chop(List.Flatten(selectedItems),3); }

# group: Create FLPointPairs
code_block_62 = CodeBlock(groupNames=code_block_58.groupNames, selectedFamilyTypesAndCivilData=code_block_61, stringSeperator=code_block_55.Separator, referenceImage=code_block_58.referenceImage, Logo=code_block_58.Logo, civilApplication=code_block_58.civilApplication, scriptSettingsDict=code_block_59.scriptSettingsDict)
# ---------- code_block_62.designscript (7 lines) ----------
groupNames;
selectedFamilyTypesAndCivilData;
stringSeperator;
referenceImage;
Logo;
civilApplication;
scriptSettingsDict;
# ----------------------------------------
code_block_63 = CodeBlock(CAPP=code_block_62.civilApplication, x=code_block_62.selectedFamilyTypesAndCivilData, Separator=code_block_62.stringSeperator)
# ---------- code_block_63.designscript (11 lines) ----------
CAPP;
familyTypes=List.Transpose(x)[0];
blank = familyTypes!="Blanco";
frequency=String.ToNumber(List.Transpose(x)[1]);
List.OfRepeatedItem(0,List.Count(familyTypes));
civilDataStr=List.Transpose(String.Split(List.Transpose(x)[2],Separator));
civilDoc=CAPP.GetDocumentByName(civilDataStr[0]);
civilCor=civilDoc.GetCorridorByName(civilDataStr[1]);
civilBL=Corridor.Baselines(civilCor);
civilFLP=List.Flatten(Baseline.GetFeaturelinePointsByCode(civilBL,civilDataStr[2]),2);
civilStations=FeaturelinePoint.Station(civilFLP);
# ----------------------------------------
count_2 = List.Count(list=code_block_63.civilFLP, lacing=Longest)
code_block_64 = CodeBlock(frequency=code_block_63.frequency, length=count_2) { frequency; length; }
calculate_sequence_of_index = Python(IN[0]=code_block_64.frequency, IN[1]=code_block_64.length)  # "calculate sequence of index: Python Script"
# ---------- calculate_sequence_of_index.python (49 lines) ----------
# Load the Python Standard and DesignScript Libraries
import sys
import clr
clr.AddReference('ProtoGeometry')
from Autodesk.DesignScript.Geometry import *

# The inputs to this node will be stored as a list in the IN variables.
freq, endIndex = IN
i=0
j=0
n=0
itemIndex=int()
arrayLength=0
outList=[]
sequence=[]

# Place your code below this line
def sumList(l):
	sum=0
	for x in l:
		sum+=x
	return sum

arrayLength= sumList(freq)

while i< len(freq):
	sequence.Clear()
	f=freq[i]
	interval = arrayLength - f+1
	startIndex= sumList(freq[:i])
	j=0
	itemIndex=0
	while j<endIndex[i]-1:
		
		itemIndex = startIndex + j*interval
		if j>0:
			itemIndex+=f*j-j
		n=0
		while n<f:
			if itemIndex<endIndex[i]-1:
				sequence.append(itemIndex)
			itemIndex+=1
			n+=1
		j+=1
	outList.append(list(sequence))
	i+=1

# Assign your output to the OUT variable.
OUT = outList
# ----------------------------------------
code_block_65 = CodeBlock(x=calculate_sequence_of_index, civilFLPoints=code_block_63.civilFLP) { x; x+1; civilFLPoints; }
getItemAtIndex_2 = List.GetItemAtIndex(list=code_block_65.civilFLPoints, index=code_block_65.x, lacing=Longest)
count_3 = List.Count(list=getItemAtIndex_2, lacing=Longest)
getItemAtIndex_3 = List.GetItemAtIndex(list=code_block_65.civilFLPoints, index=code_block_65.out1, lacing=Longest)
addItemToEnd_3 = List.AddItemToEnd(item=getItemAtIndex_3, list=getItemAtIndex_2, lacing=Longest)
code_block_66 = CodeBlock(x=count_3, n=addItemToEnd_3) { x; List.Chop(x,1); x*2; List.Flatten(n); }
chop = List.Chop(list=code_block_66.out3, lengths=code_block_66.out2)
chop_2 = List.Chop(list=chop, lengths=code_block_66.out1, lacing=Longest)
transpose = List.Transpose(lists=chop_2, lacing=Longest)
code_block_67 = CodeBlock(FLP=transpose, familyType=code_block_63.familyTypes, civilDataStr=code_block_63.civilDataStr, mask=code_block_63.blank, Startpoints=getItemAtIndex_2, groupNames=code_block_62.groupNames, scriptSettings=code_block_62.scriptSettingsDict)
# ---------- code_block_67.designscript (13 lines) ----------
FLP;
familyType;
civilDataStr;
mask;
stations=List.FilterByBoolMask(Startpoints,mask)["in"].Station;
FLPs=List.FilterByBoolMask(FLP,mask)["in"];
FTList=List.FilterByBoolMask(familyType, mask)["in"];
civilDocName=List.FilterByBoolMask(civilDataStr[0],mask)["in"];
civilCorName=List.FilterByBoolMask(civilDataStr[1],mask)["in"];
civilFPLCode=List.FilterByBoolMask(civilDataStr[2],mask)["in"];
groupNames;
scriptSettings;
positions=FeaturelinePoint.Position(FLPs);
# ----------------------------------------

# group: splitting table data and filtering out obsolete items
code_block_68 = CodeBlock(objectNames=code_block_67.groupNames, familyTypes=code_block_67.FTList, civilDocumentName=code_block_67.civilDocName, corridorName=code_block_67.civilCorName, FlpointCode=code_block_67.civilFPLCode, positions=code_block_67.positions, scriptSettings=code_block_67.scriptSettings, configfileMeta=code_block_39.configFileMeta)  # unwired: filteredTableContent, objectTypes
# ---------- code_block_68.designscript (10 lines) ----------
filteredTableContent;
objectTypes;
objectNames;
familyTypes;
civilDocumentName;
corridorName;
FlpointCode;
positions;
scriptSettings;
configfileMeta;
# ----------------------------------------

# group: Obtaining type ID's to filter settings dictionary
# note: description
code_block_69 = CodeBlock(objectNames=code_block_68.objectNames) { objectNames; }
string_15 = StringInput(": ")
split_2 = String.Split(str=code_block_69, separator0=string_15)
code_block_70 = CodeBlock { 0; }
getItemAtIndex_4 = List.GetItemAtIndex(index=code_block_70)  # unwired: list
map = List.Map(list=split_2, f_x=getItemAtIndex_4)
code_block_71 = CodeBlock(selectedObjectKeys=map) { selectedObjectKeys; }

# group: Creating reference info dict for objects
# note: description
code_block_72 = CodeBlock(civilDocumentName=code_block_68.civilDocumentName, corridorName=code_block_68.corridorName, flPointCode=code_block_68.FlpointCode) { civilDocumentName; corridorName; flPointCode; }
C3DMeta_CorridorFLPoints = Custom[C3DMeta_CorridorFLPoints](civilDocumentName=code_block_72.civilDocumentName, corridorName=code_block_72.corridorName, flPointCode=code_block_72.flPointCode)  # package ROCO Dyf Packages; create metadata script for corridorflPoint scripts
code_block_73 = CodeBlock(c3dInfoDict=C3DMeta_CorridorFLPoints) { c3dInfoDict; }

# group: creating diverse dicts to continue script
# note: description
code_block_74 = CodeBlock(settingsDict=code_block_68.scriptSettings, selectedObjectKeys=code_block_71, c3dInfo=code_block_73) { settingsDict; selectedObjectKeys; c3dInfo; }
flatten_2 = List.Flatten(list=code_block_74.selectedObjectKeys)
designscriptbuiltin_3 = DesignScript.Builtin.Dictionary.ValueAtKey(dictionary=code_block_74.settingsDict, key=flatten_2)
byKeysValues = DesignScript.Builtin.Dictionary.ByKeysValues(keys=flatten_2, values=designscriptbuiltin_3)
string_16 = StringInput("defaultParameters")
designscriptbuiltin_4 = DesignScript.Builtin.Dictionary.ValueAtKey(dictionary=designscriptbuiltin_3, key=string_16)
string_17 = StringInput(" : ")
operators_6 = flatten_2 + string_17
string_18 = StringInput("name")
designscriptbuiltin_5 = DesignScript.Builtin.Dictionary.ValueAtKey(dictionary=designscriptbuiltin_3, key=string_18)
operators_7 = operators_6 + designscriptbuiltin_5
string_19 = StringInput("numberParams")
designscriptbuiltin_list_of = DesignScript.Builtin.Dictionary.ValueAtKey(dictionary=designscriptbuiltin_3, key=string_19)
string_20 = StringInput("C3D info")
setValueAtKeys = DesignScript.Builtin.Dictionary.SetValueAtKeys(dictionary=designscriptbuiltin_3, keys=string_20, values=code_block_74.c3dInfo, lacing=Longest)
code_block_75 = CodeBlock { ["fam_search","defaultParameters","numberParams"]; }
designscriptbuiltin_prepare_dict = DesignScript.Builtin.Dictionary.RemoveKeys(dictionary=setValueAtKeys, keys=code_block_75)
code_block_76 = CodeBlock(defaultParameterList=designscriptbuiltin_4, selectedItemNames=operators_7, numberParameterNames=designscriptbuiltin_list_of, scriptSettings=designscriptbuiltin_prepare_dict) { defaultParameterList; selectedItemNames; numberParameterNames; scriptSettings; }

# group: Creating adaptive components
# note: description
code_block_77 = CodeBlock(familyTypes=code_block_68.familyTypes, pointpairLists=code_block_68.positions) { familyTypes; pointpairLists; }
code_block_78 = CodeBlock(familyTypes=code_block_77.familyTypes, pointpairLists=code_block_77.pointpairLists) { familyTypes; pointpairLists; }
byPoints = AdaptiveComponent.ByPoints(points=code_block_78.pointpairLists, familyType=code_block_78.familyTypes, lacing=Longest)

# group: format data for inputs and creating inputs for user to enter parameters
# note: description
code_block_79 = CodeBlock(referenceImage=code_block_34.referenceImageObject, Logo=code_block_58.Logo, defaultParameterLists=code_block_76.defaultParameterList, selectedGroupNames=code_block_76.selectedItemNames) { referenceImage; Logo; defaultParameterLists; selectedGroupNames; }
code_block_80 = CodeBlock { "Continue"; 1000; 850; "Cancel"; }
string_21 = StringInput("Instructions:")
string_22 = StringInput("For the object types: enter the start index of de objects")
textnote_data_4 = Custom[TextNote Data](Title=string_21, TextNote=string_22)
code_block_81 = CodeBlock { "ROCO_CNU_OBS.Index_start"; "0.0000"; }
code_block_82 = CodeBlock(selectedObjects=code_block_79.selectedGroupNames, keys=code_block_81.out0, values=code_block_81.out1)
# ---------- code_block_82.designscript (8 lines) ----------
selectedObjects;
keys;
values;
count=List.Count(selectedObjects);
paramDict=Dictionary.ByKeysValues(keys, values);
parameterList= List.OfRepeatedItem(paramDict, count);
parameterList.Keys;
parameterList[parameterList.Keys];
# ----------------------------------------
textbox_data_3 = Custom[TextBox Data](InputName=code_block_82.out6, DefaultText=code_block_82.out7)
inputgroup_data_4 = Custom[InputGroup Data](GroupTitle=code_block_82.selectedObjects, Inputs=textbox_data_3)
code_block_83 = CodeBlock(item1=textnote_data_4, inList=inputgroup_data_4, item2=code_block_79.referenceImage) { inlist1=List.AddItemToFront(item1, inList); b=List.AddItemToFront(item2,inlist1); c=List.Flatten(b); }
boolean_5 = BoolSelector(true)
passthrough = Custom[Passthrough](passThrough=boolean_5, waitFor=code_block_83.c)  # package Clockwork for Dynamo 2.x; Forces a sequential order of execution. The node wired into the output of the Passthrough node will be executed *after* the node wired into the waitFor input (e.g. important for some Revit operations). The value of the passThrough input will be passed on to the node wired into the output port of the Passthrough node.
code_block_84 = CodeBlock(logo=code_block_79.Logo, ButtonText=code_block_80.out0, inputs=code_block_83.c, objectHasData=passthrough, cancelButtonText=code_block_80.out3, maxHeight=code_block_80.out1, uiWidth=code_block_80.out2, ParameterValueHeaderLists=code_block_82.out6) { Descritpion; logo; ButtonText; inputs; objectHasData; cancelButtonText; maxHeight; uiWidth; ParameterValueHeaderLists; }  # unwired: Descritpion

# group: User enters parameter values for each object type
multipleinputform_4 = Custom[MultipleInputForm ++](Description_optional=code_block_84.Descritpion, Logo_optional=code_block_84.logo, ButtonText_optional=code_block_84.ButtonText, Inputs=code_block_84.inputs, Toggle=code_block_84.objectHasData, CancelButtonText_optional=code_block_84.cancelButtonText, MaxHeight_optional=code_block_84.maxHeight, Width_optional=code_block_84.uiWidth)
code_block_85 = CodeBlock(inList1=multipleinputform_4.User_Inputs) { List.Chop(inList1,1); }
watch = Watch(code_block_85)

# group: creating PE id for each object (ascending, incrementing by 1)
# note: description
code_block_86 = CodeBlock(adaptiveCompontents=byPoints, parameter_dict_keys=code_block_84.ParameterValueHeaderLists, parameter_dict_values=watch) { [adaptiveCompontents]; parameter_dict_keys; parameter_dict_values; firstPointsList; }  # unwired: firstPointsList
byKeysValues_2 = DesignScript.Builtin.Dictionary.ByKeysValues(keys=code_block_86.parameter_dict_keys, values=code_block_86.parameter_dict_values, lacing=Longest)
string_23 = StringInput("ROCO_CNU_OBS.Index_start")
valueAtKey_10 = DesignScript.Builtin.Dictionary.ValueAtKey(dictionary=byKeysValues_2, key=string_23)
toNumber_2 = String.ToNumber(str=valueAtKey_10)
code_block_87 = CodeBlock { "ROCO_CNU_OBS.Index"; }
create_id_dict_from_list = Python(IN[0]=code_block_86.out0, IN[1]=toNumber_2, IN[2]=code_block_87)  # "create ID dict from list adaptive components + start offset: Python Script"
# ---------- create_id_dict_from_list.python (41 lines) ----------
# Load the Python Standard and DesignScript Libraries
import sys
import clr
clr.AddReference('ProtoGeometry')
from Autodesk.DesignScript.Geometry import *

# The inputs to this node will be stored as a list in the IN variables.
firstPointsList, idStart, key = IN

templist = []
templist1 =[]
outlist = []
i = 0
j = 0

# Place your code below this line


while i < len(firstPointsList):
    firstPoints = firstPointsList[i]
    index = idStart[i]
    templist1.Clear()
    j = 0
    while j < len(firstPoints):
    	k = 0
    	templist.Clear()
        while k < len(firstPoints[j]):
            index_str = str(index)
            index_str = index_str.split(".")[0]
            index_str = index_str.split(",")[0]
            templist.append({key: int(index_str)})
            index += 1
            k += 1
        templist1.append(list(templist))
        j += 1
    outlist.append(list(templist1))
    i += 1


# Assign your output to the OUT variable.
OUT = outlist
# ----------------------------------------
code_block_88 = CodeBlock(PE_Id_dict=create_id_dict_from_list, adaptiveComponents=code_block_86.out0) { PE_Id_dict; adaptiveComponents; }

# group: creating parameter_value dict for all type objects, including the script info
# note: description
code_block_89 = CodeBlock(parameterDict=byKeysValues_2, removeStartIDValue=string_23, c3DInfoDict=code_block_76.scriptSettings, numberParams=code_block_76.numberParameterNames, configFileMeta=code_block_68.configfileMeta) { parameterDict; removeStartIDValue; c3DInfoDict; numberParams; configFileMeta; }
removeKeys = DesignScript.Builtin.Dictionary.RemoveKeys(dictionary=code_block_89.parameterDict, keys=code_block_89.removeStartIDValue)
code_block_90 = CodeBlock { ["ROCO_CTE_Dynamo.GUID","ROCO_CTE_Dynamo.Script"]; }
generateGuid = DynamoROCO.DesignLog.GenerateGuid()
string_24 = StringInput("ConfigFileMeta")
byKeysValues_3 = DesignScript.Builtin.Dictionary.ByKeysValues(keys=string_24, values=code_block_89.configFileMeta)
string_25 = StringInput("ScriptMeta")
script_CreateMeta = Custom[Script_CreateMeta]()  # package ROCO Dyf Packages; Creates script meta data to put onto object parameters
setValueAtKeys_2 = DesignScript.Builtin.Dictionary.SetValueAtKeys(dictionary=byKeysValues_3, keys=string_25, values=script_CreateMeta)
stringifyJSON = Data.StringifyJSON(values=setValueAtKeys_2, lacing=Longest)
list_create_3 = List.Create(item0=generateGuid, item1=stringifyJSON)
setValueAtKeys_3 = DesignScript.Builtin.Dictionary.SetValueAtKeys(dictionary=removeKeys, keys=code_block_90, values=list_create_3)
string_26 = StringInput("ROCO_CTE_Reference_Source_Data")
code_block_91 = CodeBlock(C3D_Reference_Dict=code_block_89.c3DInfoDict) { C3D_Reference_Dict; }
stringifyJSON_2 = Data.StringifyJSON(values=code_block_91, lacing=Longest)
setValueAtKeys_4 = DesignScript.Builtin.Dictionary.SetValueAtKeys(dictionary=setValueAtKeys_3, keys=string_26, values=stringifyJSON_2, lacing=Longest)
code_block_92 = CodeBlock(numberParams=code_block_89.numberParams) { numberParams; }
valueAtKey_11 = DesignScript.Builtin.Dictionary.ValueAtKey(dictionary=setValueAtKeys_3, key=code_block_92)
toNumber_3 = String.ToNumber(str=valueAtKey_11)
code_block_93 = CodeBlock(in_dict=setValueAtKeys_4, keys=code_block_92, values=toNumber_3) { in_dict; keys; values; }
create_parameter_dictionary = Python(IN[0]=code_block_93.in_dict, IN[1]=code_block_93.keys, IN[2]=code_block_93.values)  # "create parameter dictionary: Python Script"
# ---------- create_parameter_dictionary.python (30 lines) ----------
# Load the Python Standard and DesignScript Libraries
import sys
import clr
clr.AddReference('ProtoGeometry')
from Autodesk.DesignScript.Geometry import *

# The inputs to this node will be stored as a list in the IN variables.
in_list, add_keys, add_values =IN

tempdict ={}
outlist=[]
templist=[]
# Place your code below this line
i=0
while i< len(in_list):
	in_dict=in_list[i]
	keylist=add_keys[i]
	valuelist=add_values[i]
	j=0
	while j< len(keylist):
		in_dict[keylist[j]]=valuelist[j]	
		j+=1
	outlist.append(in_dict)
	i+=1

	
		
	
# Assign your output to the OUT variable.
OUT = outlist
# ----------------------------------------
code_block_94 = CodeBlock(parameterDict=create_parameter_dictionary) { parameterDict; }

# group: createBaselineStationDict
code_block_95 = CodeBlock(baselineStations=code_block_67.stations) { baselineStations; }
code_block_96 = CodeBlock { "ROCO_CNU_Station"; }
count_4 = List.Count(list=code_block_95, lacing=Longest)
ofRepeatedItem = List.OfRepeatedItem(item=code_block_96, amount=count_4)
createstationdict_from_baseline = Python(IN[0]=code_block_95, IN[1]=ofRepeatedItem)  # "createStationDict from baseline stations: Python Script"
# ---------- createstationdict_from_baseline.python (28 lines) ----------
# Load the Python Standard and DesignScript Libraries
import sys
import clr
clr.AddReference('ProtoGeometry')
from Autodesk.DesignScript.Geometry import *

# The inputs to this node will be stored as a list in the IN variables.
firstItemsList, keyList = IN

templist = []
templist1 = []
outlist = []
i = 0

while i < len(firstItemsList):
    firstPoints = firstItemsList[i]
    keys = keyList[i]
    templist1.Clear()
    j = 0
    while j < len(firstPoints):
        templist1.append({keys[j]: firstPoints[i]})
        j += 1
    outlist.append(list(templist1))
    i += 1


# Assign your output to the OUT variable.
OUT = outlist
# ----------------------------------------
code_block_97 = CodeBlock(stationDict=createstationdict_from_baseline) { stationDict; }

code_block_98 = CodeBlock { 1; }

# group: compiling parameter list and setting parameters on elements
# note: description
code_block_99 = CodeBlock(adaptiveComponents=code_block_88.adaptiveComponents, pe_id_dict=code_block_88.PE_Id_dict, defaultParameterList=code_block_94, stationsDict=code_block_97) { adaptiveComponents; pe_id_dict; defaultParameterList; stationsDict; objectRotationDict; }  # unwired: objectRotationDict
flatten_3 = List.Flatten(list=code_block_99.adaptiveComponents, amt=code_block_98)
flatten_4 = List.Flatten(list=code_block_99.pe_id_dict)
flatten_5 = List.Flatten(list=code_block_99.stationsDict)

flatten_6 = List.Flatten(list=flatten_3)
flatten_7 = List.Flatten(list=code_block_99.defaultParameterList)
count_5 = List.Count(list=flatten_3, lacing=Longest)
ofRepeatedItem_2 = List.OfRepeatedItem(item=flatten_7, amount=count_5, lacing=Longest)
flatten_8 = List.Flatten(list=ofRepeatedItem_2)
dictionaryupdate = Custom[dictionaryupdate](targetDict=flatten_4, addDict=flatten_5)  # package ROCO Dyf Packages; Updates dictionary with another dict
dictionaryupdate_2 = Custom[dictionaryupdate](targetDict=flatten_8, addDict=dictionaryupdate)
setParameters = Custom[Element.SetParameters](elementInstance=flatten_6, parameterDict=dictionaryupdate_2, lacing=Longest)  # package ROCO Dyf Packages; Sets parameters based on element and parameter dict

# group (continued): compiling parameter list and setting parameters on elements
parameters_set_0_watch = Watch(setParameters)  # graph output

code_block_100 = CodeBlock()
# ---------- code_block_100.designscript (1 lines) ----------
[["Family Type: W*T_7500*1200, Family: [Pr_20_93_71_18]_TBC Concrete diaphragm wall units_ROCO_(GMA2)" ,"1","alignmentProfile.dwg | COR - MWA1-Right-2.800 - (1) | Axis_Floor_Left" ],["Blanco","2","alignmentProfile.dwg | COR - MWA1-Right-2.800 - (1) | Axis_Outer_Wall_Left"],["Blanco","1","alignmentProfile.dwg | COR - MWA1-Right-2.800 - (1) | Axis_Outer_Wall_Left"]];
# ----------------------------------------
