# Dynamo graph CC_updateObjectDimensions@CorridorFLpoints_SelectedObjects.dyn (Dynamo 2.3.0.5885)
# packages: Data-Shapes 2019.2.40, ROCO Dyf Packages 1.0.0, CivilConnection2020 4.0.4

# group: DATA MANIPULATION
# note: Data manipulation on Dynamo Objects

# group: NOT IN USE
# note: Nodes to consider part of the final graph

# group: INPUT
# note: Data input and preperation for other nodes

# group: GET
# note: Get parameter values from Revit objects

# group: DEBUG
# note: Check if the graph is working as expected

# group: Package
# note: All used nodes from a package have a prefix
# added to them with the name of the node.

# group: FUNCTION
# note: Creation of dynamo objects

# group: OUTPUT
# note: Object creation in Revit, final output

# group: SET
# note: Set parameters on Revit objects

# group: INFO
# note: GENERAL INFO
# Version: 4
# Author: Dick Elsman
# Company: Infranea | ROCO
# email: dick.elsman@infranea.com
# Dynamo Core version: 2.3.0.5885
# Dynamo Revit version: 2.3.0.6270
# Revit version: 2020.2
# note: INSTRUCTIONS
# <DESCRIPTION>
# Allows user to update element geometry based on corridor featurelinpoints by selected revit elements. Runtime is app. 5 minutes, depending of ammount of elements selected
# <INSTRUCTIONS>
# navigate to the folder to play, and press play in the Dyno Browser.
# NB! This script requires a JSON config file for it to index objects and data from sources. This/these file(s) shoudl be stored in <script directory>\config_files
# note: KNOWN ISSUES AND LIMITATIONS
# - Does not yet support adaption of multiple objects
# - Does not update position of objects, only dimensions.
# note: SCRIPT META
# Script Name: CC_updateObjectDimensions@CorridorFLpoints_SelectedObjects.dyn
# Packages used in this script:
# Data-Shapes version: 2019.2.40
# ROCO Dyf Packages version: 1.0.0
# CivilConnection2020 version: 4.0.4
# TimeStamp : 2020/2/19 14:10

string = StringInput("C:\Users\delsman\GH_Repos\THVROCO_Dynamo\002 WIP\000 Dynamo Scripts\config_files\_test@CorridorFLpoints.json")  # frozen
string_2 = StringInput("C:\Users\delsman\GH_Repos\THVROCO_Dynamo\002 WIP\000 Dynamo Scripts\config_files\update_Double_Tube_Floor_Objects@CorridorFLpoints.json")  # frozen

# group: User selects config file to run script with
dynamoROCODyfs_readConfigFileDirectory = Custom[DynamoROCODyfs_readConfigFileDirectory]()  # package ROCO Dyf Packages; Import config file names stored in workspace, output UI objects for Data-Shapes containing filenames
code_block = CodeBlock(chars=dynamoROCODyfs_readConfigFileDirectory.strLength) { chars; width = Math.Max(350, Math.Round(230*chars/25)); }
data_shapes_ui_multipleinputform = Custom[Data-Shapes_UI.MultipleInputForm ++](Description_optional=dynamoROCODyfs_readConfigFileDirectory.description, Logo_optional=dynamoROCODyfs_readConfigFileDirectory.logo, ButtonText_optional=dynamoROCODyfs_readConfigFileDirectory.buttonText, Inputs=dynamoROCODyfs_readConfigFileDirectory.UIObjects, Toggle=dynamoROCODyfs_readConfigFileDirectory.hasData, CancelButtonText_optional=dynamoROCODyfs_readConfigFileDirectory.cancelButton, Width_optional=code_block.width)  # package Data-Shapes; Create a form with multiple inputs. see www.data-shapes.net for tutorials and infos!
code_block_2 = CodeBlock(x=data_shapes_ui_multipleinputform.User_Inputs) { selectedConfigFile=x[0]; }

# group: Import JSON file for script config
code_block_3 = CodeBlock(selectedConfigFile=code_block_2) { selectedConfigFile; }
code_block_4 = CodeBlock { 0; }
getItemAtIndex = List.GetItemAtIndex(list=code_block_3, index=code_block_4)
readText = FileSystem.ReadText(file=getItemAtIndex)
parseJSON = Data.ParseJSON(json=readText)
code_block_5 = CodeBlock { "scriptDataDict"; "imageDict"; "configData"; }
valueAtKey = DesignScript.Builtin.Dictionary.ValueAtKey(dictionary=parseJSON, key=code_block_5.out1)
valueAtKey_2 = DesignScript.Builtin.Dictionary.ValueAtKey(dictionary=parseJSON, key=code_block_5.out0)
valueAtKey_3 = DesignScript.Builtin.Dictionary.ValueAtKey(dictionary=parseJSON, key=code_block_5.out2)
code_block_6 = CodeBlock { "#adaptivePoints"; }
valueAtKey_4 = DesignScript.Builtin.Dictionary.ValueAtKey(dictionary=valueAtKey_3, key=code_block_6)
code_block_7 = CodeBlock(imageDict=valueAtKey, scriptSettingsDict=valueAtKey_2, amountAdaptivePoints=valueAtKey_4, configFileMeta=valueAtKey_3) { imageDict; scriptSettingsDict; amountAdaptivePoints; configFileMeta; }
dynamoROCODyfs_imageObjectsFromConfig = Custom[DynamoROCODyfs_imageObjectsFromConfig](jsonData=code_block_7.imageDict)  # package ROCO Dyf Packages; Create ui objects from configuration file

# group: User selects model elements to modify or script selects selected items
boolean = BoolSelector(true)
getCurrentElementSelection = Custom[getCurrentElementSelection](toggle=boolean)  # package ROCO Dyf Packages; Get current selected elements from Revit document
code_block_8 = CodeBlock(x=getCurrentElementSelection) { y=List.Flatten(x); List.IsEmpty(y); }
code_block_9 = CodeBlock { "Select elements"; "Instructions"; }
code_block_10 = CodeBlock(logo=dynamoROCODyfs_imageObjectsFromConfig.LogoUIObject) { logo; }
code_block_11 = CodeBlock()
# ---------- code_block_11.designscript (3 lines) ----------
"select which elements you want to change in dimension.
NB: This script is only tested to modify one type of family per corridor a time!!
Only select objects from the same dynamo run and type (i.e: only elements of 'floor' from dynamo run X";
# ----------------------------------------
data_shapes_ui_textnote_data = Custom[Data-Shapes_UI.TextNote Data](Title=code_block_9.out1, TextNote=code_block_11)  # package Data-Shapes; Create Data for TextNote input in UI.MultipleInputForm ++ . Check out www.data-shapes.net for more informations
code_block_12 = CodeBlock { "Select model elements"; }
data_shapes_ui = Custom[Data-Shapes_UI.SelectModelElements Data](InputName=code_block_12, ButtonText=code_block_12)  # package Data-Shapes; Creates a Revit element selection input for UI.MultipleInputForm++ . Check out www.data-shapes.net for more infos!
code_block_13 = CodeBlock(x=data_shapes_ui_textnote_data, y=data_shapes_ui, toggle=code_block_8.out1) { uiData=[x,y]; toggle; "Continue"; "Cancel"; }
data_shapes_ui_multipleinputform_2 = Custom[Data-Shapes_UI.MultipleInputForm ++](Description_optional=code_block_9.out0, Logo_optional=code_block_10, ButtonText_optional=code_block_13.out2, Inputs=code_block_13.uiData, Toggle=code_block_13.toggle, CancelButtonText_optional=code_block_13.out3)
code_block_14 = CodeBlock(selectedElements=data_shapes_ui_multipleinputform_2.User_Inputs) { List.Flatten(selectedElements[0]); }
code_block_15 = CodeBlock(test=code_block_8.out1, True=code_block_14, False=code_block_8.y) { test; True; False; }
python_script = Python(IN[0]=code_block_15.test, IN[1]=code_block_15.True, IN[2]=code_block_15.False)
# ---------- python_script.python (15 lines) ----------
# Load the Python Standard and DesignScript Libraries
import sys
import clr
clr.AddReference('ProtoGeometry')
from Autodesk.DesignScript.Geometry import *

# The inputs to this node will be stored as a list in the IN variables.
dataEnteringNode = IN

# Place your code below this line

if IN[0]:
	OUT = IN[1]
else:
	OUT = IN[2]
# ----------------------------------------

# group: getCivilReferenceData from elements
code_block_16 = CodeBlock(selectedElements=python_script) { selectedElements; }
code_block_17 = CodeBlock { "ROCO_CTE_Reference_Source_Data"; "ROCO_CNU_Station"; }
getParameterValueByName = Element.GetParameterValueByName(element=code_block_16, parameterName=code_block_17.out0)
uniqueItems = List.UniqueItems(list=getParameterValueByName)
parseJSON_2 = Data.ParseJSON(json=uniqueItems)
code_block_18 = CodeBlock(x=parseJSON_2) { x["name"]; x["C3D info"]["ObjectDOB"]; c3dReference = x["C3D info"]["Reference"]; }
getParameterValueByName_2 = Element.GetParameterValueByName(element=code_block_16, parameterName=code_block_17.out1)
string_from_object = FromObject(obj=getParameterValueByName_2)
byKeysValues = DesignScript.Builtin.Dictionary.ByKeysValues(keys=string_from_object, values=code_block_16)
code_block_19 = CodeBlock(objectName=code_block_18.out0, objectDOB=code_block_18.out1, C3DReference=code_block_18.c3dReference, elementDict=byKeysValues) { objectName; objectDOB; C3DReference; elementDict; }

# group: createCivil3D_ORIGIN_Dict
civilApplication = CivilConnection.CivilApplication.CivilApplication()
code_block_20 = CodeBlock(c3dReference=code_block_19.C3DReference) { c3dReference; }
code_block_21 = CodeBlock(x=code_block_20) { x["docName"]; x["corName"]; x["FLpCode"]; }
code_block_22 = CodeBlock(civilApplication=civilApplication, docName=code_block_21.out0, corName=code_block_21.out1, FLpCode=code_block_21.out2)
# ---------- code_block_22.designscript (9 lines) ----------
civilApplication;
civilDoc= CivilApplication.GetDocumentByName(civilApplication,docName);
corridor= CivilDocument.GetCorridorByName(civilDoc,corName);
baseLines= corridor.Baselines;
blRegions=Baseline.GetBaselineRegions(baseLines);
blStations=BaselineRegion.Stations(blRegions);
flPoints= Baseline.GetFeaturelinePointsByCode(baseLines, FLpCode);
flPointStations= FeatureLinePoint.Station(flPoints);
pointPair= PointPair.ByFeaturelinePoints(flPoints);
# ----------------------------------------
string_from_object_2 = FromObject(obj=code_block_22.blStations)
flatten = List.Flatten(list=string_from_object_2)
flatten_2 = List.Flatten(list=code_block_22.pointPair)
byKeysValues_2 = DesignScript.Builtin.Dictionary.ByKeysValues(keys=flatten, values=flatten_2)
code_block_23 = CodeBlock(x=byKeysValues_2)
# ---------- code_block_23.designscript (4 lines) ----------
ptpair=x[x.Keys];
ptpairFirst=Dictionary.ByKeysValues(x.Keys, ptpair.First);
ptpairLast=Dictionary.ByKeysValues(x.Keys, ptpair.Last);
{"First":ptpairFirst,"Last":ptpairLast};
# ----------------------------------------
code_block_24 = CodeBlock(corridor=code_block_22.corridor, x=code_block_23.out3, baseline=code_block_22.baseLines, blineStations=code_block_22.blStations) { corridor; pointpairDict= {"ORIGIN":x}; baseline; blineStations; }

# group: create selection objects for selecting dimensions
code_block_25 = CodeBlock(logoUI=dynamoROCODyfs_imageObjectsFromConfig.LogoUIObject, referenceImage=dynamoROCODyfs_imageObjectsFromConfig.ReferenceImageUIObject, x=code_block_7.scriptSettingsDict, elementReferenceDict=code_block_19.C3DReference, ObjectDOB=code_block_19.objectDOB, corridor=code_block_24.corridor)
# ---------- code_block_25.designscript (9 lines) ----------
logoUI;
referenceImage;
x;
x.Keys;
x[x.Keys]["name"];
x[x.Keys]["Selection"];
elementReferenceDict;
ObjectDOB;
corridor;
# ----------------------------------------
code_block_26 = CodeBlock(x=code_block_25.out5, selectionDict=code_block_25.out5, corridors=code_block_25.corridor)
# ---------- code_block_26.designscript (6 lines) ----------
x.Keys;
sortedKeys=List.Sort(x.Keys);
selection= selectionDict[sortedKeys];
"{"+sortedKeys+":"+selection+"}";
corridor=Corridor.GetCodes(corridors);
null;
# ----------------------------------------
count = List.Count(list=code_block_26.out3, lacing=Longest)
code_block_27 = CodeBlock(itemKeys=code_block_26.sortedKeys, listSegments=count) { itemKeys; listSegments; }
general_description_code_block = CodeBlock(x=code_block_25.elementReferenceDict, ObjectDOB=code_block_25.ObjectDOB)
# ---------- general_description_code_block.designscript (8 lines) ----------
"General";
"Updating geometry for objects hosted from:
C3D document= "+x["docName"]+";
Corridor= "+x["corName"]+";
Host FLpCode= "+x["FLpCode"]+";
Object date of birth= "+ ObjectDOB;
"Instructions:";
"Select FLPoints from host corridor to determine dimensions of object";
# ----------------------------------------
data_shapes_ui_textnote_data_2 = Custom[Data-Shapes_UI.TextNote Data](Title=general_description_code_block.out0, TextNote=general_description_code_block.out1)
data_shapes_ui_textnote_data_3 = Custom[Data-Shapes_UI.TextNote Data](Title=general_description_code_block.out2, TextNote=general_description_code_block.out3)
code_block_28 = CodeBlock(y=code_block_25.referenceImage, x=data_shapes_ui_textnote_data_2, p=data_shapes_ui_textnote_data_3) { z=[y,x[0],p]; }
data_shapes_selection_flpoints = Custom[Data-Shapes_Selection flpoints: UI.DropDown Data](InputName=code_block_26.out3, Keys=code_block_26.corridor, Values=code_block_26.corridor, DefaultValueIndex=code_block_26.out5, lacing=Longest)  # package Data-Shapes; Create data for DropDown input in UI.MultiInputForm ++ . Check out www.data-shapes.net for more infos.
data_shapes_ui_inputgroup_data = Custom[Data-Shapes_UI.InputGroup Data](GroupTitle=code_block_25.out4, Inputs=data_shapes_selection_flpoints)  # package Data-Shapes; Creates a group of inputs for UI.MultipleInputForm ++ . Check out www.data-shapes.net for more infos !
code_block_29 = CodeBlock(x=code_block_28, y=data_shapes_ui_inputgroup_data) { z=[List.Flatten([x,y])]; }
code_block_30 = CodeBlock(uiData=code_block_29, logo=code_block_25.logoUI) { uiData; true; logo; "Continue"; "Cancel"; 1000; 1000; }

# group: User selects C3D FLPointCodes
code_block_31 = CodeBlock(itemKeys=code_block_27.itemKeys, listSegments=code_block_27.listSegments) { itemKeys; listSegments; }
data_shapes_ui_multipleinputform_3 = Custom[Data-Shapes_UI.MultipleInputForm ++](Logo_optional=code_block_30.logo, ButtonText_optional=code_block_30.out3, Inputs=code_block_30.uiData, Toggle=code_block_30.out1, CancelButtonText_optional=code_block_30.out4, MaxHeight_optional=code_block_30.out5, Width_optional=code_block_30.out6)
code_block_32 = CodeBlock(x=data_shapes_ui_multipleinputform_3.User_Inputs, listSegments=code_block_31.listSegments) { inList=x[0]; List.Count(inList); lists=List.Chop(inList,listSegments); }
byKeysValues_3 = DesignScript.Builtin.Dictionary.ByKeysValues(keys=code_block_31.itemKeys, values=code_block_32.lists, lacing=Longest)
code_block_33 = CodeBlock(flPCodes=byKeysValues_3, listSegments=code_block_31.listSegments) { flPCodes; listSegments; }

# group: create sorted dictionary by selected featurelinepoints
code_block_34 = CodeBlock(x=code_block_33.flPCodes, baseLines=code_block_24.baseline, listSegments=code_block_33.listSegments, pointPairDict=code_block_24.pointpairDict, scriptSettingsDict=code_block_7.scriptSettingsDict)
# ---------- code_block_34.designscript (14 lines) ----------
itemKeys=x.Keys;
flPointCodes= x[x.Keys];
baseLines;
listSegments;
baselineList=List.Chop(List.Flatten(List.OfRepeatedItem(baseLines,listSegments))
,listSegments);
flPoints=Baseline.GetFeaturelinePointsByCode(baselineList, flPointCodes);
//flPoints=Baseline.GetFeaturelinesByCodeStation(baselineList, flPointCodes, stationList);
flPointStations= FeatureLinePoint.Station(flPoints);
pointPair= PointPair.ByFeaturelinePoints(flPoints);
pointPairDict;
scriptSettingsDict;
selectionGroups=scriptSettingsDict.Keys;
blineStations=BaselineRegion.Stations(Baseline.GetBaselineRegions(baselineList));
# ----------------------------------------
string_from_object_3 = FromObject(obj=code_block_34.blineStations)
byKeysValues_4 = DesignScript.Builtin.Dictionary.ByKeysValues(keys=string_from_object_3@L2, values=code_block_34.pointPair@L2, lacing=Longest)
code_block_35 = CodeBlock(x=byKeysValues_4) { x.Keys; ptpair=x[x.Keys]; ptpairFirst=ptpair.First; ptpairLast=ptpair.Last; "First"; "Last"; }
byKeysValues_5 = DesignScript.Builtin.Dictionary.ByKeysValues(keys=code_block_35.out0, values=code_block_35.ptpairFirst, lacing=Longest)
byKeysValues_6 = DesignScript.Builtin.Dictionary.ByKeysValues(keys=code_block_35.out4, values=byKeysValues_5, lacing=Longest)
byKeysValues_7 = DesignScript.Builtin.Dictionary.ByKeysValues(keys=code_block_35.out0, values=code_block_35.ptpairLast, lacing=Longest)
setValueAtKeys = DesignScript.Builtin.Dictionary.SetValueAtKeys(dictionary=byKeysValues_6, keys=code_block_35.out5, values=byKeysValues_7, lacing=Longest)
code_block_36 = CodeBlock(x=setValueAtKeys, y=code_block_34.listSegments, pointPairDict=code_block_34.pointPairDict, itemKeys=code_block_34.itemKeys) { z=List.Chop(x,y); pointPairDict; itemKeys; }
setValueAtKeys_2 = DesignScript.Builtin.Dictionary.SetValueAtKeys(dictionary=code_block_36.pointPairDict, keys=code_block_36.itemKeys, values=code_block_36.z, lacing=Longest)
byKeysValues_8 = DesignScript.Builtin.Dictionary.ByKeysValues(keys=code_block_34.selectionGroups, values=setValueAtKeys_2)

code_block_37 = CodeBlock(elementDict=code_block_19.elementDict, flpStations=code_block_35.out0, logo=dynamoROCODyfs_imageObjectsFromConfig.LogoUIObject) { elementDict; flpStations; logo; }
code_block_38 = CodeBlock(x=code_block_37.elementDict) { x.Keys; }
code_block_39 = CodeBlock(flpStations=code_block_37.flpStations, elementStations=code_block_38) { List.Sort(List.UniqueItems(List.Flatten(flpStations))); List.Sort(elementStations); }
setIntersection = List.SetIntersection(list1=code_block_39.out0, list2=code_block_39.out1)
string_3 = StringInput("Not all stations of elements are found on corridor.")
string_4 = StringInput("Instructions")
string_5 = StringInput("""Modify the table below to match the correct stations in the featureline point list. 
--------
1) Allign the stations in the first column to the correct stations in the second column. 
2) Next, check if the values in the third column are the correct values. 
3) Then press continue""")
data_shapes_ui_textnote_data_4 = Custom[Data-Shapes_UI.TextNote Data](Title=string_4, TextNote=string_5)
dif_flpoints_list_setdifference = List.SetDifference(list1=code_block_39.out1, list2=code_block_39.out0)
code_block_40 = CodeBlock(y=dif_flpoints_list_setdifference) { x=["element stations","Difference:",y]; p=List.Flatten(x); }
dif_flpoints_list_setdifference_2 = List.SetDifference(list1=code_block_39.out0, list2=code_block_39.out1)
code_block_41 = CodeBlock(y=dif_flpoints_list_setdifference_2) { x=["flPoint stations","Difference:",y]; p=List.Flatten(x); }
code_block_42 = CodeBlock(y=dif_flpoints_list_setdifference_2) { List.Flatten(["use station:","target value",y]); }
code_block_43 = CodeBlock(x=code_block_40.p, y=code_block_41.p, z=code_block_42) { [x,y,z]; }
code_block_44 = CodeBlock(x=code_block_43) { List.Transpose(x); }
code_block_45 = CodeBlock { true; }
data_shapes_ui_datatable_input = Custom[Data-Shapes_UI.DataTable input](Data=code_block_44, FirstRowIsTitles=code_block_45)  # package Data-Shapes; Create a DataTable view input for UI.MultipleInputForm ++
code_block_46 = CodeBlock(x=data_shapes_ui_textnote_data_4, y=data_shapes_ui_datatable_input) { [x,y]; }
code_block_47 = CodeBlock(x=dif_flpoints_list_setdifference_2) { List.Count(x); }
code_block_48 = CodeBlock(x=code_block_47) { x>0; }
code_block_49 = CodeBlock { 750; }

# group: User decides which stations to use
data_shapes_ui_multipleinputform_4 = Custom[Data-Shapes_UI.MultipleInputForm ++](Description_optional=string_3, Inputs=code_block_46, Toggle=code_block_48, MaxHeight_optional=code_block_49, Width_optional=code_block_49)
code_block_50 = CodeBlock(x=data_shapes_ui_multipleinputform_4.User_Inputs)
# ---------- code_block_50.designscript (5 lines) ----------
z=x[0];
y=List.Transpose(List.RemoveItemAtIndex(z,[0,1]));
elementKeys=y[0];
targetKeys=y[2];
String.Length(elementKeys)>0;
# ----------------------------------------

# group: create dict to replace element keys
code_block_51 = CodeBlock(elementKeys=code_block_50.elementKeys, targetValues=code_block_50.targetKeys, elementKeyExists=code_block_50.out4) { elementKeys; targetValues; elementKeyExists; }
isNull = Object.IsNull(obj=code_block_51.elementKeyExists)
code_block_52 = CodeBlock { "n/a"; }
if_ = If(test=isNull, true=code_block_52, false=code_block_51.elementKeys)
if_2 = If(test=isNull, true=code_block_52, false=code_block_51.targetValues)
code_block_53 = CodeBlock(elementKeys=if_, targetKeys=if_2) { Dictionary.RemoveKeys(Dictionary.ByKeysValues(elementKeys,targetKeys),"n/a"); }

# group: calculate parametervalues
code_block_54 = CodeBlock(elementDict=code_block_19.elementDict, replaceKeysDict=code_block_53)  # unwired: elementToReplace
# ---------- code_block_54.designscript (6 lines) ----------
elementDict;
replaceKeysDict;
replaceKeysDict[replaceKeysDict.Keys];
elementToReplace;
x=Dictionary.RemoveKeys(elementDict,replaceKeysDict.Keys);
replaceKeysDict.Keys;
# ----------------------------------------
valueAtKey_5 = DesignScript.Builtin.Dictionary.ValueAtKey(dictionary=code_block_54.elementDict, key=code_block_54.out5)
setValueAtKeys_3 = DesignScript.Builtin.Dictionary.SetValueAtKeys(dictionary=code_block_54.x, keys=code_block_54.out2, values=valueAtKey_5)
code_block_55 = CodeBlock(scriptSettingsDict=code_block_34.scriptSettingsDict, pointpairSelectionDict=byKeysValues_8) { scriptSettingsDict; pt=pointpairSelectionDict; }
dynamoROCODyfs_points_calculateParameter = Custom[DynamoROCODyfs_points_calculateParameterValues](ptPairDictionary=code_block_55.pt, scriptSettings=code_block_55.scriptSettingsDict)  # package ROCO Dyf Packages; Calculate parametevalues from points in dictionary by station, and settingsdictionary.
code_block_56 = CodeBlock(x=dynamoROCODyfs_points_calculateParameter.transposedParameterDict) { x[0]; }
code_block_57 = CodeBlock(x=setValueAtKeys_3, y=code_block_56) { x[x.Keys]; y[x.Keys]; }

# group: Set element parameter values
setParameters = Custom[DynamoROCODyfs_Element.SetParameters](elementInstance=code_block_57.out0, parameterDict=code_block_57.out1)  # package ROCO Dyf Packages; Sets parameters based on element and parameter dict

fixProjectUnits = Custom[FixProjectUnits](trigger=setParameters)  # package ROCO Dyf Packages; Sets project units to meters with 3 decimals
watch = Watch(code_block_35.out0)
watch_2 = Watch(code_block_34.itemKeys)
watch_3 = Watch(code_block_34.flPointCodes)
watch_4 = Watch(code_block_34.baselineList)
watch_5 = Watch(code_block_34.flPoints)
code_block_58 = CodeBlock(x=watch_5) { x.Code; }
watch_6 = Watch(code_block_35.ptpair)
surveyPoint = Coordinates.SurveyPoint()
code_block_59 = CodeBlock(FLPoint=watch_5, SP=surveyPoint) { x=FLPoint.X+SP.X; y=FLPoint.Y+SP.Y; Z=FLPoint.Z; }
byCoordinates = Point.ByCoordinates(x=code_block_59.x, y=code_block_59.y, z=code_block_59.Z)
