# Dynamo graph CC_updateObjectPositions@CorridorFLpoints_SelectedObjects.dyn (Dynamo 2.3.0.5885)
# packages: Data-Shapes 2019.2.40, CivilConnection2020 4.0.4, ROCO Dyf Packages 1.0.0

# group: DATA MANIPULATION
# note: Data manipulation on Dynamo Objects

# group: NOT IN USE
# note: Nodes to consider part of the final graph

# group: INPUT
# note: Data input and preperation for other nodes

# group: GET
# note: Get parameter values from Revit objects

# group: DEBUG
# note: Check if the graph is working as expected

# group: Package
# note: All used nodes from a package have a prefix
# added to them with the name of the node.

# group: FUNCTION
# note: Creation of dynamo objects

# group: OUTPUT
# note: Object creation in Revit, final output

# group: SET
# note: Set parameters on Revit objects

# group: INFO
# note: GENERAL INFO
# Version: 1
# Author: Dick Elsman
# Company: Infranea | ROCO
# email: dick.elsman@infranea.com
# Dynamo Core version: 2.3.0.5885
# Dynamo Revit version: 2.3.0.6270
# Revit version: 2020.2
# note: INSTRUCTIONS
# <DESCRIPTION>
# Allows user to update element position based on corridor featurelinpoints by selected revit elements. Runtime is app. 5 minutes, depending of ammount of elements selected
# <INSTRUCTIONS>
# navigate to the folder to play, and press play in the Dyno Browser. Either select all elements before run, or during the run.
# note: KNOWN ISSUES AND LIMITATIONS
# - Does not yet support adaption of multiple objects from multiple runs
# - Does not update dimensions of objects, only positions.
# - Does not update stations or source parameter on objects
# note: SCRIPT META
# Script Name: CC_updateObjectPosition@CorridorFLpoints_SelectedObjects.dyn
# Packages used in this script:
# Data-Shapes version: 2019.2.40
# ROCO Dyf Packages version: 1.0.0
# TimeStamp : 2020/07/07 14:10

# group: Get ROCO LOGO and CivilApplication
loadRocoLogo = Custom[LoadRocoLogo]()  # package ROCO Dyf Packages
civilApplication = CivilConnection.CivilApplication.CivilApplication()

# group: User selects model elements to modify or script selects selected items
boolean = BoolSelector(true)
getCurrentElementSelection = Custom[getCurrentElementSelection](toggle=boolean)  # package ROCO Dyf Packages; Get current selected elements from Revit document
code_block = CodeBlock(x=getCurrentElementSelection) { y=List.Flatten(x); List.IsEmpty(y); }
code_block_2 = CodeBlock { "Select elements"; "Instructions"; }
code_block_3 = CodeBlock(logo=loadRocoLogo) { logo; }
code_block_4 = CodeBlock()
# ---------- code_block_4.designscript (3 lines) ----------
"select which elements you want to change in dimension.
NB: This script is only tested to modify one type of family per corridor a time!!
Only select objects from the same dynamo run and type (i.e: only elements of 'floor' from dynamo run X";
# ----------------------------------------
textnote_data = Custom[TextNote Data](Title=code_block_2.out1, TextNote=code_block_4)  # package Data-Shapes; Create Data for TextNote input in UI.MultipleInputForm ++ . Check out www.data-shapes.net for more informations
code_block_5 = CodeBlock { "Select model elements"; }
selectmodelelements_data = Custom[SelectModelElements Data](InputName=code_block_5, ButtonText=code_block_5)  # package Data-Shapes; Creates a Revit element selection input for UI.MultipleInputForm++ . Check out www.data-shapes.net for more infos!
code_block_6 = CodeBlock(x=textnote_data, y=selectmodelelements_data, toggle=code_block.out1) { uiData=[x,y]; toggle; "Continue"; "Cancel"; }
multipleinputform = Custom[MultipleInputForm ++](Description_optional=code_block_2.out0, Logo_optional=code_block_3, ButtonText_optional=code_block_6.out2, Inputs=code_block_6.uiData, Toggle=code_block_6.toggle, CancelButtonText_optional=code_block_6.out3)  # package Data-Shapes; Create a form with multiple inputs. see www.data-shapes.net for tutorials and infos!
code_block_7 = CodeBlock(selectedElements=multipleinputform.User_Inputs) { List.Flatten(selectedElements[0]); }
code_block_8 = CodeBlock(test=code_block.out1, True=code_block_7, False=code_block.y) { test; True; False; }
python_script = Python(IN[0]=code_block_8.test, IN[1]=code_block_8.True, IN[2]=code_block_8.False)
# ---------- python_script.python (15 lines) ----------
# Load the Python Standard and DesignScript Libraries
import sys
import clr
clr.AddReference('ProtoGeometry')
from Autodesk.DesignScript.Geometry import *

# The inputs to this node will be stored as a list in the IN variables.
dataEnteringNode = IN

# Place your code below this line

if IN[0]:
	OUT = IN[1]
else:
	OUT = IN[2]
# ----------------------------------------

# group: getCivilReferenceData from elements
code_block_9 = CodeBlock(selectedElements=python_script) { selectedElements; }
element_ReadC3DHost = Custom[Element_ReadC3DHost](selectedElements=code_block_9)  # package ROCO Dyf Packages; Reads civil3D host from ROCO host paramaeters
code_block_10 = CodeBlock(x=element_ReadC3DHost.elementDict) { x.Keys; x[x.Keys]; }
python_script_2 = Python(IN[0]=code_block_10.out0)
# ---------- python_script_2.python (15 lines) ----------
# Load the Python Standard and DesignScript Libraries
import sys
import clr
clr.AddReference('ProtoGeometry')
from Autodesk.DesignScript.Geometry import *

# The inputs to this node will be stored as a list in the IN variables.
dataEnteringNode = IN
outList=list()
# Place your code below this line
for i in IN[0]:
	outList.append(i.strip("0").strip(".").strip(","))
	
# Assign your output to the OUT variable.
OUT = outList
# ----------------------------------------
code_block_11 = CodeBlock(x=python_script_2, y=code_block_10.out1) { Dictionary.ByKeysValues(x,y); }
code_block_12 = CodeBlock(x=python_script) { List.UniqueItems(x.Type); famInstances=List.UniqueItems(x); }
family = FamilyType.Family(familyType=code_block_12.out0)
get_adaptive_points = Python(IN[0]=family)
# ---------- get_adaptive_points.python (18 lines) ----------
import clr
clr.AddReference('RevitAPI')
from Autodesk.Revit.DB import *

clr.AddReference("RevitNodes")
import Revit
clr.ImportExtensions(Revit.Elements)

clr.AddReference("RevitServices")
import RevitServices
from RevitServices.Persistence import DocumentManager

# The inputs to this node will be stored as a list in the IN variables.
fam = UnwrapElement(IN[0][0])

# Place your code below this line

OUT="GMA"+str(AdaptiveComponentFamilyUtils.GetNumberOfAdaptivePoints(fam))
# ----------------------------------------
code_block_13 = CodeBlock { "ROCO_CTE_Dynamo.Script"; }
parameterByName = Parameter.ParameterByName(element=code_block_12.famInstances, name=code_block_13)
code_block_14 = CodeBlock(x=parameterByName)
# ---------- code_block_14.designscript (2 lines) ----------
scriptName=DSCore.Data.ParseJSON(List.UniqueItems(x.Value))["ScriptMeta"]["ScriptName"];
"@"+String.Split(scriptName,"@")[0][1];
# ----------------------------------------
code_block_15 = CodeBlock(objectName=element_ReadC3DHost.objectName, objectDOB=element_ReadC3DHost.objectDOB, C3DReference=element_ReadC3DHost.C3DReference, elementDict=code_block_11, adaptivePoints=get_adaptive_points, scriptType=code_block_14.out1) { objectName; objectDOB; C3DReference; elementDict; adaptivePoints; scriptType; }

# group: createCivil3D_flpoint_Dict (linear objects)
code_block_16 = CodeBlock(civilapp=civilApplication) { civilapp; }
code_block_17 = CodeBlock(c3dReference=code_block_15.C3DReference, adaptivePoints=code_block_15.adaptivePoints)
# ---------- code_block_17.designscript (7 lines) ----------
x=c3dReference;
List.Clean(List.UniqueItems(x["docName"]));
List.Clean(List.UniqueItems(x["corName"]));
List.Clean(List.UniqueItems(x["FLpCode"]));
"LEFT_OF_AXIS";
//List.Flatten(List.UniqueItems(c3dPath));
adaptivePoints;
# ----------------------------------------
code_block_18 = CodeBlock(civilApplication=code_block_16, docName=code_block_17.out1, corName=code_block_17.out2, FLpCodeOrigin=code_block_17.out3, FLpCodeTarget=code_block_17.out4)
# ---------- code_block_18.designscript (9 lines) ----------
civilApplication;
civilDoc= CivilApplication.GetDocumentByName(civilApplication,docName);
corridor= CivilDocument.GetCorridorByName(civilDoc,corName);
baseLines= corridor.Baselines;
flPointsOrigin= Baseline.GetFeaturelinePointsByCode(baseLines, FLpCodeOrigin);
flPointsTarget= Baseline.GetFeaturelinePointsByCode(baseLines, FLpCodeTarget);
flPointStations= FeaturelinePoint.Station(flPointsOrigin);
pointPairOrigin= PointsOrganization.ByFeaturelinePoints(flPointsOrigin);
pointPairTarget= PointsOrganization.ByFeaturelinePoints(flPointsTarget);
# ----------------------------------------
string_from_object = FromObject(obj=code_block_18.flPointStations)
flatten = List.Flatten(list=string_from_object)
python_script_3 = Python(IN[0]=flatten)  # same code as python_script_2
flatten_2 = List.Flatten(list=code_block_18.pointPairOrigin)
byKeysValues = DesignScript.Builtin.Dictionary.ByKeysValues(keys=python_script_3, values=flatten_2)
flatten_3 = List.Flatten(list=code_block_18.pointPairTarget)
byKeysValues_2 = DesignScript.Builtin.Dictionary.ByKeysValues(keys=python_script_3, values=flatten_3)
code_block_19 = CodeBlock(originPoints=byKeysValues, targetPoints=byKeysValues_2, flpStations=python_script_3) { originPoints; targetPoints; flpStations; }

# group: Create C3D Pointset dict (CorridorFLpoints)
code_block_20 = CodeBlock(flpOriginDict=code_block_19.originPoints, flpTargetDict=code_block_19.targetPoints) { flpOriginDict; flpTargetDict; }
code_block_21 = CodeBlock(x=code_block_20.flpOriginDict, originDict=code_block_20.flpOriginDict, targetDict=code_block_20.flpTargetDict)
# ---------- code_block_21.designscript (10 lines) ----------
stations=x.Keys;
GMA4list=List.Transpose([originDict[stations].First,
							originDict[stations].Last,
							targetDict[stations].First,
							targetDict[stations].Last]);
GMA2list=List.Transpose([originDict[stations].First,
							originDict[stations].Last]);
GMA4Dict=Dictionary.ByKeysValues(stations,GMA4list);
GMA2Dict=Dictionary.ByKeysValues(stations,GMA2list);
{"GMA2":GMA2Dict,"GMA4":GMA4Dict};
# ----------------------------------------

# group: createCivil3D_flpoint_Dict (perpendicular_objects)
code_block_22 = CodeBlock(civilapp=civilApplication) { civilapp; }
code_block_23 = CodeBlock(c3dReference=code_block_15.C3DReference, adaptivePoints=code_block_15.adaptivePoints)
# ---------- code_block_23.designscript (7 lines) ----------
x=c3dReference;
List.Clean(List.UniqueItems(x["docName"]));
List.Clean(List.UniqueItems(x["corName"]));
String.Split(List.Clean(List.UniqueItems(x["FLpCode"])),",")[0][0];
String.Split(List.Clean(List.UniqueItems(x["FLpCode"])),",")[0][1];
//List.Flatten(List.UniqueItems(c3dPath));
adaptivePoints;
# ----------------------------------------
code_block_24 = CodeBlock(civilApplication=code_block_22, docName=code_block_23.out1, corName=code_block_23.out2, FLpCodeOrigin=code_block_23.out3, FLpCodeTarget=code_block_23.out4)
# ---------- code_block_24.designscript (9 lines) ----------
civilApplication;
civilDoc= CivilApplication.GetDocumentByName(civilApplication,docName);
corridor= CivilDocument.GetCorridorByName(civilDoc,corName);
baseLines= corridor.Baselines;
flPointsOrigin= Baseline.GetFeaturelinePointsByCode(baseLines, FLpCodeOrigin);
flPointsTarget= Baseline.GetFeaturelinePointsByCode(baseLines, FLpCodeTarget);
flPointStations= FeaturelinePoint.Station(flPointsOrigin);
pointOriginPosition= flPointsOrigin.Position;
pointPairTarget= flPointsTarget.Position;
# ----------------------------------------
string_from_object_2 = FromObject(obj=code_block_24.flPointStations)
flatten_4 = List.Flatten(list=string_from_object_2)
python_script_4 = Python(IN[0]=flatten_4)  # same code as python_script_2
flatten_5 = List.Flatten(list=code_block_24.pointOriginPosition)
byKeysValues_3 = DesignScript.Builtin.Dictionary.ByKeysValues(keys=python_script_4, values=flatten_5)
flatten_6 = List.Flatten(list=code_block_24.pointPairTarget)
byKeysValues_4 = DesignScript.Builtin.Dictionary.ByKeysValues(keys=python_script_4, values=flatten_6)
code_block_25 = CodeBlock(originPoints=byKeysValues_3, targetPoints=byKeysValues_4, flpStations=python_script_4) { originPoints; targetPoints; flpStations; }

# group: Create C3D Pointset dict (@CorridorFLpointsAssembly)
code_block_26 = CodeBlock(flpOriginDict=code_block_25.originPoints, flpTargetDict=code_block_25.targetPoints) { flpOriginDict; flpTargetDict; }
code_block_27 = CodeBlock(x=code_block_26.flpOriginDict, originDict=code_block_26.flpOriginDict, targetDict=code_block_26.flpTargetDict)
# ---------- code_block_27.designscript (5 lines) ----------
stations=x.Keys;
GMA2list=List.Transpose([originDict[stations],
							targetDict[stations]]);
GMA2Dict=Dictionary.ByKeysValues(stations,GMA2list);
{"GMA2":GMA2Dict};
# ----------------------------------------

# group: filter which pointdictionary to use
code_block_28 = CodeBlock(x=code_block_21.out5, y=code_block_27.out3, scriptType=code_block_15.scriptType, adaptivePoints=code_block_15.adaptivePoints)
# ---------- code_block_28.designscript (3 lines) ----------
pointDict={"@CorridorFLpoints":x,"@CorridorFLpointsAssembly":y};
selectedPointDict=pointDict[scriptType][adaptivePoints];
flpStations=selectedPointDict.Keys;
# ----------------------------------------

# group: Compare stations from elements with civildata
code_block_29 = CodeBlock(elementDict=code_block_15.elementDict, flpStations=code_block_28.flpStations) { elementDict; flpStations; logo; }  # unwired: logo
code_block_30 = CodeBlock(x=code_block_29.elementDict) { x.Keys; }
code_block_31 = CodeBlock(flpStations=code_block_29.flpStations, elementStations=code_block_30) { List.Sort(List.UniqueItems(List.Flatten(flpStations))); List.Sort(elementStations); }
setIntersection = List.SetIntersection(list1=code_block_31.out0, list2=code_block_31.out1)
string = StringInput("Not all stations of elements are found on corridor.")
string_2 = StringInput("Instructions")
string_3 = StringInput("""Modify the table below to match the correct stations in the featureline point list. 
--------
1) Allign the stations in the first column to the correct stations in the second column. 
2) Next, check if the values in the third column are the correct values. 
3) Then press continue""")
textnote_data_2 = Custom[TextNote Data](Title=string_2, TextNote=string_3)
dif_flpoints_list_setdifference = List.SetDifference(list1=code_block_31.out1, list2=code_block_31.out0)
code_block_32 = CodeBlock(y=dif_flpoints_list_setdifference) { x=["element stations","Difference:",y]; p=List.Flatten(x); }
dif_flpoints_list_setdifference_2 = List.SetDifference(list1=code_block_31.out0, list2=code_block_31.out1)
code_block_33 = CodeBlock(y=dif_flpoints_list_setdifference_2) { x=["flPoint stations","Difference:",y]; p=List.Flatten(x); }
code_block_34 = CodeBlock(y=dif_flpoints_list_setdifference_2) { List.Flatten(["use station:","target value",y]); }
code_block_35 = CodeBlock(x=code_block_32.p, y=code_block_33.p, z=code_block_34) { [x,y,z]; }
code_block_36 = CodeBlock(x=code_block_35) { List.Transpose(x); }
code_block_37 = CodeBlock { true; false; }
datatable_input = Custom[DataTable input](Data=code_block_36, FirstRowIsTitles=code_block_37.out0, ShowTitleAndFileInfoInExport=code_block_37.out1)  # package Data-Shapes; Create a DataTable view input for UI.MultipleInputForm ++
code_block_38 = CodeBlock(x=textnote_data_2, y=datatable_input) { [x,y]; }
code_block_39 = CodeBlock(x=dif_flpoints_list_setdifference_2) { List.Count(x); }
code_block_40 = CodeBlock(x=code_block_39) { x>0; }
code_block_41 = CodeBlock { 1000; 750; }

code_block_42 = CodeBlock(elementDict=code_block_15.elementDict) { elementDict; }
code_block_43 = CodeBlock(logo=loadRocoLogo) { logo; }

# group: User decides which stations to use
multipleinputform_2 = Custom[MultipleInputForm ++](Description_optional=string, Logo_optional=code_block_43, Inputs=code_block_38, Toggle=code_block_40, MaxHeight_optional=code_block_41.out0, Width_optional=code_block_41.out1)
code_block_44 = CodeBlock(x=multipleinputform_2.User_Inputs)
# ---------- code_block_44.designscript (5 lines) ----------
z=x[0];
y=List.Transpose(List.RemoveItemAtIndex(z,[0,1]));
elementKeys=y[0];
targetKeys=y[2];
String.Length(elementKeys)>0;
# ----------------------------------------

# group: create dict to replace element keys
code_block_45 = CodeBlock(elementKeys=code_block_44.elementKeys, targetValues=code_block_44.targetKeys, elementKeyExists=code_block_44.out4) { elementKeys; targetValues; elementKeyExists; }
isNull = Object.IsNull(obj=code_block_45.elementKeyExists)
code_block_46 = CodeBlock { "n/a"; }
if_ = If(test=isNull, true=code_block_46, false=code_block_45.elementKeys)
if_2 = If(test=isNull, true=code_block_46, false=code_block_45.targetValues)
code_block_47 = CodeBlock(elementKeys=if_, targetKeys=if_2) { Dictionary.RemoveKeys(Dictionary.ByKeysValues(elementKeys,targetKeys),"n/a"); }

# group: calculate transponationVector
code_block_48 = CodeBlock(elementDict=code_block_42, replaceKeysDict=code_block_47)
# ---------- code_block_48.designscript (5 lines) ----------
elementDict;
replaceKeysDict;
replaceKeysDict[replaceKeysDict.Keys];
x=Dictionary.RemoveKeys(elementDict,replaceKeysDict.Keys);
replaceKeysDict.Keys;
# ----------------------------------------
valueAtKey = DesignScript.Builtin.Dictionary.ValueAtKey(dictionary=code_block_48.elementDict, key=code_block_48.out4)
setValueAtKeys = DesignScript.Builtin.Dictionary.SetValueAtKeys(dictionary=code_block_48.x, keys=code_block_48.out2, values=valueAtKey)
code_block_49 = CodeBlock(pointDict=code_block_28.selectedPointDict) { pointDict; }
code_block_50 = CodeBlock(elemDict=setValueAtKeys, pointDict=code_block_49) { elemDict; pointDict; }
get_adaptive_points_2 = Python(IN[0]=code_block_50.elemDict)
# ---------- get_adaptive_points_2.python (33 lines) ----------
import clr
clr.AddReference('RevitAPI')
from Autodesk.Revit.DB import *

clr.AddReference("RevitNodes")
import Revit
clr.ImportExtensions(Revit.Elements)

clr.AddReference("RevitServices")
import RevitServices
from RevitServices.Persistence import DocumentManager
doc = DocumentManager.Instance.CurrentDBDocument

# The inputs to this node will be stored as a list in the IN variables.
elemDict=IN[0]

stations=elemDict.Keys
refPointDict=dict()

for station in stations:
	elem=UnwrapElement(elemDict[station])
	pointIds=AdaptiveComponentInstanceUtils.GetInstancePlacementPointElementRefIds(elem)
	pointList=list()
	for pointId in pointIds:
		pointList.append(doc.GetElement(pointId))
	refPointDict[station]=list(pointList)
	
	
	

# Place your code below this line

OUT= refPointDict
# ----------------------------------------
code_block_51 = CodeBlock(x=code_block_50.pointDict) { station=List.Sort(x.Keys); }
current_coordinates = CodeBlock(x=get_adaptive_points_2, station=code_block_51) { Point.ByCoordinates(x[station].X,x[station].Y,x[station].Z); referencePoints=x[station]; referencePoints!=null; }
new_coordinates = CodeBlock(pointDict=code_block_50.pointDict, station=code_block_51) { pointDict[station]; }

code_block_52 = CodeBlock(elem=current_coordinates.referencePoints, mask=current_coordinates.out2, newpoints=current_coordinates.out0, newPos=new_coordinates)
# ---------- code_block_52.designscript (3 lines) ----------
List.FilterByBoolMask(elem,mask)["in"];
List.FilterByBoolMask(newpoints,mask)["in"];
List.FilterByBoolMask(newPos,mask)["in"];
# ----------------------------------------

# group (continued): calculate transponationVector
start = Revit.Transaction.Transaction.Start(input=code_block_52.out0)
byTwoPoints = Vector.ByTwoPoints(start=code_block_52.out1, end=code_block_52.out2)

# group: Move elements
moveByVector = Element.MoveByVector(element=start, vector=byTwoPoints)
end = Revit.Transaction.Transaction.End(input=moveByVector)
