# Dynamo graph DBC_addDocumentToBimCookbookDB@LantisModel_ActiveView.dyn "DBC_addDocumentToBimCookbookDB@LantisModel_ActiveView_BDM" (Dynamo 2.3.0.5885)
# packages: ROCO Dyf Packages 1.0.0, DynamoBIMCookbook 1.0.0.0, CookbookRevitHelpers 1.0.0.0

code_block = CodeBlock { dbRevitParameter; dbRevitParameter.Keys; }  # unwired: dbRevitParameter
count = List.Count()  # unwired: list
byLantisForRevit = DynamoBIMCookbook.Book.ByLantisForRevit()

# group: Get recipes by book
byBook = DynamoBIMCookbook.Recipe.ByBook(Book=byLantisForRevit)
code_block_2 = CodeBlock(reciptDict=byBook) { reciptDict; }
keys = DesignScript.Builtin.Dictionary.Keys(dictionary=byBook)

# group: search all elements in view for parameter
code_block_3 = CodeBlock(book=byLantisForRevit) { book; }
recipeParameter = DynamoBIMCookbook.Book.RecipeParameter(book=code_block_3)
nameInRevit = DynamoBIMCookbook.RevitParameter.NameInRevit(revitParameter=recipeParameter)
code_block_4 = CodeBlock(revitParameter=nameInRevit) { revitParameter; }
allInViewByParameterName = CookbookRevitHelpers.SelectAndFilter.AllInViewByParameterName(ParameterName=code_block_4)
code_block_5 = CodeBlock(elements=allInViewByParameterName.Included) { elements; }

# group: Filter elements based on available recipes
code_block_6 = CodeBlock(recipesDict=code_block_2, keys=keys, elements=code_block_5) { recipesDict; keys; elements; }
filterOnMatchingKeys = CookbookRevitHelpers.SelectAndFilter.FilterOnMatchingKeys(Keys=code_block_6.keys, Elements=code_block_6.elements)
keys_2 = DesignScript.Builtin.Dictionary.Keys(dictionary=filterOnMatchingKeys.Included)
valueAtKey = DesignScript.Builtin.Dictionary.ValueAtKey(dictionary=code_block_6.recipesDict, key=keys_2)

code_block_7 = CodeBlock(elementUID=filterOnMatchingKeys.Included) { elementUID; }

# group (continued): Filter elements based on available recipes
code_block_8 = CodeBlock(recipesDict=code_block_6.recipesDict, objectIds=code_block_7, recipes=valueAtKey, recipeKeys=keys_2, elementsDict=filterOnMatchingKeys.Included) { recipesDict; objectIds; recipes; recipeKeys; elementsDict; }

# group: updateProjectInfoMetadata
code_block_9 = CodeBlock(book=byLantisForRevit) { book; }
boolean = BoolSelector(false)
updateCookbookMeta = Custom[ProjectInfo.UpdateCookbookMeta](toggle=boolean)  # package ROCO Dyf Packages; Updates project info for pushing to BIMCookbook
code_block_10 = CodeBlock(x=updateCookbookMeta.metaDataDict)
# ---------- code_block_10.designscript (5 lines) ----------
x["259f97c8-4f40-4de7-8110-3e41b852ac08"]/*doc_GUID*/;
x["8b087b5e-7400-4940-83c6-c1f502d0dcb0"] /*doc_FILE*/;
x["66531f01-7c02-4542-b95c-5db573ef99b6"] /*LP_GUID*/;
x["ec84aa2b-b904-4321-9f94-c7ec8793ca57"]/*LP_TS*/;
x["d2c0bde2-9a96-4127-bee6-4d071df470d5"]/*LP_UN*/;
# ----------------------------------------
byRevitModel = DynamoBIMCookbook.ProcessedModel.ByRevitModel(Book=code_block_9, FileGuid=code_block_10.out0, ModelFileName=code_block_10.out1)
code_block_11 = CodeBlock(processedModel=byRevitModel, LP_GUID=code_block_10.out2, LP_TS=code_block_10.out3, LP_UN=code_block_10.out4) { processedModel; LP_GUID; LP_TS; LP_UN; }

code_block_12 = CodeBlock(processedModel=code_block_11.processedModel, LP_GUID=code_block_11.LP_GUID, LP_TS=code_block_11.LP_TS, LP_UN=code_block_11.LP_UN) { processedModel; LP_GUID; LP_TS; LP_UN; }
code_block_13 = CodeBlock { "DO-"; "bdm"; }
fromRecipesAndElements = CookbookRevitHelpers.ProcessedObjects.FromRecipesAndElements(Recipes=code_block_8.recipesDict, Elements=code_block_8.objectIds, Model=code_block_12.processedModel, DesignPhase=code_block_13.out0, VersionGuid=code_block_12.LP_GUID, VersionTime=code_block_12.LP_TS, User=code_block_13.out1)
code_block_14 = CodeBlock(recipes=code_block_8.recipes, recipeKeys=code_block_8.recipeKeys, ElementsDict=code_block_8.elementsDict) { recipes; recipeKeys; ElementsDict; }
namesByRecipes = DynamoBIMCookbook.RevitParameter.NamesByRecipes(Recipes=code_block_14.recipes)
getParameterValuesOnObjects = CookbookRevitHelpers.SelectAndFilter.GetParameterValuesOnObjects(RevitElements=code_block_14.ElementsDict, dBParameters=namesByRecipes)
byListOfProcessedObjects = DynamoBIMCookbook.ProcessedParameter.ByListOfProcessedObjects(ProcessedObjects=fromRecipesAndElements, Parameters=namesByRecipes, Values=getParameterValuesOnObjects)
count_2 = List.Count(list=byListOfProcessedObjects)
code_block_15 = CodeBlock(objectCount=count, parameterCount=count_2) { x="createdObjects " + objectCount + "parametersetsAdded" + parameterCount; }
watch = Watch(code_block_15)  # graph output
watch_2 = Watch(code_block_8.recipes)
