# Dynamo graph DBC_checkModelIntegrity@LantisModel_ActiveView.dyn (Dynamo 2.3.0.5885)
# packages: DynamoBIMCookbook 1.0.0.0, LantisModelInquiry 1.0.0.0, archi-lab.net 2020.22.9, ROCO Dyf Packages 1.0.0

byLantisForRevit = DynamoBIMCookbook.Book.ByLantisForRevit()

# group: check logical elements and select by id
elementsByParameter = LantisModelInquiry.Selection.ElementsByParameter()
count = List.Count(list=elementsByParameter)
recipeParameter = DynamoBIMCookbook.Book.RecipeParameter(book=byLantisForRevit)
nameInRevit = DynamoBIMCookbook.RevitParameter.NameInRevit(revitParameter=recipeParameter)
logicals = LantisModelInquiry.Selection.Logicals(LantisElements=elementsByParameter, ParameterName=nameInRevit)
count_2 = List.Count(list=logicals.Logical)
code_block = CodeBlock(x=count, y=count_2) { "total elements in active view= "+x+"; logical elements= "+y+" ("+ (y/x)*100 +"%)"; }
conformTypeAndParameter = LantisModelInquiry.Selection.ConformTypeAndParameter(LantisElements=logicals.Logical, ParameterName=nameInRevit)
code_block_2 = CodeBlock(check=code_block, parameterName=nameInRevit, structure=conformTypeAndParameter.Structure) { check; parameterName; structure; }

# group: Get recipe info
byBook = DynamoBIMCookbook.Recipe.ByBook(Book=byLantisForRevit)
code_block_3 = CodeBlock(x=byBook) { x[x.Keys]; x.Keys; }
namesByRecipes = DynamoBIMCookbook.RevitParameter.NamesByRecipes(Recipes=code_block_3.out0)
code_block_4 = CodeBlock(y=namesByRecipes, x=code_block_3.out1) { y[x]; }
code_block_5 = CodeBlock(x=code_block_4) { x[x.Keys]; }
nameInRevit_2 = DynamoBIMCookbook.RevitParameter.NameInRevit(revitParameter=code_block_5)
byKeysValues = DesignScript.Builtin.Dictionary.ByKeysValues(keys=code_block_3.out1, values=nameInRevit_2)
code_block_6 = CodeBlock(recipes=code_block_3.out0, parameterNames=byKeysValues) { recipes; parameterNames; }

# group: Check if recipes exist in Database
code_block_7 = CodeBlock(structure=code_block_2.structure, recipes=code_block_6.recipes) { structure; recipes; }
code_block_8 = CodeBlock(x=code_block_7.structure) { x.Keys; }
uniqueItems = List.UniqueItems(list=code_block_8)
matchingValue = DynamoBIMCookbook.Recipe.MatchingValue(recipe=code_block_7.recipes)
eq = uniqueItems == matchingValue  # lacing=CrossProduct
countTrue = List.CountTrue(list=eq, lacing=Longest)
code_block_9 = CodeBlock { 0; }
eq_2 = countTrue == code_block_9
not_ = Not(x=eq_2)
filterByBoolMask = List.FilterByBoolMask(list=uniqueItems, mask=not_)
code_block_10 = CodeBlock(y=code_block_7.structure, x=filterByBoolMask.in) { z=y[x]; elements=z[z.Keys]; }
flatten = List.Flatten(list=code_block_10.elements)
id = LantisModelInquiry.LantisElementInfo.Id(lantisElementInfo=flatten)
byElementId = archilab.Revit.Selection.Select.ByElementId(id=id)
code_block_11 = CodeBlock(x=uniqueItems, y=countTrue) { "# recipe relations in DB"; x +" = "+y; }
addItemToFront = List.AddItemToFront(item=code_block_11.out0, list=code_block_11.out1)
code_block_12 = CodeBlock(filteredElements=byElementId, recipeRelationsInDB=addItemToFront) { filteredElements; recipeRelationsInDB; }

boolean = BoolSelector(true)
projectInfoElement = Custom[Document.ProjectInfoElement](toggle=boolean)  # package ROCO Dyf Packages; Get project info as element
getSharedParameter = Custom[Element.GetSharedParameter](element=projectInfoElement)  # package ROCO Dyf Packages; Gets all shared parameters of object
code_block_13 = CodeBlock()
# ---------- code_block_13.designscript (5 lines) ----------
{"259f97c8-4f40-4de7-8110-3e41b852ac08":"ROCO_CTE_Document_GUID"/*doc_GUID*/,
"8b087b5e-7400-4940-83c6-c1f502d0dcb0":"ROCO_CTE_Document_Filename" /*doc_FILE*/,
"66531f01-7c02-4542-b95c-5db573ef99b6":"ROCO_CTE_Last_Push_GUID" /*LP_GUID*/,
"ec84aa2b-b904-4321-9f94-c7ec8793ca57":"ROCO_CTE_Last_Push_Timestamp" /*LP_TS*/,
"d2c0bde2-9a96-4127-bee6-4d071df470d5":"ROCO_CTE_Last_Push_Username" /*LP_UN*/};
# ----------------------------------------
code_block_14 = CodeBlock(x=getSharedParameter, y=code_block_13)
# ---------- code_block_14.designscript (8 lines) ----------
x;
y;
p=x.Keys;
z=y.Keys;
difference = List.SetDifference(z,p);
intersection = List.SetIntersection(z,p);
presentParameter=y[intersection];
missingParameter=y[difference];
# ----------------------------------------
code_block_15 = CodeBlock(missingParameter=code_block_14.missingParameter, presentParameter=code_block_14.presentParameter, parameterDict=code_block_14.y)
# ---------- code_block_15.designscript (9 lines) ----------
List.Flatten(["ProjectParameters missing for BIM_Cookbook:",missingParameter
,"-----------------------------",
"ProjectParameters present for BIM_Cookbook:",presentParameter
,"-----------------------------",
"ProjectParameters on ProjectInfo required for BIM_Cookbook",
parameterDict[parameterDict.Keys]


]);
# ----------------------------------------

# group: output
logic_check_of_objects_in = Watch(code_block_2.check)  # "Logic check of objects in RevitProject: Watch"; graph output
count_recipes_in_db_for_objects = Watch(code_block_12.recipeRelationsInDB)  # graph output
required_projectparameters_on = Watch(code_block_15)  # "Required projectparameters on projectinfo"; graph output
element_conformity = Watch(conformTypeAndParameter.Conformity)  # graph output
