# Dynamo graph LantisInquiry.dyn (Dynamo 2.3.0.5885)
# packages: LantisModelInquiry 1.0.0.0, DynamoBIMCookbook 1.0.0.0

elementsByParameter = LantisModelInquiry.Selection.ElementsByParameter()
name = LantisModelInquiry.LantisElementInfo.Name(lantisElementInfo=elementsByParameter)
code_block = CodeBlock { "OWV_SE_logisch"; }
logicals = LantisModelInquiry.Selection.Logicals(LantisElements=elementsByParameter, ParameterName=code_block)
conformTypeAndParameter = LantisModelInquiry.Selection.ConformTypeAndParameter(LantisElements=logicals.Logical, ParameterName=code_block)
watch = Watch(conformTypeAndParameter.Structure)
code_block_2 = CodeBlock {  }
watch_2 = Watch(conformTypeAndParameter.Conformity)
byLantisForRevit = DynamoBIMCookbook.Book.ByLantisForRevit()
byBook = DynamoBIMCookbook.Recipe.ByBook(Book=byLantisForRevit)
keys = DesignScript.Builtin.Dictionary.Keys(dictionary=byBook)
keys_2 = DesignScript.Builtin.Dictionary.Keys(dictionary=conformTypeAndParameter.Conformity)
