# Dynamo graph selectSimilar@SelectedElements.dyn (Dynamo 2.3.0.5885)
# packages: Data-Shapes 2019.2.40, ROCO Dyf Packages 1.0.0, LantisModelInquiry 1.0.0.0

# group: DATA MANIPULATION
# note: Data manipulation on Dynamo Objects

# group: NOT IN USE
# note: Nodes to consider part of the final graph

# group: INPUT
# note: Data input and preperation for other nodes

# group: GET
# note: Get parameter values from Revit objects

# group: DEBUG
# note: Check if the graph is working as expected

# group: Package
# note: All used nodes from a package have a prefix
# added to them with the name of the node.

# group: FUNCTION
# note: Creation of dynamo objects

# group: OUTPUT
# note: Object creation in Revit, final output

# group: SET
# note: Set parameters on Revit objects

# group: INFO
# note: GENERAL INFO
# Version: 3
# Author: Dick Elsman
# Company: Infranea | ROCO
# email: dick.elsman@infranea.com
# Dynamo Core version: 2.3.0.5885
# Dynamo Revit version: 2.3.0.6270
# Revit version: 2020.2
# note: INSTRUCTIONS
# <DESCRIPTION>
# Allows user to update element geometry based on corridor featurelinpoints by selected revit elements. Runtime is app. 5 minutes, depending of ammount of elements selected
# <INSTRUCTIONS>
# navigate to the folder to play, and press play in the Dyno Browser.
# NB! This script requires a JSON config file for it to index objects and data from sources. This/these file(s) shoudl be stored in <script directory>\config_files
# note: KNOWN ISSUES AND LIMITATIONS
# - Does not yet support adaption of multiple objects
# - Does not update position of objects, only dimensions.
# note: SCRIPT META
# Script Name: CC_updateObjectDimensions@CorridorFLpoints_SelectedObjects.dyn
# Packages used in this script:
# Data-Shapes version: 2019.2.40
# ROCO Dyf Packages version: 1.0.0
# TimeStamp : 2020/2/19 14:10

# group: User selects model elements to modify or script selects selected items
code_block = CodeBlock { true; }
getCurrentElementSelection = Custom[getCurrentElementSelection](toggle=code_block)  # package ROCO Dyf Packages; Get current selected elements from Revit document
code_block_2 = CodeBlock(x=getCurrentElementSelection) { y=List.Flatten(x); List.IsEmpty(y); }
code_block_3 = CodeBlock { "Select elements"; "Instructions"; }
loadRocoLogo = Custom[LoadRocoLogo]()  # package ROCO Dyf Packages
code_block_4 = CodeBlock(logo=loadRocoLogo) { logo; }
code_block_5 = CodeBlock()
# ---------- code_block_5.designscript (3 lines) ----------
"select which elements you want to change in dimension.
NB: This script is only tested to modify one type of family per corridor a time!!
Only select objects from the same dynamo run and type (i.e: only elements of 'floor' from dynamo run X";
# ----------------------------------------
data_shapes_ui_textnote_data = Custom[Data-Shapes_UI.TextNote Data](Title=code_block_3.out1, TextNote=code_block_5)  # package Data-Shapes; Create Data for TextNote input in UI.MultipleInputForm ++ . Check out www.data-shapes.net for more informations
code_block_6 = CodeBlock { "Select model elements"; }
data_shapes_ui = Custom[Data-Shapes_UI.SelectModelElements Data](InputName=code_block_6, ButtonText=code_block_6)  # package Data-Shapes; Creates a Revit element selection input for UI.MultipleInputForm++ . Check out www.data-shapes.net for more infos!
code_block_7 = CodeBlock(x=data_shapes_ui_textnote_data, y=data_shapes_ui, toggle=code_block_2.out1) { uiData=[x,y]; toggle; "Continue"; "Cancel"; }
data_shapes_ui_multipleinputform = Custom[Data-Shapes_UI.MultipleInputForm ++](Description_optional=code_block_3.out0, Logo_optional=code_block_4, ButtonText_optional=code_block_7.out2, Inputs=code_block_7.uiData, Toggle=code_block_7.toggle, CancelButtonText_optional=code_block_7.out3)  # package Data-Shapes; Create a form with multiple inputs. see www.data-shapes.net for tutorials and infos!
code_block_8 = CodeBlock(selectedElements=data_shapes_ui_multipleinputform.User_Inputs) { List.Flatten(selectedElements[0]); }
code_block_9 = CodeBlock(test=code_block_2.out1, True=code_block_8, False=code_block_2.y) { test; True; False; }
python_script = Python(IN[0]=code_block_9.test, IN[1]=code_block_9.True, IN[2]=code_block_9.False)
# ---------- python_script.python (15 lines) ----------
# Load the Python Standard and DesignScript Libraries
import sys
import clr
clr.AddReference('ProtoGeometry')
from Autodesk.DesignScript.Geometry import *

# The inputs to this node will be stored as a list in the IN variables.
dataEnteringNode = IN

# Place your code below this line

if IN[0]:
	OUT = IN[1]
else:
	OUT = IN[2]
# ----------------------------------------

# group: User inputs Parametername
parameterName = StringInput("ROCO_CTE_Reference_Source_Data")  # graph input

# group: Get all elements in document
elementsByParameter = LantisModelInquiry.Selection.ElementsByParameter()
id = LantisModelInquiry.LantisElementInfo.Id(lantisElementInfo=elementsByParameter)
byElementId = archilab.Revit.Selection.Select.ByElementId(id=id)

code_block_10 = CodeBlock(selectedElement=python_script, paramNames=parameterName, allElements=byElementId)
# ---------- code_block_10.designscript (3 lines) ----------
List.Flatten(ParameterFilterElement.GetParameterValueByName(selectedElement,paramNames));
allElements.Id;
List.Flatten(ParameterFilterElement.GetParameterValueByName(allElements,paramNames));
# ----------------------------------------
eq = code_block_10.out0 == code_block_10.out2  # lacing=Longest
filterByBoolMask = List.FilterByBoolMask(list=code_block_10.out1, mask=eq)  # graph output
code_block_11 = CodeBlock(elementId=filterByBoolMask.in) { elementId:double[]; }
currentdocumentselection_python = Python(IN[0]=code_block_11)  # "CurrentDocumentSelection: Python Script"
# ---------- currentdocumentselection_python.python (33 lines) ----------
# Load the Python Standard and DesignScript Libraries
import sys
import clr
clr.AddReference("System")
from System.Collections.Generic import List
clr.AddReference("RevitServices")
import RevitServices
from RevitServices.Persistence import DocumentManager
clr.AddReference("RevitAPIUI")
from Autodesk.Revit.UI.Selection import *
clr.AddReference('RevitAPI')
from Autodesk.Revit.DB import *



# The inputs to this node will be stored as a list in the IN variables.
ElementList = IN[0]

# Place your code below this line
UIdoc = DocumentManager.Instance.CurrentUIDocument
dbDocument = DocumentManager.Instance.CurrentDBDocument

elem_id=list()

for id in ElementList:
	elem_id.append(ElementId(id))

icol= List[ElementId](elem_id)
element_ids = UIdoc.Selection.SetElementIds(icol)


# Assign your output to the OUT variable.
OUT = element_ids
# ----------------------------------------
document_SelectElementByID = Custom[Document_SelectElementByID](elementId=filterByBoolMask.in)  # package ROCO Dyf Packages; Fysically select objects in document by elementID
