# Dynamo graph updateMaterialsClassificationParameters.dyn (Dynamo 2.3.0.5885)
# packages: ROCO Dyf Packages 1.0.0

# note: GENERAL INFO
# Version: 01
# Author: Dick Elsman
# Company: Infranea
# email: dick.elsman@infranea.com
# Dynamo version: 2.3.0.XXX
# Revit version: 2020.2
# note: INSTRUCTIONS
# Applies classification code for each material in Revit
# Select excel file with correct material values. fill in sheetname of the sheet containing the data and the first row named:
# MaterialName
# Classification description
# Classification Code
# press play.
# make sure any dialogs are closed in Revit.
# note: KNOWN ISSUES AND LIMITATIONS
# <ISSUES>

# group: NOT IN USE
# note: Nodes to consider part of the final graph

# group: DATA MANIPULATION
# note: Data manipulation on Dynamo Objects

# group: OUTPUT
# note: Object creation in Revit, final output

# group: INPUT
# note: Data input and preperation for other nodes

# group: GET
# note: Get parameter values from Revit objects

# group: SET
# note: Set parameters on Revit objects

# group: FUNCTION
# note: Creation of dynamo objects

# group: DEBUG
# note: Check if the graph is working as expected

# group: Package
# note: Used nodes are from a package;
# Manual change colorcode in Json : #C80000

# group: Get all materials in project
getAll = Custom[DynamoROCODyfs_Materials.GetAll]()  # package ROCO Dyf Packages; gets all materials of current document

excel_document_file_path = Filename("..\..\..\..\..\BIM 360\BAM Belgium\Oosterweel - THV ROCO\Project Files\002 WIP\000 Library\990 Documentation & Guidelines\Revit Modelling guidelines\Uniclass2015_Ma.xlsx")  # graph input
sheetname_string = StringInput("For_import_Revit")  # graph input

# group: import excel data
fromPath = FileObject(path=excel_document_file_path)  # "File.FromPath"
importExcel = Data.ImportExcel(file=fromPath, sheetName=sheetname_string)

# group: create dicionary from excel data
code_block = CodeBlock { 0; }
getItemAtIndex = List.GetItemAtIndex(list=importExcel, index=code_block)
code_block_2 = CodeBlock { 0; }
remove_header_from_table_list = List.RemoveItemAtIndex(list=importExcel, indices=code_block_2)
code_block_3 = CodeBlock(keys=getItemAtIndex, values=remove_header_from_table_list) { keys; values; }
createdictionary_python_script = Python(IN[0]=code_block_3.keys, IN[1]=code_block_3.values)
# ---------- createdictionary_python_script.python (29 lines) ----------
# Load the Python Standard and DesignScript Libraries
import sys
import clr
clr.AddReference('ProtoGeometry')
from Autodesk.DesignScript.Geometry import *

# The inputs to this node will be stored as a list in the IN variables.
keys,values =IN

tempdict={}
outlist=[]
# Place your code below this line
j=0
i=0
while i<len(values):
	tempdict.Clear()
	while j<len(keys):
		try:
			tempdict[keys[j]] = values[i][j]
		except:
			tempdict[keys[j]] = None
		j+=1
	i+=1
	j=0
	outlist.append(tempdict.copy())


# Assign your output to the OUT variable.
OUT = outlist
# ----------------------------------------
code_block_4 = CodeBlock(x=createdictionary_python_script) { name=x["MaterialName"]; classCode =x["Classification code"]; classDescription = x["Classification description"]; }
code_block_5 = CodeBlock { "ROCO_CTE_Classification.Ma.Code"; "ROCO_CTE_Classification.Ma.Description"; }
byKeysValues = DesignScript.Builtin.Dictionary.ByKeysValues(keys=code_block_5.out0, values=code_block_4.classCode, lacing=CrossProduct)
setValueAtKeys = DesignScript.Builtin.Dictionary.SetValueAtKeys(dictionary=byKeysValues, keys=code_block_5.out1, values=code_block_4.classDescription, lacing=Longest)
byKeysValues_2 = DesignScript.Builtin.Dictionary.ByKeysValues(keys=code_block_4.name, values=setValueAtKeys)
code_block_6 = CodeBlock(materialNames=code_block_4.name, excelDataDict=byKeysValues_2) { materialNames; excelDataDict; }

# group: Intersection of data and project
code_block_7 = CodeBlock(materialNamesRevit=getAll.Name, materialNamesExcel=code_block_6.materialNames) { materialNamesRevit; materialNamesExcel; }
setIntersection = List.SetIntersection(list1=code_block_7.materialNamesRevit, list2=code_block_7.materialNamesExcel)
code_block_8 = CodeBlock(filteredNames=setIntersection) { filteredNames; }

# group: Create parameterdictionary with all materials existing in project for the data that exists in excel
code_block_9 = CodeBlock(MaterialElements=getAll.Elements, MaterialNames=getAll.Name, FilteredNames=code_block_8) { MaterialElements; MaterialNames; FilteredNames; }
code_block_10 = CodeBlock { "element"; }
byKeysValues_3 = DesignScript.Builtin.Dictionary.ByKeysValues(keys=code_block_10, values=code_block_9.MaterialElements, lacing=CrossProduct)
byKeysValues_4 = DesignScript.Builtin.Dictionary.ByKeysValues(keys=code_block_9.MaterialNames, values=byKeysValues_3)
valueAtKey = DesignScript.Builtin.Dictionary.ValueAtKey(dictionary=byKeysValues_4, key=code_block_9.FilteredNames)
code_block_11 = CodeBlock(x=valueAtKey) { element=x["element"]; }
code_block_12 = CodeBlock(elementList=code_block_11) { elementList; }

# group: filterExcelData
code_block_13 = CodeBlock(filteredNames=code_block_8, excelDataDict=code_block_6.excelDataDict) { filteredNames; excelDataDict; }
valueAtKey_2 = DesignScript.Builtin.Dictionary.ValueAtKey(dictionary=code_block_13.excelDataDict, key=code_block_13.filteredNames)
code_block_14 = CodeBlock(parameterDict=valueAtKey_2) { parameterDict; }

code_block_15 = CodeBlock(elementList=code_block_12, parameterDict=code_block_14) { elementList; parameterDict; }
setParameters = Custom[DynamoROCODyfs_Element.SetParameters](elementInstance=code_block_15.elementList, parameterDict=code_block_15.parameterDict)  # package ROCO Dyf Packages; Sets parameters based on element and parameter dict
parameters_set_watch = Watch(setParameters)  # graph output
