# Dynamo custom node CurveAlignByPoint.dyf (Dynamo 1.3.4.6666)
# category: CIB.Geometry.Curve.Actions
# Aligns all Curve to the same point

curves = Input(curves : Curve[])  # Curve, Line, Polycurve
reverse = Curve.Reverse(curves)
addItemToFront = List.AddItemToFront(item=curves@@L1, list=reverse@L1)
code_block = CodeBlock { {0,1}; }
pointAtParameter = Curve.PointAtParameter(curve=curves@@L1, param=code_block)
point = Input(point : Point [])  # Startpoint
code_block_2 = CodeBlock(A=point) { A[0]; }
distanceTo = Geometry.DistanceTo(geometry=pointAtParameter, other=code_block_2)
boolean = BoolSelector(true)
sortIndexByValue = SortIndexByValue(distanceTo, boolean)
code_block_3 = CodeBlock { 0; }
getItemAtIndex = List.GetItemAtIndex(list=sortIndexByValue@@L2, index=code_block_3)
getItemAtIndex_2 = List.GetItemAtIndex(list=addItemToFront@@L2, index=getItemAtIndex@L1)
Curves = Output(getItemAtIndex_2)
watch = Watch(addItemToFront)
