# Dynamo custom node CurveSortAlongCurve.dyf (Dynamo 1.3.4.6666)
# category: CIB.Geometry.Curve.Actions
# Sorts a list of curves in order along an other curve

curves = Input(curves : Curve[])  # List of Curves to sort
startPoint = Curve.StartPoint(curves)
endPoint = Curve.EndPoint(curves)
create = List.Create(startPoint, endPoint)
transpose = List.Transpose(create)
sortingCurve = Input(sortingCurve : Curve)  # Curve which represents the Axis along which you want to sort
distanceTo = Geometry.DistanceTo(geometry=transpose, other=sortingCurve@L1)
flatten = Flatten(distanceTo@L2)
boolean = BoolSelector(true)
sortIndexByValue = SortIndexByValue(flatten, boolean)
firstItem = List.FirstItem(sortIndexByValue@L2)
code_block = CodeBlock { 0; }
eq = firstItem == code_block
getItemAtIndex = List.GetItemAtIndex(list=transpose@L2, index=firstItem@L1)
parameterAtPoint = Curve.ParameterAtPoint(curve=sortingCurve, point=getItemAtIndex, lacing=CrossProduct)
flatten_2 = Flatten(parameterAtPoint)
sortIndexByValue_2 = SortIndexByValue(flatten_2, boolean)
getItemAtIndex_2 = List.GetItemAtIndex(list=curves, index=sortIndexByValue_2)
reverse = Curve.Reverse(getItemAtIndex_2)
if_ = If(test=eq, true=getItemAtIndex_2, false=reverse)
sortedCurves3D = Output(if_)  # "sortedCurves3D : var"; 3D sorted Curves
XY = Plane.XY()
pullOntoPlane = Curve.PullOntoPlane(curve=if_, plane=XY)
sortedCurves2D = Output(pullOntoPlane)  # "sortedCurves2D : var"; 2D Representation of the sorted Curves on the XY plane
indices = Output(sortIndexByValue_2)  # "indices : var"; Indices in order along the sorting curve
