# Dynamo custom node ElementGetAnalyticalModel.dyf (Dynamo 1.3.4.6666)
# category: CIB.Revit.Elements.Element.Actions
# Returns the Analytical Model element of a given Element is this Element has one

element = Input(element : Elements.Element)  # Element
python_script_get_analytical = Python(IN[0]=element)  # "Python Script | Get Analytical model"
# ---------- python_script_get_analytical.python (48 lines) ----------
import clr
clr.AddReference('ProtoGeometry')
from Autodesk.DesignScript.Geometry import *

#Import the Revit Services
clr.AddReference("RevitServices")
import RevitServices
from RevitServices.Persistence import DocumentManager
from RevitServices.Transactions import TransactionManager
doc = DocumentManager.Instance.CurrentDBDocument

#Import the Revit Nodes
clr.AddReference("RevitNodes")
import Revit
clr.ImportExtensions(Revit.Elements)

#Import the Revit API
clr.AddReference("RevitAPI")
import Autodesk
from Autodesk.Revit.DB import *

clr.AddReference("System.Windows.Forms")
from System.Windows.Forms import *

#Define tolist function
def tolist(obj1):
	if hasattr(obj1,"__iter__"):
		return obj1
	else:
		return [obj1]
		
#Define Input (IN)
element = UnwrapElement(IN[0])

if element.CanHaveAnalyticalModel():
	if element.GetAnalyticalModel() != None:
		output = element.GetAnalyticalModel()
	else:
		output = "Element doesn't have an Analytical Model"
else:
	output = "Element doesn't have an Analytical Model"


#End Transaction
TransactionManager.Instance.TransactionTaskDone()

#Define Output (OUT)
OUT = output
# ----------------------------------------
AnalyticalModelElement = Output(python_script_get_analytical)  # "AnalyticalModelElement : var"; the Analytical Element of a String Error Message
