# Dynamo custom node ElementSetWorkset.dyf (Dynamo 1.3.4.6666)
# category: CIB.Revit.Elements.Element.Actions
# Set the workset of an element

element = Input(element : Elements.Element)  # Element to set the workset to
workset = Input(workset : var)  # Workset
python_script_set_workset = Python(IN[0]=element, IN[1]=workset)
# ---------- python_script_set_workset.python (74 lines) ----------
import clr
clr.AddReference('ProtoGeometry')
from Autodesk.DesignScript.Geometry import *

clr.AddReference('System')
from System.Collections.Generic import *

#Import the Revit Services
clr.AddReference("RevitServices")
import RevitServices
from RevitServices.Persistence import DocumentManager
from RevitServices.Transactions import TransactionManager

doc = DocumentManager.Instance.CurrentDBDocument
uiapp = DocumentManager.Instance.CurrentUIApplication
app = uiapp.Application
uidoc = DocumentManager.Instance.CurrentUIApplication.ActiveUIDocument

#Import the Revit Nodes
clr.AddReference("RevitNodes")
import Revit
clr.ImportExtensions(Revit.Elements)
# Import geometry conversion extension methods
clr.ImportExtensions(Revit.GeometryConversion)

#Import the Revit API
clr.AddReference("RevitAPI")
import Autodesk
from Autodesk.Revit.DB import *

#Import math functions
import math

#Define functions
def tolist(obj1):
	if hasattr(obj1,"__iter__"):
		return obj1
	else:
		return [obj1]
		
def FeetToMm(d):
	return float(d) * 304.8
	
def MmToFeet(d):
	return float(d) / 304.8
	
def Flatten(a, result=None):
	if result is None:
		result = []
	for x in a:
		if isinstance(x, list):
			Flatten(x, result)
		else:
			result.append(x)
	return result

#Define Input (IN)
element = IN[0]
workset = IN[1]


# Start Transaction
TransactionManager.Instance.EnsureInTransaction(doc)
				
element = UnwrapElement(element)
parameter = element.GetParameters("Workset")[0]
parameter.Set(int(str(workset.Id)))
	
#End Transaction
TransactionManager.Instance.TransactionTaskDone()

#Define Output (OUT)
OUT = element
	
# ----------------------------------------
element_2 = Output(python_script_set_workset)  # "element : Elements.Element"; Element
