# Dynamo custom node ExcelColumnByHeader.dyf (Dynamo 1.3.4.6666)
# category: CIB.Office.Excel.Actions
# Returns the column  corresponding with the selected Header

ExcelRows = Input(ExcelRows:var[]..[])  # Excel Columns as lists
transpose = List.Transpose(ExcelRows)
Headers = Input(Headers : string[])  # A flat list with strings which contain the Headers of the Columns in Excel
HeaderName = Input(HeaderName : string)  # The Name of the Header to search for
indexOf = IndexOf(Headers, HeaderName)
getItemAtIndex = List.GetItemAtIndex(list=transpose, index=indexOf)
Items = Output(getItemAtIndex)  # The Items of the Corresponding Header
