# Dynamo custom node FamilyTypeDoesExist.dyf (Dynamo 1.3.4.6666)
# category: CIB.Revit.Elements.FamilyType.Actions
# Checks if the given Family name exists in the current Document

# group: Input
familyTypeName = Input(familyTypeName:string)  # The Name to Search for
category = Input(category : Category)  # In which Category is the Family Type

# group: Filter the Familytypes which don't have a Category
python_script_get_all_families = Python()
# ---------- python_script_get_all_families.python (67 lines) ----------
import clr
clr.AddReference('ProtoGeometry')
from Autodesk.DesignScript.Geometry import *

clr.AddReference('System')
from System.Collections.Generic import *

#Import the Revit Services
clr.AddReference("RevitServices")
import RevitServices
from RevitServices.Persistence import DocumentManager
from RevitServices.Transactions import TransactionManager

doc = DocumentManager.Instance.CurrentDBDocument
uiapp = DocumentManager.Instance.CurrentUIApplication
app = uiapp.Application
uidoc = DocumentManager.Instance.CurrentUIApplication.ActiveUIDocument

#Import the Revit Nodes
clr.AddReference("RevitNodes")
import Revit
clr.ImportExtensions(Revit.Elements)
# Import geometry conversion extension methods
clr.ImportExtensions(Revit.GeometryConversion)

#Import the Revit API
clr.AddReference("RevitAPI")
import Autodesk
from Autodesk.Revit.DB import *

#Import math functions
import math

#Define functions
def tolist(obj1):
	if hasattr(obj1,"__iter__"):
		return obj1
	else:
		return [obj1]
		
def FeetToMm(d):
	return float(d) * 304.8
	
def MmToFeet(d):
	return float(d) / 304.8
	
def Flatten(a, result=None):
	if result is None:
		result = []
	for x in a:
		if isinstance(x, list):
			Flatten(x, result)
		else:
			result.append(x)
	return result

#Define Input (IN)

# Start Transaction
TransactionManager.Instance.EnsureInTransaction(doc)

OUT = [f for f in FilteredElementCollector(doc).OfClass(Family)]

#End Transaction
TransactionManager.Instance.TransactionTaskDone()

#Define Output (OUT)
# ----------------------------------------
types = Family.Types(python_script_get_all_families)
isEmpty = List.IsEmpty(types@L2)
filterByBoolMask = List.FilterByBoolMask(list=types, mask=isEmpty)
code_block = CodeBlock { "Category"; }
getParameterValueByName = Element.GetParameterValueByName(element=filterByBoolMask.out, parameterName=code_block)

# group: Filter Familytypes by Category
flatten = Flatten(filterByBoolMask.out)
string_from_object = FromObject(category)
string_from_object_2 = FromObject(getParameterValueByName)
eq = string_from_object == string_from_object_2
flatten_2 = Flatten(eq)
filterByBoolMask_2 = List.FilterByBoolMask(list=flatten, mask=flatten_2)

# group: Check if name is unique
name = FamilyType.Name(filterByBoolMask_2.in)
eq_2 = familyTypeName == name
allFalse = AllFalse(eq_2)

# group: Output
IsUnique = Output(allFalse)  # "IsUnique:bool"
