# Dynamo custom node FormSetSubcategory.dyf (Dynamo 1.3.4.6666)
# category: CIB.Revit.Elements.Form.Actions
# Sets the Subcategory of the created Form

form = Input(form : Form)  # The Forms
Subcategory = Input(Subcategory : var)  # The Subcategory
python_script = Python(IN[0]=form, IN[1]=Subcategory)
# ---------- python_script.python (77 lines) ----------
import clr
clr.AddReference('ProtoGeometry')
from Autodesk.DesignScript.Geometry import *

clr.AddReference('System')
from System.Collections.Generic import *

#Import the Revit Services
clr.AddReference("RevitServices")
import RevitServices
from RevitServices.Persistence import DocumentManager
from RevitServices.Transactions import TransactionManager

doc = DocumentManager.Instance.CurrentDBDocument
uiapp = DocumentManager.Instance.CurrentUIApplication
app = uiapp.Application
uidoc = DocumentManager.Instance.CurrentUIApplication.ActiveUIDocument

#Import the Revit Nodes
clr.AddReference("RevitNodes")
import Revit
clr.ImportExtensions(Revit.Elements)
# Import geometry conversion extension methods
clr.ImportExtensions(Revit.GeometryConversion)

#Import the Revit API
clr.AddReference("RevitAPI")
import Autodesk
from Autodesk.Revit.DB import *

#Import math functions
import math

#Define functions
def tolist(obj1):
	if hasattr(obj1,"__iter__"):
		return obj1
	else:
		return [obj1]
		
def FeetToMm(d):
	return float(d) * 304.8
	
def MmToFeet(d):
	return float(d) / 304.8
	
def Flatten(a, result=None):
	if result is None:
		result = []
	for x in a:
		if isinstance(x, list):
			Flatten(x, result)
		else:
			result.append(x)
	return result



#Define Input (IN)
element = UnwrapElement(IN[0])
subcategory = UnwrapElement(IN[1])
# Start Transaction
TransactionManager.Instance.EnsureInTransaction(doc)

if element.GetType() == Form:
	try:
		element.get_Parameter(BuiltInParameter.FAMILY_ELEM_SUBCATEGORY).Set(subcategory.Id)
		OUT = element
	except Exception as e:
		OUT = str(e)
else:
	OUT = "Given Object is not a Form"

#End Transaction
TransactionManager.Instance.TransactionTaskDone()

#Define Output (OUT)
# ----------------------------------------
Form = Output(python_script)  # "Form : Form"; The Forms
