# Dynamo custom node LevelZero.dyf (Dynamo 1.3.4.6666)
# category: CIB.Revit.Elements.Level.Actions
# Return the Level with an Projected Elevation of 0. Often refered to as "Sealevel"

code_block = CodeBlock { Category.ByName("Levels"); }
all_elements_of_category = ElementsOfCategory(code_block)
projectElevation = Level.ProjectElevation(all_elements_of_category)
round = Math.Round(projectElevation)
code_block_2 = CodeBlock { 0; }
eq = round == code_block_2
filterByBoolMask = List.FilterByBoolMask(list=all_elements_of_category, mask=eq)
firstItem = List.FirstItem(filterByBoolMask.in)
level = Output(firstItem)  # "level : Level"; Level with Elevation of 0
