# Dynamo custom node ListMakeSubLists.dyf (Dynamo 1.3.4.6666)
# category: CIB.Core.List.Actions
# Divides a List in Sub Lists. Each Sub List Starts with the Last Item of the Previous Sub List. Perfect for create point lists for Adaptive Components

# group: Input
returnRest = Input(returnRest : bool = false)
list = Input(list : var[])
subListLength = Input(subListLength : int)
subListShift = Input(subListShift :int)

# group: Create the Sublists
code_block = CodeBlock(x=subListLength) { 0..x-1; }
code_block_2 = CodeBlock { 0; }
eq = subListShift == code_block_2
sub = subListLength - subListShift
if_ = If(test=eq, true=subListLength, false=sub)
sublists = List.Sublists(list=list, ranges=code_block, offset=if_)

# group: Check if the Rest should be Returned
count = List.Count(sublists@L2)
eq_2 = count == subListLength
filterByBoolMask = List.FilterByBoolMask(list=sublists, mask=eq_2)
python_script_if_statement = Python(IN[0]=returnRest, IN[1]=sublists, IN[2]=filterByBoolMask.in)
# ---------- python_script_if_statement.python (13 lines) ----------
import clr
clr.AddReference('ProtoGeometry')
from Autodesk.DesignScript.Geometry import *
#The inputs to this node will be stored as a list in the IN variables.
dataEnteringNode = IN

#Did this because the normal If node didn't work for some reason
bool = IN[0]

if bool:
	OUT = IN[1];
else:
	OUT = IN[2]
# ----------------------------------------

# group: Output
subLists = Output(python_script_if_statement)  # "subLists : var"
