# Dynamo custom node ListNumberToString.dyf (Dynamo 1.3.4.6666)
# category: CIB.Core.List.Actions
# Turns a List of Integers into Strings

numbers = Input(numbers : int[])  # Number to convert to multiple Digits
numberOfDigits = Input(numberOfDigits : int = 0)  # Number of Digits
prefixture = Input(prefixture : string = null)  # Prefix for each number
sufix = Input(sufix : string = null)  # Sufix for each number
python_script = Python(IN[0]=numbers, IN[1]=numberOfDigits, IN[2]=prefixture, IN[3]=sufix)
# ---------- python_script.python (32 lines) ----------
import clr
clr.AddReference('ProtoGeometry')
from Autodesk.DesignScript.Geometry import *

import sys
from System import String
#The inputs to this node will be stored as a list in the IN variables.
dataEnteringNode = IN

numbers = IN[0]
decimals = IN[1]
prefix = IN[2]
sufix = IN[3]
output = []

for number in numbers:
	empty = []
	if prefix != None:
		empty.append(prefix)
	number = str(int(number))
	rest = decimals - len(number);
	for i in range(rest):
		empty.append("0");
	empty.append(number)
	
	if sufix != None:
		empty.append(sufix)
	
	stringNumber = String.Concat(empty)
	output.append(stringNumber)

OUT = output
# ----------------------------------------
newNumbers = Output(python_script)  # "newNumbers : string[]"; New Numbers as Strings
