# Dynamo custom node ScopeBoxByBoundingBox.dyf (Dynamo 1.3.4.6666)
# category: CIB.Revit.Elements.SectionBox.Create
# Creates a Section Box in a Specific View by a given Bounding Box

# group: Input
view = Input(view : Elements.View3D)
boundingBox = Input(boundingBox : BoundingBox)
margin = Input(margin : double = 250)

# group: Core
python_script_section_box_by = Python(IN[0]=view, IN[1]=boundingBox, IN[2]=margin)  # "Python Script | Section Box By Bounding Box"
# ---------- python_script_section_box_by.python (79 lines) ----------
import clr
clr.AddReference('ProtoGeometry')
from Autodesk.DesignScript.Geometry import *

clr.AddReference('System')
from System.Collections.Generic import *

#Import the Revit Services
clr.AddReference("RevitServices")
import RevitServices
from RevitServices.Persistence import DocumentManager
from RevitServices.Transactions import TransactionManager

doc = DocumentManager.Instance.CurrentDBDocument
uiapp = DocumentManager.Instance.CurrentUIApplication
app = uiapp.Application
uidoc = DocumentManager.Instance.CurrentUIApplication.ActiveUIDocument

#Import the Revit Nodes
clr.AddReference("RevitNodes")
import Revit
clr.ImportExtensions(Revit.Elements)
# Import geometry conversion extension methods
clr.ImportExtensions(Revit.GeometryConversion)

#Import the Revit API
clr.AddReference("RevitAPI")
import Autodesk
from Autodesk.Revit.DB import *

#Import math functions
import math

#Define functions
def tolist(obj1):
	if hasattr(obj1,"__iter__"):
		return obj1
	else:
		return [obj1]
		
def FeetToMm(d):
	return float(d) * 304.8
	
def MmToFeet(d):
	return float(d) / 304.8
	
def Flatten(a, result=None):
	if result is None:
		result = []
	for x in a:
		if isinstance(x, list):
			Flatten(x, result)
		else:
			result.append(x)
	return result
	
def pointToXYZ(point, margin):
	x = MmToFeet(point.X + margin) 
	y = MmToFeet(point.Y + margin) 
	z = MmToFeet(point.Z + margin) 
	return XYZ(x, y, z)

#Define Input (IN)
view3d = UnwrapElement(IN[0])
boundingBox = IN[1]
margin = IN[2]

# Start Transaction
TransactionManager.Instance.EnsureInTransaction(doc)

newSectionBox = BoundingBoxXYZ()
newSectionBox.Max = pointToXYZ(boundingBox.MaxPoint, margin)
newSectionBox.Min = pointToXYZ(boundingBox.MinPoint, -margin)
view3d.SetSectionBox(newSectionBox)
#End Transaction
TransactionManager.Instance.TransactionTaskDone()

#Define Output (OUT)
OUT = view3d
# ----------------------------------------

# group: Output
View = Output(python_script_section_box_by)  # "View : Elements.View3D"
