# Dynamo custom node SolidRoadMarking.dyf (Dynamo 1.3.4.6666)
# category: CIB.Geometry.Solid.Create
# Sweeps a rectangular profile along a curve with or without spacing.

XZ = Plane.XZ()
markingHeight = Input(markingHeight:double)  # Thickness of the markings
markingWidth = Input(markingWidth:double)  # Width of the markings
byWidthLength = Rectangle.ByWidthLength(plane=XZ, width=markingHeight, length=markingWidth)
curves = Input(curves:Curve)  # Guide curve for the markings
startPoint = Curve.StartPoint(curves)
spacing = Input(spacing : double = 0)  # Spacing between markings
pointsAtSegmentLengthFromPoint = Curve.PointsAtSegmentLengthFromPoint(curves, startPoint, spacing)
addItemToFront = List.AddItemToFront(item=startPoint@L1, list=pointsAtSegmentLengthFromPoint@L2)
code_block = CodeBlock { 2; }
takeEveryNthItem = List.TakeEveryNthItem(addItemToFront@L2, code_block)
splitByPoints = Curve.SplitByPoints(curve=curves, points=takeEveryNthItem)
code_block_2 = CodeBlock { 2; }
dropEveryNthItem = List.DropEveryNthItem(list=splitByPoints@L2, n=code_block_2)
coordinateSystemAtParameter = Curve.CoordinateSystemAtParameter(dropEveryNthItem)
transform = Geometry.Transform(byWidthLength, coordinateSystemAtParameter)
code_block_3 = CodeBlock(x=markingHeight) { x/2; }
translate = Geometry.Translate(geometry=transform, zTranslation=code_block_3)
sweepAsSolid = Curve.SweepAsSolid(translate, splitByPoints)
byUnion = Solid.ByUnion(sweepAsSolid@L2)
flatten = Flatten(byUnion)
Solid = Output(flatten)
