# Dynamo custom node ViewDuplicateWithDetailing.dyf (Dynamo 1.3.4.6666)
# category: CIB.Revit.Views.View.Actions
# Duplicates a given View with all detailing elements

view = Input(view : Elements.View)  # The View to Duplicate
name = Input(name : string = null)  # The name of the duplicate View
python_script_duplicate_view = Python(IN[0]=view, IN[1]=name)
# ---------- python_script_duplicate_view.python (79 lines) ----------
import clr
clr.AddReference('ProtoGeometry')
from Autodesk.DesignScript.Geometry import *

clr.AddReference('System')
from System.Collections.Generic import *

#Import the Revit Services
clr.AddReference("RevitServices")
import RevitServices
from RevitServices.Persistence import DocumentManager
from RevitServices.Transactions import TransactionManager

doc = DocumentManager.Instance.CurrentDBDocument
uiapp = DocumentManager.Instance.CurrentUIApplication
app = uiapp.Application
uidoc = DocumentManager.Instance.CurrentUIApplication.ActiveUIDocument

#Import the Revit Nodes
clr.AddReference("RevitNodes")
import Revit
clr.ImportExtensions(Revit.Elements)
# Import geometry conversion extension methods
clr.ImportExtensions(Revit.GeometryConversion)

#Import the Revit API
clr.AddReference("RevitAPI")
import Autodesk
from Autodesk.Revit.DB import *

#Import math functions
import math

#Define functions
def tolist(obj1):
	if hasattr(obj1,"__iter__"):
		return obj1
	else:
		return [obj1]
		
def FeetToMm(d):
	return float(d) * 304.8
	
def MmToFeet(d):
	return float(d) / 304.8
	
def Flatten(a, result=None):
	if result is None:
		result = []
	for x in a:
		if isinstance(x, list):
			Flatten(x, result)
		else:
			result.append(x)
	return result
	
		
#Define Input (IN)
view = UnwrapElement(IN[0])
name = IN[1]
options = ViewDuplicateOption.WithDetailing
output = None

# Start Transaction
TransactionManager.Instance.EnsureInTransaction(doc)

try:
	elementId = view.Duplicate(options)
	dupliView = doc.GetElement(elementId)
	if name != None:
		UnwrapElement(dupliView).Name = name
	output = dupliView
except Exception as e:
	output = str(e)

#End Transaction
TransactionManager.Instance.TransactionTaskDone()

OUT = output
# ----------------------------------------
view_2 = Output(python_script_duplicate_view)  # "view : Elements.View"; Duplicated View
