# Dynamo custom node WallTypeByMaterialAndThickness.dyf (Dynamo 1.3.3.4651)
# category: CIB.Revit.Elements.WallType.Create
# Creates a Wall Type by Material and Thickness

# group: Input
thickness = Input(thickness : double)
material = Input(material : Revit.Material)

# group: Core Function
python_script = Python(IN[0]=thickness, IN[1]=material)  # "Python Script | WallTypeByMaterialAndThickness"
# ---------- python_script.python (116 lines) ----------
import clr
clr.AddReference('ProtoGeometry')
from Autodesk.DesignScript.Geometry import *

#Import the Revit Services
clr.AddReference("RevitServices")
import RevitServices
from RevitServices.Persistence import DocumentManager
from RevitServices.Transactions import TransactionManager
doc = DocumentManager.Instance.CurrentDBDocument

#Import the Revit Nodes
clr.AddReference("RevitNodes")
import Revit
clr.ImportExtensions(Revit.Elements)

#Import the Revit API
clr.AddReference("RevitAPI")
import Autodesk
from Autodesk.Revit.DB import *

#Import system
from System import *
from System.Collections.Generic import *

#Define tolist function
def tolist(obj1):
	if hasattr(obj1,"__iter__"):
		return obj1
	else:
		return [obj1]
		
def fromlist(obj1):
	if len(obj1) == 1:
		return obj1[0];
	else:
		return obj1;

def FeetToMm(d):
	return float(d) * 304.8
	
def MmToFeet(d):
	return float(d) / 304.8

def WallTypeByWidthAndMaterial(doc, width, material):
	widths = tolist(width)
	materials = tolist(UnwrapElement(material))
	output = []
	for width, material in zip(widths, materials):
	
		#Get all Wall types in the Current Document
		wall_types = [w for w in FilteredElementCollector(doc).OfClass(WallType) if w.Kind == WallKind.Basic]
		
		#Is the Width larger then 0
		if width > 0:
		
			#Try to find a matching Wall type
			current_walls = []
			for wall_type in wall_types:
				wall_width = FeetToMm(wall_type.Width)
				cs = wall_type.GetCompoundStructure();
				matId = cs.GetMaterialId(0);
				if width == wall_width and material.Id == matId:
					current_walls.append(wall_type);
					break
					
			#Determine If Wall type is Found
			if len(current_walls) > 0:
				output.append(current_walls[0]);
				
			#Create a New WallType
			else:
				name = material.Name + "_" + str(int(width));
				#Try to create a type
				try:
					type = wall_types[0].Duplicate(name)
					csl = CompoundStructureLayer()
					csl.Width = MmToFeet(width)
					csl.Function = MaterialFunctionAssignment.Structure
					csl.MaterialId = material.Id
					cs = CompoundStructure.CreateSimpleCompoundStructure(List[CompoundStructureLayer]([csl]))
					cs.EndCap = EndCapCondition.NoEndCap
					cs.StructuralMaterialIndex = cs.GetFirstCoreLayerIndex()
					type.SetCompoundStructure(cs)
					type.Function = WallFunction.Foundation
					output.append(type);
				#Return an existing type
				except:
					output.append(Revit.Elements.WallType.ByName(name))
				
		#Return Error
		else:
			output.append("Thickness has to be greater than zero!");
			
	return fromlist(output);


width = IN[0];
material = IN[1];

doc = DocumentManager.Instance.CurrentDBDocument
uiapp = DocumentManager.Instance.CurrentUIApplication
app = uiapp.Application
uidoc = DocumentManager.Instance.CurrentUIApplication.ActiveUIDocument


# Start Transaction
TransactionManager.Instance.EnsureInTransaction(doc)

wall_types = WallTypeByWidthAndMaterial(doc, width, material)

#End Transaction
TransactionManager.Instance.TransactionTaskDone()


OUT = wall_types
# ----------------------------------------

# group: Output
wallType = Output(python_script)  # "wallType : WallType"
