# Dynamo custom node UI.Slider Data.dyf "UI.Slider" (Dynamo 2.0.2.6826)
# category: Data-Shapes.UI
# Creates slider input for UI.MultipleInputForm ++ . Set the step to decimal value if you want a double slider, or to a integer value if you want an integer slider.

InputName = Input(InputName: string = "")
Minimum = Input(Minimum: var[]..[])
Maximum = Input(Maximum: var[]..[])
Default_Value = Input(Default_Value: var = "")
Step = Input(Step: var = 1)
python_script = Python(IN[0]=InputName, IN[1]=Minimum, IN[2]=Maximum, IN[3]=Default_Value, IN[4]=Step)
# ---------- python_script.python (19 lines) ----------
#Copyright (c) mostafa el ayoubi ,  2016
#Data-Shapes www.data-shapes.net , elayoubi.mostafa@gmail.com

class uislider():

    def __init__(self,inputname,minimum,maximum,defaultvalue,step):
        self.inputname = inputname
        self.minimum = minimum
        self.maximum = maximum
        self.defaultvalue = defaultvalue
        self.step = step

    def __repr__(self):
        return 'UI.IntegerSlider input'
        
x = uislider(IN[0],IN[1],IN[2],IN[3],IN[4])


OUT = x
# ----------------------------------------
Slider_input = Output(python_script)
