# Dynamo custom node Alignment.SetStartEndEndstation.dyf (Dynamo 2.3.0.5885)
# category: DynamoROCODyfs.Alignments
# Sets start and endstation of the alignment
# packages: ROCO Dyf Packages 1.0.0, Data-Shapes 2019.2.40, infranea 0.0.4, CivilConnection2020 4.0.4

# group: Input
alignment = Input(alignment: CivilConnection.Alignment)

loadRocoLogo = Custom[LoadRocoLogo]()  # package infranea
code_block = CodeBlock { "Apply"; }
code_block_2 = CodeBlock { "Start station"; }
start = CivilConnection.Alignment.Start(alignment=alignment)
string_from_object = FromObject(obj=start)
boolean = BoolSelector(false)  # graph input
ui_textbox_data = Custom[UI.TextBox Data](InputName=code_block_2, DefaultText=string_from_object, IsNumberEntry=boolean)  # package Data-Shapes; Create Data for TextBox input in UI.MultipleInputForm ++ . Check out www.data-shapes.net for more informations
code_block_3 = CodeBlock { "End station"; }
end = CivilConnection.Alignment.End(alignment=alignment)
string_from_object_2 = FromObject(obj=end)
boolean_2 = BoolSelector(false)  # graph input
ui_textbox_data_2 = Custom[UI.TextBox Data](InputName=code_block_3, DefaultText=string_from_object_2, IsNumberEntry=boolean_2)
create = List.Create(item0=ui_textbox_data, item1=ui_textbox_data_2)
flatten = List.Flatten(list=create)
boolean_3 = BoolSelector(true)  # graph input
code_block_4 = CodeBlock { "Cancel"; }
ui_multipleinputform = Custom[UI.MultipleInputForm ++](Logo_optional=loadRocoLogo, ButtonText_optional=code_block, Inputs=flatten, Toggle=boolean_3, CancelButtonText_optional=code_block_4)  # package Data-Shapes; Create a form with multiple inputs. see www.data-shapes.net for tutorials and infos!
string = StringInput(",")  # graph input
string_2 = StringInput(".")
replace = String.Replace(str=ui_multipleinputform.User_Inputs, searchFor=string, replaceWith=string_2, lacing=Longest)
code_block_5 = CodeBlock(x=replace) { x[0]; x[1]; }
toNumber = String.ToNumber(str=code_block_5.out0)
startStationToUse = Custom[StartStationToUse](alignment=alignment, startstation=toNumber)  # package ROCO Dyf Packages; Checks if the given startstation is in conflict with the startstation of the alignment
toNumber_2 = String.ToNumber(str=code_block_5.out1)
endStationToUse = Custom[EndStationToUse](endStation=toNumber_2, alignment=alignment)  # package ROCO Dyf Packages; Depending on the value of the end station input, selects the input value or the alignment length

# group: Output
startStation = Output(startStationToUse)
endStation = Output(endStationToUse)
alignment_2 = Output(alignment)  # "alignment"
