# Dynamo graph C3DMeta_Alignment.dyf (Dynamo 2.3.0.5885)
# packages: CivilConnection2020 4.0.4, infranea 0.0.4, Dynamo@ROCO_Dyf 1.0.0, DynamoROCO 2.3.0.0, ROCO Dyf Packages 1.0.0

code_block = CodeBlock { "select below"; }
civilApplication = CivilConnection.CivilApplication.CivilApplication()
selectAlignmentByNameAndDrawing2 = Custom[SelectAlignmentByNameAndDrawing2](descritpionText=code_block, civilApp=civilApplication)  # package Dynamo@ROCO_Dyf
setStartEndEndstation = Custom[Alignment.SetStartEndEndstation](alignment=selectAlignmentByNameAndDrawing2.alignment)  # package infranea; Sets start and endstation of the alignment
code_block_2 = CodeBlock(startStation=setStartEndEndstation.startStation, endStation=setStartEndEndstation.endStation, alignment=setStartEndEndstation.alignment) { startStation; endStation; alignment; }

# group: Input
base_level_m = Levels("T.A.W.")  # graph input
n2nd_family_type = FamilyTypes("[Pr_20_85_62_14]_TBC Sheet pile AZ36-700N_(GMA2):TY_AZ36-700N")  # "2nd Family Type"; graph input
number_of_type_1_elements_in = DoubleSlider(1, range=1..20 step 1)  # "Number of Type 1 Elements in Sequence"; graph input
number_of_type_2_elements_in = DoubleSlider(1, range=1..20 step 1)  # "Number of Type 2 Elements in Sequence"; graph input
n1st_family_type = FamilyTypes("[Pr_20_85_62_10]_TBC Combi-Buispaal 1422-12_C9 Slot_ROCO_(GMA2):D*T - Lock_1422*12 - C9")  # "1st Family Type"; graph input
top_offset_m = DoubleInput(0.9)  # graph input
bottom_offset_m = DoubleInput(-39)  # graph input
cut_offset_m = DoubleInput(0.9)  # graph input
roco_pe_id_startid = DoubleInput(1)  # graph input
mirror_1st_family = BoolSelector(false)  # graph input
mirror_2nd_family = BoolSelector(false)  # graph input

# group: Input to Script Parameters
name = CivilConnection.Alignment.Name(alignment=code_block_2.alignment)
name_2 = CivilConnection.CivilDocument.Name(civilDocument=selectAlignmentByNameAndDrawing2.civilDocument)
code_block_3 = CodeBlock()
# ---------- code_block_3.designscript (6 lines) ----------
"\"CivilDocument.Name\": \"";
"\", \"Alignment.Name\": \"";
"\", \"Startstation\": ";
", \"Endstation\"";
", \"BaseLevel\"";
", \"Parameter for Pointdistance\" : \"Width\"";
# ----------------------------------------
startstation = CodeBlock(startStation=code_block_2.startStation) { startStation; }
string_from_object = FromObject(obj=startstation)
endstation = CodeBlock(endStation=code_block_2.endStation) { endStation; }
string_from_object_2 = FromObject(obj=endstation)
baselevel = Level.Elevation(level=base_level_m)
string_from_object_3 = FromObject(obj=baselevel)
parameter_for_pairdistance = CodeBlock { "ROCO_CLE_Length_Calc"; }

# group: C3DInfo for Component
code = CodeBlock(alignmentName=name) { out: string = alignmentName[0] +"|#"; }
name_3 = Watch(code)  # "ROCO.PM.Alignment.Name"
name_4 = Watch(name_2)  # "ROCO.PM.C3DDocument.Name"

# group: Converted Input
concat = String.Concat(string0=code_block_3.out0, string1=name_2, string2=code_block_3.out1, string3=name, string4=code_block_3.out2, string5=string_from_object, string6=code_block_3.out3, string7=string_from_object_2, string8=code_block_3.out4, string9=string_from_object_3, string10=code_block_3.out5, lacing=Longest)

# group: Get Elementwidth & Passtrough
getParameterValueByName = Element.GetParameterValueByName(element=n2nd_family_type, parameterName=parameter_for_pairdistance)
code_block_4 = CodeBlock(alignment=code_block_2.alignment, startstation=startstation, endstation=endstation, elevation=baselevel, type1Number=number_of_type_1_elements_in, type2Number=number_of_type_2_elements_in) { alignment; startstation; endstation; elevation; type1Number; type2Number; }
getParameterValueByName_2 = Element.GetParameterValueByName(element=n1st_family_type, parameterName=parameter_for_pairdistance)
code_block_5 = CodeBlock(alignment=code_block_4.alignment, startstation=code_block_4.startstation, endstation=code_block_4.endstation, elevation=code_block_4.elevation, type1Number=code_block_4.type1Number, type1Width=getParameterValueByName_2, type2Number=code_block_4.type2Number, type2Width=getParameterValueByName)
# ---------- code_block_5.designscript (12 lines) ----------
alignment;
startstation;
endstation;
elevation;
type1Number;
type1Width;
type1Gap = type1Width * type1Number;
0;
type2Number;
type2Width;
type2Gap = type2Width * type2Number;
startstation2 = startstation+ type1Gap;
# ----------------------------------------

watch = Watch(getParameterValueByName)
code_block_6 = CodeBlock { 0; }

# group: createStations
code_block_7 = CodeBlock(alignment=code_block_5.alignment, startstation=code_block_5.startstation, endstation=code_block_5.endstation, elevation=code_block_5.elevation, type1Number=code_block_5.type1Number, type1Width=code_block_5.type1Width, type2Number=code_block_5.type2Number, type2Width=code_block_5.type2Width)  # unwired: type1Mirror, type2Mirror
# ---------- code_block_7.designscript (14 lines) ----------
alignment;
startstation;
endstation;
elevation;
type1Number;
type1Width;
type1Gap = type1Width * type1Number;
0;
type2Number;
type2Width;
type2Gap = type2Width * type2Number;
startstation2 = startstation + type1Gap;
type1Mirror;
type2Mirror;
# ----------------------------------------
createStations3ByStartEndIntervalSpacing = Custom[CreateStations3ByStartEndIntervalSpacing](startStation=code_block_7.startstation2, endStation=code_block_7.endstation, interval=code_block_7.type2Width, spacing_m=code_block_7.type1Gap)  # creates stationlist based on start, end, interval and spacing. (spacing can be zero or Null
code_block_8 = CodeBlock { ["startStation","endStation"]; ["endStation","startStation"]; "midStation"; "index"; }
midstations_dictionary = DesignScript.Builtin.Dictionary.ValueAtKey(dictionary=createStations3ByStartEndIntervalSpacing, key=code_block_8.out2, lacing=CrossProduct)
createStations3ByStartEndIntervalSpacing_2 = Custom[CreateStations3ByStartEndIntervalSpacing](startStation=code_block_7.startstation, endStation=code_block_7.endstation, interval=code_block_7.type1Width, spacing_m=code_block_7.type2Gap)
code_block_9 = CodeBlock { ["startStation","endStation"]; ["endStation","startStation"]; "midStation"; "index"; }
mirroredorder_dictionary = DesignScript.Builtin.Dictionary.ValueAtKey(dictionary=createStations3ByStartEndIntervalSpacing_2, key=code_block_9.out1, lacing=CrossProduct)
regularorder_dictionary = DesignScript.Builtin.Dictionary.ValueAtKey(dictionary=createStations3ByStartEndIntervalSpacing_2, key=code_block_9.out0, lacing=CrossProduct)
if_ = If(test=code_block_7.type1Mirror, true=mirroredorder_dictionary, false=regularorder_dictionary)
mirroredorder_dictionary_2 = DesignScript.Builtin.Dictionary.ValueAtKey(dictionary=createStations3ByStartEndIntervalSpacing, key=code_block_8.out1, lacing=CrossProduct)
regularorder_dictionary_2 = DesignScript.Builtin.Dictionary.ValueAtKey(dictionary=createStations3ByStartEndIntervalSpacing, key=code_block_8.out0, lacing=CrossProduct)
if_2 = If(test=code_block_7.type2Mirror, true=mirroredorder_dictionary_2, false=regularorder_dictionary_2)
midstations_dictionary_2 = DesignScript.Builtin.Dictionary.ValueAtKey(dictionary=createStations3ByStartEndIntervalSpacing_2, key=code_block_9.out2, lacing=CrossProduct)
index_dictionary_valueatkey = DesignScript.Builtin.Dictionary.ValueAtKey(dictionary=createStations3ByStartEndIntervalSpacing_2, key=code_block_9.out3, lacing=CrossProduct)
index_dictionary_valueatkey_2 = DesignScript.Builtin.Dictionary.ValueAtKey(dictionary=createStations3ByStartEndIntervalSpacing, key=code_block_8.out3, lacing=CrossProduct)
code_block_10 = CodeBlock(alignment=code_block_7.alignment, type1PosStations=if_, type2PosStations=if_2, type1MidStations=midstations_dictionary_2, type2MidStation=mirroredorder_dictionary_2, elevations=code_block_7.elevation, index1=index_dictionary_valueatkey, index2=index_dictionary_valueatkey_2) { alignment; type1PosStations; type2PosStations; type1MidStations; type2MidStation; elevations; index1; index2; }

code_block_11 = CodeBlock { null; }
watch_2 = Watch(code_block_7.startstation2)
watch_3 = Watch(code_block_7.endstation)

# group: Creating reference info dict for objects
code_block_12 = CodeBlock { ["docName","aliName","StartStation","EndStation"]; }
code_block_13 = CodeBlock(civilDocumentName=name_2, alignmentName=name, startStation=startstation, endStation=endstation) { civilDocumentName; alignmentName; startStation; endStation; }
list_create = List.Create(item0=code_block_13.civilDocumentName, item1=code_block_13.alignmentName, item2=code_block_13.startStation, item3=code_block_13.endStation)
flatten = List.Flatten(list=list_create)
# note: description
code_block_14 = CodeBlock { ["Source","Type","ObjectDOB"]; ["C3D","Corridor&Alignment"]; }
now = DateTime.Now()
string_from_object_4 = FromObject(obj=now)
addItemToEnd = List.AddItemToEnd(item=string_from_object_4, list=code_block_14.out1)
byKeysValues = DesignScript.Builtin.Dictionary.ByKeysValues(keys=code_block_14.out0, values=addItemToEnd)
code_block_15 = CodeBlock(keys=code_block_12, values=flatten, main_dict=byKeysValues) { keys; values; main_dict; }
byKeysValues_2 = DesignScript.Builtin.Dictionary.ByKeysValues(keys=code_block_12, values=flatten)
code_block_16 = CodeBlock(c3dInfoDict=byKeysValues_2) { c3dInfoDict; }

code_block_17 = CodeBlock { "No config file used"; }
script_CreateMeta = Custom[Script_CreateMeta]()  # creates script meta data to put onto object parameters

# group: creating parameter_value dict for all type objects, including the script info
code_block_18 = CodeBlock { ["ROCO_CTE_Dynamo.GUID","ROCO_CTE_Dynamo.Script"]; }
generateGuid = DynamoROCO.DesignLog.GenerateGuid()
string = StringInput("ConfigFileMeta")
# note: description
code_block_19 = CodeBlock(c3DInfoDict=code_block_16, configFileMeta=code_block_17, scriptMeta=script_CreateMeta) { c3DInfoDict; configFileMeta; scriptMeta; }
byKeysValues_3 = DesignScript.Builtin.Dictionary.ByKeysValues(keys=string, values=code_block_19.configFileMeta)
string_2 = StringInput("ScriptMeta")
setValueAtKeys = DesignScript.Builtin.Dictionary.SetValueAtKeys(dictionary=byKeysValues_3, keys=string_2, values=code_block_19.scriptMeta)
stringifyJSON = Data.StringifyJSON(values=setValueAtKeys, lacing=Longest)
list_create_2 = List.Create(item0=generateGuid, item1=stringifyJSON)
setValueAtKeys_2 = DesignScript.Builtin.Dictionary.SetValueAtKeys(keys=code_block_18, values=list_create_2)  # unwired: dictionary
string_3 = StringInput("ROCO_CTE_Reference_Source_Data")
code_block_20 = CodeBlock(C3D_Reference_Dict=code_block_19.c3DInfoDict) { C3D_Reference_Dict; }
stringifyJSON_2 = Data.StringifyJSON(values=code_block_20, lacing=Longest)

# group: Create Positions for type1
code_block_21 = CodeBlock(alignment=code_block_10.alignment, type1PosStations=code_block_10.type1PosStations, type1MidStations=code_block_10.type1MidStations, elevations=code_block_10.elevations, index1=code_block_10.index1) { alignment; type1PosStations; type1MidStations; elevations; index1; }
code_block_22 = CodeBlock { 0; }
type1points_alignment = CivilConnection.Alignment.PointByStationOffsetElevation(alignment=code_block_21.alignment, station=code_block_21.type1PosStations, offset=code_block_22, elevation=code_block_21.elevations, lacing=CrossProduct)
X = Point.X(point=type1points_alignment)
surveyPoint = Coordinates.SurveyPoint()
X_2 = Point.X(point=surveyPoint)
add = X + X_2
Y = Point.Y(point=type1points_alignment)
Y_2 = Point.Y(point=surveyPoint)
add_2 = Y + Y_2
Z = Point.Z(point=type1points_alignment)
byCoordinates = Point.ByCoordinates(x=add, y=add_2, z=Z)
code_block_23 = CodeBlock(type1Positions=byCoordinates, type1MidStations=code_block_21.type1MidStations, index=code_block_21.index1) { type1Positions; type1MidStations; index; }

code_block_24 = CodeBlock()
# ---------- code_block_24.designscript (12 lines) ----------
["ROCO_CTE_OBS.Code",
"ROCO_CTE_OBS.Description",
"ROCO_CTE_Classification.Uniclass.Co.Code",
"ROCO_CTE_Classification.Uniclass.Co.Description",
"ROCO_CTE_Classification.Uniclass.EF.Code",
"ROCO_CTE_Classification.Uniclass.EF.Description",
"ROCO_CTE_Classification.Uniclass.En.Code",
"ROCO_CTE_Classification.Uniclass.En.Description",
"ROCO_CTE_Classification.Uniclass.SL.Code",
"ROCO_CTE_Classification.Uniclass.SL.Description",
"ROCO_CTE_Classification.Uniclass.Ss.Code",
"ROCO_CTE_Classification.Uniclass.Ss.Description"];
# ----------------------------------------

# group: Classification Input
code_2 = StringInput("")  # "Classification.ROCO.OBS.Code"; graph input
description = StringInput("")  # "Classification.ROCO.OBS.Description"; graph input
code_3 = StringInput("")  # "Uniclass.ROCO.Co.Code"; graph input
description_2 = StringInput("")  # "Uniclass.ROCO.Co.Description"; graph input
code_4 = StringInput("EF_37_50")  # "Classification.Uniclass.EF.Code"; graph input
description_3 = StringInput("Tunnels")  # "Classification.Uniclass.EF.Description"; graph input
code_5 = StringInput("En_")  # "Classification.Uniclass.En.Code"; graph input
description_4 = StringInput("")  # "Classification.Uniclass.En.Description"; graph input
code_6 = StringInput("SL_")  # "Classification.Uniclass.SL.Code"; graph input
description_5 = StringInput("")  # "Classification.Uniclass.SL.Description"; graph input
code_7 = StringInput("Ss_")  # "Classification.Uniclass.Ss.Code"; graph input
description_6 = StringInput("")  # "Classification.Uniclass.Ss.Description"; graph input

list_create_3 = List.Create(item0=code_2, item1=description, item2=code_3, item3=description_2, item4=code_4, item5=description_3, item6=code_5, item7=description_4, item8=code_6, item9=description_5, item10=code_7, item11=description_6)
byKeysValues_4 = DesignScript.Builtin.Dictionary.ByKeysValues(keys=code_block_24, values=list_create_3)
code_block_25 = CodeBlock()
# ---------- code_block_25.designscript (3 lines) ----------
["ROCO_CLE_Base_Offset",
"ROCO_CLE_Top_Offset",
"ROCO_CLE_Cut_Offset"];
# ----------------------------------------
list_create_4 = List.Create(item0=bottom_offset_m, item1=top_offset_m, item2=cut_offset_m)
byKeysValues_5 = DesignScript.Builtin.Dictionary.ByKeysValues(keys=code_block_25, values=list_create_4)
code_block_26 = CodeBlock(familyTypes1=n1st_family_type, familyType2=n2nd_family_type, topOffset=top_offset_m, baseOffset=bottom_offset_m, cutOffset=cut_offset_m, indexStart=roco_pe_id_startid, mirror2ndFam=mirror_1st_family, mirror1stFam=mirror_2nd_family, classificationParameters=byKeysValues_4, geometryParameters=byKeysValues_5)
# ---------- code_block_26.designscript (10 lines) ----------
familyTypes1;
familyType2;
topOffset;
baseOffset;
cutOffset;
indexStart;
mirror2ndFam;
mirror1stFam;
classificationParameters;
geometryParameters;
# ----------------------------------------
byKeysValues_6 = DesignScript.Builtin.Dictionary.ByKeysValues(keys=code_block_18, values=list_create_2)

# group (continued): creating parameter_value dict for all type objects, including the script info
setValueAtKeys_3 = DesignScript.Builtin.Dictionary.SetValueAtKeys(dictionary=byKeysValues_6, keys=string_3, values=stringifyJSON_2)
code_block_27 = CodeBlock(DynamoParameterDict=setValueAtKeys_3) { DynamoParameterDict; }

code_block_28 = CodeBlock(familyTypes1=code_block_26.familyTypes1, familyType2=code_block_26.familyType2, topOffset=code_block_26.topOffset, baseOffset=code_block_26.baseOffset, cutOffset=code_block_26.cutOffset, indexStart=code_block_26.indexStart, mirror2ndFam=code_block_26.mirror2ndFam, mirror1stFam=code_block_26.mirror1stFam, classificationDict=code_block_26.classificationParameters, geometryParameters=code_block_26.geometryParameters, DynamoParameterDict=code_block_27)
# ---------- code_block_28.designscript (11 lines) ----------
familyTypes1;
familyType2;
topOffset;
baseOffset;
cutOffset;
indexStart;
mirror2ndFam;
mirror1stFam;
classificationDict;
geometryParameters;
DynamoParameterDict;
# ----------------------------------------

# group: CreateParameterValues1
code_block_29 = CodeBlock { "ROCO_CNU_OBS.Index"; "ROCO_CNU_Station"; }
code_block_30 = CodeBlock(index1=code_block_23.index, indexstart=code_block_28.indexStart, type1MidStations=code_block_23.type1MidStations, ClassificationDict=code_block_28.classificationDict, geometryParameters=code_block_28.geometryParameters, DynamoParameterDict=code_block_28.DynamoParameterDict) { index1; indexstart; type1MidStations; ClassificationDict; geometryParameters; DynamoParameterDict; }
set1indexvalues = code_block_30.index1 + code_block_30.indexstart
parameterset1_dictionary = DesignScript.Builtin.Dictionary.ByKeysValues(keys=code_block_29.out0, values=set1indexvalues, lacing=CrossProduct)
setValueAtKeys_4 = DesignScript.Builtin.Dictionary.SetValueAtKeys(dictionary=parameterset1_dictionary, keys=code_block_29.out1, values=code_block_30.type1MidStations, lacing=Longest)
keys = DesignScript.Builtin.Dictionary.Keys(dictionary=code_block_30.ClassificationDict)
valueAtKey = DesignScript.Builtin.Dictionary.ValueAtKey(dictionary=code_block_30.ClassificationDict, key=keys)
setValueAtKeys_5 = DesignScript.Builtin.Dictionary.SetValueAtKeys(dictionary=setValueAtKeys_4, keys=keys, values=valueAtKey)
keys_2 = DesignScript.Builtin.Dictionary.Keys(dictionary=code_block_30.geometryParameters)
valueAtKey_2 = DesignScript.Builtin.Dictionary.ValueAtKey(dictionary=code_block_30.geometryParameters, key=keys_2)
setValueAtKeys_6 = DesignScript.Builtin.Dictionary.SetValueAtKeys(dictionary=setValueAtKeys_5, keys=keys_2, values=valueAtKey_2)
keys_3 = DesignScript.Builtin.Dictionary.Keys(dictionary=code_block_30.DynamoParameterDict)
valueAtKey_3 = DesignScript.Builtin.Dictionary.ValueAtKey(dictionary=code_block_30.DynamoParameterDict, key=keys_3)
setValueAtKeys_7 = DesignScript.Builtin.Dictionary.SetValueAtKeys(dictionary=setValueAtKeys_6, keys=keys_3, values=valueAtKey_3)

# group: Create Positions for type2
code_block_31 = CodeBlock(alignment=code_block_10.alignment, type2PosStations=code_block_10.type2PosStations, type2MidStations=code_block_10.type2MidStation, elevations=code_block_10.elevations, index2=code_block_10.index2) { alignment; type2PosStations; type2MidStations; elevations; index2; }
code_block_32 = CodeBlock { 0; }
type2points_alignment = CivilConnection.Alignment.PointByStationOffsetElevation(alignment=code_block_31.alignment, station=code_block_31.type2PosStations, offset=code_block_32, elevation=code_block_31.elevations, lacing=CrossProduct)
X_3 = Point.X(point=type2points_alignment)
surveyPoint_2 = Coordinates.SurveyPoint()
X_4 = Point.X(point=surveyPoint_2)
add_3 = X_3 + X_4
Y_3 = Point.Y(point=type2points_alignment)
Y_4 = Point.Y(point=surveyPoint_2)
add_4 = Y_3 + Y_4
Z_2 = Point.Z(point=type2points_alignment)
byCoordinates_2 = Point.ByCoordinates(x=add_3, y=add_4, z=Z_2)
code_block_33 = CodeBlock(type2Positions=byCoordinates_2, type2MidStations=code_block_31.type2MidStations, index=code_block_31.index2) { type2Positions; type2MidStations; index; }

# group: Create family instances
code_block_34 = CodeBlock(type1Positions=code_block_23.type1Positions, type2Positions=code_block_33.type2Positions, familyType1=code_block_28.familyTypes1, familyType2=code_block_28.familyType2) { type1Positions; type2Positions; familyType1; familyType2; }
byPoints = AdaptiveComponent.ByPoints(points=code_block_34.type1Positions, familyType=code_block_34.familyType1)
byPoints_2 = AdaptiveComponent.ByPoints(points=code_block_34.type2Positions, familyType=code_block_34.familyType2)

# group: CreateParameterValues2
code_block_35 = CodeBlock { "ROCO_CNU_OBS.Index"; "ROCO_CNU_Station"; }
code_block_36 = CodeBlock(index2=code_block_33.index, indexstart=code_block_28.indexStart, type2MidStations=code_block_33.type2MidStations, ClassificationDict=code_block_28.classificationDict, geometryParameters=code_block_28.geometryParameters, DynamoParameterDict=code_block_28.DynamoParameterDict) { index2; indexstart; type2MidStations; ClassificationDict; geometryParameters; DynamoParameterDict; }
set1indexvalues_2 = code_block_36.index2 + code_block_36.indexstart
parameterset1_dictionary_2 = DesignScript.Builtin.Dictionary.ByKeysValues(keys=code_block_35.out0, values=set1indexvalues_2, lacing=CrossProduct)
setValueAtKeys_8 = DesignScript.Builtin.Dictionary.SetValueAtKeys(dictionary=parameterset1_dictionary_2, keys=code_block_35.out1, values=code_block_36.type2MidStations, lacing=Longest)
keys_4 = DesignScript.Builtin.Dictionary.Keys(dictionary=code_block_36.ClassificationDict)
valueAtKey_4 = DesignScript.Builtin.Dictionary.ValueAtKey(dictionary=code_block_36.ClassificationDict, key=keys_4)
setValueAtKeys_9 = DesignScript.Builtin.Dictionary.SetValueAtKeys(dictionary=setValueAtKeys_8, keys=keys_4, values=valueAtKey_4)
keys_5 = DesignScript.Builtin.Dictionary.Keys(dictionary=code_block_36.geometryParameters)
valueAtKey_5 = DesignScript.Builtin.Dictionary.ValueAtKey(dictionary=code_block_36.geometryParameters, key=keys_5)
setValueAtKeys_10 = DesignScript.Builtin.Dictionary.SetValueAtKeys(dictionary=setValueAtKeys_9, keys=keys_5, values=valueAtKey_5)
keys_6 = DesignScript.Builtin.Dictionary.Keys(dictionary=code_block_36.DynamoParameterDict)
valueAtKey_6 = DesignScript.Builtin.Dictionary.ValueAtKey(dictionary=code_block_36.DynamoParameterDict, key=keys_6)
setValueAtKeys_11 = DesignScript.Builtin.Dictionary.SetValueAtKeys(dictionary=setValueAtKeys_10, keys=keys_6, values=valueAtKey_6)

# group: Set Parameters
type_2_code_block = CodeBlock(parameterDict=setValueAtKeys_7, familyInstance=byPoints) { parameterDict; familyInstance; }
type_1_code_block = CodeBlock(parameterDict=setValueAtKeys_11, familyInstance=byPoints_2) { parameterDict; familyInstance; }
familyinstances_list_create = List.Create(item0=type_2_code_block.familyInstance, item1=type_1_code_block.familyInstance)
parameterdict_list_create = List.Create(item0=type_2_code_block.parameterDict, item1=type_1_code_block.parameterDict)
element_SetParams = Custom[element_SetParams](elementInstance=familyinstances_list_create, parameterDict=parameterdict_list_create, lacing=Longest)  # package ROCO Dyf Packages; Sets parameters based on element and parameter dict
