# Dynamo custom node C3DMeta_CorridorFLPoints.dyf (Dynamo 2.3.0.5885)
# category: DynamoROCODyfs.DataFunctions
# create metadata script for corridorflPoint scripts

# group: INPUT
civilDocumentName = Input(civilDocumentName: var[]..[])
corridorName = Input(corridorName: var[]..[])
flPointCode = Input(flPointCode: var[]..[])

# group: Creating reference info dict for objects
code_block = CodeBlock { ["docName","corName","FLpCode"]; }
code_block_2 = CodeBlock(civilDocumentName=civilDocumentName, corridorName=corridorName, flPointCode=flPointCode) { civilDocumentName; corridorName; flPointCode; }
list_create = List.Create(item0=code_block_2.civilDocumentName, item1=code_block_2.corridorName, item2=code_block_2.flPointCode)
transpose = List.Transpose(lists=list_create)
# note: description
code_block_3 = CodeBlock { ["Source","Type","ObjectDOB"]; ["C3D","Corridor&FLPoints"]; }
now = DateTime.Now()
addItemToEnd = List.AddItemToEnd(item=now, list=code_block_3.out1)
byKeysValues = DesignScript.Builtin.Dictionary.ByKeysValues(keys=code_block_3.out0, values=addItemToEnd)
code_block_4 = CodeBlock(keys=code_block, values=transpose, main_dict=byKeysValues) { keys; values; main_dict; }
dict_nested_in_list_python = Python(IN[0]=code_block_4.keys, IN[1]=code_block_4.values, IN[2]=code_block_4.main_dict)  # "dict nested in list: Python Script"
# ---------- dict_nested_in_list_python.python (25 lines) ----------
# Load the Python Standard and DesignScript Libraries
import sys
import clr
clr.AddReference('ProtoGeometry')
from Autodesk.DesignScript.Geometry import *

# The inputs to this node will be stored as a list in the IN variables.
keys, values, main_dict= IN

outlist=[]
# Place your code below this line
for sublist in values:
	tempdict={}
	i=0
	while i< len(keys):
		keyItem= str(keys[i])
		listItem=str(sublist[i])
		tempdict[keyItem]=listItem
		i+=1
		main_dict["Reference"]=tempdict.copy()
				
	outlist.append(main_dict.copy())
		
# Assign your output to the OUT variable.
OUT = outlist
# ----------------------------------------
code_block_5 = CodeBlock(c3dInfoDict=dict_nested_in_list_python) { c3dInfoDict; }

c3dInfoDict = Output(code_block_5)
