# Dynamo custom node Chart.GetChart.dyf (Dynamo 1.3.4.6666)
# category: DynamoROCODyfs.Charts
# Get chart by type and name

element_type = Input()

# group: Get parameters to set for charts
# note: Get parameter values from Revit objects
categories = Categories("GenericAnnotation")
all_elements_of_category = ElementsOfCategory(categories)
name = Element.Name(all_elements_of_category)
eq = element_type == name  # lacing=CrossProduct
flatten = Flatten(eq)
filterByBoolMask = List.FilterByBoolMask(list=all_elements_of_category, mask=flatten)

code_block = CodeBlock { x={"chartName"}; }
parameterByName = Parameter.ParameterByName(element=filterByBoolMask.in, name=code_block, lacing=Longest)
chartName = Input()

# group: Filter element by Chart name
value = Parameter.Value(parameterByName)
eq_2 = value == chartName
filterByBoolMask_2 = List.FilterByBoolMask(list=filterByBoolMask.in, mask=eq_2)
