# Dynamo custom node Colors.ColorsFromString.dyf (Dynamo 1.3.4.6666)
# category: DynamoROCODyfs.Colors
# creates color values based on color string

colors = Input()
string = StringInput(",")
split = String.Split(colors, string, lacing=Longest)
string_2 = StringInput(")")
string_3 = StringInput("")
replace = String.Replace(str=split, searchFor=string_2, replaceWith=string_3, lacing=Longest)
string_4 = StringInput("=")
split_2 = String.Split(replace, string_4, lacing=Longest)
code_block = CodeBlock { 1; }
flatten = List.Flatten(list=split_2, amt=code_block)
getItemAtIndex = List.GetItemAtIndex(list=flatten, index=code_block, lacing=CrossProduct)
code_block_2 = CodeBlock { 3; }
getItemAtIndex_2 = List.GetItemAtIndex(list=getItemAtIndex, index=code_block_2)
toNumber = String.ToNumber(getItemAtIndex_2)
code_block_3 = CodeBlock { 0; }
getItemAtIndex_3 = List.GetItemAtIndex(list=getItemAtIndex, index=code_block_3)
toNumber_2 = String.ToNumber(getItemAtIndex_3)
code_block_4 = CodeBlock { 1; }
getItemAtIndex_4 = List.GetItemAtIndex(list=getItemAtIndex, index=code_block_4)
toNumber_3 = String.ToNumber(getItemAtIndex_4)
code_block_5 = CodeBlock { 2; }
getItemAtIndex_5 = List.GetItemAtIndex(list=getItemAtIndex, index=code_block_5)
toNumber_4 = String.ToNumber(getItemAtIndex_5)
byARGB = Color.ByARGB(a=toNumber, r=toNumber_2, g=toNumber_3, b=toNumber_4, lacing=Longest)
