# Dynamo custom node ConditionalOutput.dyf (Dynamo 2.3.0.5885)
# category: DynamoROCODyfs.ControlFlow
# posts output to true or false, based on conditional

# group: INPUTS
Condition = Input(Condition: var[]..[])
True_ = Input(True: var[]..[])
False_ = Input(False: var[]..[])

python_script = Python(IN[0]=Condition, IN[1]=True_, IN[2]=False_)
# ---------- python_script.python (19 lines) ----------
# Load the Python Standard and DesignScript Libraries
import sys
import clr
clr.AddReference('ProtoGeometry')
from Autodesk.DesignScript.Geometry import *

# The inputs to this node will be stored as a list in the IN variables.
condition, trueVal, falseVal = IN

# Place your code below this line

if condition:
	falseVal=None
else:
	trueVal=None


# Assign your output to the OUT variable.
OUT = {"True": trueVal,"False":falseVal}
# ----------------------------------------
code_block = CodeBlock(x=python_script) { x["True"]; x["False"]; }
True_2 = Output(code_block.out0)  # "True"
False_2 = Output(code_block.out1)  # "False"
