# Dynamo custom node CreateStations3ByStartEndInterval.dyf (Dynamo 2.3.0.5885)
# category: DynamoROCODyfs.Alignments
# Create sequence of stations Start,Mid and End based on the start station, end station and interval of points

startStation = Input(startStation: double)
endstation = Input(endstation: double)
interval = Input(interval: double)
code_block = CodeBlock(startStation=startStation, endStation=endstation, interval=interval) { startStation; endStation; interval; startMidstation=startStation + 0.5* interval; }
range = Range(start=code_block.startStation, end=code_block.endStation, step=code_block.interval)
lastItem = List.LastItem(list=range)
eq = code_block.endStation == lastItem
addItemToEnd = List.AddItemToEnd(item=code_block.endStation, list=range)
flatten = List.Flatten(list=addItemToEnd)
list_create = List.Create(item0=flatten)

# group: if-statement (fixed)
code_block_2 = CodeBlock(boolean=eq, trueValue=range, falseValue=list_create) { boolean; trueValue; falseValue; }
python_script = Python(IN[0]=code_block_2.boolean, IN[1]=code_block_2.trueValue, IN[2]=code_block_2.falseValue)
# ---------- python_script.python (20 lines) ----------
# Load the Python Standard and DesignScript Libraries
import sys
import clr
clr.AddReference('ProtoGeometry')
from Autodesk.DesignScript.Geometry import *

# The inputs to this node will be stored as a list in the IN variables.
dataEnteringNode = IN
boolean=IN[0]

# Place your code below this line

if boolean==True:
	result=IN[1]
else:
	result=IN[2]


# Assign your output to the OUT øvariable.
OUT = result
# ----------------------------------------

flatten_2 = List.Flatten(list=python_script)
count = List.Count(list=flatten_2)
code_block_3 = CodeBlock { 1; }
sub = count - code_block_3
removeItemAtIndex = List.RemoveItemAtIndex(list=flatten_2, indices=sub)
range_2 = Range(start=code_block.startMidstation, end=lastItem, step=code_block.interval)
code_block_4 = CodeBlock(endStation=code_block.endStation, lastCalcStation=lastItem) { endStation; lastCalcStation; lastMidStation=lastCalcStation + (endStation-lastCalcStation)/2; }
watch = Watch(code_block_4.lastMidStation)
flatten_3 = List.Flatten(list=range_2)
addItemToEnd_2 = List.AddItemToEnd(item=watch, list=flatten_3)
list_create_2 = List.Create(item0=addItemToEnd_2)

# group: if-statement (fixed)
code_block_5 = CodeBlock(boolean=eq, trueValue=range_2, falseValue=list_create_2) { boolean; trueValue; falseValue; }
python_script_2 = Python(IN[0]=code_block_5.boolean, IN[1]=code_block_5.trueValue, IN[2]=code_block_5.falseValue)  # same code as python_script

flatten_4 = List.Flatten(list=python_script_2)
code_block_6 = CodeBlock { 0; }
removeItemAtIndex_2 = List.RemoveItemAtIndex(list=flatten_2, indices=code_block_6)
code_block_7 = CodeBlock(startstations=removeItemAtIndex, midstations=flatten_4, endstations=removeItemAtIndex_2) { startstations; midstations; endstations; }
list_create_3 = List.Create(item0=code_block_7.startstations, item1=code_block_7.midstations, item2=code_block_7.endstations)
transpose = List.Transpose(lists=list_create_3)
stations_SME = Output(transpose)  # "stations_SME:List"
code_block_8 = CodeBlock {  }
