# Dynamo custom node CreateStations3ByStartEndIntervalSpacing.dyf (Dynamo 2.3.0.5885)
# category: DynamoROCODyfs.Alignments
# creates stationlist based on start, end, interval and spacing. (spacing can be zero or Null

startStation = Input(startStation: double)
endStation = Input(endStation: double)
interval = Input(interval: double)
spacing_m = Input(spacing_m: var[]..[])
code_block = CodeBlock(startStation=startStation, endStation=endStation, interval=interval, spacing_m=spacing_m) { startStation; endStation; interval; spacing_m; }
python_script = Python(IN[0]=code_block.startStation, IN[1]=code_block.endStation, IN[2]=code_block.interval, IN[3]=code_block.spacing_m)
# ---------- python_script.python (58 lines) ----------
# Load the Python Standard and DesignScript Libraries
import sys
import clr
clr.AddReference('ProtoGeometry')
from Autodesk.DesignScript.Geometry import *

# The inputs to this node will be stored as a list in the IN variables.

startStation=IN[0]
endStation=IN[1]
interval=IN[2]
spacing_m=IN[3]
# Place your code below this line


startStation = float(startStation)
endStation = float(endStation)
interval = float(interval)
try:
	spacing_m = float(spacing_m)
except:
	spacing_m=float(0)
	
tempStationDict = {}
stationsList = []
newStartStation = float(startStation)
i = newStartStation
rno=0


while i <= endStation and rno< 10000:
    i = newStartStation
    if (i + interval) < endStation:
        tempStationDict["index"] = rno
        tempStationDict["startStation"] = i
        tempStationDict["midStation"] = i + (interval / 2)
        tempStationDict["endStation"] = i + interval
        stationsList.append(tempStationDict.copy())
        if i+ interval + spacing_m < endStation:
        	newStartStation = i+interval+spacing_m
        else:
        	break
    else:
    	tempStationDict["index"] = rno
        tempStationDict["startStation"] = i
        tempStationDict["midStation"] = i + (endStation - i) / 2
        tempStationDict["endStation"] = endStation
        stationsList.append(tempStationDict.copy())
        break
    rno += 1

i=len(stationsList) - 1
for i in stationsList:
	if i["startStation"]> endStation:
		i["startStation"] = endStation

# Assign your output to the OUT variable.
OUT = stationsList
# ----------------------------------------
stationsList = Output(python_script)
