# Dynamo custom node CurrentDocument.GetProjectParameters.dyf "CurrentDocument_GetProjectParameters" (Dynamo 2.3.0.5885)
# category: DynamoROCODyfs.Document
# Get current project parameter elements from document

code_block = CodeBlock { "Name"; "Element"; "GUID"; }
python_script = Python()
# ---------- python_script.python (54 lines) ----------
import clr
clr.AddReference('RevitAPI')
from Autodesk.Revit.DB import *
import Autodesk

clr.AddReference("RevitNodes")
import Revit
clr.ImportExtensions(Revit.Elements)

clr.AddReference("RevitServices")
import RevitServices
from RevitServices.Persistence import DocumentManager


doc = DocumentManager.Instance.CurrentDBDocument


names = []
cats = []
vag = []
pgs = []
pts = []
uts = []
isvis = []
elems = []
guids = []
isinst = []
iterator = doc.ParameterBindings.ForwardIterator()
while iterator.MoveNext():
	vag.append(iterator.Key.VariesAcrossGroups)
	names.append(iterator.Key.Name)
	pgs.append(iterator.Key.ParameterGroup)
	pts.append(iterator.Key.ParameterType)
	uts.append(iterator.Key.UnitType)
	isvis.append(iterator.Key.Visible)
	elem = doc.GetElement(iterator.Key.Id)
	elems.append(elem)
	if elem.GetType().ToString() == 'Autodesk.Revit.DB.SharedParameterElement':
		guids.append(elem.GuidValue)
	else: guids.append(None)
	if iterator.Current.GetType().ToString() == 'Autodesk.Revit.DB.InstanceBinding':
		isinst.append(True)
	else:
		isinst.append(False)
	thesecats = []
	for cat in iterator.Current.Categories:
		try:
			thesecats.append(Revit.Elements.Category.ById(cat.Id.IntegerValue))
		except:
			# Return null if category is not supported by Dynamo
			# This way the user knows there are unsupported categories assigned
			thesecats.append(None)
	cats.append(thesecats)
OUT = (names, elems, guids)
# ----------------------------------------
code_block_2 = CodeBlock(x=python_script) { x[0]; x[1]; x[2]; }
byKeysValues = DesignScript.Builtin.Dictionary.ByKeysValues(keys=code_block.out0, values=code_block_2.out0, lacing=CrossProduct)
setValueAtKeys = DesignScript.Builtin.Dictionary.SetValueAtKeys(dictionary=byKeysValues, keys=code_block.out1, values=code_block_2.out1, lacing=Longest)
isNull = Object.IsNull(obj=code_block_2.out2)
code_block_3 = CodeBlock { "N/A"; }
if_ = If(test=isNull, true=code_block_3, false=code_block_2.out2)
setValueAtKeys_2 = DesignScript.Builtin.Dictionary.SetValueAtKeys(dictionary=setValueAtKeys, keys=code_block.out2, values=if_, lacing=Longest)
projectParameters = Output(setValueAtKeys_2)
