# Dynamo custom node Curve.direction.dyf (Dynamo 1.3.4.6666)
# category: DynamoROCODyfs.Curves
# calculates the direction of curve (cw or ccw) i, based on vector between start and endpoint of curve

# group: Input
curve = Input()

endPoint = Curve.EndPoint(curve)
startPoint = Curve.StartPoint(curve)
byTwoPoints = Vector.ByTwoPoints(start=endPoint, end=startPoint)
X = Vector.X(byTwoPoints)
number = DoubleInput(0)
lt = X < number
code_block = CodeBlock { out1="1"; out2="-1"; }
if_ = If(test=lt, true=code_block.out1, false=code_block.out2)
Y = Vector.Y(byTwoPoints)
lt_2 = Y < number
if_2 = If(test=lt_2, true=code_block.out1, false=code_block.out2)
Z = Vector.Z(byTwoPoints)
lt_3 = Z < number
if_3 = If(test=lt_3, true=code_block.out1, false=code_block.out2)
code_block_2 = CodeBlock(in1=if_, in2=if_2, in3=if_3) { in1; in2; in3; out1=in1+in2+in3; }
string = StringInput("-1-1-1")
eq = code_block_2.out1 == string
string_2 = StringInput("true")
string_3 = StringInput("false")
code_block_3 = CodeBlock(in1=string_2, in2=string_3) { in1; in2; out1=in1; out2=in2; }
if_4 = If(test=eq, true=code_block_3.out1, false=code_block_3.out2)

# group: Output
direction = Output(if_4)

number_2 = DoubleInput(0)
byCoordinates = Point.ByCoordinates(x=number_2, y=number_2, z=number_2)
code_block_4 = CodeBlock { 0; }
removeItemAtIndex = List.RemoveItemAtIndex(list=startPoint, indices=code_block_4)
