# Dynamo custom node Curves.directionbypoints.dyf (Dynamo 1.3.4.6666)
# category: DynamoROCODyfs.Curves
# calculates the direction (cw or ccw) by comparing whether or not the startpoints are equal to previous and same for the endpoints of the curve

# group: input
curve = Input()

endPoint = Curve.EndPoint(curve)

# group: Compare endpoints
byCoordinates = Point.ByCoordinates()
code_block = CodeBlock(list=endPoint) { list; }
addItemToEnd = List.AddItemToEnd(item=byCoordinates, list=code_block)
xyz = Custom[Point.xyz](point=addItemToEnd)  # get xyz coordinates from point
addItemToFront = List.AddItemToFront(item=byCoordinates, list=code_block)
xyz_2 = Custom[Point.xyz](point=addItemToFront)
eq = xyz.x == xyz_2.x
count = List.Count(eq)
code_block_2 = CodeBlock { 1; }
sub = count - code_block_2
removeItemAtIndex = List.RemoveItemAtIndex(list=eq, indices=sub)
code_block_3 = CodeBlock { out1="1"; out2="0"; }
if_ = If(test=removeItemAtIndex, true=code_block_3.out1, false=code_block_3.out2)
eq_2 = xyz.y == xyz_2.y
removeItemAtIndex_2 = List.RemoveItemAtIndex(list=eq_2, indices=sub)
if_2 = If(test=removeItemAtIndex_2, true=code_block_3.out1, false=code_block_3.out2)
eq_3 = xyz.z == xyz_2.z
removeItemAtIndex_3 = List.RemoveItemAtIndex(list=eq_3, indices=sub)
if_3 = If(test=removeItemAtIndex_3, true=code_block_3.out1, false=code_block_3.out2)
code_block_4 = CodeBlock(in1=if_, in2=if_2, in3=if_3) { in1; in2; in3; out1=in1+in2+in3; }

startPoint = Curve.StartPoint(curve)

# group: Compare startpoints
byCoordinates_2 = Point.ByCoordinates()
code_block_5 = CodeBlock(list=startPoint) { list; }
addItemToEnd_2 = List.AddItemToEnd(item=byCoordinates_2, list=code_block_5)
xyz_3 = Custom[Point.xyz](point=addItemToEnd_2)
addItemToFront_2 = List.AddItemToFront(item=byCoordinates_2, list=code_block_5)
xyz_4 = Custom[Point.xyz](point=addItemToFront_2)
eq_4 = xyz_3.x == xyz_4.x
code_block_6 = CodeBlock { 0; }
removeItemAtIndex_4 = List.RemoveItemAtIndex(list=eq_4, indices=code_block_6)
code_block_7 = CodeBlock { out1="1"; out2="0"; }
if_4 = If(test=removeItemAtIndex_4, true=code_block_7.out1, false=code_block_7.out2)
eq_5 = xyz_3.y == xyz_4.y
removeItemAtIndex_5 = List.RemoveItemAtIndex(list=eq_5, indices=code_block_6)
if_5 = If(test=removeItemAtIndex_5, true=code_block_7.out1, false=code_block_7.out2)
eq_6 = xyz_3.z == xyz_4.z
removeItemAtIndex_6 = List.RemoveItemAtIndex(list=eq_6, indices=code_block_6)
if_6 = If(test=removeItemAtIndex_6, true=code_block_7.out1, false=code_block_7.out2)
code_block_8 = CodeBlock(in1=if_4, in2=if_5, in3=if_6) { in1; in2; in3; out1=in1+in2+in3; }

eq_7 = code_block_4.out1 == code_block_8.out1
code_block_9 = CodeBlock { "000"; }
if_7 = If(test=eq_7, true=code_block_4.out1, false=code_block_9)
string = StringInput("111")
eq_8 = if_7 == string
direction = Output(eq_8)
