# Dynamo custom node Document.ProjectInfoElement.dyf (Dynamo 2.3.0.5885)
# category: DynamoROCODyfs.Document
# Get project info as element

toggle = Input(toggle: bool = true)
python_script = Python(IN[0]=toggle)
# ---------- python_script.python (26 lines) ----------
import clr
clr.AddReference("RevitServices")
import RevitServices
from RevitServices.Persistence import DocumentManager

doc = DocumentManager.Instance.CurrentDBDocument

elementDict = dict()
projinfo = doc.ProjectInformation
elementDict["OrganizationName"]= projinfo.OrganizationName
elementDict["OrganizationDescription"]= projinfo.OrganizationDescription
elementDict["BuildingName"]= projinfo.BuildingName

try:
	elementDict["Author"]=projinfo.Author
except:
	elementDict["Author"] = None

elementDict["IssueDate"]=projinfo.IssueDate
elementDict["Status"]=projinfo.Status
#elementlist.append(projinfo.ClientName)
#elementlist.append(projinfo.Address)
#elementlist.append(projinfo.Name)
#elementlist.append(projinfo.Number)
elementDict["Parameters"] = projinfo.Parameters
OUT = projinfo
# ----------------------------------------
ProjectInfo = Output(python_script)
