# Dynamo custom node Document.SelectElementByID.dyf "SelectElementByID" (Dynamo 2.3.0.5885)
# category: DynamoROCODyfs.Document.Selection
# Fysically select objects in document by elementID

elementId = Input(elementId: double[])
currentdocumentselection_python = Python(IN[0]=elementId)  # "CurrentDocumentSelection: Python Script"
# ---------- currentdocumentselection_python.python (33 lines) ----------
# Load the Python Standard and DesignScript Libraries
import sys
import clr
clr.AddReference("System")
from System.Collections.Generic import List
clr.AddReference("RevitServices")
import RevitServices
from RevitServices.Persistence import DocumentManager
clr.AddReference("RevitAPIUI")
from Autodesk.Revit.UI.Selection import *
clr.AddReference('RevitAPI')
from Autodesk.Revit.DB import *



# The inputs to this node will be stored as a list in the IN variables.
ElementList = IN[0]

# Place your code below this line
UIdoc = DocumentManager.Instance.CurrentUIDocument
dbDocument = DocumentManager.Instance.CurrentDBDocument

elem_id=list()

for id in ElementList:
	elem_id.append(ElementId(id))

icol= List[ElementId](elem_id)
element_ids = UIdoc.Selection.SetElementIds(icol)


# Assign your output to the OUT variable.
OUT = element_ids
# ----------------------------------------
