# Dynamo custom node Document.SetCoordinateSystem.dyf "SetCoordinateSystem" (Dynamo 2.3.0.5885)
# category: DynamoROCODyfs.Document.Location
# Changes the coordinate system without changing the project reference points (Project Basepoint and Survey Point). Requires string id of the coordinate system to work.

coordinateSystemId = Input(coordinateSystemId: string = "Belge72/b.Lambert72A")
setparam_python_script = Python(IN[0]=coordinateSystemId)
# ---------- setparam_python_script.python (33 lines) ----------
import clr
clr.AddReference('RevitAPI')
from Autodesk.Revit.DB import *
from Autodesk.Revit.DB.UnitUtils import *

clr.AddReference("RevitNodes")
import Revit
from Revit.Elements import *
clr.ImportExtensions(Revit.Elements)

clr.AddReference("RevitServices")
import RevitServices
from RevitServices.Persistence import DocumentManager

from RevitServices.Transactions import TransactionManager

doc = DocumentManager.Instance.CurrentDBDocument
TransactionManager.Instance.EnsureInTransaction(doc)
stringOut = ""

try:
	doc.SiteLocation.SetGeoCoordinateSystem(IN[0])
except:
	stringOut= stringOut + "Failed to change coordinate system" 
	if IN[0]=="":
		stringOut= stringOut+ ", No coordinate system defined"
	if IN[0]==None:
		stringOut= stringOut+ ", no input defined"
	elif IN[0]!="":
		stringOut= stringOut+", Coordinate system not recognized"

	
OUT= stringOut
# ----------------------------------------
errorMessage = Output(setparam_python_script)
