# Dynamo custom node Documents.getRoot.dyf (Dynamo 1.3.4.6666)
# category: DynamoROCODyfs.Document
# Get document rooth w.o. file name based on document

document = Input(document:Document)
filePath = Document.FilePath(document)
code_block = CodeBlock { "\\"; }
split = String.Split(filePath, code_block)
count = List.Count(split)
code_block_2 = CodeBlock { 1; }
sub = count - code_block_2
removeItemAtIndex = List.RemoveItemAtIndex(list=split, indices=sub)
code_block_3 = CodeBlock { "\\"; }
add = removeItemAtIndex + code_block_3
concat = String.Concat(add)
filepath = Output(concat)
