# Dynamo custom node Element.GetSharedParameter.dyf (Dynamo 2.3.0.5885)
# category: DynamoROCODyfs.Elements
# Gets all shared parameters of object

element = Input(element: var[]..[])
element_getsharedparameter = Python(IN[0]=element)  # "Element_GetSharedParameter: Python Script"
# ---------- element_getsharedparameter.python (47 lines) ----------
import clr
clr.AddReference('RevitAPI')
from Autodesk.Revit.DB import *
from Autodesk.Revit.DB.UnitUtils import *

clr.AddReference("RevitNodes")
import Revit
from Revit.Elements import *
clr.ImportExtensions(Revit.Elements)

clr.AddReference("RevitServices")
import RevitServices
from RevitServices.Persistence import DocumentManager

from RevitServices.Transactions import TransactionManager
	
doc = DocumentManager.Instance.CurrentDBDocument
TransactionManager.Instance.EnsureInTransaction(doc)


outDict= {}

outList =[]

items = IN[0]
if "LIST" in str(type(items)).ToUpper():
	for item in items:
		unwrapItem = UnwrapElement(item)
		itemParam=item.Parameters
		for param in itemParam:
			unwrappedParam = unwrapItem.GetParameters(param.Name)[0]
			if unwrappedParam.IsShared:
				outDict[str(unwrappedParam.GUID)] = {"element":item, "elementId":item.Id,  "elementUId":item.UniqueId, "guid":unwrappedParam.GUID,"Name":param.Name,"Value":param.Value}
		outList.append(outDict.copy())
else:
	item = items
	unwrapItem = UnwrapElement(item)
	itemParam=item.Parameters
	for param in itemParam:
		unwrappedParam = unwrapItem.GetParameters(param.Name)[0]
		if unwrappedParam.IsShared:
			outDict[str(unwrappedParam.GUID)] = {"element":item, "elementId":item.Id, "elementUId":item.UniqueId, "guid":unwrappedParam.GUID,"Name":param.Name,"Value":param.Value}
	outList.append(outDict.copy())
	
TransactionManager.Instance.TransactionTaskDone()

OUT = outList
# ----------------------------------------
parameters = Output(element_getsharedparameter)
