# Dynamo custom node Element.ReadC3DHost.dyf "Parameter.ReadC3DHost" (Dynamo 2.3.0.5885)
# category: DynamoROCODyfs.Elements
# Reads civil3D host from ROCO host paramaeters

# group: Input
selectedElements = Input(selectedElements: var[]..[])

# group: getCivilReferenceData from elements
code_block = CodeBlock(selectedElements=selectedElements) { selectedElements; }
code_block_2 = CodeBlock { "ROCO_CTE_Reference_Source_Data"; "ROCO_CNU_Station"; }
getParameterValueByName = Element.GetParameterValueByName(element=code_block, parameterName=code_block_2.out0)
parseJSON = Data.ParseJSON(json=getParameterValueByName)
code_block_3 = CodeBlock(x=parseJSON) { x["name"]; x["C3D info"]["ObjectDOB"]; c3dReference = x["C3D info"]["Reference"]; }
getParameterValueByName_2 = Element.GetParameterValueByName(element=code_block, parameterName=code_block_2.out1)
string_from_object = FromObject(obj=getParameterValueByName_2)
byKeysValues = DesignScript.Builtin.Dictionary.ByKeysValues(keys=string_from_object, values=code_block)
code_block_4 = CodeBlock(objectName=code_block_3.out0, objectDOB=code_block_3.out1, C3DReference=code_block_3.c3dReference, elementDict=byKeysValues) { objectName; objectDOB; C3DReference; elementDict; }

# group: Output
elementDict = Output(code_block_4.elementDict)
objectName = Output(code_block_4.objectName)
objectDOB = Output(code_block_4.objectDOB)
C3DReference = Output(code_block_4.C3DReference)
