# Dynamo custom node Element.SearchForParameter.dyf (Dynamo 2.3.0.5885)
# category: DynamoROCODyfs.Elements
# searches all element parameter and returns list of matching items

element = Input(element: var[]..[])
parameters = Element.Parameters(element=element)
name = Parameter.Name(parameter=parameters)
searchFor = Input(searchFor: var[]..[])
ignoreCase = Input(ignoreCase: var[]..[])
contains = String.Contains(str=name, searchFor=searchFor, ignoreCase=ignoreCase)
filterByBoolMask = List.FilterByBoolMask(list=parameters, mask=contains)
Match = Output(filterByBoolMask.in)
watch = Watch(filterByBoolMask.out)
