# Dynamo custom node Element.delete_NameContains.dyf (Dynamo 1.3.4.6666)
# category: DynamoROCODyfs.Elements
# Delete alle elements in project by category, where name matches input string

category = Input()
all_elements_of_category = ElementsOfCategory(category)
name = Element.Name(all_elements_of_category)
toUpper = String.ToUpper(name)
searchFor = Input()
ignoreCase = Input()
contains = String.Contains(str=toUpper, searchFor=searchFor, ignoreCase=ignoreCase)
filterByBoolMask = List.FilterByBoolMask(list=all_elements_of_category, mask=contains)
delete = archilab.Revit.Elements.Elements.Delete(filterByBoolMask.in)
name_2 = Element.Name(filterByBoolMask.in)
