# Dynamo custom node ElementToPolyCurve.dyf "Element.ToPolyCurve" (Dynamo 1.3.3.4111)
# category: DynamoROCODyfs.Elements

element = Input(element : Element)
curves = Element.Curves(element)
code_block = CodeBlock { 1; }
flatten = List.Flatten(list=curves, amt=code_block)
byJoinedCurves = PolyCurve.ByJoinedCurves(flatten)
Geometry = Output(byJoinedCurves)
length = Curve.Length(byJoinedCurves)
Length = Output(length)
