# Dynamo custom node Elements.associateFamParameters.dyf "Element.associateFamParameters" (Dynamo 1.3.4.6666)
# category: DynamoROCODyfs.Elements
# associate family parameters to list of elements

element = Input()
elemParameterNames = Input()
famParameterNames = Input()
python_script = Python(IN[0]=element, IN[1]=elemParameterNames, IN[2]=famParameterNames)
# ---------- python_script.python (50 lines) ----------
import clr
clr.AddReference('RevitAPI')
from Autodesk.Revit.DB import *

clr.AddReference('RevitNodes')

import Revit
clr.ImportExtensions(Revit.GeometryConversion)
clr.ImportExtensions(Revit.Elements)

clr.AddReference('RevitServices')
from RevitServices.Persistence import DocumentManager
from RevitServices.Transactions import TransactionManager

doc = DocumentManager.Instance.CurrentDBDocument

elem = UnwrapElement(IN[0])
paramNames = IN[1]
famNames = IN[2]

if not isinstance(paramNames, list):
	paramNames = [paramNames]
if not isinstance(famNames, list):
	famNames = [famNames]
famParams = doc.FamilyManager.Parameters
for e in elem:
	elemParams = e.Parameters
	
	elemAssoc = []
	famAssoc = []
	
	for param in elemParams:
		for name in paramNames:
			if param.Definition.Name == name:
				elemAssoc.append(param)
	
	for fparam in famParams:
		for fname in famNames:
			if fparam.Definition.Name == fname:
				famAssoc.append(fparam)
	
	TransactionManager.Instance.EnsureInTransaction(doc)
	
	for i,j in zip(elemAssoc, famAssoc):
		doc.FamilyManager.AssociateElementParameterToFamilyParameter(i, j)
		
	TransactionManager.Instance.TransactionTaskDone()

OUT = elem
#from https://forum.dynamobim.com/t/associate-family-parameter-in-a-family/19709/7
# ----------------------------------------
elem = Output(python_script)
