# Dynamo custom node EndStationToUse.dyf (Dynamo 1.3.4.6666)
# category: DynamoROCODyfs.Alignments
# Depending on the value of the end station input, selects the input value or the alignment length

alignment = Input()
end = CivilConnection.Alignment.End(alignment)

# group: If the endstation==0, use the alignment endstation
code_block = CodeBlock { 0; }
endStation = Input()
ne = code_block != endStation
if_ = If(test=ne, true=endStation, false=end)

# group: if the user defined endstation is beyond the alignment use alignment endstation
le = if_ <= end
if_2 = If(test=le, true=if_, false=end)

station = Output(if_2)
