# Dynamo custom node Family.CreateNewType.dyf (Dynamo 1.3.4.6666)
# category: DynamoROCODyfs.Family
# creates new family type in the open family document

new_type_name = Input(new_type_name: string = "General")
create_new_familytype_python = Python(IN[0]=new_type_name)  # "create new familyType: Python Script"
# ---------- create_new_familytype_python.python (50 lines) ----------
import clr

clr.AddReference("RevitAPI")
from Autodesk.Revit.DB import *

clr.AddReference("RevitServices")
import RevitServices
from RevitServices.Persistence import DocumentManager
from RevitServices.Transactions import TransactionManager
import Autodesk
from Autodesk.Revit.DB import *

# The inputs to this node will be stored as a list in the IN variables.
dataEnteringNode = IN

new_type_name = IN[0]
check = 0

doc = DocumentManager.Instance.CurrentDBDocument  # GETS CURRENT DOCUMENT

TransactionManager.Instance.EnsureInTransaction(doc)  # ensures transaction with document core
if doc.IsFamilyDocument:
    fam_manager = doc.FamilyManager
    fam = doc.OwnerFamily
    fam_types = fam_manager.Types

    if fam_manager.Types.IsEmpty:
        fam_type = fam_manager.NewType("General")
        fam_type_name = fam_type.Name
    else:
        for type in fam_types:
            fam_type_name = type.Name
            if new_type_name == fam_type_name:
                check = 1
                break
        if check == 0:
            try:
                fam_type = fam_manager.NewType(new_type_name)
                fam_type_name = fam_type.Name
                task_msg = "succesfully create type: " + fam_type_name
            except:
                task_msg = "invalid input"
                fam_type = []
        else:
            task_msg = "name already exists"
            fam_type = []

TransactionManager.Instance.TransactionTaskDone()  # closes transaction manager with document core

OUT = fam_type, task_msg
# ----------------------------------------
code_block = CodeBlock(x=create_new_familytype_python) { x[0]; x[1]; }
family_types = Output(code_block.out0)
task_message = Output(code_block.out1)
