# Dynamo custom node FamilySelectionUIData.FromName.dyf "FamilySelectionUIData_FromName" (Dynamo 2.3.0.5885)
# category: DynamoROCODyfs.UIObjects.Data
# Creates family ui data from Family Names

# group: Input
familyName = Input(familyName: var[]..[])

# group: creating input data for selecting families and type in UI
# note: description
byName = Family.ByName(name=familyName)
types = Family.Types(family=byName)
python_script = Python(IN[0]=types)
# ---------- python_script.python (21 lines) ----------
# Load the Python Standard and DesignScript Libraries
import sys
import clr
clr.AddReference('ProtoGeometry')
from Autodesk.DesignScript.Geometry import *

# The inputs to this node will be stored as a list in the IN variables.
inlist=IN[0]
templist=[]
outlist=[]
# Place your code below this line
for sublist in inlist:
	templist.Clear()
	for item in sublist:
		for i in item:
			templist.append(i)
	outlist.append(list(templist))
			
		
# Assign your output to the OUT variable.
OUT = outlist
# ----------------------------------------
isEmpty = List.IsEmpty(list=python_script, lacing=Longest)
code_block = CodeBlock { ["N/A"]; }
code_block_2 = CodeBlock(targetlist=python_script, booleanList=isEmpty, itemToPlace=code_block) { targetlist; booleanList; itemToPlace; }
replaceitemsbybool_python_script = Python(IN[0]=code_block_2.targetlist, IN[1]=code_block_2.booleanList, IN[2]=code_block_2.itemToPlace)
# ---------- replaceitemsbybool_python_script.python (20 lines) ----------
# Load the Python Standard and DesignScript Libraries
import sys
import clr
clr.AddReference('ProtoGeometry')
from Autodesk.DesignScript.Geometry import *

# The inputs to this node will be stored as a list in the IN variables.
targetlist, booleanlist, replaceitem = IN
i=0
# Place your code below this line
try:
	while i< len(booleanlist):
		if booleanlist[i]:
			targetlist[i]=replaceitem
		i+=1
except:
	pass

# Assign your output to the OUT variable.
OUT = targetlist
# ----------------------------------------
name = Family.Name(family=byName)
string = StringInput(" | Type: ")
operators = name + string  # lacing=Longest
name_2 = FamilyType.Name(familyType=types)
operators_2 = operators + name_2
string_2 = StringInput("  | Category: ")
operators_3 = operators_2 + string_2  # lacing=Longest
getCategory = Element.GetCategory(element=types)
operators_4 = operators_3 + getCategory
python_script_2 = Python(IN[0]=operators_4)  # same code as python_script
isEmpty_2 = List.IsEmpty(list=python_script_2, lacing=Longest)
code_block_3 = CodeBlock { ["no family or type found"]; }
code_block_4 = CodeBlock(targetlist=python_script_2, booleanList=isEmpty_2, itemToPlace=code_block_3) { targetlist; booleanList; itemToPlace; }
replaceitemsbybool_python_script_2 = Python(IN[0]=code_block_4.targetlist, IN[1]=code_block_4.booleanList, IN[2]=code_block_4.itemToPlace)  # same code as replaceitemsbybool_python_script
code_block_5 = CodeBlock(familyTypes=replaceitemsbybool_python_script, inputFamilyTypeString=replaceitemsbybool_python_script_2) { familyTypes; inputFamilyTypeString; }

# group: Output
inputFamilyTypeString = Output(code_block_5.inputFamilyTypeString)
familyTypes = Output(code_block_5.familyTypes)
