# Dynamo custom node JoinElements.dyf (Dynamo 2.3.0.5885)
# category: DynamoROCODyfs.Elements
# cut or join element instances

# group: Input
mainElement = Input(mainElement: var[]..[])
joiningElement = Input(joiningElement: var[]..[])
joinObjects = Input(joinObjects: bool = true)

# group: Cut geometry
code_block = CodeBlock(HOSTELEMENT=mainElement, jcINSTANCE=joiningElement, joinObjects=joinObjects) { HOSTELEMENT; jcINSTANCE; joinObjects; }
join_elements_python_script = Python(IN[0]=code_block.HOSTELEMENT, IN[1]=code_block.jcINSTANCE, IN[2]=code_block.joinObjects)
# ---------- join_elements_python_script.python (49 lines) ----------
import clr
import sys
# import Revit API
clr.AddReference('RevitAPI')
from Autodesk.Revit.DB import *
# import Revit API UI
clr.AddReference('RevitAPIUI')
# import Revit Services
clr.AddReference('RevitServices')
import RevitServices
from RevitServices.Persistence import DocumentManager
from RevitServices.Transactions import TransactionManager 
# import ProtoGeometry 
clr.AddReference('ProtoGeometry')
from Autodesk.DesignScript.Geometry import *

dmi=DocumentManager.Instance #setting up document manager instance
doc=dmi.CurrentDBDocument #Gets current document
uiapp = dmi.CurrentUIApplication #gets current Revit app 
app= uiapp.Application #gets current UI app

#The inputs to this node will be stored as a list in the IN variables.
hostElem, jcElem, joinType = UnwrapElement(IN)

msg=list()
# Start Transaction
TransactionManager.Instance.EnsureInTransaction(doc)

if joinType:
	try:
		JoinGeometryUtils.JoinGeometry(doc, jcElem, hostElem)
		msg.append("SUCCESS")
	except:
		pass
else:
	try:
		if InstanceVoidCutUtils.IsVoidInstanceCuttingElement(jcElem):
			InstanceVoidCutUtils.AddInstanceVoidCut(doc, hostElem, jcElem)
			msg.append("SUCCES")
		else:
			SolidSolidCutUtils.AddCutBetweenSolids(doc,hostElem, jcElem)
			msg.append("SUCCES")
	except:
		pass

# End Transaction
TransactionManager.Instance.TransactionTaskDone()

OUT=msg
# ----------------------------------------

# group: Output
msg = Output(join_elements_python_script)
