# Dynamo custom node List.Filterbystring.dyf (Dynamo 2.3.0.5885)
# category: DynamoROCODyfs.Lists
# Filters targetlist based on string:
# | is used to define 'or'
# , is used to define 'and'

Filterlist = Input(Filterlist: var[]..[])
TargetList = Input(TargetList: var[]..[])
ignorCase = Input(ignorCase: bool = true)
code_block = CodeBlock(filters=Filterlist, targetList=TargetList, ignoreCase=ignorCase) { filters; targetList; ignoreCase; }
python_script = Python(IN[0]=code_block.filters, IN[1]=code_block.targetList, IN[2]=code_block.ignoreCase)
# ---------- python_script.python (76 lines) ----------
# Load the Python Standard and DesignScript Libraries
import sys
import clr
clr.AddReference('ProtoGeometry')
from Autodesk.DesignScript.Geometry import *
# functions

def unique(list0): 
    # insert the list to the set 
    list_set = set(list0) 
    # convert the set to the list 
    unique_list = (list(list_set)) 
    return unique_list
    
# The inputs to this node will be stored as a list in the IN variables.
filters=IN[0]
targetlist = IN[1]
ignorecase=IN[2]

outdict={}
tempdict={}
list1=[]
target_templist=[]
target_temp = list(targetlist)
target_outlist=[]
i=0
# Place your code below this line
for filtr in filters:
    if "str" in str(type(filtr)):
        list1.append(filtr.split(","))
    else:
        list1.append(["@/NSF/@"])
    i += 1

if ignorecase:  # setting all items to lower instead of capitalized, then reassinging them in the to edit list.
    j = 0
    for sublist in list1:
        k = 0
        for item in sublist:
            sublist[k] = item.lower()
            k += 1
        list1[j] = sublist
        j += 1
    j = 0
    for item in target_temp:
        target_temp[j] = item.lower()
        j += 1

outdict["filters"] = list1

for sublist in list1:                   #FOR SUBLIST IN LIST OF SEARCH QUERIES
    target_templist.Clear()             #CLEAR TEMP LIST OF TARGETS
    count0 = 0                          #SETTING REFERENCE VALUE 0
    for target in target_temp:          #FOR EACH SEARCH QUERY
        count1 = 0                      #COUNT MATCHES=O
        for item in sublist:            #FOR EACH SEARCH ITEM IN THE SEARCH QUERY
            if "|" in item:             # filter based on OR value
                item = item.split("|")  #split the match cases
                for i in item:          #if 1 of the matches is in the string, add 1 to the counter
                    if i in target:
                        count1 += 1
                        break
            elif "!=" in item[:2]:       #if search query contains "not" symbol
                if item[2:] in target:
                    count1 -= 1         #reduces count of checks
                else:
                	count1 += 1
            elif item in target:        #if target contains stringvalue
                count1 += 1
        if count1 == len(sublist):
            target_templist.append(targetlist[count0])
        count0 += 1
    target_outlist.append(unique(list(target_templist)))
outdict["match"] = target_outlist
# Assign your output to the OUT variable.
OUT = outdict
# ----------------------------------------
