# Dynamo custom node Lists.ItemsToString.dyf "List.ItemsToString" (Dynamo 2.2.1.5175)
# category: DynamoROCODyfs.Lists
# converts list items to string

inlist = Input(inlist: List)
force_nested_list_to_string_for = Python(IN[0]=inlist)  # "force nested list to string for incoming list: python script"
# ---------- force_nested_list_to_string_for.python (48 lines) ----------
import clr
clr.AddReference('ProtoGeometry')
from Autodesk.DesignScript.Geometry import *
#The inputs to this node will be stored as a list in the IN variables.
def getListItems(l,c=0, g=""):
	oList1=[]
	oList2=[]
	tList1=[]
	group=g #defines the grouping index of values (0 by default)
	counter=c #counter for levels of nesting (to create correct structure for output)
	loopnum=0
	for e in l: #for each element in list
		if isinstance(e, list): #if element is of type 'list'
			counter=c+1 #add 1 to counter
			group=group + "\." + str(loopnum)
			oList1.append([e, counter,group]) #rerun function
		else: 
			oList1.append([e,counter, group])#append value and nestlvl of element to outptulist
		loopnum=loopnum+1
	#return oList1	
	oList2.append(list(oList1))
	return oList1 #returns list [listvalue, additional nest lvls] 
#--------------------------------end functions
	
inlist=IN[0]
outValue=[]
outNestlvl=[]
outGrp=[]

templist1=[]
templist2=[]
templist3=[]
t0=[]

templist=[]
groupnum=0


for i in inlist:
	t0=getListItems(i,0,str(groupnum))
	templist1.Clear()
	for e in t0:
		templist1.append(str(e[0])) #gets element value
	outValue.append(list(templist1))
	groupnum=groupnum+1
	
#Assign your output to the OUT variable.
OUT = outValue
# ----------------------------------------
List = Output(force_nested_list_to_string_for)
