# Dynamo custom node LoadRocoLogo.dyf (Dynamo 2.3.0.5885)
# category: DynamoROCODyfs.UIObjects

python_script = Python()  # unwired: IN[0]
# ---------- python_script.python (29 lines) ----------
# Importing Reference Modules
# CLR ( Common Language Runtime Module )
import clr
# Adding the DynamoRevitDS.dll module to work with the Dynamo API
clr.AddReference('DynamoRevitDS')
import Dynamo 

# access to the current Dynamo instance and workspace
dynamoRevit = Dynamo.Applications.DynamoRevit()
currentWorkspace = dynamoRevit.RevitDynamoModel.CurrentWorkspace

# Access current version of dynamo
version=dynamoRevit.RevitDynamoModel.Version

# checks version of dynamo and adjusts output according to version
if version.StartsWith("1."):
	
	# Gets file name which includes full path
	filename=currentWorkspace.FileName
	
	
	# Splits out file path to just file name
	OUT=filename

elif version.StartsWith("2."):
	OUT=currentWorkspace.FileName

else:
	OUT="Not supported"
# ----------------------------------------
directoryName = FileSystem.DirectoryName(path=python_script)
code_block = CodeBlock { "\\config_files\\ROCO.jpg"; }
concat = String.Concat(string0=directoryName, string1=code_block)
fromPath = FileObject(path=concat)  # "File.FromPath"
readFromFile = Image.ReadFromFile(file=fromPath)
image = Output(readFromFile)
