# Dynamo custom node MatchRegEx.dyf (Dynamo 2.3.0.5885)
# category: DynamoROCODyfs.String
# Matches string input with regular expression

data = Input(data: var)
string_from_object = FromObject(obj=data)
Regex = Input(Regex: string)
python_script = Python(IN[0]=string_from_object, IN[1]=Regex)
# ---------- python_script.python (20 lines) ----------
# ROCO_Match regular exprssion

#Load the Python Standard and DesignScript Libraries
import sys
import clr
import re

# The inputs to this node will be stored as a list in the IN variables.
data_in = IN[0]
regex = IN[1]

# Place your code below this line
data_check = re.compile(regex)
if data_check.match(data_in):
	result = True
else:
	result = False
	
# Assign your output to the OUT variable.
OUT = result
# ----------------------------------------
output = Output(python_script)
