# Dynamo custom node Materials.GetAll.dyf (Dynamo 2.2.1.5175)
# category: DynamoROCODyfs.Materials
# gets all materials of current document

categories = Categories("OST_Materials")  # graph input

# group: Get material info
all_elements_of_category = ElementsOfCategory(Category=categories)
name = Element.Name(element=all_elements_of_category)
byName = Material.ByName(name=name)
materialClass = Material.MaterialClass(material=byName)
materialCategory = Material.MaterialCategory(material=byName)
parameters = Element.Parameters(element=all_elements_of_category)

# group: OUTPUT
Elements = Output(all_elements_of_category)
Name = Output(name)
class_ = Output(materialClass)  # "class"
Category = Output(materialCategory)
Parameter = Output(parameters)  # "Parameter[]"
