# Dynamo custom node NeedsDummyAlignment.dyf (Dynamo 1.3.4.6666)
# category: DynamoROCODyfs.Alignments

endstation = Input()
alignment = Input()
length = Curve.Length(alignment)
ge = endstation >= length
code_block = CodeBlock { false; true; }
if_ = If(test=ge, true=code_block.out0, false=code_block.out1)
code_block_2 = CodeBlock { 0; }
eq = endstation == code_block_2
if_2 = If(test=eq, true=code_block.out0, false=code_block.out1)
startstation = Input()
eq_2 = code_block_2 == startstation
if_3 = If(test=eq_2, true=code_block.out0, false=code_block.out1)
or_ = Or(if_, if_2, if_3)
NeedsDummy = Output(or_)
