# Dynamo custom node OpenDetachedPreserve.dyf "OpenAsDetachedPreserve" (Dynamo 2.3.0.5885)
# category: DynamoROCODyfs.Document.Upgrade
# Opens all files from filepath, and saves them to destination path (including filename)

sourceFilePath = Input(sourceFilePath: var[]..[])
destinationFilePath = Input(destinationFilePath: var[]..[])
python_script = Python(IN[0]=sourceFilePath, IN[1]=destinationFilePath)
# ---------- python_script.python (50 lines) ----------
# Load the Python Standard and DesignScript Libraries
import sys
import clr
clr.AddReference('ProtoGeometry')
from Autodesk.DesignScript.Geometry import *
clr.AddReference('RevitAPI')

from Autodesk.Revit.DB import *
from Autodesk.Revit.DB.UnitUtils import *
clr.AddReference("RevitServices")
import RevitServices
from RevitServices.Persistence import DocumentManager
from Autodesk.Revit.ApplicationServices import *
# The inputs to this node will be stored as a list in the IN variables.
sourceFilePath, destinationFilePath=IN[0],IN[1]

fileName=sourceFilePath.Split("\\")[(len(sourceFilePath.Split("\\"))-1)]
msg="filename: "+fileName
# Place your code below this line
doc = DocumentManager.Instance.CurrentDBDocument
app= doc.Application
try:
	openOptions = OpenOptions()
	openOptions.DetachFromCentralOption= DetachFromCentralOption.DetachAndPreserveWorksets
	saveAsOptions = SaveAsOptions()
	saveAsOptions.OverwriteExistingFile=True
	msg=msg+"\n"+"Save and open options set correctly"
except:
	msg=msg+"\n"+"Failed to set open and save options"+"\n"
try:	
	modelPath = ModelPathUtils.ConvertUserVisiblePathToModelPath(IN[0])
	msg=msg+"\n"+"Created modelpath"
except:
	msg=msg+"\n"+"Failed convert filepath to modelpath"
try:
	revitDocument = app.OpenDocumentFile(modelPath,openOptions)
	msg=msg+"\n"+"Opened Revit Document in background"
except:
	msg=msg+"\n"+"Failed to open document"
if revitDocument:
	try:
		revitDocument.SaveAs(destinationFilePath,saveAsOptions)
		msg=msg+"\n"+"Document saved to: "+destinationFilePath
		revitDocument.Close()
	except:
		msg=msg+"\n"+"Failed to save document"
else:
	revitDocument=None
#Assign your output to the OUT variable.
OUT = msg, destinationFilePath
# ----------------------------------------
code_block = CodeBlock(x=python_script) { msg=x[0]; filePath=x[1]; }
filePath = Output(code_block.filePath)
scriptMessage = Output(code_block.msg)
