# Dynamo custom node Parameter.SetValueByName.dyf (Dynamo 2.3.0.5885)
# category: DynamoROCODyfs.Parameters
# Sets element parameter value by name

element = Input(element: var[]..[])
name = Input(name: string)
parameterByName = Parameter.ParameterByName(element=element, name=name)
value = Input(value: var[]..[])
setValue = Parameter.SetValue(parameter=parameterByName, value=value)
