# Dynamo custom node Point.xyz.dyf (Dynamo 1.3.4.6666)
# category: DynamoROCODyfs.Points
# get xyz coordinates from point

point = Input()
X = Point.X(point)
x = Output(X)
Y = Point.Y(point)
y = Output(Y)
Z = Point.Z(point)
z = Output(Z)
