# Dynamo custom node ProjectInfo.UpdateCookbookMeta.dyf (Dynamo 2.3.0.5885)
# category: DynamoROCODyfs.BIMCookbook
# Updates project info for pushing to BIMCookbook
# packages: ROCO Dyf Packages 1.0.0, DynamoROCO 2.3.0.0, Clockwork for Dynamo 2.x 2.1.2

toggle = Input(toggle: var[]..[])

# group: Get project info and shared params
projectInfoElement = Custom[DynamoROCODyfs_Document.ProjectInfoElement](toggle=toggle)  # package ROCO Dyf Packages; Get project info as element
getSharedParameter = Custom[DynamoROCODyfs_Element.GetSharedParameter](element=projectInfoElement)  # package ROCO Dyf Packages; Gets all shared parameters of object
code_block = CodeBlock(projectInfoElement=projectInfoElement, sharedParameters=getSharedParameter) { projectInfoElement; sharedParameters; }

# group: Check for document GUID
code_block_2 = CodeBlock(sharedProjInfoParameters=code_block.sharedParameters) { sharedProjInfoParameters; }
code_block_3 = CodeBlock(x=code_block_2) { x["259f97c8-4f40-4de7-8110-3e41b852ac08"]/*doc_GUID*/; }
code_block_4 = CodeBlock(x=code_block_3) { x["Value"][0]; }
length = String.Length(str=code_block_4)
code_block_5 = CodeBlock { 0; }
operators = length > code_block_5
generateGuid = DynamoROCO.DesignLog.GenerateGuid()
if_ = If(test=operators, true=code_block_4, false=generateGuid)

# group: Create new parameters data
current = Document.Current()
filePath = Document.FilePath(document=current)
fileName = FileSystem.FileName(path=filePath)
generateGuid_2 = DynamoROCO.DesignLog.GenerateGuid()
now = DateTime.Now()
string_from_object = FromObject(obj=now)
userName = Custom[Clockwork_System.UserName]()  # package Clockwork for Dynamo 2.x; Returns the user name of the person who is currently logged on to Windows on the machine the script is executed on.

code_block_6 = CodeBlock(doc_GUID=if_, doc_File=fileName, LP_GUID=generateGuid_2, LP_TS=string_from_object, LP_UN=userName) { doc_GUID; doc_File; LP_GUID; LP_TS; LP_UN; }

# group: Update projectInfo
code_block_7 = CodeBlock(doc_GUID=code_block_6.doc_GUID, doc_File=code_block_6.doc_File, LP_GUID=code_block_6.LP_GUID, LP_TS=code_block_6.LP_TS, LP_UN=code_block_6.LP_UN, projectInfoElement=code_block.projectInfoElement)
# ---------- code_block_7.designscript (6 lines) ----------
x={"ROCO_CTE_Document_GUID":doc_GUID/*doc_GUID*/,
"ROCO_CTE_Document_Filename":doc_File /*doc_FILE*/,
"ROCO_CTE_Document_Last_Push_GUID":LP_GUID /*LP_GUID*/,
"ROCO_CTE_Document_Last_Push_Timestamp":LP_TS /*LP_TS*/,
"ROCO_CTE_Document_Last_Push_Username":LP_UN /*LP_UN*/};
projectInfoElement;
# ----------------------------------------
setParameters = Custom[DynamoROCODyfs_Element.SetParameters](elementInstance=code_block_7.projectInfoElement, parameterDict=code_block_7.x)  # package ROCO Dyf Packages; Sets parameters based on element and parameter dict

# group: OUTPUT
code_block_8 = CodeBlock(setParameters=setParameters) { setParameters["succes"]["element"]; }
code_block_9 = CodeBlock(doc_GUID=code_block_6.doc_GUID, doc_File=code_block_6.doc_File, LP_GUID=code_block_6.LP_GUID, LP_TS=now, LP_UN=code_block_6.LP_UN)
# ---------- code_block_9.designscript (5 lines) ----------
x={"259f97c8-4f40-4de7-8110-3e41b852ac08":doc_GUID/*doc_GUID*/,
"8b087b5e-7400-4940-83c6-c1f502d0dcb0":doc_File /*doc_FILE*/,
"66531f01-7c02-4542-b95c-5db573ef99b6":LP_GUID /*LP_GUID*/,
"ec84aa2b-b904-4321-9f94-c7ec8793ca57":LP_TS /*LP_TS*/,
"d2c0bde2-9a96-4127-bee6-4d071df470d5":LP_UN /*LP_UN*/};
# ----------------------------------------
code_block_10 = CodeBlock(projInfoElement=code_block_8, metaDataDict=code_block_9) { projInfoElement; metaDataDict; }
projectInfoElement_2 = Output(code_block_10.projInfoElement)  # "projectInfoElement"
metaDataDict = Output(code_block_10.metaDataDict)
