# Dynamo custom node ReadBIMParameters+.dyf (Dynamo 1.3.4.6666)
# category: DynamoROCODyfs.Parameters

AdativeComponents = Input()
code_block = CodeBlock { {"Family", "Plaats.Code","Plaats.Beschrijving","Deel.Code","Deel.Beschrijving","En.Code","En.Beschrijving","Ss.Code","Ss.Beschrijving", "Dynamo.GUID", "Dynamo.Script", "Dynamo.Report","SBS.ID", "SBS.Mp", "Lengte"}; }

# group: Read all parameters to report
getParameterValueByName = Element.GetParameterValueByName(parameterName=code_block)  # unwired: element
map = List.Map(list=AdativeComponents, f_x=getParameterValueByName)
locations = AdaptiveComponent.Locations(AdativeComponents)
code_block_2 = CodeBlock { {"SX", "SY", "SZ", "EX", "EY", "EZ"}; }
create_list_of_headers = List.Join(code_block, code_block_2)
code_block_3 = CodeBlock(map, locations, create_list_of_headers)
# ---------- code_block_3.designscript (56 lines) ----------
out = {};
errors = {};

paramList: var[][];
positions: var[][];
headers: var[];
[Imperative]
{
 _index=0;
 _errorIndex=0;
 _headerCount = Count(headers);
 _line = {};
 while (_index<_headerCount)
 {
  _line[_index]=headers[_index];
  _index=_index+1;
 }
 _index=0;
 out[_index]=_line;
 _index=_index+1;
 _paramCount= Count(paramList);
 _posCount = Count(positions);
 errors[_errorIndex] = _paramCount;
 _errorIndex=_errorIndex+1;
 errors[_errorIndex] =_posCount;
 _errorIndex=_errorIndex+1;
 _eIndex=0;
 if (_paramCount!=_posCount)
 {
  errors [_errorIndex]="# of parameters and positions not equal";
  _errorIndex=_errorIndex+1;
 } else {
  while (_eIndex<_paramCount)
  {
   _line = {};
   _lIndex =0;
   for (_s in paramList[_eIndex])
   {
    _line[_lIndex]=_s;
    _lIndex=_lIndex+1;
   }
   for (_p in positions[_eIndex])
   {
    _line[_lIndex]=_p.X;
    _lIndex=_lIndex+1;
    _line[_lIndex]=_p.Y;
    _lIndex=_lIndex+1;
    _line[_lIndex]=_p.Z;
    _lIndex=_lIndex+1;
   }
   out[_index]=_line;
   _index=_index+1;
   _eIndex=_eIndex+1;
  }
 }
};
# ----------------------------------------

ParameterList = Output(code_block_3.out0)
Errors = Output(code_block_3.out1)
