# Dynamo custom node Script_CreateMeta.dyf (Dynamo 2.3.0.5885)
# category: DynamoROCODyfs.DynamoROCO.Script
# creates script meta data to put onto object parameters
# packages: Clockwork for Dynamo 2.x 2.1.2

# group: Create script meta data file
string = StringInput("ScriptName")
python_script = Python()
# ---------- python_script.python (29 lines) ----------
# Importing Reference Modules
# CLR ( Common Language Runtime Module )
import clr
# Adding the DynamoRevitDS.dll module to work with the Dynamo API
clr.AddReference('DynamoRevitDS')
import Dynamo 

# access to the current Dynamo instance and workspace
dynamoRevit = Dynamo.Applications.DynamoRevit()
currentWorkspace = dynamoRevit.RevitDynamoModel.CurrentWorkspace

# Access current version of dynamo
version=dynamoRevit.RevitDynamoModel.Version

# checks version of dynamo and adjusts output according to version
if version.StartsWith("1."):
	
	# Gets file name which includes full path
	filename=currentWorkspace.FileName
	
	
	# Splits out file path to just file name
	OUT=filename

elif version.StartsWith("2."):
	OUT=currentWorkspace.Name

else:
	OUT="Not supported"
# ----------------------------------------
string_from_object = FromObject(obj=python_script)
byKeysValues = DesignScript.Builtin.Dictionary.ByKeysValues(keys=string, values=string_from_object)
string_2 = StringInput("username")
userName = Custom[System.UserName]()  # package Clockwork for Dynamo 2.x; Returns the user name of the person who is currently logged on to Windows on the machine the script is executed on.
setValueAtKeys = DesignScript.Builtin.Dictionary.SetValueAtKeys(dictionary=byKeysValues, keys=string_2, values=userName)
code_block = CodeBlock(scriptMeta=setValueAtKeys) { scriptMeta; }

scriptMeta = Output(code_block)
