# Dynamo custom node SectionView.MoveByVector.dyf "SectionView_MoveByVector" (Dynamo 2.3.0.5885)
# category: DynamoROCODyfs.Views
# move section view element by vector(startpoint,endpoint,length)

elem = Input(elem: var[]..[])
vector = Input(vector: var[]..[])
code_block = CodeBlock(elem=elem, vector=vector) { SectionView.MoveByVector(elem,vector); }
code_block_2 = CodeBlock(sectionViews=code_block) { sectionViews; }
