# Dynamo custom node SelectAlignmentByNameAndDrawing.dyf (Dynamo 2.3.0.5885)
# category: DynamoROCODyfs.Alignments
# packages: infranea 0.0.4, Data-Shapes 2019.2.40

civilApp = Input(civilApp: CivilConnection.CivilApplication)
code_block = CodeBlock(civilApplication=civilApp) { civilApplication; }

# group: Input
descritpionText = Input(descritpionText: string = "select below")

loadRocoLogo = Custom[LoadRocoLogo]()  # package infranea
code_block_2 = CodeBlock { "Select"; }
code_block_3 = CodeBlock { "Civil3D Alignments"; }
documents_alignmentslist = CodeBlock(app=civilApp)
# ---------- documents_alignmentslist.designscript (22 lines) ----------
app: CivilApplication;
out = [Imperative]
{
	_out=[];
	_docs = app.GetDocuments();
	_index: int =0;
	for (_doc in _docs)
	{
		_docName : string = _doc.Name;
		//_out[_index]=_doc.Name;
		_alignments: var[] = _doc.GetAlignments();
		if (_alignments!=null)
		{
			for (_a in _alignments)
			{
				_out[_index]=_docName+"|"+_a.Name;
				_index=_index+1;
			}
		}
	}
	return _out;
};
# ----------------------------------------
list_create = List.Create(item0=documents_alignmentslist.out1)
code_block_4 = CodeBlock { zero:int=0; }
ui_dropdown_data = Custom[UI.DropDown Data](InputName=code_block_3, Keys=list_create, Values=list_create, DefaultValueIndex=code_block_4, lacing=Shortest)  # package Data-Shapes; Create data for DropDown input in UI.MultiInputForm ++ . Check out www.data-shapes.net for more infos.

# group: List has items?
count = List.Count(list=documents_alignmentslist.out1)
code_block_5 = CodeBlock { 0; }
ne = count != code_block_5

code_block_6 = CodeBlock { "Cancel"; }
length = String.Length(str=documents_alignmentslist.out1, lacing=Longest)
maximumItem = List.MaximumItem(list=length)
code_block_7 = CodeBlock(chars=maximumItem) { chars; width = Math.Max(350, Math.Round(230*chars/25)); }
ui_multipleinputform = Custom[UI.MultipleInputForm ++](Description_optional=descritpionText, Logo_optional=loadRocoLogo, ButtonText_optional=code_block_2, Inputs=ui_dropdown_data, Toggle=ne, CancelButtonText_optional=code_block_6, Width_optional=code_block_7.width, lacing=Shortest)  # package Data-Shapes; Create a form with multiple inputs. see www.data-shapes.net for tutorials and infos!
code_block_8 = CodeBlock(app=code_block, userinputs=ui_multipleinputform.User_Inputs, wasrun=ui_multipleinputform.Was_Run, wascancelled=ui_multipleinputform.Was_Cancelled)
# ---------- code_block_8.designscript (26 lines) ----------
app: CivilApplication;
userinputs: var[][];
wasrun: var[];
wascancelled:var[];

[Imperative]
{
	if (userinputs==null || Count (userinputs)==0)
	{
		return {"CivilDocument": null, "Alignment": null};
	}
	if (userinputs[0]==null || userinputs[0][0]==null)
	{
		return {"CivilDocument": null, "Alignment": null};
	}
	_item = userinputs[0][0];
	_strs = String.Split(_item,["|"]);
	if (wasrun[0] && !wascancelled[0] && Count(_strs==2))
	{
		document = app.GetDocumentByName(_strs[0]);
		alignment = document.GetAlignmentByName(_strs[1]);
		return {"CivilDocument": document, "Alignment": alignment};
	} else {
		return {"CivilDocument": null, "Alignment": null};
	}
};
# ----------------------------------------
code_block_9 = CodeBlock { "CivilDocument"; "Alignment"; }
valueAtKey = DesignScript.Builtin.Dictionary.ValueAtKey(dictionary=code_block_8.out4, key=code_block_9.out1)

# group: Output
alignment = Output(valueAtKey)

valueAtKey_2 = DesignScript.Builtin.Dictionary.ValueAtKey(dictionary=code_block_8.out4, key=code_block_9.out0)

# group: Output
civilDocument = Output(valueAtKey_2)
