# Dynamo custom node SelectProfileByAlignmentNameDrawing.dyf (Dynamo 1.3.4.6666)
# category: DynamoROCODyfs.Profiles
# UI to select alignment profile

# group: Input
alignment = Input()

string = StringInput("Select a profile on the given alignment:")
name = CivilConnection.Alignment.Name(alignment)
code_block = CodeBlock(t0=string, t1=name) { t0; t1; t2=t0+" "+t1+":"; }
loadRocoLogo = Custom[LoadRocoLogo]()
code_block_2 = CodeBlock { "Apply"; }
code_block_3 = CodeBlock { "Civil3D profiles"; }
string_2 = StringInput("|")
add = name + string_2  # lacing=Longest
getProfiles = CivilConnection.Alignment.GetProfiles(alignment)
name_2 = CivilConnection.Profile.Name(getProfiles)
add_2 = add + name_2  # lacing=Longest
code_block_4 = CodeBlock { 0; }
ui_dropdown_data = Custom[UI.DropDown Data](InputName=code_block_3, Keys=add_2, Values=getProfiles, DefaultValueIndex=code_block_4)  # Create data for DropDown input in UI.MultiInputForm ++ . Check out www.data-shapes.net for more infos.
boolean = BoolSelector(true)
code_block_5 = CodeBlock { "Cancel"; }
length = String.Length(add_2)
maximumItem = List.MaximumItem(length)
code_block_6 = CodeBlock(chars=maximumItem) { chars; width = Math.Max(350, Math.Round(500*chars/25)); }
ui_multipleinputform = Custom[UI.MultipleInputForm ++](Description_optional=code_block.t2, Logo_optional=loadRocoLogo, ButtonText_optional=code_block_2, Inputs=ui_dropdown_data, Toggle=boolean, CancelButtonText_optional=code_block_5, Width_optional=code_block_6.width)  # Create a form with multiple inputs. see www.data-shapes.net for tutorials and infos!
flatten = Flatten(ui_multipleinputform.User_Inputs)

# group: Output
alignment_2 = Output(alignment)  # "alignment"
profile = Output(flatten)

code_block_7 = CodeBlock {  }
