# Dynamo custom node SelectProfileByAlignmentNameDrawingOrLvl.dyf (Dynamo 2.2.1.5175)
# category: DynamoROCODyfs.Profiles
# Toggles profile or lvl selection and runs dialog based on input

# group: Input
alignment = Input(alignment: var[]..[])

getProfiles = CivilConnection.Alignment.GetProfiles(alignment=alignment)
name = CivilConnection.Profile.Name(profile=getProfiles)
isNull = Object.IsNull(obj=name)

# group: Input
defaultLvl = Input(defaultLvl: Revit.Elements.Level)

# group: Input
profileOrLvl = Input(profileOrLvl: bool = False)

string = StringInput("Select a profile on the given alignment:")
name_2 = CivilConnection.Alignment.Name(alignment=alignment)
code_block = CodeBlock(t0=string, t1=name_2) { t0; t1; t2=t0+" "+t1+":"; }
loadRocoLogo = Custom[LoadRocoLogo]()
code_block_2 = CodeBlock { "Apply"; }
code_block_3 = CodeBlock { "Civil3D profiles"; }
string_2 = StringInput("|")
add = name_2 + string_2  # lacing=Longest
add_2 = add + name  # lacing=Longest
code_block_4 = CodeBlock { 0; }
ui_dropdown_data = Custom[UI.DropDown Data](InputName=code_block_3, Keys=add_2, Values=getProfiles, DefaultValueIndex=code_block_4)  # Create data for DropDown input in UI.MultiInputForm ++ . Check out www.data-shapes.net for more infos.
boolean = BoolSelector(true)  # graph input
boolean_2 = BoolSelector(false)  # graph input
if_ = If(test=profileOrLvl, true=boolean, false=boolean_2)
code_block_5 = CodeBlock { "Cancel"; }
length = String.Length(str=add_2)
maximumItem = List.MaximumItem(list=length)
code_block_6 = CodeBlock(chars=maximumItem) { chars; width = Math.Max(350, Math.Round(500*chars/25)); }
ui_multipleinputform = Custom[UI.MultipleInputForm ++](Description_optional=code_block.t2, Logo_optional=loadRocoLogo, ButtonText_optional=code_block_2, Inputs=ui_dropdown_data, Toggle=if_, CancelButtonText_optional=code_block_5, Width_optional=code_block_6.width)  # Create a form with multiple inputs. see www.data-shapes.net for tutorials and infos!
flatten = List.Flatten(list=ui_multipleinputform.User_Inputs)
if_2 = If(test=profileOrLvl, true=flatten, false=defaultLvl)
if_3 = If(test=isNull, true=defaultLvl, false=if_2)
flatten_2 = List.Flatten(list=if_3)
uniqueItems = List.UniqueItems(list=flatten_2)

# group: Output
alignment_2 = Output(alignment)  # "alignment"
zHost = Output(uniqueItems)
