# Dynamo custom node StartStationToUse.dyf (Dynamo 1.3.4.6666)
# category: DynamoROCODyfs.Alignments
# Checks if the given startstation is in conflict with the startstation of the alignment

startstation = Input()
alignment = Input(alignment : Alignment)

# group: Startstation of Alignment
start = CivilConnection.Alignment.Start(alignment)
gt = startstation > start
if_ = If(test=gt, true=startstation, false=start)

result = Output(if_)
