# Dynamo custom node String.isempty.dyf (Dynamo 2.2.1.5175)
# category: DynamoROCODyfs.String
# checks if string is an empty string

boolean = BoolSelector(true)
instring = Input(instring: DSCore.String)
empty_string_to_check_if = StringInput("")  # "EMPTY STRING, TO CHECK IF FILEPATH IS EMPTY:String"
eq = instring == empty_string_to_check_if
eq_2 = boolean == eq
bool = Output(eq_2)
