# Dynamo custom node UI.MessageBox.dyf "UI_MessageBox" (Dynamo 2.3.0.5885)
# category: DynamoROCODyfs.UIObjects
# windows messagebox, needing style, title and message.
# ##  Styles:
# ##  0 : OK
# ##  1 : OK | Cancel
# ##  2 : Abort | Retry | Ignore
# ##  3 : Yes | No | Cancel
# ##  4 : Yes | No
# ##  5 : Retry | No
# ##  6 : Cancel | Try Again | Continue

title = Input(title: string = "HEADS-UP")
message = Input(message: string = "")
style = Input(style: int = 0)
showMessage = Input(showMessage: bool = false)
python_script = Python(IN[0]=title, IN[1]=message, IN[2]=style, IN[3]=showMessage)
# ---------- python_script.python (19 lines) ----------
# Load the Python Standard and DesignScript Libraries
import sys
import clr
import ctypes
clr.AddReference('ProtoGeometry')
from Autodesk.DesignScript.Geometry import *


def mBox(title, text, style):
	return ctypes.windll.user32.MessageBoxW(0, text, title, style)
# The inputs to this node will be stored as a list in the IN variables.
title, message, style,showMessage = IN

# Place your code below this line
if showMessage:
	OUT={"continueRun":False,"mboxSelection":mBox(title,message,style)}
else:
	OUT={"continueRun":True,"mboxSelection":"No Errors"}
# Assign your output to the OUT variable.
# ----------------------------------------
buttonSelection = Output(python_script)
