# Dynamo custom node Units_FixProjectUnits.dyf "FixProjectUnits" (Dynamo 2.3.0.5885)
# category: DynamoROCODyfs.ActiveDocument
# Sets project units to meters with 3 decimals

trigger = Input(trigger: var[]..[])
python_script = Python(IN[0]=trigger)
# ---------- python_script.python (42 lines) ----------
import clr
import sys
# import Revit API
clr.AddReference('RevitAPI')
from Autodesk.Revit.DB import *
# import Revit API UI
clr.AddReference('RevitAPIUI')
# import Revit Services
clr.AddReference('RevitServices')
import RevitServices
from RevitServices.Persistence import DocumentManager
from RevitServices.Transactions import TransactionManager 
# import ProtoGeometry 
clr.AddReference('ProtoGeometry')
from Autodesk.DesignScript.Geometry import *

dmi=DocumentManager.Instance #setting up document manager instance
doc=dmi.CurrentDBDocument #Gets current document
uiapp = dmi.CurrentUIApplication #gets current Revit app 
app= uiapp.Application #gets current UI app

#The inputs to this node will be stored as a list in the IN variables.
Trigger = IN[0]

# Start Transaction
TransactionManager.Instance.EnsureInTransaction(doc)
try:
	DUT=DisplayUnitType.DUT_METERS
	UST=UnitSymbolType.UST_M
	
	targetUnits=Units(UnitSystem.Metric)
	formatOptions=FormatOptions(DUT,UST,.001)
	targetUnits.SetFormatOptions(UnitType.UT_Length,formatOptions)
	
	doc.SetUnits(targetUnits)
	OUT="SUCCESS"
except:
	OUT="FAIL"
	pass

# End Transaction
TransactionManager.Instance.TransactionTaskDone()
# ----------------------------------------
Result = Output(python_script)
