# Dynamo custom node WriteBIMParameters.dyf (Dynamo 1.3.4.6666)
# category: DynamoROCODyfs.Parameters
# Write the ROCO BIM Parameters on the components

Componenten = Input()
code_block = CodeBlock { {"Plaats.Code","Plaats.Beschrijving","Deel.Code","Deel.Beschrijving","En.Code","En.Beschrijving","Ss.Code","Ss.Beschrijving", "Dynamo.GUID", "Dynamo.Script", "Dynamo.Report"}; }
BIMParameterWaarden = Input()

# group: Set BIM Parameters
code_block_2 = CodeBlock(Componenten, code_block, BIMParameterWaarden)
# ---------- code_block_2.designscript (26 lines) ----------
out ={};
comps: var[];

ParameterNames : var[];
ParameterValues :var[];
[Imperative]
{
 pIndex:int=0;
 for (c in comps)
 {
  paramIndex:int =0;
  _namesCount :int = Count(ParameterNames);
  while (paramIndex<_namesCount)
  {
   _name :string = ParameterNames[paramIndex]+"";
   _value :string = ParameterValues[paramIndex]+"";
   if (_name!=null && _value!=null)
   {
    c.SetParameterByName(_name, _value);
   }
   paramIndex=paramIndex+1;
  }
  out[pIndex] = c;
  pIndex=pIndex+1;
 }
};
# ----------------------------------------

Componenten_2 = Output(code_block_2)  # "Componenten"
