# Dynamo custom node civilApplication.GetFLPCodesAsString.dyf (Dynamo 2.3.0.5885)
# category: DynamoROCODyfs.FeaturelinePoints
# gets corridor names form all open CivilDocuments, outputting it in list with format "Doc | Corridor | FLPointsCodes"
# packages: CivilConnection2020 4.0.4

# group: Importing civil documents from application and fomratting for selecting corridor and FPcodes in UI
code_block = CodeBlock { "Doc | Corridor | FLPointCode"; }
# note: description
civilApplication = CivilConnection.CivilApplication.CivilApplication()
getDocuments = CivilConnection.CivilApplication.GetDocuments(civilApplication=civilApplication)
name = CivilConnection.CivilDocument.Name(civilDocument=getDocuments, lacing=Longest)
string = StringInput(" | ")
operators = name + string
getCorridors = CivilConnection.CivilDocument.GetCorridors(civilDocument=getDocuments)
name_2 = CivilConnection.Corridor.Name(corridor=getCorridors)
operators_2 = operators + name_2
operators_3 = operators_2 + string
getCodes = CivilConnection.Corridor.GetCodes(corridor=getCorridors)
operators_4 = operators_3 + getCodes
flatten = List.Flatten(list=operators_4)
addItemToFront = List.AddItemToFront(item=code_block, list=flatten)
length = String.Length(str=flatten)
maximumItem = List.MaximumItem(list=length)
code_block_2 = CodeBlock(civilApplication=civilApplication, seperator=string) { civilApplication; seperator; }
code_block_3 = CodeBlock(stringList=addItemToFront, stringLength=maximumItem, civilApplication=code_block_2.civilApplication, Separator=code_block_2.seperator) { stringList; stringLength; civilApplication; Separator; }

# group: OUTPUT
flPointCodes = Output(code_block_3.stringList)
stringLength = Output(code_block_3.stringLength)
civilApplication_2 = Output(code_block_3.civilApplication)  # "civilApplication"
stringSeparator = Output(code_block_3.Separator)
