# Dynamo custom node dictionary.update.dyf "dictionaryupdate" (Dynamo 2.3.0.5885)
# category: DynamoROCODyfs.Dictionary
# Updates dictionary with another dict

targetDict = Input(targetDict: var[]..[])
addDict = Input(addDict: var[]..[])
merge_list_of_dicts_python = Python(IN[0]=targetDict, IN[1]=addDict)  # "merge list of dicts: Python Script"
# ---------- merge_list_of_dicts_python.python (23 lines) ----------
# Load the Python Standard and DesignScript Libraries
import sys
import clr
clr.AddReference('ProtoGeometry')
from Autodesk.DesignScript.Geometry import *

# The inputs to this node will be stored as a list in the IN variables.
list1,list2 = IN

i = 0
outlist = []
while i < len(list1):
	try:
		dict1 = list1[i]
		dict2 = list2[i]
		dict1.update(dict2)
		outlist.append(dict1)
	except:
		pass
	i += 1

# Assign your output to the OUT variable.
OUT = outlist
# ----------------------------------------
resultDict = Output(merge_list_of_dicts_python)
