# Dynamo custom node familyAndCivilData.createTableData.dyf "UI_createTableData" (Dynamo 2.3.0.5885)
# category: DynamoROCODyfs.UIObjects.Data
# create table data from nested list

# group: Input
groupNames = Input(groupNames: var[]..[])
dataSelection = Input(dataSelection: var[]..[])
stringSeperator = Input(stringSeperator: var[]..[])

# group: creating data for table view from selectedFamilyAndTypes and Family data
code_block = CodeBlock { "Overview"; }
# note: description
code_block_2 = CodeBlock(groupNames=groupNames, selectedFamilyTypesAndCivilData=dataSelection, stringSeperator=stringSeperator) { groupNames; selectedFamilyTypesAndCivilData; stringSeperator; }
code_block_3 = CodeBlock { null; }
flatten = List.Flatten(list=code_block_2.selectedFamilyTypesAndCivilData)
code_block_4 = CodeBlock { 2; }
chop = List.Chop(list=flatten, lengths=code_block_4)
code_block_5 = CodeBlock { 0; 1; }
getItemAtIndex = List.GetItemAtIndex(list=chop, index=code_block_5.out0, lacing=CrossProduct)
family = FamilyType.Family(familyType=getItemAtIndex)
name = Family.Name(family=family)
operators = code_block_3 == name
code_block_6 = CodeBlock { "N/A"; }
if_ = If(test=operators, true=code_block_6, false=name)
name_2 = FamilyType.Name(familyType=getItemAtIndex)
if_2 = If(test=operators, true=code_block_6, false=name_2)
getItemAtIndex_2 = List.GetItemAtIndex(list=chop, index=code_block_5.out1, lacing=CrossProduct)
split = String.Split(str=getItemAtIndex_2, separator0=code_block_2.stringSeperator)
code_block_7 = CodeBlock { 0; 1; 2; }
getItemAtIndex_3 = List.GetItemAtIndex(list=split, index=code_block_7.out0, lacing=CrossProduct)
getItemAtIndex_4 = List.GetItemAtIndex(list=split, index=code_block_7.out1, lacing=CrossProduct)
getItemAtIndex_5 = List.GetItemAtIndex(list=split, index=code_block_7.out2, lacing=CrossProduct)
list_create = List.Create(item0=code_block_2.groupNames, item1=if_, item2=if_2, item3=getItemAtIndex_3, item4=getItemAtIndex_4, item5=getItemAtIndex_5)
code_block_8 = CodeBlock(tableTitle=code_block, tableData=list_create) { tableTitle; tableData; }

# group: OUTPUT
tableTitle = Output(code_block_8.tableTitle)
tableData = Output(code_block_8.tableData)
