# Dynamo custom node getCurrentElementSelection.dyf (Dynamo 2.3.0.5885)
# category: DynamoROCODyfs.DynamoROCO.Selections
# Get current selected elements from Revit document

toggle = Input(toggle: var[]..[])
currentdocumentselection_python = Python(IN[0]=toggle)  # "CurrentDocumentSelection: Python Script"
# ---------- currentdocumentselection_python.python (22 lines) ----------
# Load the Python Standard and DesignScript Libraries
import sys
import clr
clr.AddReference("RevitServices")
import RevitServices
from RevitServices.Persistence import DocumentManager
clr.AddReference("RevitAPIUI")
from Autodesk.Revit.UI.Selection import *


# The inputs to this node will be stored as a list in the IN variables.
dbDocument = IN[0]

# Place your code below this line
UIdoc = DocumentManager.Instance.CurrentUIDocument
dbDocument = DocumentManager.Instance.CurrentDBDocument

element_ids = list(UIdoc.Selection.GetElementIds())


# Assign your output to the OUT variable.
OUT = element_ids
# ----------------------------------------
getelementbyid_python_script = Python(IN[0]=currentdocumentselection_python)
# ---------- getelementbyid_python_script.python (32 lines) ----------
import clr
clr.AddReference('RevitAPI')
from Autodesk.Revit.DB import *

clr.AddReference("RevitNodes")
import Revit
clr.ImportExtensions(Revit.Elements)

clr.AddReference("RevitServices")
import RevitServices
from RevitServices.Persistence import DocumentManager

def ElementById(item, doc):
	try: 
		return doc.GetElement(item).ToDSType(True)
	except:
		try:
			return doc.GetElement(ElementId(item)).ToDSType(True)
		except:
			return None

outDict = {}

items = UnwrapElement(IN[0])

doc = DocumentManager.Instance.CurrentDBDocument

if isinstance(IN[0], list): elementList = [ElementById(x, doc) for x in items]

else: elementList = ElementById(items, doc)

OUT = elementList
# ----------------------------------------
selectedElements = Output(getelementbyid_python_script)
