# Dynamo custom node getRecipeCodesFromElements.dyf (Dynamo 2.3.0.5885)
# category: DynamoROCODyfs.BIMCookbook
# Get recipe codes from all elements in active view
# packages: archi-lab.net 2020.22.9, ROCO Dyf Packages 1.0.0

all_elements_in_active_view = ElementsInView()
getSharedParameter = Custom[Element.GetSharedParameter](element=all_elements_in_active_view, lacing=Longest)  # package ROCO Dyf Packages; Gets all shared parameters of object
code_block = CodeBlock { ["30d2c196-4edc-4e9c-b0e8-092c86210268"]; }
valueAtKey = DesignScript.Builtin.Dictionary.ValueAtKey(dictionary=getSharedParameter, key=code_block, lacing=Longest)
flatten = List.Flatten(list=valueAtKey)
clear_list = Custom[Clear List](input=flatten)  # package archi-lab.net; This node will remove all Null and Empty Lists from any list.
code_block_2 = CodeBlock { "Value"; }
valueAtKey_2 = DesignScript.Builtin.Dictionary.ValueAtKey(dictionary=clear_list, key=code_block_2)
length = String.Length(str=valueAtKey_2)
code_block_3 = CodeBlock { 0; }
gt = length > code_block_3
isNull = Object.IsNull(obj=gt)
code_block_4 = CodeBlock { false; }
if_ = If(test=isNull, true=code_block_4, false=gt)
filterByBoolMask = List.FilterByBoolMask(list=clear_list, mask=if_)
filteredElementList = Output(filterByBoolMask.in)
elements_wo_recipe = Output(filterByBoolMask.out)
