# Dynamo custom node imageObjectsFromConfig.dyf (Dynamo 2.3.0.5885)
# category: DynamoROCODyfs.UIObjects
# Create ui objects from configuration file
# packages: Data-Shapes 2019.2.40

# note: User selects config file to run script with
# note: Import JSON file for script config
# note: createCivil3D_ORIGIN_Dict
# note: getCivilReferenceData from elements
# note: create selection objects for selecting dimensions
# note: Output
# note: Input

# group: DATA MANIPULATION
# note: Data manipulation on Dynamo Objects

# group: NOT IN USE
# note: Nodes to consider part of the final graph

# group: INPUT
# note: Data input and preperation for other nodes

# group: GET
# note: Get parameter values from Revit objects

# group: DEBUG
# note: Check if the graph is working as expected

# group: Package
# note: All used nodes from a package have a prefix
# added to them with the name of the node.

# group: FUNCTION
# note: Creation of dynamo objects

# group: OUTPUT
# note: Object creation in Revit, final output

# group: SET
# note: Set parameters on Revit objects

# group: INFO
# note: GENERAL INFO
# Version: 3
# Author: Dick Elsman
# Company: Infranea | ROCO
# email: dick.elsman@infranea.com
# Dynamo Core version: 2.3.0.5885
# Dynamo Revit version: 2.3.0.6270
# Revit version: 2020.2
# note: INSTRUCTIONS
# <DESCRIPTION>
# Allows the user to place GMA2 objects on featureline points in the direction of the alignment (and corridor).  Duration of scripts depends on complexity of corridor and to be placed objects. Min runtime is about 5 minutes
# <INSTRUCTIONS>
# navigate to the folder to play, and press play in the Dynamo Player.
# NB! This script requires a JSON config file for it to index objects and data from sources. This/these file(s) shoudl be stored in <script directory>\config_files
# note: KNOWN ISSUES AND LIMITATIONS
# - Does not support retaining objects yet
# - Does not yet facilitate slopes in floors
# note: SCRIPT META
# Script Name: CC_GMA2_GMA4_createObjects@CorridorFLpoints.dyn
# Packages used in this script:
# Data-Shapes version: 2019.2.40
# Clockwork for Dynamo 2.x version: 2.1.2
# DynamoROCO version: 2.3.0.0
# ROCO Dyf Packages version: 1.0.0
# TimeStamp : 2020/2/6 17:58

# group: Creating image data for use in script
# note: Converting the imported json into 2 filepath, 1 for the logo in the UI, the other as reference image in the UI

# group: Input
python_script = Python()
# ---------- python_script.python (29 lines) ----------
# Importing Reference Modules
# CLR ( Common Language Runtime Module )
import clr
# Adding the DynamoRevitDS.dll module to work with the Dynamo API
clr.AddReference('DynamoRevitDS')
import Dynamo 

# access to the current Dynamo instance and workspace
dynamoRevit = Dynamo.Applications.DynamoRevit()
currentWorkspace = dynamoRevit.RevitDynamoModel.CurrentWorkspace

# Access current version of dynamo
version=dynamoRevit.RevitDynamoModel.Version

# checks version of dynamo and adjusts output according to version
if version.StartsWith("1."):
	
	# Gets file name which includes full path
	filename=currentWorkspace.FileName
	
	
	# Splits out file path to just file name
	OUT=filename

elif version.StartsWith("2."):
	OUT=currentWorkspace.FileName

else:
	OUT="Not supported"
# ----------------------------------------
code_block = CodeBlock(path=python_script) { FileSystem.DirectoryName(path); }
jsonData = Input(jsonData: var[]..[])
code_block_2 = CodeBlock(workspaceDirectory=code_block, JSONImportPictureData=jsonData) { workspaceDirectory; JSONImportPictureData; }

# group: Creating image data for use in script
# note: Converting the imported json into 2 filepath, 1 for the logo in the UI, the other as reference image in the UI
code_block_3 = CodeBlock(JSONImportPictureData=code_block_2.JSONImportPictureData, workspaceDirectory=code_block_2.workspaceDirectory) { JSONImportPictureData; workspaceDirectory; }
code_block_4 = CodeBlock { "Logo"; "ReferenceImage"; }
valueAtKey = DesignScript.Builtin.Dictionary.ValueAtKey(dictionary=code_block_3.JSONImportPictureData, key=code_block_4.out0)
string = StringInput("Reference image")
valueAtKey_2 = DesignScript.Builtin.Dictionary.ValueAtKey(dictionary=code_block_3.JSONImportPictureData, key=code_block_4.out1)
boolean = BoolSelector(false)

code_block_5 = CodeBlock(x=code_block_3.workspaceDirectory, y=valueAtKey) { x+"\\"+y; }

# group (continued): Creating image data for use in script
fromPath = FileObject(path=code_block_5)  # "File.FromPath"
readFromFile = Image.ReadFromFile(file=fromPath)

code_block_6 = CodeBlock(x=code_block_3.workspaceDirectory, y=valueAtKey_2) { x+"\\"+y; }

# group (continued): Creating image data for use in script
fromPath_2 = FileObject(path=code_block_6)  # "File.FromPath"
string_from_object = FromObject(obj=fromPath_2)
data_shapes_ui_image_data = Custom[Data-Shapes_UI.Image Data](ImageTitle=string, Image=string_from_object, ShowBorder_optional=boolean)  # package Data-Shapes; Places an image on UI.MultipleInutForm ++ .
code_block_7 = CodeBlock(LogoImage=readFromFile, referenceImageObject=data_shapes_ui_image_data) { LogoImage; referenceImageObject; }

# group: Output
code_block_8 = CodeBlock(LogoImage=code_block_7.LogoImage, referenceImageObject=code_block_7.referenceImageObject) { LogoImage; referenceImageObject; }
LogoUIObject = Output(code_block_8.LogoImage)
ReferenceImageUIObject = Output(code_block_8.referenceImageObject)
