# Dynamo custom node infranea.DynamoClipboard.dyf "DynamoROCODyfs.DynamoClipboard" (Dynamo 2.3.0.5885)
# category: DynamoROCODyfs.DynamoClipboard
# node used as clipboard for transferring nodes between scripts
# packages: Data-Shapes 2019.2.40, CivilConnection2020 4.0.4, Clockwork for Dynamo 2.x 2.1.2

# note: GENERAL INFO
# Version: 05
# Author: Mark Castelijns
# Company: Infranea
# email: mark.castelijns@infranea.com
# Dynamo version: 1.3.3.4111
# Revit version: 2018.3
# note: INSTRUCTIONS
# <DESCRIPTION>
# <INSTRUCTIONS>
# note: KNOWN ISSUES AND LIMITATIONS
# <ISSUES>
# note: USED PACKAGES
# Autodesk CivilConnection2018 v1.1.3

# group: FUNCTION
# note: Creation of dynamo objects

# group: OUTPUT
# note: Object creation in Revit, final output

# group: INPUT
# note: Data input and preperation for other nodes

# group: GET
# note: Get parameter values from Revit objects

# group: SET
# note: Set parameters on Revit objects

# group: DEBUG
# note: Check if the graph is working as expected

# group: Package
# note: Used nodes are from a package;
# Manual change colorcode in Json : #C80000

# group: DATA MANIPULATION
# note: Data manipulation on Dynamo Objects

# group: NOT IN USE
# note: Nodes to consider part of the final graph

code_block = CodeBlock { positions; stations; familyType; baseOffset; cutOffset; topOffset; mirror; startIndex; }  # unwired: positions, stations, familyType, baseOffset, cutOffset, topOffset, mirror, startIndex

# group: Create components
code_block_2 = CodeBlock { 1; }
flatten = List.Flatten(list=code_block.positions, amt=code_block_2)
byPoints = AdaptiveComponent.ByPoints(points=flatten, familyType=code_block.familyType)
count = List.Count(list=byPoints)

# group: Create parameter values
code_block_3 = CodeBlock { ["ROCO.PM.Mp", "ROCO.PE.Id", "Base Offset", "Cut Offset", "Top Offset", "Mirror"]; }
parameterByName = Parameter.ParameterByName(element=byPoints, name=code_block_3, lacing=CrossProduct)
code_block_4 = CodeBlock { 1; }
sequence = Sequence(start=code_block.startIndex, amount=count, step=code_block_4)
string_from_object = FromObject(obj=sequence)
code_block_5 = CodeBlock { 1; }
flatten_2 = List.Flatten(list=code_block.stations, amt=code_block_5)
addItemToEnd = List.AddItemToEnd(item=string_from_object, list=flatten_2, lacing=Longest)
addItemToEnd_2 = List.AddItemToEnd(item=code_block.baseOffset, list=addItemToEnd, lacing=Longest)
addItemToEnd_3 = List.AddItemToEnd(item=code_block.cutOffset, list=addItemToEnd_2, lacing=Longest)
addItemToEnd_4 = List.AddItemToEnd(item=code_block.topOffset, list=addItemToEnd_3, lacing=Longest)
addItemToEnd_5 = List.AddItemToEnd(item=code_block.mirror, list=addItemToEnd_4, lacing=Longest)
setValue = Parameter.SetValue(parameter=parameterByName, value=addItemToEnd_5)

move_last_dimension_in_list_up_1 = Python()  # "Move last dimension in list up 1 (flatten-1):Python Script"; unwired: IN[0]
# ---------- move_last_dimension_in_list_up_1.python (21 lines) ----------
# Load the Python Standard and DesignScript Libraries
import sys
import clr
clr.AddReference('ProtoGeometry')
from Autodesk.DesignScript.Geometry import *

# The inputs to this node will be stored as a list in the IN variables.
inlist=IN[0]
templist=[]
outlist=[]
# Place your code below this line
for sublist in inlist:
	templist.Clear()
	for item in sublist:
		for i in item:
			templist.append(i)
	outlist.append(list(templist))
			
		
# Assign your output to the OUT variable.
OUT = outlist
# ----------------------------------------

# group: Importing civil documents from application and fomratting for selecting corridor and FPcodes in UI
string = StringInput("Select only 1 FL point code below!")
code_block_6 = CodeBlock { "Doc | Corridor | FLPointCode"; }
# note: description
civilApplication = CivilConnection.CivilApplication.CivilApplication()
getDocuments = CivilConnection.CivilApplication.GetDocuments(civilApplication=civilApplication)
name = CivilConnection.CivilDocument.Name(civilDocument=getDocuments, lacing=Longest)
string_2 = StringInput(" | ")
operators = name + string_2
getCorridors = CivilConnection.CivilDocument.GetCorridors(civilDocument=getDocuments)
name_2 = CivilConnection.Corridor.Name(corridor=getCorridors)
operators_2 = operators + name_2
operators_3 = operators_2 + string_2
getCodes = CivilConnection.Corridor.GetCodes(corridor=getCorridors)
operators_4 = operators_3 + getCodes
flatten_3 = List.Flatten(list=operators_4)
addItemToFront = List.AddItemToFront(item=code_block_6, list=flatten_3)
code_block_7 = CodeBlock { false; 75; }
ui_treeview_input = Custom[UI.TreeView input](InputName=string, Data=addItemToFront, FirstItemIsTitle=code_block_7.out0, Height=code_block_7.out1)  # package Data-Shapes; Create a TreeView input for UI.MultipleInputForm ++ . Check out www.data-shapes.net for more infos and tips!
length = String.Length(str=flatten_3)
maximumItem = List.MaximumItem(list=length)
code_block_8 = CodeBlock(civilApplication=civilApplication, seperator=string_2) { civilApplication; seperator; }
code_block_9 = CodeBlock(UIobject=ui_treeview_input, stringLength=maximumItem, civilApplication=code_block_8.civilApplication, Separator=code_block_8.seperator) { UIobject; stringLength; civilApplication; Separator; }
code_block_10 = CodeBlock { "Civil3D Corridor"; }
list_create = List.Create(item0=flatten_3)
code_block_11 = CodeBlock { zero:int=0; }
data_shapes_ui_dropdown_data = Custom[Data-Shapes_UI.DropDown Data](InputName=code_block_10, Keys=list_create, Values=list_create, DefaultValueIndex=code_block_11, lacing=Shortest)  # package Data-Shapes; Create data for DropDown input in UI.MultiInputForm ++ . Check out www.data-shapes.net for more infos.

# group: Creating UI objects for selecting family types and civil corridor FPCodes
# note: description
code_block_12 = CodeBlock(uiObject=code_block_9.UIobject, stringLength=code_block_9.stringLength) { uiObject; stringLength; familyTypes; family_input_selection_string; logo; referenceImage; groupImages; }  # unwired: familyTypes, family_input_selection_string, logo, referenceImage, groupImages
string_3 = StringInput("Continue")
string_4 = StringInput("instructions:")
string_5 = StringInput("Select which familys and types match with the objects previously checked. Additionally select the corridor featurelinepoint on which the objects should be hosted. If the UI shows \"No family or type found\", it means that no family is loaded which matches the search query for the object. Make sure the names of the families are correct!")
data_shapes_ui_textnote_data = Custom[Data-Shapes_UI.TextNote Data](Title=string_4, TextNote=string_5)  # package Data-Shapes; Create Data for TextNote input in UI.MultipleInputForm ++ . Check out www.data-shapes.net for more informations
code_block_13 = CodeBlock { "select famliy + type"; }
code_block_14 = CodeBlock { 0; }
data_shapes_ui_dropdown_data_2 = Custom[Data-Shapes_UI.DropDown Data](InputName=code_block_13, Keys=code_block_12.family_input_selection_string, Values=code_block_12.familyTypes, DefaultValueIndex=code_block_14, lacing=Longest)
flatten_4 = List.Flatten(list=code_block_12.family_input_selection_string)
length_2 = String.Length(str=flatten_4)
maximumItem_2 = List.MaximumItem(list=length_2)
code_block_15 = CodeBlock(UIobject=data_shapes_ui_dropdown_data_2, stringLength=maximumItem_2) { UIobject; stringLength; }
clockwork_Passthrough = Custom[Clockwork_Passthrough](passThrough=code_block_15.UIobject, waitFor=code_block_12.uiObject)  # package Clockwork for Dynamo 2.x; Forces a sequential order of execution. The node wired into the output of the Passthrough node will be executed *after* the node wired into the waitFor input (e.g. important for some Revit operations). The value of the passThrough input will be passed on to the node wired into the output port of the Passthrough node.
clockwork_Passthrough_2 = Custom[Clockwork_Passthrough](passThrough=code_block_12.uiObject, waitFor=code_block_15.UIobject)
addItemToEnd_6 = List.AddItemToEnd(item=clockwork_Passthrough_2)  # unwired: list
map = List.Map(list=clockwork_Passthrough, f_x=addItemToEnd_6)
data_shapes_ui_inputgroup_data = Custom[Data-Shapes_UI.InputGroup Data](GroupTitle=code_block_12.groupImages, Inputs=map)  # package Data-Shapes; Creates a group of inputs for UI.MultipleInputForm ++ . Check out www.data-shapes.net for more infos !
addItemToFront_2 = List.AddItemToFront(item=data_shapes_ui_textnote_data, list=data_shapes_ui_inputgroup_data)
addItemToFront_3 = List.AddItemToFront(item=code_block_12.referenceImage, list=addItemToFront_2)
isNull = Object.IsNull(obj=data_shapes_ui_inputgroup_data)
uniqueItems = List.UniqueItems(list=isNull)
operators_Not = Not(x=uniqueItems)
code_block_16 = CodeBlock { "Cancel"; 1000; }
max = Math.Max(value1=code_block_12.stringLength, value2=code_block_15.stringLength)
code_block_17 = CodeBlock(chars=max) { chars; width = Math.Max(750, Math.Round(200*chars/25 + 0.5*chars)); }
code_block_18 = CodeBlock(logo=code_block_12.logo, ButtonText=string_3, inputs=addItemToFront_3, objectHasData=operators_Not, cancelButtonText=code_block_16.out0, maxHeight=code_block_16.out1, uiWidth=code_block_17.width) { Descritpion; logo; ButtonText; inputs; objectHasData; cancelButtonText; maxHeight; uiWidth; }  # unwired: Descritpion
python_script = Python(IN[0]=map)
# ---------- python_script.python (24 lines) ----------
# Load the Python Standard and DesignScript Libraries
import sys
import clr
clr.AddReference('ProtoGeometry')
from Autodesk.DesignScript.Geometry import *

# The inputs to this node will be stored as a list in the IN variables.
inlist=IN[0]
templist=[]
outlist=[]
# Place your code below this line
for sublist in inlist:
	templist.Clear()
	for item in sublist:
		if "list" in str(type(item)):
			for i in item:
				templist.append(i)
		else:
			templist.append(item)
	outlist.append(list(templist))
			
		
# Assign your output to the OUT variable.
OUT = outlist
# ----------------------------------------

# group: User selects family types and FP codes
# note: description
data_shapes_ui_multipleinputform = Custom[Data-Shapes_UI.MultipleInputForm ++](Description_optional=code_block_18.Descritpion, Logo_optional=code_block_18.logo, ButtonText_optional=code_block_18.ButtonText, Inputs=code_block_18.inputs, Toggle=code_block_18.objectHasData, CancelButtonText_optional=code_block_18.cancelButtonText, MaxHeight_optional=code_block_18.maxHeight, Width_optional=code_block_18.uiWidth)  # package Data-Shapes; Create a form with multiple inputs. see www.data-shapes.net for tutorials and infos!
code_block_19 = CodeBlock { null; }
if_ = If(test=data_shapes_ui_multipleinputform.Was_Cancelled, true=code_block_19, false=data_shapes_ui_multipleinputform.User_Inputs)
code_block_20 = CodeBlock(selectedItems=if_) { selectedItems; }
