# Dynamo custom node materials.importdatasplitROCO.dyf (Dynamo 1.3.4.6666)
# category: DynamoROCODyfs.Materials
# splits combined material data from ROCO materials to sensible info

data = Input()
code_block = CodeBlock(x=data)
# ---------- code_block.designscript (19 lines) ----------
x;
x[0]
/*matNames*/;
x[1]
/*unicCode*/;
x[2]
/*unicDescr*/;
x[3]
/*cutfpatID*/;
x[4]
/*cutfpatColor*/;
x[5]
/*surfpatID*/;
x[6]
/*surfpatColor*/;
x[7]/*matColor*/;
x[8]/*class*/;
x[9]/*AppearanceAssetID*/;
x[10]/*AppearanceAssetName*/;
# ----------------------------------------
materialName = Output(code_block.out1)
uniclassCode = Output(code_block.out2)
uniclassDescription = Output(code_block.out3)
string = StringInput("@[]@")
split = String.Split(code_block.out4, string)
split_2 = String.Split(code_block.out5, string)

# group: create cutpattern FOREGROUND ID + COLOR
code_block_2 = CodeBlock { 0; }
getItemAtIndex = List.GetItemAtIndex(list=split, index=code_block_2, lacing=Longest)
code_block_3 = CodeBlock(surfFrontpatId=getItemAtIndex) { surfFrontpatId; }
create = List.Create(code_block_3)
itemsToString = Custom[List.ItemsToString](List=create)  # converts list items to string
toNumber = String.ToNumber(itemsToString)
flatten = Flatten(toNumber)
getItemAtIndex_2 = List.GetItemAtIndex(list=split_2, index=code_block_2, lacing=Longest)
code_block_4 = CodeBlock(surfFrontpatColor=getItemAtIndex_2) { surfFrontpatColor; }
colorsFromString = Custom[Colors.ColorsFromString](colors=code_block_4, lacing=Longest)  # creates color values based on color string
flatten_2 = Flatten(colorsFromString)

frontCutpatID = Output(flatten)
frontCutpatCol = Output(flatten_2)

# group: create cutpattern BACKGROUND ID + COLOR
code_block_5 = CodeBlock { 1; }
getItemAtIndex_3 = List.GetItemAtIndex(list=split, index=code_block_5, lacing=Longest)
code_block_6 = CodeBlock(surfFrontpatId=getItemAtIndex_3) { surfFrontpatId; }
create_2 = List.Create(code_block_6)
itemsToString_2 = Custom[List.ItemsToString](List=create_2)
toNumber_2 = String.ToNumber(itemsToString_2)
flatten_3 = Flatten(toNumber_2)
getItemAtIndex_4 = List.GetItemAtIndex(list=split_2, index=code_block_5, lacing=Longest)
code_block_7 = CodeBlock(surfFrontpatColor=getItemAtIndex_4) { surfFrontpatColor; }
colorsFromString_2 = Custom[Colors.ColorsFromString](colors=code_block_7, lacing=Longest)
flatten_4 = Flatten(colorsFromString_2)

backCutpatID = Output(flatten_3)
backCutpatCol = Output(flatten_4)
split_3 = String.Split(code_block.out6, string)
split_4 = String.Split(code_block.out7, string)

# group: create surfpattern FOREGROUND ID + COLOR
code_block_8 = CodeBlock { 0; }
getItemAtIndex_5 = List.GetItemAtIndex(list=split_3, index=code_block_8, lacing=Longest)
code_block_9 = CodeBlock(surfFrontpatId=getItemAtIndex_5) { surfFrontpatId; }
create_3 = List.Create(code_block_9)
itemsToString_3 = Custom[List.ItemsToString](List=create_3)
toNumber_3 = String.ToNumber(itemsToString_3)
flatten_5 = Flatten(toNumber_3)
getItemAtIndex_6 = List.GetItemAtIndex(list=split_4, index=code_block_8, lacing=Longest)
code_block_10 = CodeBlock(surfFrontpatColor=getItemAtIndex_6) { surfFrontpatColor; }
colorsFromString_3 = Custom[Colors.ColorsFromString](colors=code_block_10, lacing=Longest)
flatten_6 = Flatten(colorsFromString_3)

frontSurfpatID = Output(flatten_5)
frontSurfpatCol = Output(flatten_6)

# group: create surfpattern BACKGROUND ID + COLOR
code_block_11 = CodeBlock { 1; }
getItemAtIndex_7 = List.GetItemAtIndex(list=split_3, index=code_block_11, lacing=Longest)
code_block_12 = CodeBlock(surfBackpatId=getItemAtIndex_7) { surfBackpatId; }
create_4 = List.Create(code_block_12)
itemsToString_4 = Custom[List.ItemsToString](List=create_4)
toNumber_4 = String.ToNumber(itemsToString_4)
flatten_7 = Flatten(toNumber_4)
getItemAtIndex_8 = List.GetItemAtIndex(list=split_4, index=code_block_11, lacing=Longest)
code_block_13 = CodeBlock(surfBackpatColor=getItemAtIndex_8) { surfBackpatColor; }
colorsFromString_4 = Custom[Colors.ColorsFromString](colors=code_block_13, lacing=Longest)
flatten_8 = Flatten(colorsFromString_4)

backSurfpatID = Output(flatten_7)
backSurfpatCol = Output(flatten_8)

# group: create material color from colorstring
isNull = Object.IsNull(code_block.out8, lacing=Longest)
string_2 = StringInput("Color(Red = 0, Green = 0, Blue = 0, Alpha = 255)")
if_ = If(test=isNull, true=string_2, false=code_block.out8)
colorsFromString_5 = Custom[Colors.ColorsFromString](colors=if_, lacing=Longest)
flatten_9 = Flatten(colorsFromString_5)

materialColor = Output(flatten_9)
materialClass = Output(code_block.out9)
AppearanceAssetID = Output(code_block.out10)
AppearanceAssetName = Output(code_block.out11)
