# Dynamo custom node points_calculateParameterValues.dyf "Points.calculateParameterValues" (Dynamo 2.3.0.5885)
# category: DynamoROCODyfs.Points
# Calculate parametevalues from points in dictionary by station, and settingsdictionary.

# group: INPUT
scriptSettings = Input(scriptSettings: var[]..[])
ptPairDictionary = Input(ptPairDictionary: var[]..[])

# group: Calculation
stringifyJSON = Data.StringifyJSON(values=scriptSettings)
python_script = Python(IN[0]=stringifyJSON, IN[1]=ptPairDictionary)
# ---------- python_script.python (141 lines) ----------
# Load the Python Standard and DesignScript Libraries
import sys
import clr
import json

clr.AddReference('ProtoGeometry')
from Autodesk.DesignScript.Geometry import *

# The inputs to this node will be stored as a list in the IN variables.
settingsDict = json.loads(IN[0])
selectionDict = IN[1]

outValues=dict()
outParameters=dict()


# Place your code below this line

def dh_points(start_point, end_point):  # calculate horizontal distance between points
    try:
        distance = (abs(end_point.X - start_point.X) ** 2 + abs(end_point.Y - start_point.Y) ** 2) ** 0.5
    except:
        distance = None
    return distance


def dl_points(start_point, end_point):  # calculate xyz distance between points
    try:
        distance = (abs(end_point.X - start_point.X) ** 2 + abs(end_point.Y - start_point.Y) ** 2 + abs(
            end_point.Z - start_point.Z) ** 2) ** 0.5
    except:
        distance = None
    return distance


def dz_points(start_point, end_point):  # calculate vertical distance between points
    try:
        distance = end_point.Z - start_point.Z
    except:
        distance = None
    return distance


def calc_dz(keyList, pointdict):  # loop through dicts, outputting calculated values by keyvalues
    value_dict = dict()
    pointdict1 = pointdict[keyList[0]]
    pointdict2 = pointdict[keyList[1]]
    for key in pointdict1:
        value_dict[key] = dz_points(pointdict1[key], pointdict2[key])
    return value_dict


def calc_dh(keyList, pointdict):  # loop through dicts, outputting calculated values by keyvalues
    value_dict = dict()
    pointdict1 = pointdict[keyList[0]]
    pointdict2 = pointdict[keyList[1]]
    for key in pointdict1:
        value_dict[key] = dh_points(pointdict1[key], pointdict2[key])
    return value_dict


def calc_dl(keyList, pointdict):  # loop through dicts, outputting calculated values by keyvalues
    value_dict = dict()
    pointdict1 = pointdict[keyList[0]]
    pointdict2 = pointdict[keyList[1]]
    for key in pointdict1:
        value_dict[key] = dl_points(pointdict1[key], pointdict2[key])
    return value_dict


def calculate(parameterKey, calculation, group, selections):  # calculate values based on settings dictionary
    for calc in calculation:
        value = None
        keyList = list()
        tempdict = dict()
        if calc == "dZ":
            keyList = calculation[calc]
            tempdict.clear()
            for key in keyList:
                try:
                    tempdict[key] = selections[key][group]
                except:
                    pass
            try:
                value = calc_dz(keyList, tempdict)
            except:
                pass
        elif calc == "dH":
            keyList = calculation[calc]
            tempdict.clear()
            for key in keyList:
                try:
                    tempdict[key] = selections[key][group]
                except:
                    pass
            try:
                value = calc_dh(keyList, tempdict)
            except:
                pass
        elif calc == "dL":
            keyList = calculation[calc]
            tempdict.clear()
            for key in keyList:
                try:
                    tempdict[key] = selections[key][group]
                except:
                    pass
            try:
                value = calc_dl(keyList, tempdict)
            except:
                pass
        else:
            value = None
            parameterKey = None
            calc = None
    return {parameterKey: value}


for item in selectionDict:
    selections = selectionDict[item]
    settings = settingsDict[item]
    groups = settings["Group"]
    calculation = settings["Calculation"]
    # print(groups, calculation)
    tempdict = {}
    # print("//////////////////////////////////////////////////////calculate values////////////////////////////////////")
    for group in groups:
        parameterKeys = groups[group]
        for parameterKey in parameterKeys:
            calculated = calculate(parameterKey, calculation[parameterKey], group, selections)
            tempdict.update(calculated)
	outValues[item] = tempdict.copy()
	outParameters[item]=settings["parameters"]

parameterdict={}
for item in outValues:
	for key in outValues[item]:
		parameterdict[outParameters[item][key]]= outValues[item][key]
	
# Assign your output to the OUT variable.
OUT = {"paramValues":outValues, "paramNames":outParameters,"paramDict":parameterdict}
# ----------------------------------------

# group: output
code_block = CodeBlock(x=python_script) { x["paramValues"]; x["paramNames"]; }
paramValues = Output(code_block.out0)
paramNames = Output(code_block.out1)
code_block_2 = CodeBlock(x=python_script)
# ---------- code_block_2.designscript (5 lines) ----------
paramNames=x["paramDict"].Keys;
paramValStations=x["paramDict"][paramNames].Keys;
paramValsByStation=x["paramDict"][paramNames];
paramVals=x["paramDict"][paramNames][paramValStations];
transposedList=List.Transpose(paramVals);
# ----------------------------------------
byKeysValues = DesignScript.Builtin.Dictionary.ByKeysValues(keys=code_block_2.paramNames, values=code_block_2.transposedList@L2)
byKeysValues_2 = DesignScript.Builtin.Dictionary.ByKeysValues(keys=code_block_2.paramValStations, values=byKeysValues)
transposedParameterDict = Output(byKeysValues_2)
