# Dynamo custom node readCivilCorridorFLpointCodes.dyf (Dynamo 2.3.0.5885)
# category: DynamoROCODyfs.UIObjects
# Reads the open civil documents for corridor featurelinepoints and outputs treeview with  docname | corridorname | FLPointName|
# packages: CivilConnection2020 4.0.4, Data-Shapes 2019.2.40

civilApplication = Input(civilApplication: CivilConnection.CivilApplication)

# group: Importing civil documents from application and fomratting for selecting corridor and FPcodes in UI
string = StringInput("Select only 1 FL point code below!")
code_block = CodeBlock { "Doc | Corridor | FLPointCode"; }
# note: description
code_block_2 = CodeBlock(civilApplication=civilApplication) { civilApplication; }
getDocuments = CivilConnection.CivilApplication.GetDocuments(civilApplication=code_block_2)
name = CivilConnection.CivilDocument.Name(civilDocument=getDocuments, lacing=Longest)
string_2 = StringInput(" | ")
operators = name + string_2
getCorridors = CivilConnection.CivilDocument.GetCorridors(civilDocument=getDocuments)
name_2 = CivilConnection.Corridor.Name(corridor=getCorridors)
operators_2 = operators + name_2
operators_3 = operators_2 + string_2
getCodes = CivilConnection.Corridor.GetCodes(corridor=getCorridors)
operators_4 = operators_3 + getCodes
flatten = List.Flatten(list=operators_4)
addItemToFront = List.AddItemToFront(item=code_block, list=flatten)
code_block_3 = CodeBlock { false; 75; }
ui_treeview_input = Custom[UI.TreeView input](InputName=string, Data=addItemToFront, FirstItemIsTitle=code_block_3.out0, Height=code_block_3.out1)  # package Data-Shapes; Create a TreeView input for UI.MultipleInputForm ++ . Check out www.data-shapes.net for more infos and tips!
length = String.Length(str=flatten)
maximumItem = List.MaximumItem(list=length)
code_block_4 = CodeBlock(civilApplication=code_block_2, seperator=string_2) { civilApplication; seperator; }
code_block_5 = CodeBlock(UIobject=ui_treeview_input, stringLength=maximumItem, civilApplication=code_block_4.civilApplication, Separator=code_block_4.seperator, ListData=addItemToFront) { UIobject; stringLength; civilApplication; Separator; ListData; }

# group: Output
code_block_6 = CodeBlock(UIobject=code_block_5.UIobject, stringLength=code_block_5.stringLength, civilApplication=code_block_5.civilApplication, Separator=code_block_5.Separator, ListData=code_block_5.ListData) { UIobject; stringLength; civilApplication; Separator; ListData; }
UIObject = Output(code_block_6.UIobject)
stringLength = Output(code_block_6.stringLength)
civilApplication_2 = Output(code_block_6.civilApplication)  # "civilApplication"
stringSeperator = Output(code_block_6.Separator)
listData = Output(code_block_6.ListData)
