# Dynamo custom node readConfigFile.dyf (Dynamo 2.3.0.5885)
# category: DynamoROCODyfs.DynamoROCO.DataFunctions
# Reads config file from filepath, outputs dictionary of content

# group: Input
filePath = Input(filePath: var[]..[])

# group: Import JSON file for script config and parse to dictionaries
code_block = CodeBlock(selectedConfigFile=filePath) { selectedConfigFile; }
code_block_2 = CodeBlock { 0; }
getItemAtIndex = List.GetItemAtIndex(list=code_block, index=code_block_2)
readText = FileSystem.ReadText(file=getItemAtIndex)
parseJSON = Data.ParseJSON(json=readText)
code_block_3 = CodeBlock { "scriptDataDict"; "imageDict"; "configData"; }
valueAtKey = DesignScript.Builtin.Dictionary.ValueAtKey(dictionary=parseJSON, key=code_block_3.out1)
valueAtKey_2 = DesignScript.Builtin.Dictionary.ValueAtKey(dictionary=parseJSON, key=code_block_3.out0)
valueAtKey_3 = DesignScript.Builtin.Dictionary.ValueAtKey(dictionary=parseJSON, key=code_block_3.out2)
code_block_4 = CodeBlock { "#adaptivePoints"; }
valueAtKey_4 = DesignScript.Builtin.Dictionary.ValueAtKey(dictionary=valueAtKey_3, key=code_block_4)
code_block_5 = CodeBlock(imageDict=valueAtKey, scriptSettingsDict=valueAtKey_2, amountAdaptivePoints=valueAtKey_4, configFileMeta=valueAtKey_3) { imageDict; scriptSettingsDict; amountAdaptivePoints; configFileMeta; }

# group: Output
code_block_6 = CodeBlock(imageDict=code_block_5.imageDict, scriptSettingsDict=code_block_5.scriptSettingsDict, amountAdaptivePoints=code_block_5.amountAdaptivePoints, configFileMeta=code_block_5.configFileMeta) { imageDict; scriptSettingsDict; amountAdaptivePoints; configFileMeta; }
imageDict = Output(code_block_6.imageDict)
configFileMeta = Output(code_block_6.configFileMeta)
scriptSettingsDict = Output(code_block_6.scriptSettingsDict)
amountAdaptivePoints = Output(code_block_6.amountAdaptivePoints)
