# Dynamo custom node readConfigFileDirectory.dyf (Dynamo 2.3.0.5885)
# category: DynamoROCODyfs.UIObjects
# Import config file names stored in workspace, output UI objects for Data-Shapes containing filenames
# packages: Clockwork for Dynamo 2.x 2.3.0, Data-Shapes 2021.2.9

# note: User enters parameter values for each object type
# note: User selects config file to run script with
# note: Import JSON file for script config
# note: get directional flPoints for each baseline
# note: filter for GMA2 or GMA4 info
# note: Combines target and axis lists for GMA4
# note: Create script meta data file
# note: importing text file containing json into 2 streams:
# 1 stream is used for importing the pictures into the UI.
# 1 stream is used as foundation for the information in the script
# note: required packages are prefixed in node names

# group: DATA MANIPULATION
# note: Data manipulation on Dynamo Objects

# group: NOT IN USE
# note: Nodes to consider part of the final graph

# group: INPUT
# note: Data input and preperation for other nodes

# group: GET
# note: Get parameter values from Revit objects

# group: DEBUG
# note: Check if the graph is working as expected

# group: Package
# note: All used nodes from a package have a prefix
# added to them with the name of the node.

# group: FUNCTION
# note: Creation of dynamo objects

# group: OUTPUT
# note: Object creation in Revit, final output

# group: SET
# note: Set parameters on Revit objects

# group: INPUT
python_script = Python()  # unwired: IN[0]
# ---------- python_script.python (29 lines) ----------
# Importing Reference Modules
# CLR ( Common Language Runtime Module )
import clr
# Adding the DynamoRevitDS.dll module to work with the Dynamo API
clr.AddReference('DynamoRevitDS')
import Dynamo 

# access to the current Dynamo instance and workspace
dynamoRevit = Dynamo.Applications.DynamoRevit()
currentWorkspace = dynamoRevit.RevitDynamoModel.CurrentWorkspace

# Access current version of dynamo
version=dynamoRevit.RevitDynamoModel.Version

# checks version of dynamo and adjusts output according to version
if version.StartsWith("1."):
	
	# Gets file name which includes full path
	filename=currentWorkspace.FileName
	
	
	# Splits out file path to just file name
	OUT=filename

elif version.StartsWith("2."):
	OUT=currentWorkspace.FileName

else:
	OUT="Not supported"
# ----------------------------------------
userName = Custom[System.UserName]()  # package Clockwork for Dynamo 2.x
code_block = CodeBlock(workspaceFilePath=python_script, userName=userName) { workspaceFilePath; userName; }

# group: Create UI data from config file
code_block_2 = CodeBlock(workspaceFilepath=code_block.workspaceFilePath) { workspaceFilepath; }
directoryName = FileSystem.DirectoryName(path=code_block_2)
code_block_3 = CodeBlock { "\\config_files"; }
concat = String.Concat(string0=directoryName, string1=code_block_3)
directory_from_path = DirectoryObject(path=concat)
code_block_4 = CodeBlock { false; }
getDirectoryContents = FileSystem.GetDirectoryContents(directory=directory_from_path, includeSubdirectories=code_block_4)
code_block_5 = CodeBlock { false; }
fileName = FileSystem.FileName(path=code_block_2, withExtension=code_block_5)
string = StringInput("@")
split = String.Split(str=fileName, separator0=string)
code_block_6 = CodeBlock(x=split) { "@" +x[1]+".JSON"; true; }
contains = String.Contains(str=getDirectoryContents.files, searchFor=code_block_6.out0, ignoreCase=code_block_6.out1)
filterByBoolMask = List.FilterByBoolMask(list=getDirectoryContents.files, mask=contains)
fileName_2 = FileSystem.FileName(path=filterByBoolMask.in)
length = String.Length(str=fileName_2)
maximumItem = List.MaximumItem(list=length)
code_block_7 = CodeBlock(fileNames=fileName_2, filePaths=filterByBoolMask.in, str_length=maximumItem) { fileNames; filePaths; str_length; }

passthrough = Custom[Passthrough](passThrough=code_block.userName, waitFor=code_block_7.filePaths)  # package Clockwork for Dynamo 2.x; Forces a sequential order of execution. The node wired into the output of the Passthrough node will be executed *after* the node wired into the waitFor input (e.g. important for some Revit operations). The value of the passThrough input will be passed on to the node wired into the output port of the Passthrough node.

# group: Create UI objects for selection in script
code_block_8 = CodeBlock(fileNames=code_block_7.fileNames, filePaths=code_block_7.filePaths, userNames=passthrough) { fileNames; filePaths; userNames; }
code_block_9 = CodeBlock { 0; "Cancel"; "Select configuration"; "Select configuration predefined in the script folder"; }
data_shapes_ui_dropdown_data = Custom[Data-Shapes_UI.DropDown Data](Keys=code_block_8.fileNames, Values=code_block_8.filePaths, DefaultValueIndex=code_block_9.out0)  # package Data-Shapes
code_block_10 = CodeBlock { "Enter the author name you want to place on the objects. By default windows username"; }
ui_textnote_data = Custom[UI.TextNote Data](TextNote=code_block_10)  # package Data-Shapes
code_block_11 = CodeBlock { "Username to place on all objects in this run"; }
ui_textnote_data_2 = Custom[UI.TextNote Data](Title=code_block_11, TextNote=code_block_8.userNames)
count = List.Count(list=code_block_8.fileNames)
operators = count != code_block_9.out0

passthrough_2 = Custom[Passthrough](passThrough=data_shapes_ui_dropdown_data, waitFor=ui_textnote_data)
passthrough_3 = Custom[Passthrough](passThrough=passthrough_2, waitFor=ui_textnote_data_2)

# group (continued): Create UI objects for selection in script
list_create = List.Create(item0=passthrough_3, item1=ui_textnote_data, item2=ui_textnote_data_2)
code_block_12 = CodeBlock(UIObjects=list_create, fileNames=code_block_8.fileNames, filePaths=code_block_8.filePaths, userNames=code_block_8.userNames, description=code_block_9.out3, buttonText=code_block_9.out2, hasData=operators, cancelButton=code_block_9.out1) { UIObjects; fileNames; filePaths; userNames; description; logo; buttonText; hasData; cancelButton; }  # unwired: logo

passthrough_4 = Custom[Passthrough](passThrough=code_block_7.str_length, waitFor=code_block_12.UIObjects)

# group: OUTPUT
code_block_13 = CodeBlock(description=code_block_12.description, logo=code_block_12.logo, buttonText=code_block_12.buttonText, inputs=code_block_12.UIObjects, hasData=code_block_12.hasData, cancelButton=code_block_12.cancelButton, fileNames=code_block_12.fileNames, filePaths=code_block_12.filePaths, userNames=code_block_12.userNames, str_length=passthrough_4) { description; logo; buttonText; inputs; hasData; cancelButton; fileNames; filePaths; userNames; str_length; }
code_block_14 = CodeBlock(logo=code_block_13.logo) { logo; }
code_block_15 = CodeBlock(description=code_block_13.description) { description; }
code_block_16 = CodeBlock(UIObjects=code_block_13.inputs) { UIObjects; }
code_block_17 = CodeBlock(buttonText=code_block_13.buttonText) { buttonText; }
code_block_18 = CodeBlock(hasData=code_block_13.hasData) { hasData; }
code_block_19 = CodeBlock(filePaths=code_block_13.filePaths) { filePaths; }
code_block_20 = CodeBlock(fileNames=code_block_13.fileNames) { fileNames; }
code_block_21 = CodeBlock(cancelButton=code_block_13.cancelButton) { cancelButton; }
code_block_22 = CodeBlock(userName=code_block_13.userNames) { userName; }
code_block_23 = CodeBlock(strLength=code_block_13.str_length) { strLength; }

# group: OUTPUT
code_block_24 = CodeBlock { description; logo; buttonText; inputs; hasData; cancelButton; fileNames; filePaths; userNames; str_length; }  # unwired: description, logo, buttonText, inputs, hasData, cancelButton, fileNames, filePaths, userNames, str_length
description = Output(code_block_13.description)
UIObjects = Output(code_block_13.inputs)
buttonText = Output(code_block_13.buttonText)
hasData = Output(code_block_13.hasData)
logo = Output(code_block_13.logo)
cancelButton = Output(code_block_13.cancelButton)
fileNames = Output(code_block_13.fileNames)
filePaths = Output(code_block_13.filePaths)
userName_2 = Output(code_block_13.userNames)  # "userName"
strLength = Output(code_block_13.str_length)
