# Dynamo custom node selectFamilyTypeAndParameterValues.dyf (Dynamo 2.2.1.5175)
# category: DynamoROCODyfs.Family
# Select family by name and type based on string in family name. next it allows you to enter parameter values which can be used to fill the parameter values.

# group: Input
inputFormDescriptionText = Input(inputFormDescriptionText: string = "Select below")

dynamo_roco_loadrocologo = Custom[Dynamo@ROCO_LoadRocoLogo]()
code_block = CodeBlock { "Select"; }

# group: Input
textNoteTitle = Input(textNoteTitle: string = "Instructions")
textNoteDescription = Input(textNoteDescription: string = "<description here>")
dropdownDescription = Input(dropdownDescription: string = "Select family")
textBoxTitles = Input(textBoxTitles: var[]..[] = "textboxTitle")
textBoxdefaultFamilies = Input(textBoxdefaultFamilies: var[]..[] = "Select family")
booleanInputTitle = Input(booleanInputTitle: var[]..[] = "booleanTitle")
booleanInputDescription = Input(booleanInputDescription: var[]..[] = "Yes/No")

ui_textnote_data = Custom[UI.TextNote Data](Title=textNoteTitle, TextNote=textNoteDescription)  # Create Data for TextNote input in UI.MultipleInputForm ++ . Check out www.data-shapes.net for more informations

# group: Input
familyNameContains = Input(familyNameContains: string)

# group: Create input form data for family types and names
element_types = ElementTypes("Family")
all_elements_of_type = ElementsOfType(element_type=element_types)
name = Element.Name(element=all_elements_of_type)
boolean = BoolSelector(false)
contains = String.Contains(str=name, searchFor=familyNameContains, ignoreCase=boolean)
filterByBoolMask = List.FilterByBoolMask(list=all_elements_of_type, mask=contains)
name_2 = Family.Name(family=filterByBoolMask.in)
string = StringInput(" | Type: ")
add = name_2 + string  # lacing=Longest
types = Family.Types(family=filterByBoolMask.in)
name_3 = FamilyType.Name(familyType=types)
add_2 = add + name_3
flatten = List.Flatten(list=types)
list_create = List.Create(item0=flatten)

string_2 = StringInput("  | Category: ")
add_3 = add_2 + string_2  # lacing=Longest
getCategory = Element.GetCategory(element=types)
add_4 = add_3 + getCategory

# group (continued): Create input form data for family types and names
flatten_2 = List.Flatten(list=add_4)
list_create_2 = List.Create(item0=flatten_2)

# group: formatting data to fill userinputform
code_block_2 = CodeBlock { zero:int=0; }
data_shapes_ui_dropdown_data = Custom[Data-Shapes_UI.DropDown Data](InputName=dropdownDescription, Keys=list_create_2, Values=list_create, DefaultValueIndex=code_block_2, lacing=Shortest)  # Create data for DropDown input in UI.MultiInputForm ++ . Check out www.data-shapes.net for more infos.

ui_textbox_data = Custom[UI.TextBox Data](InputName=textBoxTitles, DefaultText=textBoxdefaultFamilies)  # Create Data for TextBox input in UI.MultipleInputForm ++ . Check out www.data-shapes.net for more informations
ui_boolean_input = Custom[UI.Boolean input](InputName=booleanInputTitle, SideText=booleanInputDescription)  # Creates a boolean input for UI.MultipleInputForm ++ . Check out www.data-shapes.net for more infos!
list_create_3 = List.Create(item0=ui_textnote_data, item1=data_shapes_ui_dropdown_data, item2=ui_textbox_data, item3=ui_boolean_input)
flatten_3 = List.Flatten(list=list_create_3)
list_create_4 = List.Create(item0=flatten_3)
isNull = Object.IsNull(obj=add_4)
flatten_4 = List.Flatten(list=isNull)
uniqueItems = List.UniqueItems(list=flatten_4)
operators_Not = Not(x=uniqueItems)
code_block_3 = CodeBlock { "Cancel"; }
length = String.Length(str=flatten_2, lacing=Longest)
maximumItem = List.MaximumItem(list=length)
code_block_4 = CodeBlock(chars=maximumItem) { chars; width = Math.Max(350, Math.Round(200*chars/25 + 0.5*chars)); }
ui_multipleinputform = Custom[UI.MultipleInputForm ++](Description_optional=inputFormDescriptionText, Logo_optional=dynamo_roco_loadrocologo, ButtonText_optional=code_block, Inputs=list_create_4, Toggle=operators_Not, CancelButtonText_optional=code_block_3, Width_optional=code_block_4.width, lacing=Shortest)  # Create a form with multiple inputs. see www.data-shapes.net for tutorials and infos!

# group: obtaining family element
firstItem = List.FirstItem(list=ui_multipleinputform.User_Inputs)
code_block_5 = CodeBlock(x=firstItem) { x; family_type=x[0]; }
code_block_6 = CodeBlock { 0; }
removeItemAtIndex = List.RemoveItemAtIndex(list=firstItem, indices=code_block_6)
flatten_5 = List.Flatten(list=removeItemAtIndex)
code_block_7 = CodeBlock { null; }
operators = firstItem == code_block_7
string_3 = StringInput("error: no family type selected")
if_ = If(test=operators, true=string_3, false=code_block_7)

familytype = Output(code_block_5.family_type)
list_create_5 = List.Create(item0=textBoxTitles, item1=booleanInputTitle)
flatten_6 = List.Flatten(list=list_create_5)
byKeysValues = DesignScript.Builtin.Dictionary.ByKeysValues(keys=flatten_6, values=flatten_5)
values = Output(byKeysValues)
errormsg = Output(if_)
