# Dynamo custom node Element.SearchForParameter.dyf (Dynamo 1.3.4.6666)
# category: infranea.Elements
# searches all element parameter and returns list of matching items

element = Input()
parameters = Element.Parameters(element)
name = Parameter.Name(parameters)
searchFor = Input()
ignoreCase = Input()
contains = String.Contains(str=name, searchFor=searchFor, ignoreCase=ignoreCase)
filterByBoolMask = List.FilterByBoolMask(list=parameters, mask=contains)
