# Dynamo custom node Lists.listToMatrix.dyf "list to matrix" (Dynamo 2.2.1.5175)
# category: Core.List
# creates a matrix from (nested) lists

inlits = Input(inlits: archilab.Lists.Lists)
number = Input(number: var[]..[])
python_script = Python(IN[0]=inlits, IN[1]=number)
# ---------- python_script.python (30 lines) ----------
import clr
clr.AddReference('ProtoGeometry')
from Autodesk.DesignScript.Geometry import *
#The inputs to this node will be stored as a list in the IN variables.
dataEnteringNode = IN


#----------end of functions---------------------------------------

inputList = IN[0]


lvlNest = IN[1]
lengthList = len(inputList)


for i in range(len(inputList)):
	for j in range(lvlNest):
		matrix [i,j]
	inputList[i]=lvlNest

	


#Assign your output to the OUT variable.
OUT  = inputList



    
# ----------------------------------------
output = Output(python_script)
