# Dynamo custom node LoadRocoLogo.dyf (Dynamo 1.3.4.6666)
# category: Dynamo@ROCO

python_script = Python()  # unwired: IN[0]
# ---------- python_script.python (28 lines) ----------
# Importing Reference Modules
# CLR ( Common Language Runtime Module )
import clr
# Adding the DynamoRevitDS.dll module to work with the Dynamo API
clr.AddReference('DynamoRevitDS')
import Dynamo 

# access to the current Dynamo instance and workspace
dynamoRevit = Dynamo.Applications.DynamoRevit()
currentWorkspace = dynamoRevit.RevitDynamoModel.CurrentWorkspace

# Access current version of dynamo
version=dynamoRevit.RevitDynamoModel.Version

# checks version of dynamo and adjusts output according to version
if version.StartsWith("1."):
	
	# Gets file name which includes full path
	filename=currentWorkspace.FileName
	
	# Splits out file path to just file name
	OUT=filename

elif version.StartsWith("2."):
	OUT=currentWorkspace.Name

else:
	OUT="Not supported"
# ----------------------------------------
directoryName = FilePath.DirectoryName(python_script)
code_block = CodeBlock { "\\ROCO.jpg"; }
concat = String.Concat(directoryName, code_block)
fromPath = FileObject(concat)  # "File.FromPath"
readFromFile = Image.ReadFromFile(fromPath)
image = Output(readFromFile)
