# Dynamo custom node Parameter.SetValueByName.dyf (Dynamo 1.3.4.6666)
# category: infranea.Parameters
# Sets element parameter value by name

element = Input()
name = Input(name:string)
parameterByName = Parameter.ParameterByName(element=element, name=name)
value = Input(value:string)
setValue = Parameter.SetValue(parameterByName, value)
