# Dynamo custom node Python.defaultSetupTransaction.dyf (Dynamo 1.3.4.6666)
# category: infranea.Python
# Default code for setting up transactions between Dynamo and Revit API

python_script = Python()  # unwired: IN[0]
# ---------- python_script.python (27 lines) ----------
import clr
import sys
# import Revit API
clr.AddReference('RevitAPI')
from Autodesk.Revit.DB import *
# import Revit API UI
clr.AddReference('RevitAPIUI')
# import Revit Services
clr.AddReference('RevitServices')
import RevitServices
from RevitServices.Persistence import DocumentManager
from RevitServices.Transactions import TransactionManager 
# import ProtoGeometry 
clr.AddReference('ProtoGeometry')
from Autodesk.DesignScript.Geometry import *

dmi=DocumentManager.Instance #setting up document manager instance
doc=dmi.CurrentDBDocument #Gets current document
uiapp = dmi.CurrentUIApplication #gets current Revit app 
app= uiapp.Application #gets current UI app

#The inputs to this node will be stored as a list in the IN variables.
dataEnteringNode = IN


#Assign your output to the OUT variable.
OUT = 0
# ----------------------------------------
