# Dynamo custom node material.CreateNew_Uniclass.dyf (Dynamo 1.3.4.6666)
# category: infranea.Materials
# Creates new materials using 'Cut' settings, 'surface' settings, graphics settings and uniclass coding, based on materialName

materialName = Input()
materialColor = Input()
frontCutpatternId = Input()
frontCutpatternColor = Input()
backCutpatternId = Input()
backCutpatternColor = Input()
frontSurfpatternId = Input()
frontSurfpatternColor = Input()
backSurfPatternId = Input()
backSurfPatternColor = Input()
uniclassCode = Input()
uniclassDescription = Input()
materialClass = Input()
appearanceAssetId = Input()
code_block = CodeBlock(materialName=materialName, materialColor=materialColor, materialCutfrontpatternID=frontCutpatternId, materialCutfrontpatternColor=frontCutpatternColor, materialCutbackpatternID=backCutpatternId, materialCutbackpatternColor=backCutpatternColor, materialSurfacefrontpatternID=frontSurfpatternId, materialSurfacefrontpatternColor=frontSurfpatternColor, materialSurfacebackpatternID=backSurfPatternId, materialSurfacebackpaternColor=backSurfPatternColor, uniclassCode=uniclassCode, uniclassDesc=uniclassDescription, matClass=materialClass, AppearanceAssetID=appearanceAssetId)
# ---------- code_block.designscript (14 lines) ----------
materialName;
materialColor;
materialCutfrontpatternID;
materialCutfrontpatternColor;
materialCutbackpatternID;
materialCutbackpatternColor;
materialSurfacefrontpatternID;
materialSurfacefrontpatternColor;
materialSurfacebackpatternID;
materialSurfacebackpaternColor;
uniclassCode;
uniclassDesc;
matClass;
AppearanceAssetID;
# ----------------------------------------
create_new_materials_python = Python(IN[0]=code_block.materialName, IN[1]=code_block.materialColor, IN[2]=code_block.materialCutfrontpatternID, IN[3]=code_block.materialCutfrontpatternColor, IN[4]=code_block.materialCutbackpatternID, IN[5]=code_block.materialCutbackpatternColor, IN[6]=code_block.materialSurfacefrontpatternID, IN[7]=code_block.materialSurfacefrontpatternColor, IN[8]=code_block.materialSurfacebackpatternID, IN[9]=code_block.materialSurfacebackpaternColor, IN[10]=code_block.uniclassCode, IN[11]=code_block.uniclassDesc, IN[12]=code_block.matClass, IN[13]=code_block.AppearanceAssetID)  # "create new materials: Python Script"
# ---------- create_new_materials_python.python (103 lines) ----------
import clr
clr.AddReference("RevitAPI")
from Autodesk.Revit.DB import *
clr.AddReference("RevitServices")
import RevitServices
from RevitServices.Persistence import DocumentManager
from RevitServices.Transactions import TransactionManager
import Autodesk
from Autodesk.Revit.DB import *

def ToRevitColor(dynamoColor):
	return Color(dynamoColor.Red, dynamoColor.Green, dynamoColor.Blue)
	
#The inputs to this node will be stored as a list in the IN variables.
dataEnteringNode = IN
mat_names=IN[0] #Name
mat_cols=IN[1] #color
mat_cutfpatids=IN[2] #cutpattern id foreground
mat_cutfpatcols=IN[3] #cutpattern color foreground
mat_cutbpatids=IN[4] #cutpattern id background
mat_cutbpatcols=IN[5] #cutpattern color background
mat_surfFpatids=IN[6] #surfpattern id foreground
mat_surfFpatcols=IN[7] #surfpattern color foreground
mat_surfBpatids=IN[8] #surfpattern id background
mat_surfBpatcols=IN[9] #cutpattern color background
uniCodes=IN[10] #uniclass code
uniDescs=IN[11] #uniclass description
mat_class=IN[12] #material class
appAssetIds=IN[13] #appearanceAssetId 
matlist=[]
totalErrorList=[]
doc = DocumentManager.Instance.CurrentDBDocument


colVal1=[]
colVal2=[]
r=0
g=0
b=0


TransactionManager.Instance.EnsureInTransaction(doc) #ensures transaction with document core
for i in range(0,len(mat_names)):
	#Define material properties--------------------------------------
	mName=mat_names[i]#materialName
	mColor=ToRevitColor(mat_cols[i])  #graphicsColor
	mCPfId=mat_cutfpatids[i]#cutpatternid foreground
	mCPfCol=ToRevitColor(mat_cutfpatcols[i])#cutpatterncolor foreground
	mCPbId=mat_cutbpatids[i] #cutpatternid background
	mCPbCol=ToRevitColor(mat_cutbpatcols[i]) #cutpatterncolor background
	mSPfId=mat_surfFpatids[i]#surfacepatternid foreground
	mSPfCol=ToRevitColor(mat_surfFpatcols[i])#surfacepatterncolors foreground
	mSPbId=mat_surfBpatids[i] #surfacepatterncolors background
	mSPbCol=ToRevitColor(mat_surfBpatcols[i]) #surfacepatterncolors background
	mClass=mat_class[i]
	appAssetId=appAssetIds[i]
	#End define material properties--------------------------------------
	
	#Creating new material with properties-------------------------------
	try:
		new_mat_id = Material.Create(doc, mName)
	except:
		new_mat_id ="None"
	if new_mat_id != "None":
		new_mat = doc.GetElement(new_mat_id)
		new_mat.Color= mColor
		new_mat.MaterialClass= str(mClass)
		#---try adding cutpatterns----------------------------------------------------
		try:
			new_mat.CutForegroundPatternId =ElementId(mCPfId) 
		except:
			pass
		new_mat.CutForegroundPatternColor= mCPfCol
		try:
			new_mat.CutBackgroundPatternId =ElementId(mCPbId) 
		except:
			pass
		new_mat.CutBackgroundPatternColor= mCPbCol
		#---end try adding cutpatterns------------------------------------------------
		
		#---try adding surfacepatterns---------------------------------------------------
		try:
			new_mat.SurfaceForegroundPatternId = ElementId(mSPfId)
		except:
			pass
		new_mat.SurfaceForegroundPatternColor  = mSPfCol
		try:
			new_mat.SurfaceBackgroundPatternId = ElementId(mSPbId)
		except:
			pass
		new_mat.SurfaceBackgroundPatternColor  = mSPbCol 
		try:
			new_mat.AppearanceAssetId= ElementId(appAssetId)
		except:
			pass
		#---end try adding surfacepatterns---------------------------------------------------
	    
		#creating materiallist with elements
		matlist.append(new_mat)
		#End creating new material with properties--------------------------------------
TransactionManager.Instance.TransactionTaskDone() #closes transaction manager with document core

OUT = matlist,  uniCodes, uniDescs
# ----------------------------------------
code_block_2 = CodeBlock(x=create_new_materials_python) { x; materialElements=x[0]; uniclassCode=x[1]; uniclassDesc=x[2]; }
flatten = Flatten(code_block_2.materialElements)
materialElements = Output(flatten)
flatten_2 = Flatten(code_block_2.uniclassCode)
uniclassCode_2 = Output(flatten_2)  # "uniclassCode"
flatten_3 = Flatten(code_block_2.uniclassDesc)
uniclassDesc = Output(flatten_3)
