# Dynamo graph testnode.dyf (Dynamo 2.2.1.5175)

# group: Input
start_station_m = DoubleInput(0)  # graph input
level_base = Levels("T.A.W.")  # graph input
family_type = FamilyTypes("[Pr_20_85_62_10]_TBC Combi-Buispaal 1422-12_C9 Slot_ROCO_(GMA2):1422x20")  # graph input
spacing_in_between_elements_m = DoubleInput(2.5)  # graph input
base_offset_m = DoubleInput(-35)  # graph input
cut_offset_m = DoubleInput(-4.5)  # graph input
top_offset_m = DoubleInput(5.2)  # graph input
object_numbering_start = DoubleInput(1)  # graph input

string = StringInput("Select alignment to host objects on")
selectAlignmentByNameAndDrawing2 = Custom[SelectAlignmentByNameAndDrawing2](descritpionText=string)
code_block = CodeBlock { 0; }
setStartEndEndstation = Custom[infranea_Alignment.SetStartEndEndstation](alignment=selectAlignmentByNameAndDrawing2.alignment, startStation=code_block, endStation=code_block)  # Sets start and endstation of the alignment

# group: Inputs to values
elevation = Level.Elevation(level=level_base)
code_block_2 = CodeBlock { "Width"; }
getParameterValueByName = Element.GetParameterValueByName(element=family_type, parameterName=code_block_2)

pointPairsByInterval = CivilConnection.Alignment.PointPairsByInterval(alignment=setStartEndEndstation.alignment, StartStation=setStartEndEndstation.startStation, EndStation=setStartEndEndstation.endStation, Elevation=elevation, PointDistance=getParameterValueByName, DistanceBetweenPairs=spacing_in_between_elements_m)
name = CivilConnection.Alignment.Name(alignment=selectAlignmentByNameAndDrawing2.alignment)

# group: Create Elements
code_block_3 = CodeBlock(positions=pointPairsByInterval.PointPairs, stations=pointPairsByInterval.MidStations, alignmentName=name, familyType=family_type, baseOffset=base_offset_m, cutOffset=cut_offset_m, topOffset=top_offset_m, startIndex=object_numbering_start)
# ---------- code_block_3.designscript (47 lines) ----------
out =[];
errors = [];
positions: var[][];
stations: double[];
alignmentName: string;


familyType: FamilyType;
baseOffset: double;
cutOffset: double;
topOffset: double;
startIndex: int;
[Imperative]
{
		_offset : Point = Coordinates.SurveyPoint();
		if (familyType!=null) {
			_Index=0;
			_count = Count(positions);
			_posIndex=0;
			while (_posIndex<_count)
			{
				_outerPoints=[];
				_outerPoints[0][0] = positions[_posIndex][0].Translate(_offset.X, _offset.Y, 0);
				_outerPoints[0][1] = positions[_posIndex][1].Translate(_offset.X, _offset.Y, 0);
				if (_outerPoints[0][0]==null || _outerPoints[0][1]==null )
				{
					errors[_errorIndex]="AdaptivePoint not calculated";
					_errorIndex=_errorIndex+1;
				} else
				{
					_comps = AdaptiveComponent.ByPoints(_outerPoints, familyType);
					_comps.SetParameterByName("Base Offset", baseOffset);
					_comps.SetParameterByName("Cut Offset", cutOffset);
					_comps.SetParameterByName("Top Offset", topOffset);
					_SBSI :string = (startIndex)+"";
					startIndex=startIndex+1;
					_comps.SetParameterByName("ROCO.PE.ID", _SBSI);
					_comps.SetParameterByName("ROCO.PM.Alignment.Name", alignmentName);
					_comps.SetParameterByName("ROCO.PM.Mp", stations[_posIndex]);
					out[_Index] = _comps;
					_Index=_Index+1;
				}
				_posIndex=_posIndex+1;

			};
	}
};
# ----------------------------------------

watch = Watch(code_block_3.out0)
watch_2 = Watch(code_block_3.out1)

# group: Classification & Design Log
current = Document.Current()
filePath = Document.FilePath(document=current)
dynamo_roco_designlog = Dynamo_ROCO.DesignLog.DesignLogFilename(Guid=filePath)
watch_3 = Watch(dynamo_roco_designlog)
dynamo_roco_designlog_2 = Dynamo_ROCO.DesignLog.GenerateGuid()
code_block_4 = CodeBlock { "Classification Input"; }
dynamo_roco_designlog_3 = Dynamo_ROCO.DesignLog.WriteClassificationParameters(ClassificationGroup=code_block_4, Guid=dynamo_roco_designlog_2, CreatedElements=code_block_3.out0)
dynamo_roco_designlog_4 = Dynamo_ROCO.DesignLog.ClassificationParameters(ClassificationGroup=code_block_4)
code_block_5 = CodeBlock { ["Classification.Uniclass.Pr.Code", "Classification.Uniclass.Pr.Description", "Base Offset", "Top Offset", "Cut Offset", "ROCO.PE.ID", "ROCO.PM.Alignment.Name", "ROCO.PM.Mp"]; }
join = List.Join(list0=dynamo_roco_designlog_4, list1=code_block_5)
dynamo_roco_designlog_buildjson = Dynamo_ROCO.DesignLog.BuildJSON(Guid=filePath, CreatedElements=dynamo_roco_designlog_2, DerivedParametersToLog=dynamo_roco_designlog_3, ParametersToLog=join)
writeText = FileSystem.WriteText(filePath=dynamo_roco_designlog, text=dynamo_roco_designlog_buildjson)

# group: Classification Input
code = StringInput("PL_50_10_70")  # "Classification.ROCO.PL.Code"; graph input
description = StringInput("Kanaaltunnel Deel 7")  # "Classification.ROCO.PL.Description"; graph input
code_2 = StringInput("PE_10_01_03 ")  # "Classification.ROCO.PE.Code"; graph input
description_2 = StringInput("Baretten 1")  # "Classification.ROCO.PE.Description"; graph input
code_3 = StringInput("En_80_96_90")  # "Classification.Uniclass.EF.Code"; graph input
description_3 = StringInput("Tunnel")  # "Classification.Uniclass.EF.Description"; graph input
code_4 = StringInput("Ss_20_60_30_70")  # "Classification.Uniclass.Ss.Code"; graph input
description_4 = StringInput("Gewapende betonnen diepwanden")  # "Classification.Uniclass.Ss.Description"; graph input
code_5 = StringInput("	")  # "Classification.Uniclass.SL.Code"; graph input
description_5 = StringInput("	")  # "Classification.Uniclass.SL.Description"; graph input
