# Dynamo custom node Combine by Pattern.dyf (Dynamo 2.2.1.5175)
# category: archilab.Core.Lists
# Combines two list based on a input pattern of true and false.

false = Input(_false: var[]..[])
empty = List.Empty()
create = List.Create(item0=false, item1=empty)
flatten = List.Flatten(list=create)
true = Input(_true: var[]..[])
empty_2 = List.Empty()
create_2 = List.Create(item0=true, item1=empty_2)
flatten_2 = List.Flatten(list=create_2)
pattern = Input(_pattern: var[]..[])
empty_3 = List.Empty()
create_3 = List.Create(item0=pattern, item1=empty_3)
flatten_3 = List.Flatten(list=create_3)
python_script = Python(IN[0]=flatten, IN[1]=flatten_2, IN[2]=flatten_3)
# ---------- python_script.python (22 lines) ----------
#Copyright(c) 2015, Konrad K Sobon
# @arch_laboratory, http://archi-lab.net

import clr
clr.AddReference('ProtoGeometry')
from Autodesk.DesignScript.Geometry import *
#The inputs to this node will be stored as a list in the IN variable.
dataEnteringNode = IN

lst_1 = IN[0]
lst_2 = IN[1]
pattern = IN[2]
result = []

for i, j, k in zip(lst_1, lst_2, pattern):
	if k == False:
		result.append(i)
	else:
		result.append(j)

#Assign your output to the OUT variable
OUT = result
# ----------------------------------------
list = Output(python_script)  # "_list"
