# Dynamo custom node AdaptiveComponent.SetLocations.dyf (Dynamo 1.3.4.6666)
# category: CIB.Revit.Elements.AdaptiveComponent.Actions
# Updates the location of the Adaptive components. The amount of Points should be the same as the amount of Adaptive points of the Elements

adaptiveComponent = Input()  # The AdaptiveComponent Instances
code_block = CodeBlock(item=adaptiveComponent) { Flatten({item}); }
Points = Input()  # The List with new location Points
code_block_2 = CodeBlock { 2; }
python_script = Python(IN[0]=Points, IN[1]=code_block_2)
# ---------- python_script.python (32 lines) ----------
import clr
clr.AddReference('ProtoGeometry')
from Autodesk.DesignScript.Geometry import *

def islist(l):
	if type(l) is list:
		return True
	return False

def depth(l):
	if isinstance(l, list):
		return 1 + max(depth(item) for item in l)
	else:
		return 0

#The inputs to this node will be stored as a list in the IN variables.
dataEnteringNode = IN
l = IN[0]
x = IN[1]

d = depth(l)

if d < x:
	for n in range(0, (x-d)):
		l = [l]
elif d > x:
	for n in range(0, (d-x)):
		l = [item for sublist in l for item in sublist]


#Assign your output to the OUT variable.
OUT = l
# ----------------------------------------
python_script_2 = Python(IN[0]=code_block, IN[1]=python_script)
# ---------- python_script_2.python (72 lines) ----------
###################################################
##   TBI Dynamo Python Node Template
###################################################

import clr
clr.AddReference('ProtoGeometry')
from Autodesk.DesignScript.Geometry import *

# Import ToDSType(bool) extension method
clr.AddReference('RevitNodes')
import Revit

# conversion methoeds
clr.ImportExtensions(Revit.Elements)
clr.ImportExtensions(Revit.GeometryConversion)

# Import DocumentManager and TransactionManager
clr.AddReference('RevitServices')
import RevitServices
from RevitServices.Persistence import DocumentManager
from RevitServices.Transactions import TransactionManager

clr.AddReference('RevitAPI')
import Autodesk
from Autodesk.Revit.DB import *

doc = DocumentManager.Instance.CurrentDBDocument
uiapp = DocumentManager.Instance.CurrentUIApplication
app = uiapp.Application

# Utility functions
# revit owned, False if created, True if fetcht
def maybeToDSType(element, revitOwned):
	try:
		return element.ToDSType(revitOwned)
	except:
		return element

def islist(l):
	if type(l) is list:
    		return True
	return False

#The inputs to this node will be stored as a list in the IN variable.
dataEnteringNode = IN
els = [UnwrapElement(x) for x in IN[0]]
pointsl = IN[1]


TransactionManager.Instance.EnsureInTransaction(doc)

r = []
for el, pts in zip(els, pointsl):
	try:
		apts = AdaptiveComponentInstanceUtils.GetInstancePlacementPointElementRefIds(el)
		if len(pts) != len(apts):
			r.append(None)
			continue
	
		for pt, apt in zip(pts, apts):
			tapt = doc.GetElement(apt)
			trans = pt.ToXyz().Subtract(tapt.Position)
			ElementTransformUtils.MoveElement(doc, apt, trans)
		
		r.append(maybeToDSType(el, True))
	except:
		r.append(None)
		raise

TransactionManager.Instance.TransactionTaskDone()

OUT = r
# ----------------------------------------
python_script_3 = Python(IN[0]=adaptiveComponent, IN[1]=python_script_2)
# ---------- python_script_3.python (4 lines) ----------
check = IN[0]
items = IN[1]
if isinstance(check, (list)): OUT = items
else: OUT = items[0]
# ----------------------------------------
adaptiveComponent_2 = Output(python_script_3)  # "adaptiveComponent : AdaptiveComponent"; The AdaptiveComponent Instances
