# Dynamo custom node CurveDivideByDistance.dyf (Dynamo 1.3.4.6666)
# category: CIB.Geometry.Curve.Actions
# Returns all properties along a Curve by a specified distance. Points, Parameters, Planes, SegmentLengths, Tangents and Normals

# group: Input
curves = Input(curves:Curve)  # Curves to Divide
distance = Input(distance:double)  # Distance to divide
addEndPoint = Input(addEndPoint:bool=false)  # Adds the last point

length = Curve.Length(curves)
code_block = CodeBlock(A=length, B=distance, Addend=addEndPoint)
# ---------- code_block.designscript (10 lines) ----------
An=Count(A);
n= Math.Floor(A/B);
nlist= (0..n);
nC= List.Cycle(B,nlist);
segL1= Math.Sum(nC);
segL2= List.AddItemToEnd(A@-1<1>,segL1@-2<1>);

segL= {segL1,segL2[0..An-1]};

Seg= segL[Addend?1:0];
# ----------------------------------------
pointAtSegmentLength = Curve.PointAtSegmentLength(curve=curves, segmentLength=code_block.Seg)
parameterAtSegmentLength = Curve.ParameterAtSegmentLength(curves, code_block.Seg)
planeAtSegmentLength = Curve.PlaneAtSegmentLength(curves, code_block.Seg)
tangentAtParameter = Curve.TangentAtParameter(curves, parameterAtSegmentLength)
normalAtParameter = Curve.NormalAtParameter(curve=curves, param=parameterAtSegmentLength)

# group: Outputs
Points = Output(pointAtSegmentLength)  # "Points:Point[]"; Divided points along curve
Parameters = Output(parameterAtSegmentLength)  # "Parameters:double[]"; Parameters along curve
Planes = Output(planeAtSegmentLength)  # "Planes:Plane[]"; Planes along curve
SegmentLengths = Output(code_block.segL1)  # "SegmentLengths:double[]"; Planes along curve
Tangets = Output(tangentAtParameter)  # "Tangets:Vector[]"; Tangents along curve
Normals = Output(normalAtParameter)  # "Normals:Vector[]"; Normals along curve
