# Dynamo custom node CurveDivideWithOffset.dyf (Dynamo 1.3.4.6666)
# category: CIB.Geometry.Curve.Actions
# Divides a Curve using a Chord length offset and a Chord length distance

# group: Input
offset = Input(offset : double = 0)  # Offset chord length to begin the dividence
curves = Input(curves : Curve[])  # Curve to devide
chordLength = Input(chordLength : double)  # Length between the Points

# group: Divide points
code_block = CodeBlock { 0; }
eq = offset == code_block
startPoint = Curve.StartPoint(curves)
pointAtChordLength = Curve.PointAtChordLength(curves, offset)
pointsAtChordLengthFromPoint = Curve.PointsAtChordLengthFromPoint(curves, pointAtChordLength, chordLength)
addItemToFront = List.AddItemToFront(item=startPoint@L2, list=pointsAtChordLengthFromPoint)
if_ = If(test=eq, true=addItemToFront, false=pointsAtChordLengthFromPoint)
flatten = Flatten(if_)

# group: Output
points = Output(flatten)  # Divides points
