# Dynamo custom node ElementFamilyInstance.dyf (Dynamo 1.3.4.6666)
# category: CIB.Revit.Elements.Element.Actions
# Returns the FamilyInstance corresponding with a Element

element = Input(element : Elements.Element)  # Elements from which you eant the FamilyInstances

# group: Filter Elements By Id and return the FamilyInstances
elementType = Element.ElementType(element)
byFamilyType = FamilyInstance.ByFamilyType(elementType)
id = Element.Id(element)
id_2 = Element.Id(byFamilyType)
eq = id == id_2
filterByBoolMask = List.FilterByBoolMask(list=byFamilyType, mask=eq)

# group: Family Instances
isNull = Object.IsNull(byFamilyType)
code_block = CodeBlock { "Element is not a FamilyInstance"; }
flatten = Flatten(filterByBoolMask.in)
if_ = If(test=isNull, true=code_block, false=flatten)

Familyinstance = Output(if_)  # "Familyinstance : var"; Familyinstance
