# Dynamo custom node ElementRotate.dyf (Dynamo 1.3.4.6666)
# category: CIB.Revit.Elements.Element.Actions
# Rotates an element

element = Input(element : Elements.Element)  # Element to Rotate
degrees = Input(degrees : double = 0)  # Degrees
python_script = Python(IN[0]=element, IN[1]=degrees)
# ---------- python_script.python (73 lines) ----------
import clr
clr.AddReference('ProtoGeometry')
from Autodesk.DesignScript.Geometry import *

clr.AddReference('System')
from System.Collections.Generic import *

#Import the Revit Services
clr.AddReference("RevitServices")
import RevitServices
from RevitServices.Persistence import DocumentManager
from RevitServices.Transactions import TransactionManager

doc = DocumentManager.Instance.CurrentDBDocument
uiapp = DocumentManager.Instance.CurrentUIApplication
app = uiapp.Application
uidoc = DocumentManager.Instance.CurrentUIApplication.ActiveUIDocument

#Import the Revit Nodes
clr.AddReference("RevitNodes")
import Revit
clr.ImportExtensions(Revit.Elements)
# Import geometry conversion extension methods
clr.ImportExtensions(Revit.GeometryConversion)

#Import the Revit API
clr.AddReference("RevitAPI")
import Autodesk
from Autodesk.Revit.DB import *

#Import math functions
import math

#Define functions
def tolist(obj1):
	if hasattr(obj1,"__iter__"):
		return obj1
	else:
		return [obj1]
		
def FeetToMm(d):
	return float(d) * 304.8
	
def MmToFeet(d):
	return float(d) / 304.8
	
def Flatten(a, result=None):
	if result is None:
		result = []
	for x in a:
		if isinstance(x, list):
			Flatten(x, result)
		else:
			result.append(x)
	return result

#Define Input (IN)
element = UnwrapElement(IN[0])
degrees = math.radians(IN[1])

# Start Transaction
TransactionManager.Instance.EnsureInTransaction(doc)

bbox = element.get_BoundingBox(doc.ActiveView)
midPoint = bbox.Min + ((bbox.Max - bbox.Min)/2)
axis = Line.CreateBound(midPoint, XYZ(midPoint.X, midPoint.Y, midPoint.Z+1000))
ElementTransformUtils.RotateElement(doc, element.Id, axis, degrees)

#End Transaction
TransactionManager.Instance.TransactionTaskDone()

#Define Output (OUT)
OUT = element
# ----------------------------------------
element_2 = Output(python_script)  # "element : Elements.Element"; Element
