# Dynamo custom node FamilyInstanceBySpacingAlongCurves.dyf (Dynamo 1.3.4.6666)
# category: CIB.Revit.Elements.FamilyInstance.Create
# Places a number of Family Instances parallel to a Curve.

# group: Input
familyType = Input(familyType : FamilyType)  # The Family type to place along the Curve
curves = Input(curves : Curve[])  # The Curve to place the Family along
Spacing = Input(Spacing : double = 1000)  # The Chord Length Distance
level = Input(level : Level = null)  # The Level for the Families The default is Level Zero
Flip = Input(Flip : bool = false)  # A 180 degree rotation to flip Families
AdditionalRotation = Input(AdditionalRotation : double = 0)  # An additional Rotation Value

# group: Get the Family Rotation
startPoint = Curve.StartPoint(curves)
pointsAtChordLengthFromPoint = Curve.PointsAtChordLengthFromPoint(curves, arg2=Spacing)
addItemToFront = List.AddItemToFront(item=startPoint@L1, list=pointsAtChordLengthFromPoint@L2)
parameterAtPoint = Curve.ParameterAtPoint(curve=curves, point=addItemToFront)
coordinateSystemAtParameter = Curve.CoordinateSystemAtParameter(curves, parameterAtPoint)
YAxis = CoordinateSystem.YAxis(coordinateSystemAtParameter)
code_block = CodeBlock(v=YAxis) { v.X; }
code_block_2 = CodeBlock { 0; }
gt = code_block > code_block_2
YAxis_2 = Vector.YAxis()
angleWithVector = Vector.AngleWithVector(vector=YAxis_2, otherVector=YAxis)
code_block_3 = CodeBlock { 360; }
sub = code_block_3 - angleWithVector
if_ = If(test=gt, true=angleWithVector, false=sub)
code_block_4 = CodeBlock(x=if_) { x; x+180; }
python_script_if_function = Python(IN[0]=Flip, IN[1]=code_block_4.out1, IN[2]=code_block_4.x)
# ---------- python_script_if_function.python (12 lines) ----------
import clr
clr.AddReference('ProtoGeometry')
from Autodesk.DesignScript.Geometry import *
#The inputs to this node will be stored as a list in the IN variables.
dataEnteringNode = IN

if IN[0] == 1:
	OUT = IN[1];
else:
	OUT = IN[2];

#Assign your output to the OUT variable.
# ----------------------------------------
add = python_script_if_function + AdditionalRotation

# group: Get Level Zero
isNull = Object.IsNull(level)
code_block_5 = CodeBlock { Category.ByName("Levels"); }
all_elements_of_category = ElementsOfCategory(code_block_5)
projectElevation = Level.ProjectElevation(all_elements_of_category)
code_block_6 = CodeBlock { 0; }
eq = projectElevation == code_block_6
filterByBoolMask = List.FilterByBoolMask(list=all_elements_of_category, mask=eq)
python_script_if_function_2 = Python(IN[0]=isNull, IN[1]=filterByBoolMask.in, IN[2]=level)
# ---------- python_script_if_function_2.python (12 lines) ----------
import clr
clr.AddReference('ProtoGeometry')
from Autodesk.DesignScript.Geometry import *
#The inputs to this node will be stored as a list in the IN variables.
dataEnteringNode = IN

if IN[0] == 1:
	OUT = IN[1][0];
else:
	OUT = IN[2];

#Assign your output to the OUT variable.
# ----------------------------------------

# group: Place Families along Path
origin = CoordinateSystem.Origin(coordinateSystemAtParameter)
byPointAndLevel = FamilyInstance.ByPointAndLevel(familyType=familyType, point=origin, level=python_script_if_function_2)

# group: Rotate the Families
setRotation = FamilyInstance.SetRotation(familyInstance=byPointAndLevel, degree=add)

FamilyInstance = Output(setRotation)  # "FamilyInstance : FamilyInstance"; The Family Instances
