# Dynamo custom node FamilyTypeByAssemblyCode.dyf (Dynamo 1.3.4.6666)
# category: CIB.Revit.Elements.FamilyType.Actions
# Returns all Family types with the given Assembly code as a string

AssemblyCode = Input(AssemblyCode : string)  # The Assembly Code as String
python_script = Python(IN[0]=AssemblyCode)
# ---------- python_script.python (41 lines) ----------
import clr
clr.AddReference('ProtoGeometry')
from Autodesk.DesignScript.Geometry import *

# Import DocumentManager and TransactionManager
clr.AddReference("RevitServices")
import RevitServices
from RevitServices.Persistence import DocumentManager
from RevitServices.Transactions import TransactionManager

# Import RevitAPI
clr.AddReference("RevitAPI")
import Autodesk
from Autodesk.Revit.DB import *

doc = DocumentManager.Instance.CurrentDBDocument
uiapp = DocumentManager.Instance.CurrentUIApplication
app = uiapp.Application

# Import ToDSType(bool) extension method
clr.AddReference("RevitNodes")
import Revit
clr.ImportExtensions(Revit.Elements)

#The inputs to this node will be stored as a list in the IN variables.
assemblyCode = IN[0]

# Filter elements with element collector
collector = FilteredElementCollector(doc)

provider = ParameterValueProvider(ElementId(BuiltInParameter.UNIFORMAT_CODE));
evaluator = FilterStringContains()
rule = FilterStringRule(provider, evaluator, assemblyCode, True)
filter = ElementParameterFilter( rule )

collector.OfClass(FamilySymbol).WherePasses(filter)

#Assign your output to the OUT variable.
OUT = []
for x in (x.ToDSType(True) for x in collector):
	OUT.append(x)
# ----------------------------------------
familyTypes = Output(python_script)  # "familyTypes : FamilyType"; All Families
