# Dynamo custom node FloorTypeByMaterialAndThickness.dyf (Dynamo 1.3.4.6666)
# category: CIB.Revit.Elements.FloorType.Create
# Creates a Floor Type  or Slab Type by Material and Thickness. Structural = True for a Slab Type, False for a Floor Type

# group: Input
thickness = Input(thickness : double)
material = Input(material : Revit.Material)
floorType = Input(floorType : bool = false)

# group: Core Function
python_script = Python(IN[0]=thickness, IN[1]=material, IN[2]=floorType)  # "Python Script | FloorTypeByMaterialAndThickness"
# ---------- python_script.python (113 lines) ----------
import clr
clr.AddReference('ProtoGeometry')
from Autodesk.DesignScript.Geometry import *

#Import the Revit Services
clr.AddReference("RevitServices")
import RevitServices
from RevitServices.Persistence import DocumentManager
from RevitServices.Transactions import TransactionManager
doc = DocumentManager.Instance.CurrentDBDocument

#Import the Revit Nodes
clr.AddReference("RevitNodes")
import Revit
clr.ImportExtensions(Revit.Elements)

#Import the Revit API
clr.AddReference("RevitAPI")
import Autodesk
from Autodesk.Revit.DB import *

#Import system
from System import *
from System.Collections.Generic import *

#Define tolist function
def tolist(obj1):
	if hasattr(obj1,"__iter__"):
		return obj1
	else:
		return [obj1]

def fromlist(obj1):
	if len(obj1) == 1:
		return obj1[0];
	else:
		return obj1;

def FeetToMm(d):
	return float(d) * 304.8
	
def MmToFeet(d):
	return float(d) / 304.8

#Function to Create a FloorType (false) of StructuralFoundationType (true) By Width and Material
def FloorTypeByWidthAndMaterial(doc, width, material, floorBool):
	widths = tolist(width)
	materials = tolist(UnwrapElement(material))
	output = []
	for width, material in zip(widths, materials):
	
		#Get all Floor types in the current Document
		floor_types = [f for f in FilteredElementCollector(doc).OfClass(FloorType)]
		
		#Is it a Structural Foundation
		if floorBool:
			floor_types = [f for f in floor_types if f.Category.Id.IntegerValue == int(BuiltInCategory.OST_Floors)]
		else:
			floor_types = [f for f in floor_types if f.Category.Id.IntegerValue == int(BuiltInCategory.OST_StructuralFoundation)]
			
		
		#Is the Width larger then 0
		if width > 0:
		
			#Try to find a matching Floor type
			current_floors = []
			for floor_type in floor_types:
				cs = floor_type.GetCompoundStructure();
				floor_width = FeetToMm(cs.GetLayerWidth(0))
				matId = cs.GetMaterialId(0);
				if width == floor_width and material.Id == matId:
					current_floors.append(floor_type);
					break
			
			#Determine if Floor type is Found
			if len(current_floors) > 0:
				output.append(current_floors[0]);
				
			#Create a New Floor type
			else:
				name = material.Name + "_" + str(int(width));
				#Try to create a type
				try:
					type = floor_types[0].Duplicate(name)
					csl = CompoundStructureLayer()
					csl.Width = MmToFeet(width)
					csl.Function = MaterialFunctionAssignment.Structure
					csl.MaterialId = material.Id
					cs = CompoundStructure.CreateSimpleCompoundStructure(List[CompoundStructureLayer]([csl]))
					cs.EndCap = EndCapCondition.NoEndCap
					cs.StructuralMaterialIndex = cs.GetFirstCoreLayerIndex()
					type.SetCompoundStructure(cs)
					output.append(type)
				#Return an existing type
				except:
					output.append(Revit.Elements.FloorType.ByName(name))
		else:
			output.append("Thickness has to be greater than zero!");
			
	return fromlist(output);

doc = DocumentManager.Instance.CurrentDBDocument
uiapp = DocumentManager.Instance.CurrentUIApplication
app = uiapp.Application
uidoc=DocumentManager.Instance.CurrentUIApplication.ActiveUIDocument

# Start Transaction
TransactionManager.Instance.EnsureInTransaction(doc)

OUT = FloorTypeByWidthAndMaterial(doc,IN[0],IN[1],IN[2]);

#End Transaction
TransactionManager.Instance.TransactionTaskDone()
# ----------------------------------------

# group: Output
floorType_2 = Output(python_script)  # "floorType : var"
