# Dynamo custom node FormulaCrossEquation.dyf (Dynamo 1.3.4.6666)
# category: CIB.Core.Math.Actions
# Calculates value A2 for A1 x B1 == A2 x B2

# group: Input
A1 = Input(A1 : double = 0)  # Value for A in the First Formula
B1 = Input(B1 : double = 0)  # Value for B in the First Formula
B2 = Input(B2 : double = 0)  # Value for B in the Second Formula

code_block = CodeBlock(x=A1, y=B1, y2=B2) { x*y/y2; }

# group: Output
A2 = Output(code_block)  # "A2:double"; Value for A in the Second Formula
