# Dynamo custom node FormulaPythagoras.dyf (Dynamo 1.3.4.6666)
# category: CIB.Core.Math.Actions
# Returns the lengths of the sides A B & C

# group: Input
A = Input(A : double = 0.0)  # Value A for one of the perpendicular sides
B = Input(B : double = 0.0)  # Value B for one of the perpendicular sides
C = Input(C : double = 0)  # Value c for the hypotenuse

# group: Check for a non usable value
code_block = CodeBlock { 0; }
gt = A > code_block
gt_2 = B > code_block
code_block_2 = CodeBlock { 2; }
gt_3 = C > code_block

# group: A + B
and_ = And(gt, gt_2)
pow = Math.Pow(number=A, power=code_block_2)
pow_2 = Math.Pow(number=B, power=code_block_2)
add = pow + pow_2
sqrt = Math.Sqrt(add)
if_ = If(test=and_, true=sqrt, false=C)

C_2 = Output(if_)  # "C : double"; Value for C by using values A & B

# group: A - C
and_2 = And(gt, gt_3)
pow_3 = Math.Pow(number=C, power=code_block_2)
pow_4 = Math.Pow(number=A, power=code_block_2)
sub = pow_3 - pow_4
sqrt_2 = Math.Sqrt(sub)
if_2 = If(test=and_2, true=sqrt_2, false=B)

B_2 = Output(if_2)  # "B : double"; Value for B by using values A & C

# group: B - C
and_3 = And(gt_2, gt_3)
pow_5 = Math.Pow(number=C, power=code_block_2)
pow_6 = Math.Pow(number=B, power=code_block_2)
sub_2 = pow_5 - pow_6
sqrt_3 = Math.Sqrt(sub_2)
if_3 = If(test=and_3, true=sqrt_3, false=A)

A_2 = Output(if_3)  # "A : double"; Value for B by using values B & C
