# Dynamo custom node GeometryTransformProjectToShared.dyf (Dynamo 1.3.4.6666)
# category: CIB.Geometry.Geometry.Actions
# Transforms objects from Shared Coordinates to Project Coordinates, since Dynamo calculates with Project Coordinates

# group: Geometry in Revit Coordinate System
geometry = Input(geometry : Geometry)  # Geometry in Revit Coordinate System

# group: Translate Geometry
surveyPoint = Coordinates.SurveyPoint()
basePoint = Coordinates.BasePoint()
byTwoPoints = Vector.ByTwoPoints(start=surveyPoint, end=basePoint)

# group: Rotate Transformed Geometry
ZAxis = Vector.ZAxis()
projectRotation = Coordinates.ProjectRotation()
code_block = CodeBlock(rotation=projectRotation) { -rotation; }
rotate = Geometry.Rotate(geometry=geometry, origin=surveyPoint, axis=ZAxis, degrees=code_block)

# group (continued): Translate Geometry
translate = Geometry.Translate(geometry=rotate, direction=byTwoPoints)

# group: Transformed Geometry in World Coordinate System
geometry_2 = Output(translate)  # "geometry:Geometry"; Geometry in World Coordinate System
