# Dynamo custom node GeometryTransformSharedToProject.dyf (Dynamo 1.3.4.6666)
# category: CIB.Geometry.Geometry.Actions
# Transforms objects from Shared Coordinates to Project Coordinates, since Dynamo calculates with Project Coordinates

# group: Geometry in World Coordinate System
geometry = Input(geometry : Geometry)  # Geometry in World Coordinate System

# group: Translate the Geometry
basePoint = Coordinates.BasePoint()
surveyPoint = Coordinates.SurveyPoint()
byTwoPoints = Vector.ByTwoPoints(start=basePoint, end=surveyPoint)
translate = Geometry.Translate(geometry=geometry, direction=byTwoPoints)

# group: Rotate The Geometry
ZAxis = Vector.ZAxis()
projectRotation = Coordinates.ProjectRotation()
rotate = Geometry.Rotate(geometry=translate, origin=surveyPoint, axis=ZAxis, degrees=projectRotation)

# group: Transformed Geometry in Revit Coordinate System
geometry_2 = Output(rotate)  # "geometry:Geometry"; Geometry in Revit Coordinate System
