# Dynamo custom node MathEvensOdds.dyf (Dynamo 1.3.3.4651)
# category: CIB.Core.Math.Actions
# Filters the Odd and Even numbers from a List

# group: Input
list = Input(list : var[])

# group: Condition
code_block = CodeBlock { 2; }
mod = list % code_block
code_block_2 = CodeBlock { 0; }
eq = mod == code_block_2

# group: Filter
filterByBoolMask = List.FilterByBoolMask(list=list, mask=eq)

# group: Output
Evens = Output(filterByBoolMask.in)  # "Evens : var[]"
Odds = Output(filterByBoolMask.out)  # "Odds : var[]"
