# Dynamo custom node MeshToPolySurface.dyf (Dynamo 1.3.4.6666)
# category: CIB.Geometry.Mesh.Actions
# Converts a Mesh to a PolySurface

mesh = Input(mesh : Mesh)  # Mesh to Convert to PolySurface
vertexPositions = Mesh.VertexPositions(mesh)
faceIndices = Mesh.FaceIndices(mesh)
A = IndexGroup.A(faceIndices)
B = IndexGroup.B(faceIndices)
C = IndexGroup.C(faceIndices)
code_block = CodeBlock(a=A, b=B, c=C) { List.Transpose({a,b,c}); }
getItemAtIndex = List.GetItemAtIndex(list=vertexPositions, index=code_block)
byPerimeterPoints = Surface.ByPerimeterPoints(getItemAtIndex)
code_block_2 = CodeBlock { false; }
clean = List.Clean(list=byPerimeterPoints, preserveIndices=code_block_2)
byJoinedSurfaces = PolySurface.ByJoinedSurfaces(clean)
Polysurface = Output(byJoinedSurfaces)  # "Polysurface : PolySurface"; PolySurface
