# Dynamo custom node PolyCurveOffsetNonPlanar.dyf (Dynamo 1.3.4.6666)
# category: CIB.Geometry.PolyCurve.Actions
# Offsets a non-planar Polycurve in Vertical and Horizontal Distance

# group: Input
polyCurve = Input(polyCurve : PolyCurve)  # Polycurve to Offset
horizontalOffset = Input(horizontalOffset : double = 0)  # Horizontal distance to offset
verticalOffset = Input(verticalOffset : double = 0)  # Vertical distance to offset

# group: Get Offset Points
curves = PolyCurve.Curves(polyCurve)
code_block = CodeBlock { 0..1..#2; }
pointAtParameter = Curve.PointAtParameter(curve=curves, param=code_block, lacing=CrossProduct)
flatten = Flatten(pointAtParameter)
pruneDuplicates = Point.PruneDuplicates(points=flatten)

# group: Get Offset Vector
coordinateSystemAtParameter = Curve.CoordinateSystemAtParameter(curves, code_block, lacing=CrossProduct)
flatten_2 = Flatten(coordinateSystemAtParameter)
code_block_2 = CodeBlock { 1; -1; }
takeItems = List.TakeItems(list=flatten_2, amount=code_block_2.out0)
XAxis = CoordinateSystem.XAxis(takeItems)
dropItems = List.DropItems(list=flatten_2, amount=code_block_2.out0)
dropItems_2 = List.DropItems(list=dropItems, amount=code_block_2.out1)
code_block_3 = CodeBlock { 0..1; 2; }
sublists = List.Sublists(list=dropItems_2, ranges=code_block_3.out0, offset=code_block_3.out1)
XAxis_2 = CoordinateSystem.XAxis(sublists)
transpose = List.Transpose(XAxis_2)
firstItem = List.FirstItem(transpose)
lastItem = List.LastItem(transpose)
add = Vector.Add(firstItem, lastItem)
lastItem_2 = List.LastItem(flatten_2)
XAxis_3 = CoordinateSystem.XAxis(lastItem_2)

# group: Translate Poly Curve
create = List.Create(XAxis, add, XAxis_3)
flatten_3 = Flatten(create)
translate = Geometry.Translate(geometry=pruneDuplicates, direction=flatten_3, distance=horizontalOffset)
byPoints = PolyCurve.ByPoints(points=translate)

# group: Output
translate_2 = Geometry.Translate(geometry=byPoints, zTranslation=verticalOffset)
polyCurve_2 = Output(translate_2)  # "polyCurve : PolyCurve"; Offsetted Polycurve
