# Dynamo custom node RevitDocumentCoordination.dyf (Dynamo 1.3.4.6666)
# category: CIB.Revit.Coordination.Query
# Returns all Coordination info from the current Revit model

# group: Get Base Point Info
element_types = ElementTypes("BasePoint")
all_elements_of_type = ElementsOfType(element_types)
code_block = CodeBlock(a=all_elements_of_type) { a[1]; }
code_block_2 = CodeBlock { {"E/W","N/S","Elev"}; "Angle to True North"; }
getParameterValueByName = Element.GetParameterValueByName(element=code_block, parameterName=code_block_2.out0)
code_block_3 = CodeBlock { 3; }
round = Math.Round(number=getParameterValueByName, digits=code_block_3)
code_block_4 = CodeBlock(p=round) { X=p[0]; Y=p[1]; Z=p[2]; }
byCoordinates = Point.ByCoordinates(x=code_block_4.X, y=code_block_4.Y, z=code_block_4.Z)
getParameterValueByName_2 = Element.GetParameterValueByName(element=code_block, parameterName=code_block_2.out1)

# group: Calculate Unclipped Basepoint translation
basePoint = Coordinates.BasePoint()
code_block_5 = CodeBlock { 0; }
byCoordinates_2 = Point.ByCoordinates(x=code_block_5, y=code_block_5, z=code_block_5)
distanceTo = Geometry.DistanceTo(geometry=basePoint, other=byCoordinates_2)
X = Point.X(basePoint)
Y = Point.Y(basePoint)

# group: Output
basePointInWCS = Output(byCoordinates)  # "basePointInWCS : Point"; Base point in World Coordinate System
basePointLocationInDynamo = Output(basePoint)  # "basePointLocationInDynamo:Point"; This Point resembles the Base Point in Revit
basePointRotation = Output(getParameterValueByName_2)  # "basePointRotation:double"; Base point rotation to True north
UnclippedBasePointTranslation = Output(distanceTo)  # "UnclippedBasePointTranslation:double"; Shows how much the Base point has been moved in the Unclipped state
UnclippedBasePointXTranslation = Output(X)  # "UnclippedBasePointXTranslation:double"; Shows how much the Base point has been moved in X Direction in the Unclipped state
UnclippedBasePointYTranslation = Output(Y)  # "UnclippedBasePointYTranslation:double"; Shows how much the Base point has been moved in Y Direction in the Unclipped state
