# Dynamo custom node SortPointsByDistance.dyf (Dynamo 1.3.4.6666)
# category: CIB.Geometry.Point.Actions
# Sorts a List of Points by Distance Between them starting with the first point in the List

# group: Input
points = Input(points : var[])  # List of points to sort starting with the first point

# group: Core
python_script_points_sort_by = Python(IN[0]=points)  # "Python Script | Points Sort By Distance"
# ---------- python_script_points_sort_by.python (78 lines) ----------
import clr
clr.AddReference('ProtoGeometry')
from Autodesk.DesignScript.Geometry import *

clr.AddReference('DSCoreNodes')
from DSCore import *
#The inputs to this node will be stored as a list in the IN variables.
dataEnteringNode = IN

def tolist(obj1):
	if hasattr(obj1,"__iter__"):
		return obj1
	else:
		return [obj1]

def get_length(point, p):
	line = Line.ByStartPointEndPoint(point, p)
	length = line.Length;
	return length
	
def indexOf(list, point):
	count = 0
	list = tolist(list)
	output = None
	for p in list:
		if p.X == point.X and p.Y == point.Y and p.Z == point.Z:
			output = count
			break
		else:
			count += 1
			
	output = count
	return output			
	
def copy(list):
	copied = []
	for i in list:
		copied.append(i)
	return copied
	
def shortest(point, pointArray):
	lengths = []
	for p in pointArray:
		if p.X == point.X and p.Y == point.Y and p.Z == point.Z:
			lengths.append(0)
		else:
			length = get_length(point, p)
			lengths.append(length)
	lengths_sorted = copy(lengths);
	lengths_sorted.sort()
	index = lengths.IndexOf(lengths_sorted[1])
	second_point = pointArray[index]
	#return lengths_sorted
	return second_point
	

points = IN[0];
pointArray = copy(points)
start_point = points[0]
output = [start_point]
lengths = []; 
count = 0

while len(pointArray) >= 0:
	try:
		second_point = shortest(start_point, pointArray)
		try:
			pointArray.Remove(start_point)
		except:
			pass
		output.append(second_point)
		start_point = second_point
		count += 1
	except:
		#Run out of points to Check
		break

OUT = output
# ----------------------------------------

# group: Output
flatten = Flatten(python_script_points_sort_by)
points_2 = Output(flatten)  # "points : Point"; Points sorted by Distance
