# Dynamo custom node SubCategoryByName.dyf (Dynamo 1.3.4.6666)
# category: CIB.Revit.Elements.SubCategory.Create
# Checks if the given Family name exists in the current Document

name = Input(name :string)  # Name of the Subcategory
category = Input(category:Category=null)  # The main Category to which the Subcategory belongs In Family Document it will take the Category of the Family Document
python_script = Python(IN[0]=name, IN[1]=category)
# ---------- python_script.python (74 lines) ----------
import clr
clr.AddReference('ProtoGeometry')
from Autodesk.DesignScript.Geometry import *

# Import ToDSType(bool) extension method
clr.AddReference('RevitNodes')
import Revit
clr.ImportExtensions(Revit.Elements)
clr.ImportExtensions(Revit.GeometryConversion)

# Import DocumentManager and TransactionManager
clr.AddReference('RevitServices')
import RevitServices
from RevitServices.Persistence import DocumentManager
from RevitServices.Transactions import TransactionManager

# Import RevitAPI
clr.AddReference('RevitAPI')
import Autodesk
from Autodesk.Revit.DB import *

clr.AddReference("System.Windows.Forms")
import System
from System.Windows.Forms import *

doc = DocumentManager.Instance.CurrentDBDocument
uiapp = DocumentManager.Instance.CurrentUIApplication
app = uiapp.Application

#from System.Collections.Generic import *

#Utility functions
def tolist(obj1):
	if hasattr(obj1,"__iter__"):
		return obj1
	else:
		return [obj1]
		
def ContainsName(subCat, newName):
	bool = False
	for i in subCat:
		if newName == i.Name:
			bool = True
			break
		else:
			pass
	return bool


#The inputs to this node will be stored as a list in the IN variable.
newName = IN[0]

if doc.IsFamilyDocument:
	mainCategory = doc.OwnerFamily.FamilyCategory
else:
	mainCategory = UnwrapElement(IN[1])

TransactionManager.Instance.EnsureInTransaction(doc)

subCat = mainCategory.SubCategories
if mainCategory.CanAddSubcategory:
	
	if ContainsName(subCat, newName):
		subCategory = subCat[newName]
	else:
		newSubCategory = Categories.NewSubcategory(doc.Settings.Categories, mainCategory, newName)
		subCategory = newSubCategory
else:
	subCategory = subCat[newName]
	

TransactionManager.Instance.TransactionTaskDone()

OUT = subCategory
# ----------------------------------------
Subcategory = Output(python_script)  # "Subcategory : var"; the Subcategory
