# Dynamo custom node SubCategoryName.dyf (Dynamo 1.3.4.6666)
# category: CIB.Revit.Elements.SubCategory.Query
# Returns the name of the given Subcategory

SubCategory = Input(SubCategory : var)  # Subcategory
python_script = Python(IN[0]=SubCategory)
# ---------- python_script.python (43 lines) ----------
import clr
clr.AddReference('ProtoGeometry')
from Autodesk.DesignScript.Geometry import *

# Import ToDSType(bool) extension method
clr.AddReference('RevitNodes')
import Revit
clr.ImportExtensions(Revit.Elements)
clr.ImportExtensions(Revit.GeometryConversion)

# Import DocumentManager and TransactionManager
clr.AddReference('RevitServices')
import RevitServices
from RevitServices.Persistence import DocumentManager
from RevitServices.Transactions import TransactionManager

# Import RevitAPI
clr.AddReference('RevitAPI')
import Autodesk
from Autodesk.Revit.DB import *

doc = DocumentManager.Instance.CurrentDBDocument
uiapp = DocumentManager.Instance.CurrentUIApplication
app = uiapp.Application

#from System.Collections.Generic import *

#Utility functions
def tolist(obj1):
	if hasattr(obj1,"__iter__"):
		return obj1
	else:
		return [obj1]
		

#The inputs to this node will be stored as a list in 
subCategory = IN[0]

TransactionManager.Instance.EnsureInTransaction(doc)

OUT = subCategory.Name

TransactionManager.Instance.TransactionTaskDone()
# ----------------------------------------
name = Output(python_script)  # "name : string"; Name of the Subcategory
