# Dynamo custom node SubCategorySetProperties.dyf (Dynamo 1.3.4.6666)
# category: CIB.Revit.Elements.SubCategory.Actions
# Set the Different Properties of the Subcategory like: Line Weights, Line Pattern, Line Colors and Material

# group: Input
subcategory = Input(subcategory : var)  # Subcategory
projectionLineWeight = Input(projectionLineWeight : int = null)  # Projection Line Weight
cutLineWeight = Input(cutLineWeight : int = null)  # Projection Line Weight
lineColor = Input(lineColor : Color = null)  # Line Color
linePattern = Input(linePattern : LinePatternElement = null)  # Line Color
material = Input(material : Material = null)  # Line Color

python_script = Python(IN[0]=subcategory, IN[1]=projectionLineWeight, IN[2]=cutLineWeight, IN[3]=lineColor, IN[4]=linePattern, IN[5]=material)
# ---------- python_script.python (80 lines) ----------
import clr
clr.AddReference('ProtoGeometry')
from Autodesk.DesignScript.Geometry import *

# Import ToDSType(bool) extension method
clr.AddReference('RevitNodes')
import Revit
clr.ImportExtensions(Revit.Elements)
clr.ImportExtensions(Revit.GeometryConversion)

# Import DocumentManager and TransactionManager
clr.AddReference('RevitServices')
import RevitServices
from RevitServices.Persistence import DocumentManager
from RevitServices.Transactions import TransactionManager

# Import RevitAPI
clr.AddReference('RevitAPI')
import Autodesk
from Autodesk.Revit.DB import *

clr.AddReference("System.Windows.Forms")
import System
from System.Windows.Forms import *

doc = DocumentManager.Instance.CurrentDBDocument
uiapp = DocumentManager.Instance.CurrentUIApplication
app = uiapp.Application

#from System.Collections.Generic import *

#Utility functions
def tolist(obj1):
	if hasattr(obj1,"__iter__"):
		return obj1
	else:
		return [obj1]
		
def ContainsName(subCat, newName):
	bool = False
	for i in subCat:
		if newName == i.Name:
			bool = True
			break
		else:
			pass
	return bool


#The inputs to this node will be stored as a list in the IN variable.
subcategory = UnwrapElement(IN[0])
projectionLineWeight = IN[1]
cutLineWeight = IN[2]
lineColor = IN[3]
linePattern = UnwrapElement(IN[4])
material = UnwrapElement(IN[5])



TransactionManager.Instance.EnsureInTransaction(doc)

#LineWeights
if projectionLineWeight != None:
	subcategory.SetLineWeight(int(projectionLineWeight), GraphicsStyleType.Projection)

if cutLineWeight != None:
	subcategory.SetLineWeight(int(cutLineWeight), GraphicsStyleType.Cut)

if lineColor != None:
	subcategory.LineColor = Color(lineColor.Red, lineColor.Green, lineColor.Blue)

if linePattern != None:
	subcategory.SetLinePatternId(linePattern.Id, GraphicsStyleType.Projection)
	
if material != None:
	subcategory.Material = material

TransactionManager.Instance.TransactionTaskDone()

OUT = subcategory
# ----------------------------------------
subcategory_2 = Output(python_script)  # "subcategory : var"; Subcategory
