# Dynamo custom node SubcategoryGetProperties.dyf (Dynamo 1.3.4.6666)
# category: CIB.Revit.Elements.SubCategory.Query
# Get the properties of the Subcategory

# group: Input
subcategory = Input(subcategory : var)  # Subcategory

python_script = Python(IN[0]=subcategory)
# ---------- python_script.python (72 lines) ----------
import clr
clr.AddReference('ProtoGeometry')
from Autodesk.DesignScript.Geometry import *

clr.AddReference('DSCoreNodes')
from DSCore import Color as DesignscriptColor

# Import ToDSType(bool) extension method
clr.AddReference('RevitNodes')
import Revit
clr.ImportExtensions(Revit.Elements)
clr.ImportExtensions(Revit.GeometryConversion)

# Import DocumentManager and TransactionManager
clr.AddReference('RevitServices')
import RevitServices
from RevitServices.Persistence import DocumentManager
from RevitServices.Transactions import TransactionManager

# Import RevitAPI
clr.AddReference('RevitAPI')
import Autodesk
from Autodesk.Revit.DB import *

clr.AddReference("System.Windows.Forms")
import System
from System.Windows.Forms import *

doc = DocumentManager.Instance.CurrentDBDocument
uiapp = DocumentManager.Instance.CurrentUIApplication
app = uiapp.Application

#from System.Collections.Generic import *

#Utility functions
def tolist(obj1):
	if hasattr(obj1,"__iter__"):
		return obj1
	else:
		return [obj1]
		
def ContainsName(subCat, newName):
	bool = False
	for i in subCat:
		if newName == i.Name:
			bool = True
			break
		else:
			pass
	return bool


#The inputs to this node will be stored as a list in the IN variable.
subcategory = UnwrapElement(IN[0])
output = []



TransactionManager.Instance.EnsureInTransaction(doc)

#LineWeights
output.append(subcategory.GetLineWeight(GraphicsStyleType.Projection))
output.append(subcategory.GetLineWeight(GraphicsStyleType.Cut))
color = subcategory.LineColor
dsColor = DesignscriptColor.ByARGB(255, color.Red, color.Green, color.Blue)
output.append(dsColor)
output.append(doc.GetElement(subcategory.GetLinePatternId(GraphicsStyleType.Projection)))
output.append(subcategory.Material)

TransactionManager.Instance.TransactionTaskDone()

OUT = output
# ----------------------------------------
code_block = CodeBlock(l=python_script) { l[0]; l[1]; l[2]; l[3]; l[4]; }
projectionLineWeight = Output(code_block.out0)  # "projectionLineWeight : int"; Projection Line Weight
cutLineWeight = Output(code_block.out1)  # "cutLineWeight : int"; Projection Line Weight
lineColor = Output(code_block.out2)  # "lineColor : Color"; Line Color
linePattern = Output(code_block.out3)  # "linePattern : LinePatternElement"; Line Color
material = Output(code_block.out4)  # "material : Material"; Line Color
