# Dynamo custom node UITools.SearchElements.dyf (Dynamo 1.3.4.6666)
# category: CIB.UITools.Create
# Opens a UI in which all the Element names are displayed. The user can type in a Search Term to search all the items.

# group: Input
elements = Input(elements : var[])  # A List with Elements
Rerun = Input(Rerun : bool = true)  # Reruns the Nodes. Switch between True/False to Rerun the Node

# group: Filter Content and Make UI
code_block = CodeBlock { false; }
clean = List.Clean(list=elements, preserveIndices=code_block)
name = Element.Name(clean)
python_script = Python(IN[0]=clean, IN[1]=name, IN[2]=Rerun)
# ---------- python_script.python (160 lines) ----------
# Enable Python support and load DesignScript library
import clr
clr.AddReference('ProtoGeometry')

clr.AddReference('System.Drawing')
from System.Drawing import *

clr.AddReference('System.Windows.Forms')
from System.Windows.Forms import *

class SearchForm(Form):
	def __init__(self, items, names):
		self.InitializeComponent(items, names)
	
	def InitializeComponent(self, items, names):
		self.Items = items
		self.Names = names
		self.FoundNames = names
		self.FoundItems = items
		self.SelectedItems = []
		
		
		self._listBox = ListBox()
		self._searchBox = TextBox()
		self.button = Button()
		self.AllButton = Button()
		self.NoneButton = Button()
		self.SuspendLayout()
		# 
		# listBox
		# 
		self._listBox.BackColor = SystemColors.Window
		self._listBox.Font = Font("Microsoft Sans Serif", 9.75, FontStyle.Regular, GraphicsUnit.Point, 0)
		self._listBox.FormattingEnabled = True
		self._listBox.ItemHeight = 16
			
		self._listBox.Location = Point(13, 39)
		self._listBox.Name = "listBox"
		self._listBox.Size = Size(223, 260)
		self._listBox.TabIndex = 0
		self._listBox.SelectionMode = SelectionMode.MultiSimple
		for name in self.Names:
			self._listBox.Items.Add(name)
		# 
		# searchBox
		# 
		self._searchBox.BackColor = SystemColors.Window
		self._searchBox.Font = Font("Microsoft Sans Serif", 9.75, FontStyle.Regular, GraphicsUnit.Point, 0)
		self._searchBox.Location = Point(13, 13)
		self._searchBox.Name = "searchBox"
		self._searchBox.Size = Size(222, 22)
		self._searchBox.TabIndex = 1
		self._searchBox.Text = "Search for ..."
		self._searchBox.TextChanged += self.SearchBoxTextChanged
		# 
		# OKButton
		# 
		self.button.FlatStyle = FlatStyle.Popup
		self.button.ForeColor = Color.Black
		self.button.Location = Point(170, 308)
		self.button.Name = "button1"
		self.button.Size = Size(60, 23)
		self.button.TabIndex = 2
		self.button.Text = "OK"
		self.button.UseVisualStyleBackColor = True
		self.button.Click += self.ButtonClicked
		# 
		# Select All
		# 
		self.AllButton.FlatStyle = FlatStyle.Popup
		self.AllButton.ForeColor = Color.Black
		self.AllButton.Location = Point(10, 308)
		self.AllButton.Name = "AllButton"
		self.AllButton.Size = Size(65, 23)
		self.AllButton.TabIndex = 2
		self.AllButton.Text = "Select All"
		self.AllButton.UseVisualStyleBackColor = True
		self.AllButton.Click += self.AllButtonClicked
		# 
		# Select None
		# 
		self.NoneButton.FlatStyle = FlatStyle.Popup
		self.NoneButton.ForeColor = Color.Black
		self.NoneButton.Location = Point(83, 308)
		self.NoneButton.Name = "NoneButton"
		self.NoneButton.Size = Size(80, 23)
		self.NoneButton.TabIndex = 2
		self.NoneButton.Text = "Select None"
		self.NoneButton.UseVisualStyleBackColor = True
		self.NoneButton.Click += self.NoneButtonClicked
		# 
		# Form1
		# 
		self.BackColor = Color.White
		self.ClientSize = Size(247, 342)
		self.Controls.Add(self.button)
		self.Controls.Add(self.AllButton)
		self.Controls.Add(self.NoneButton)
		self.Controls.Add(self._searchBox)
		self.Controls.Add(self._listBox)
		self.ForeColor = Color.White
		self.MaximizeBox = False
		self.MinimizeBox = False
		self.Name = "Form1"
		self.ShowIcon = False
		self.SizeGripStyle = SizeGripStyle.Hide
		self.StartPosition = FormStartPosition.CenterScreen
		self.Text = "Select Items"
		self.ResumeLayout(False)
		self.PerformLayout()
	
	def ButtonClicked(self, sender, args):
		indices = self._listBox.SelectedIndices
		for index in indices:
			item = self.FoundItems[index]
			self.SelectedItems.Add(item)
		self.Close()
		
	def AllButtonClicked(self, sender, args):
		self._listBox.SelectedItems.Clear()
		for i in range(len(self._listBox.Items)):
			self._listBox.SetSelected(i, True)
		
	def NoneButtonClicked(self, sender, args):
		self._listBox.SelectedItems.Clear()
		
	def SearchBoxTextChanged(self, sender, args):
		searchTerm = self._searchBox.Text
		self._listBox.Items.Clear()
		self.FoundNames = []
		self.FoundItems = []
		if searchTerm != "":
			for i in range(len(names)):
				name = names[i]
				item = items[i]
				if name.ToUpper().Contains(searchTerm.ToUpper()):
					self._listBox.Items.Add(name)
					self.FoundNames.Add(name)
					self.FoundItems.Add(item)
		else:
			self.FoundItems = self.Items
			self.FoundNames = self.Names
			for name in self.FoundNames:
				self._listBox.Items.Add(name)
					
					
		
# The inputs to this node will be stored as a list in the IN variables.
items = IN[0]
names = IN[1]
rerun = IN[2]

if rerun:
	searchForm = SearchForm(items, names)
	searchForm.ShowDialog()
	OUT = searchForm.SelectedItems
else:
	searchForm = SearchForm(items, names)
	searchForm.ShowDialog()
	OUT = searchForm.SelectedItems
# ----------------------------------------

# group: Output
SelectedElements = Output(python_script)  # "SelectedElements : var[]"; A List with Elements
