# Dynamo custom node ViewSortFiltersAlphabetically.dyf (Dynamo 1.3.4.6666)
# category: CIB.Revit.Views.View.Actions
# Sorts the Filters of a given View in Alpabetical order

# group: Input
view = Input(view : Elements.View)

# group: Sort Filters Alphabetically
python_script_sort_filter = Python(IN[0]=view)  # "Python Script | Sort Filter Alphabetically"
# ---------- python_script_sort_filter.python (125 lines) ----------
import clr
clr.AddReference('ProtoGeometry')
from Autodesk.DesignScript.Geometry import *

clr.AddReference('System')
from System.Collections.Generic import *

#Import the Revit Services
clr.AddReference("RevitServices")
import RevitServices
from RevitServices.Persistence import DocumentManager
from RevitServices.Transactions import TransactionManager

doc = DocumentManager.Instance.CurrentDBDocument
uiapp = DocumentManager.Instance.CurrentUIApplication
app = uiapp.Application
uidoc = DocumentManager.Instance.CurrentUIApplication.ActiveUIDocument

#Import the Revit Nodes
clr.AddReference("RevitNodes")
import Revit
clr.ImportExtensions(Revit.Elements)
# Import geometry conversion extension methods
clr.ImportExtensions(Revit.GeometryConversion)

#Import the Revit API
clr.AddReference("RevitAPI")
import Autodesk
from Autodesk.Revit.DB import *

#Import math functions
import math

#Define functions
def tolist(obj1):
	if hasattr(obj1,"__iter__"):
		return obj1
	else:
		return [obj1]
		
def FeetToMm(d):
	return float(d) * 304.8
	
def MmToFeet(d):
	return float(d) / 304.8
	
def Flatten(a, result=None):
	if result is None:
		result = []
	for x in a:
		if isinstance(x, list):
			Flatten(x, result)
		else:
			result.append(x)
	return result

def SortFiltersAlphabetically(view):
	view = UnwrapElement(view)
	filterIds = view.GetFilters();
	unsortedFilters = []
	unsortedFilterNames = []
	for id in filterIds:
		id = int(str(id))
		filter = Revit.Elements.ElementSelector.ByElementId(id)
		unsortedFilters.append(filter)
		unsortedFilterNames.append(filter.Name)
	
	filters = []
	filterNames = sorted(unsortedFilterNames)
	for name in filterNames:
		index = unsortedFilterNames.IndexOf(name)
		filters.append(unsortedFilters[index])
		
	visibilities = []
	overrides = []
	for filter in filters:
		id = ElementId(filter.Id)
		override = view.GetFilterOverrides(id)
		isVisible = view.GetFilterVisibility(id)
		
		visibilities.append(isVisible)
		
		view.RemoveFilter(id)
		view.AddFilter(id)
		view.SetFilterOverrides(id, override)
		view.SetFilterVisibility(id, isVisible)
	
	return view
	

def DynamicSortFiltersAlphabetically(view):
	output = []
	IsList = False
	
	#Check if input is a List
	if hasattr(view,"__iter__"):
		IsList = True
	
	if IsList:
		views = view
		for view in views:
			result = DynamicSortFiltersAlphabetically(view)
			output.append(result)
			
	else:
		output = SortFiltersAlphabetically(view)
		#output.append(result)
	
	if len(tolist(output)) == 0:
		return output[0]
	else:
		return output
	
		
#Define Input (IN)
view = IN[0]

# Start Transaction
TransactionManager.Instance.EnsureInTransaction(doc)

OUT = SortFiltersAlphabetically(view)
	

#End Transaction
TransactionManager.Instance.TransactionTaskDone()
# ----------------------------------------

# group: Output
view_2 = Output(python_script_sort_filter)  # "view : Elements.View"
