# Dynamo custom node WorksetByName.dyf (Dynamo 1.3.4.6666)
# category: CIB.Revit.Elements.Workset.Create
# Creates or Gets a workset by a given name

worksetName = Input(worksetName : string)  # the name of the workset
python_script_create_workset = Python(IN[0]=worksetName)
# ---------- python_script_create_workset.python (78 lines) ----------
import clr
clr.AddReference('ProtoGeometry')
from Autodesk.DesignScript.Geometry import *

clr.AddReference('System')
from System.Collections.Generic import *

#Import the Revit Services
clr.AddReference("RevitServices")
import RevitServices
from RevitServices.Persistence import DocumentManager
from RevitServices.Transactions import TransactionManager

doc = DocumentManager.Instance.CurrentDBDocument
uiapp = DocumentManager.Instance.CurrentUIApplication
app = uiapp.Application
uidoc = DocumentManager.Instance.CurrentUIApplication.ActiveUIDocument

#Import the Revit Nodes
clr.AddReference("RevitNodes")
import Revit
clr.ImportExtensions(Revit.Elements)
# Import geometry conversion extension methods
clr.ImportExtensions(Revit.GeometryConversion)

#Import the Revit API
clr.AddReference("RevitAPI")
import Autodesk
from Autodesk.Revit.DB import *

#Import math functions
import math

#Define functions
def tolist(obj1):
	if hasattr(obj1,"__iter__"):
		return obj1
	else:
		return [obj1]
		
def FeetToMm(d):
	return float(d) * 304.8
	
def MmToFeet(d):
	return float(d) / 304.8
	
def Flatten(a, result=None):
	if result is None:
		result = []
	for x in a:
		if isinstance(x, list):
			Flatten(x, result)
		else:
			result.append(x)
	return result

#Define Input (IN)
name = IN[0]

# Start Transaction
TransactionManager.Instance.EnsureInTransaction(doc)
if doc.IsWorkshared:
	try:
		workset = Workset.Create(doc, name)
	except:
		worksets = [w for w in FilteredWorksetCollector(doc).ToWorksets()]
		for w in worksets:
			if name == w.Name:
				workset = w
else: 
	workset = "Document is not a workshared model";
			
	
#End Transaction
TransactionManager.Instance.TransactionTaskDone()

#Define Output (OUT)
OUT = workset
# ----------------------------------------
workset = Output(python_script_create_workset)  # "workset : var"; the workset matching the name
